# Grasshopper definition FacadeEmbed_JinQiao_Podium.gh (Grasshopper 1.0.7)
# Copyright: Arup
# plug-ins: EleFront, TT Toolbox, Pufferfish, Hare, treesloth01

# ----
# 线段延长长度
number_slider = Slider(1001, range=0..10000)  # disabled

# ----
# remove duplicate curves
geo = Geometry()  # disabled
number_slider_2 = Slider(0.1, range=0..0.1)  # disabled
boundary = BoundarySurfaces(Edges=geo)  # disabled
area = Area(Geometry=boundary)  # -> Area, Centroid; disabled
cullduppoints = RemoveDuplicatePoints(InputPoints=area.Centroid, Tolerance=number_slider_2)  # -> OutputPoints, FirstPointIndexes; disabled
null = NullItem(Item=cullduppoints.FirstPointIndexes)  # -> NullFlags, InvalidFlags, Description; disabled
dispatch = Dispatch(List=boundary, DispatchPattern=null.NullFlags)  # -> ListA, ListB; disabled
geo_2 = Geometry(dispatch.ListA)  # disabled

# ----
# 调换阴阳角设定
toggle = BooleanToggle(False)  # disabled

# ----
# 按图层整理curves
# 2.Line-0-建筑
# 3.Line-1-结构
panel = Panel("Line-1-檐口")
reflay = ReferenceByLayer(LayerName="Line-0-建筑-Whole")
reflay_2 = ReferenceByLayer(LayerName=panel)
reflay_3 = ReferenceByLayer(LayerName="Line-1-结构-All")

# ----
# 1.按图层整理curves
# 1.Line-1-建筑-
panel_2 = Panel("Line-1-建筑-Whole")
reflay_4 = ReferenceByLayer(LayerName=panel_2)

# ----
# （3）导入局部单体建筑的参考线
# 按照图层导入建筑、结构、檐口线
panel_3 = Panel("Line-1-檐口-吊顶处理")
reflay_5 = ReferenceByLayer(LayerName=panel_3)
reflay_6 = ReferenceByLayer(LayerName="Line-1-檐口-车道等灰空间")
xy = XYPlane(Origin=Point(0, 0, 0))
xy_2 = XYPlane(Origin=Point(0, 0, 0))
xy_3 = XYPlane(Origin=Point(0, 0, 0))
xy_4 = XYPlane(Origin=Point(0, 0, 0))
xy_5 = XYPlane(Origin=Point(0, 0, 0))
xy_6 = XYPlane(Origin=Point(0, 0, 0))
project = Project(Geometry=reflay_4, Plane=xy)  # -> Geometry, Transform
project_2 = Project(Geometry=reflay, Plane=xy_2)  # -> Geometry, Transform
project_3 = Project(Geometry=reflay_2, Plane=xy_3)  # -> Geometry, Transform
project_4 = Project(Geometry=reflay_5, Plane=xy_4)  # -> Geometry, Transform
project_5 = Project(Geometry=reflay_6, Plane=xy_5)  # -> Geometry, Transform
project_6 = Project(Geometry=reflay_3, Plane=xy_6)  # -> Geometry, Transform
crv = Curve(project_2.Geometry)
crv_2 = Curve(<curve referenced from the Rhino model>)
crv_3 = Curve(project_5.Geometry)
crv_4 = Curve(project_6.Geometry)
crv_5 = Curve(project.Geometry)
crv_6 = Curve(project_3.Geometry)
crv_7 = Curve(project_4.Geometry)

# ----
# Input Blocks (Correct Plan-Y轴向外)
# 主体定位点
data = Data(["PX-GLAZ-F2$0$PX-GLAZ-F1$0$标准块", "PX-GLAZ-F2$0$PX-GLAZ-F2$0$标准块", "PX-GLAZ-F2$0$PX-GLAZ-F3$0$标准块"])

# ----
# Input Curves
# 主体定位点（按图层导入）
crv_8 = Curve(<curve referenced from the Rhino model>)

# ----
# （1）导入埋件定位点
# Block & Curve的形式
# block names
listblockd = ListBlockDocument()
panel_4 = Panel(listblockd)

# ----
# Input Blocks (Wrong Plan)
# 主体定位点
data_2 = Data("PX-GLAZ-F2$0$T3T")

# ----
# 按图层整理curves
# 1.导入建筑线：Arch_curve_
panel_5 = Panel("Arch_curve_Whole")
reflay_7 = ReferenceByLayer(LayerName=panel_5)
reflay_8 = ReferenceByLayer(LayerName="Arch_curve_smooth")
reflay_9 = ReferenceByLayer(LayerName="Arch_curve_withLocation")
reflay_10 = ReferenceByLayer(LayerName="Arch_curve_angular")

# ----
# 特殊建筑线
# This Project Only
panel_6 = Panel("Arch_curve_other")
reflay_11 = ReferenceByLayer(LayerName=panel_6)

# ----
# 1.输入block names
data_3 = Data(["PX-GLAZ-F2$0$PX-GLAZ-F2$0$fin", "PX-GLAZ-F2$0$PX-GLAZ-F1$0$fin"])
panel_7 = Panel(data_3)

# ----
# （0）Prep
# 检测Block的Plane
# block names
listblockd_2 = ListBlockDocument()
panel_9 = Panel(listblockd_2)
refblock = ReferenceBlockByName(BlockName=panel_7)
deblock = DeconstructBlock(Block=refblock)  # -> Name, Plane, Geometry

# ----
# 撞到梁交点-Offset
number_slider_3 = Slider(450, range=0..1000)

layer = ObjectLayer(Guid=crv_8)  # -> LayerIndex, LayerPathName
panel_10 = Panel(data)
panel_12 = Panel(data_2)
panel_13 = Panel(layer.LayerPathName)
refblock_2 = ReferenceBlockByName(BlockName=panel_10)
refblock_3 = ReferenceBlockByName(BlockName=panel_12)
reflay_12 = ReferenceByLayer(LayerName=panel_13)
xy_7 = XYPlane(Origin=Point(0, 0, 0))
xy_8 = XYPlane(Origin=Point(0, 0, 0))
xy_9 = XYPlane(Origin=Point(0, 0, 0))
project_7 = Project(Geometry=refblock_3, Plane=xy_9)  # -> Geometry, Transform
project_8 = Project(Geometry=refblock_2, Plane=xy_8)  # -> Geometry, Transform
project_9 = Project(Geometry=reflay_12, Plane=xy_7)  # -> Geometry, Transform

# ---- group: 混凝土
# 板埋几何INPUT
list = ValueList({"C15": 0, "C20": 1, "C25": 2, "C30": 3, "C35": 4, "C40": 5}, selected="C35")

# ---- group: 钢筋牌号
list_2 = ValueList({"HPB300": 0, "HRB400": 1}, selected="HPB300")

# ---- group: 直径
list_3 = ValueList({"10": 0, "12": 1, "16": 2, "18": 3, "20": 4, "25": 5}, selected="12")

# ---- group: 列
list_4 = ValueList({"2X": 0, "3X": 1, "4X": 2}, selected="3X")

# ---- group: 行
list_5 = ValueList({"2Y": 0, "3Y": 1, "4Y": 2}, selected="2Y")

# ---- group: 锚筋间距
s_x = Slider(22, range=14..60, expression="X*5")
s_y = Slider(22, range=14..60, expression="X*5")

# ----
# （2）导入整个site的参考线
# 按照图层导入所有的建筑、结构、檐口线
xy_10 = XYPlane(Origin=Point(0, 0, 0))
xy_11 = XYPlane(Origin=Point(0, 0, 0))
xy_12 = XYPlane(Origin=Point(0, 0, 0))
xy_13 = XYPlane(Origin=Point(0, 0, 0))
xy_14 = XYPlane(Origin=Point(0, 0, 0))
project_10 = Project(Geometry=reflay_7, Plane=xy_10)  # -> Geometry, Transform
project_11 = Project(Geometry=reflay_8, Plane=xy_11)  # -> Geometry, Transform
project_12 = Project(Geometry=reflay_9, Plane=xy_12)  # -> Geometry, Transform
project_13 = Project(Geometry=reflay_10, Plane=xy_13)  # -> Geometry, Transform
project_14 = Project(Geometry=reflay_11, Plane=xy_14)  # -> Geometry, Transform
crv_9 = Curve(project_12.Geometry)
crv_10 = Curve(project_13.Geometry)
crv_11 = Curve(project_11.Geometry)
crv_12 = Curve(project_10.Geometry)
crv_13 = Curve(project_14.Geometry)

# ----
# 钢埋板长度（按需设定）
number_slider_4 = Slider(350, range=0..1000)

# ----
# 钢埋板厚度（按需设定）
number_slider_5 = Slider(16, range=0..100)

# ----
# 钢埋板长度（按需设定）
number_slider_6 = Slider(350, range=0..1000)

number_slider_7 = Slider(16, range=0..100)

# ----
# 钢结构截面列表
txt = Text(["GL2A-1\tHN 250x125x6x9\t\tQ235B\t热轧", "GL3-1\tHN 300x150x6.5x9\t\tQ235B\t热轧", "GL3-2\tH 300x100x8x10\t\tQ235B\t焊接H型", "GL3-3\tH 300x200x8x16\t\tQ355B\t焊接H型", "GL3-4\tHW 300x300x10x15\t\tQ355B\t热轧", "GL4-1\tHN 400x200x8x13\t\tQ355B\t热轧", "GL4-2\tH 400x200x10x16\t\tQ355B\t焊接H型", "GL4-3\tH 400x250x10x20\t\tQ355B\t焊接H型", "GL4-4\tH 400x350x16x35\t\tQ355B\t焊接H型", "GL4a-1\tH 450x200x9x14\t\tQ355B\t热轧", "GL5-1\tHN 500x200x10x16\t\tQ355B\t热轧", "GL5-2\tH 500x200x10x20\t\tQ355B\t焊接H型", "GL5-3\tH 500x300x14x20\t\tQ355B\t焊接H型", "GL5a-1\tH 550x250x10x25\t\tQ355B\t焊接H型", "GL5a-2\tH 550x300x14x25\t\tQ355B\t焊接H型", "GL6-1\tHN 600x200x11x17\t\tQ355B\t热轧", "GL6-2\tH 600x300x12x20\t\tQ355B\t焊接H型", "GL6-3\tH 600x350x12x25\t\tQ355B\t焊接H型", "GL6-4\tH 600x350x16x35\t\tQ355B\t焊接H型", "GL7-1\tHN 700x300x13x24\t\tQ355B\t热轧", "GL7-2\tH 700x350x14x30\t\tQ355B\t焊接H型", "GL7-3\tH 700x350x14x35\t\tQ355B\t焊接H型", "GL8-1\tHN 800x300x14x26\t\tQ355B\t热轧", "GL8-2\tH 800x300x20x40\t\tQ345GJB\t焊接H型", "GL9-1\tH 900x300x20x30\t\tQ355B\t焊接H型", "GL9-2\tH 900x400x20x40\t\tQ345GJB\t焊接H型", "GL10-1\tH 1000x400x20x30\t\tQ355B\t焊接H型", "GL10-2\tH 1000x500x20x30\t\tQ355B\t焊接H型", "GL10-3\tH 1000x500x20x35\t\tQ355B\t焊接H型", "GL10-4\tH 1000x400x20x40\t\tQ345GJB\t焊接H型", "GL10-5\tH 1000x500x20x40\t\tQ345GJB\t焊接H型", "GL10-6\t□ 1000x400x20x40\t\tQ345GJB\t焊接箱型", "GL12-1\tH 1200x400x25x50\t\tQ345GJB\t焊接H型"])

# ----
# 肋板倒角距离（按需设定）
number_slider_8 = Slider(30, range=0..100)

# ----
# 钢埋板长度（按需设定）
number_slider_9 = Slider(350, range=0..1000)

# ----
# 钢结构截面列表
txt_2 = Text(["GL2A-1\tHN 250x125x6x9\t\tQ235B\t热轧", "GL3-1\tHN 300x150x6.5x9\t\tQ235B\t热轧", "GL3-2\tH 300x100x8x10\t\tQ235B\t焊接H型", "GL3-3\tH 300x200x8x16\t\tQ355B\t焊接H型", "GL3-4\tHW 300x300x10x15\t\tQ355B\t热轧", "GL4-1\tHN 400x200x8x13\t\tQ355B\t热轧", "GL4-2\tH 400x200x10x16\t\tQ355B\t焊接H型", "GL4-3\tH 400x250x10x20\t\tQ355B\t焊接H型", "GL4-4\tH 400x350x16x35\t\tQ355B\t焊接H型", "GL4a-1\tH 450x200x9x14\t\tQ355B\t热轧", "GL5-1\tHN 500x200x10x16\t\tQ355B\t热轧", "GL5-2\tH 500x200x10x20\t\tQ355B\t焊接H型", "GL5-3\tH 500x300x14x20\t\tQ355B\t焊接H型", "GL5a-1\tH 550x250x10x25\t\tQ355B\t焊接H型", "GL5a-2\tH 550x300x14x25\t\tQ355B\t焊接H型", "GL6-1\tHN 600x200x11x17\t\tQ355B\t热轧", "GL6-2\tH 600x300x12x20\t\tQ355B\t焊接H型", "GL6-3\tH 600x350x12x25\t\tQ355B\t焊接H型", "GL6-4\tH 600x350x16x35\t\tQ355B\t焊接H型", "GL7-1\tHN 700x300x13x24\t\tQ355B\t热轧", "GL7-2\tH 700x350x14x30\t\tQ355B\t焊接H型", "GL7-3\tH 700x350x14x35\t\tQ355B\t焊接H型", "GL8-1\tHN 800x300x14x26\t\tQ355B\t热轧", "GL8-2\tH 800x300x20x40\t\tQ345GJB\t焊接H型", "GL9-1\tH 900x300x20x30\t\tQ355B\t焊接H型", "GL9-2\tH 900x400x20x40\t\tQ345GJB\t焊接H型", "GL10-1\tH 1000x400x20x30\t\tQ355B\t焊接H型", "GL10-2\tH 1000x500x20x30\t\tQ355B\t焊接H型", "GL10-3\tH 1000x500x20x35\t\tQ355B\t焊接H型", "GL10-4\tH 1000x400x20x40\t\tQ345GJB\t焊接H型", "GL10-5\tH 1000x500x20x40\t\tQ345GJB\t焊接H型", "GL10-6\t□ 1000x400x20x40\t\tQ345GJB\t焊接箱型", "GL12-1\tH 1200x400x25x50\t\tQ345GJB\t焊接H型"])

# ----
# 钢埋板厚度（按需设定）
number_slider_10 = Slider(16, range=0..100)

# ----
# 钢结构截面列表
txt_3 = Text(["GL2A-1\tHN 250x125x6x9\t\tQ235B\t热轧", "GL3-1\tHN 300x150x6.5x9\t\tQ235B\t热轧", "GL3-2\tH 300x100x8x10\t\tQ235B\t焊接H型", "GL3-3\tH 300x200x8x16\t\tQ355B\t焊接H型", "GL3-4\tHW 300x300x10x15\t\tQ355B\t热轧", "GL4-1\tHN 400x200x8x13\t\tQ355B\t热轧", "GL4-2\tH 400x200x10x16\t\tQ355B\t焊接H型", "GL4-3\tH 400x250x10x20\t\tQ355B\t焊接H型", "GL4-4\tH 400x350x16x35\t\tQ355B\t焊接H型", "GL4a-1\tH 450x200x9x14\t\tQ355B\t热轧", "GL5-1\tHN 500x200x10x16\t\tQ355B\t热轧", "GL5-2\tH 500x200x10x20\t\tQ355B\t焊接H型", "GL5-3\tH 500x300x14x20\t\tQ355B\t焊接H型", "GL5a-1\tH 550x250x10x25\t\tQ355B\t焊接H型", "GL5a-2\tH 550x300x14x25\t\tQ355B\t焊接H型", "GL6-1\tHN 600x200x11x17\t\tQ355B\t热轧", "GL6-2\tH 600x300x12x20\t\tQ355B\t焊接H型", "GL6-3\tH 600x350x12x25\t\tQ355B\t焊接H型", "GL6-4\tH 600x350x16x35\t\tQ355B\t焊接H型", "GL7-1\tHN 700x300x13x24\t\tQ355B\t热轧", "GL7-2\tH 700x350x14x30\t\tQ355B\t焊接H型", "GL7-3\tH 700x350x14x35\t\tQ355B\t焊接H型", "GL8-1\tHN 800x300x14x26\t\tQ355B\t热轧", "GL8-2\tH 800x300x20x40\t\tQ345GJB\t焊接H型", "GL9-1\tH 900x300x20x30\t\tQ355B\t焊接H型", "GL9-2\tH 900x400x20x40\t\tQ345GJB\t焊接H型", "GL10-1\tH 1000x400x20x30\t\tQ355B\t焊接H型", "GL10-2\tH 1000x500x20x30\t\tQ355B\t焊接H型", "GL10-3\tH 1000x500x20x35\t\tQ355B\t焊接H型", "GL10-4\tH 1000x400x20x40\t\tQ345GJB\t焊接H型", "GL10-5\tH 1000x500x20x40\t\tQ345GJB\t焊接H型", "GL10-6\t□ 1000x400x20x40\t\tQ345GJB\t焊接箱型", "GL12-1\tH 1200x400x25x50\t\tQ345GJB\t焊接H型"])

# ----
# 肋板倒角距离（按需设定）
number_slider_11 = Slider(30, range=0..100)

# ----
# 钢埋板长度（按需设定）
number_slider_12 = Slider(350, range=0..1000)

# ----
# 钢埋板厚度（按需设定）
number_slider_13 = Slider(16, range=0..100)

# ----
# 2.检测plane是否存在
pln = Plane(deblock.Plane)

# ----
# 钢结构截面列表
txt_4 = Text(["GL2A-1\tHN 250x125x6x9\t\tQ235B\t热轧", "GL3-1\tHN 300x150x6.5x9\t\tQ235B\t热轧", "GL3-2\tH 300x100x8x10\t\tQ235B\t焊接H型", "GL3-3\tH 300x200x8x16\t\tQ355B\t焊接H型", "GL3-4\tHW 300x300x10x15\t\tQ355B\t热轧", "GL4-1\tHN 400x200x8x13\t\tQ355B\t热轧", "GL4-2\tH 400x200x10x16\t\tQ355B\t焊接H型", "GL4-3\tH 400x250x10x20\t\tQ355B\t焊接H型", "GL4-4\tH 400x350x16x35\t\tQ355B\t焊接H型", "GL4a-1\tH 450x200x9x14\t\tQ355B\t热轧", "GL5-1\tHN 500x200x10x16\t\tQ355B\t热轧", "GL5-2\tH 500x200x10x20\t\tQ355B\t焊接H型", "GL5-3\tH 500x300x14x20\t\tQ355B\t焊接H型", "GL5a-1\tH 550x250x10x25\t\tQ355B\t焊接H型", "GL5a-2\tH 550x300x14x25\t\tQ355B\t焊接H型", "GL6-1\tHN 600x200x11x17\t\tQ355B\t热轧", "GL6-2\tH 600x300x12x20\t\tQ355B\t焊接H型", "GL6-3\tH 600x350x12x25\t\tQ355B\t焊接H型", "GL6-4\tH 600x350x16x35\t\tQ355B\t焊接H型", "GL7-1\tHN 700x300x13x24\t\tQ355B\t热轧", "GL7-2\tH 700x350x14x30\t\tQ355B\t焊接H型", "GL7-3\tH 700x350x14x35\t\tQ355B\t焊接H型", "GL8-1\tHN 800x300x14x26\t\tQ355B\t热轧", "GL8-2\tH 800x300x20x40\t\tQ345GJB\t焊接H型", "GL9-1\tH 900x300x20x30\t\tQ355B\t焊接H型", "GL9-2\tH 900x400x20x40\t\tQ345GJB\t焊接H型", "GL10-1\tH 1000x400x20x30\t\tQ355B\t焊接H型", "GL10-2\tH 1000x500x20x30\t\tQ355B\t焊接H型", "GL10-3\tH 1000x500x20x35\t\tQ355B\t焊接H型", "GL10-4\tH 1000x400x20x40\t\tQ345GJB\t焊接H型", "GL10-5\tH 1000x500x20x40\t\tQ345GJB\t焊接H型", "GL10-6\t□ 1000x400x20x40\t\tQ345GJB\t焊接箱型", "GL12-1\tH 1200x400x25x50\t\tQ345GJB\t焊接H型"])

# ----
# 肋板倒角距离（按需设定）
number_slider_14 = Slider(30, range=0..100)

# ----
# 需要出图的钢结构编号
panel_14 = Panel("GL3-3H")

panel_15 = Panel(txt_4)
cluster = Cluster_4(
    T=txt_4,
    D=panel_14,
    A=number_slider_12,
    A_2=number_slider_13,
    B=number_slider_13,
    B_2=number_slider_14,
    A_3=number_slider_12,
    B_3=number_slider_13,
    B_4=number_slider_13,
    B_5=number_slider_13)  # -> R, B_6, G
entwine = Entwine(Branch00=cluster.B_6, Branch01=cluster.G, FlattenInputs=True)

deblock_2 = DeconstructBlock(Block=refblock_3)  # -> Name, Plane, Geometry
deblock_3 = DeconstructBlock(Block=refblock_2)  # -> Name, Plane, Geometry

# ----
# 3.如果不存在则Blake geometry
# 并在rhino里面清理线段
geo_3 = Geometry(deblock.Geometry)

data_4 = Data(entwine)

# ----
# 单体选型
list_6 = ValueList({"顶埋": 0, "侧埋": 1}, selected="顶埋")

# ----
# 选要重塑的线段长度
number_slider_15 = Slider(1200, range=0..10000)

# ----
# 调整重塑线段的平滑度
number_slider_16 = Slider(11, range=0..11)

# ----
# 根据F2建筑线制作轮廓线
crv_14 = Curve(crv_5)
explode = Explode(Curve=crv_14, Recursive=True)  # -> Segments, Vertices
len = Length(Curve=explode.Segments)
sort = SortList(Keys=len)  # -> Keys, ValuesA
larger = LargerThan(FirstNumber=len, SecondNumber=number_slider_15)  # -> LargerThan, OrEqualTo
panel_16 = Panel(sort.Keys)
dispatch_2 = Dispatch(List=explode.Segments, DispatchPattern=larger.LargerThan)  # -> ListA, ListB
data_5 = Data(dispatch_2.ListA)
data_6 = Data(dispatch_2.ListB)
join = JoinCurves(Curves=data_6, Preserve=False)
disc = Discontinuity(Curve=join, Level=1)  # -> Points, Parameters
nurbs = NurbsCurve(Vertices=disc.Points, Degree=number_slider_16, Periodic=False)  # -> flatten(Curve), Length, Domain
join_2 = JoinCurves(Curves=flatten([data_5, nurbs.Curve]), Preserve=False)
offset = OffsetCurve(Curve=join_2, Distance=Slider(6859, range=0..10000), Corners=1)

# ----
# Default Curve
reb = RebuildCurve(Curve=offset, Count=Slider(17, range=0..100), Tangents=invert(False))

# ----
# InputCurve
crv_15 = Curve()

# ----
# Curve-框住要分析的建筑单体
# 如果要用自己导入Curve作为分析线，
# 请在InputCurve那里导入curve,
# 然后在上方的选型列表选择Input Curve。
# 
# 如果要用Grasshopper自动生成的Curve,
# 请在上方的选型列表选择Default Curve。
list_7 = ValueList({"Default Curve": 0, "Input Curve": 1}, selected="Default Curve")
filter = StreamFilter(Gate=list_7, Stream0=reb, Stream1=crv_15)

# ----
# 埋件向外探索最远出的梁的距离
number_slider_17 = Slider(5000, range=0..10000)

# ----
# 是否有吊顶：
# 下层幕墙边线在结构边梁以内>350
# 
# （最外层结构线）
number_slider_18 = Slider(350, range=0..1000)

crv_16 = Curve(crv)

# ----
# 2.2下层建筑边线内侧300-600mm范围内
number_slider_19 = Slider(600, range=0..1000)
crv_17 = Curve(crv_16)
offset_2 = OffsetCurve(Curve=crv_17, Distance=expr("-x", Slider(300, range=0..1000)), Corners=1)
offset_3 = OffsetCurve(Curve=crv_17, Distance=expr("-x", number_slider_19), Corners=1)

# ----
# 2.1下层建筑边线外侧50-350mm范围内
number_slider_20 = Slider(350, range=0..1000)
crv_18 = Curve(crv_16)
offset_4 = OffsetCurve(Curve=crv_18, Distance=Slider(50, range=0..100), Corners=1)
offset_5 = OffsetCurve(Curve=crv_18, Distance=number_slider_20, Corners=1)

# ----
# 下层建筑内侧到300到外侧50内
# 有钢结构
number_slider_21 = Slider(50, range=0..1000)
crv_19 = Curve(crv_16)
offset_6 = OffsetCurve(Curve=crv_19, Distance=expr("-x", Slider(300, range=0..1000)), Corners=1)
offset_7 = OffsetCurve(Curve=crv_19, Distance=number_slider_21, Corners=1)

# ----
# 求内部曲线转折点
crv_20 = Curve()  # disabled
number_slider_22 = Slider(300, range=0..1000)  # disabled
neg = Negative(Value=number_slider_22)  # disabled
filter_2 = StreamFilter(Gate=toggle, Stream0=number_slider_22, Stream1=neg)  # disabled
number_slider_23 = Slider(60, range=0..100)  # disabled

ext = ExtendCurve(Curve=crv_20, Type=0, Start=number_slider, End=number_slider)  # disabled

# ----
# 第二层
# 
# Curves(location point)+ Smooth Curves(architecture line)
# 第二层-区分阴阳角
area_2 = Area(Geometry=geo_2)  # -> Area, Centroid; disabled
crv_21 = Curve(crv_20)  # disabled
pull = PullPoint(Point=area_2.Centroid, Geometry=crv_21, ClosestOnly=True)  # -> ClosestPoint, Distance; disabled
number_slider_24 = Slider(200, range=0..1000)  # disabled
number_slider_25 = Slider(100, range=0..300)  # disabled

# ----
# 第二层-阴阳角
panel_17 = Panel("0.5 * Pi")  # disabled
toggle_2 = BooleanToggle(True)  # disabled
neg_2 = Negative(Value=panel_17)  # disabled
filter_3 = StreamFilter(Gate=toggle_2, Stream0=panel_17, Stream1=neg_2)  # disabled

# ----
# 第二层-大面定位
panel_18 = Panel("0.5 * Pi")  # disabled
toggle_3 = BooleanToggle(True)  # disabled
neg_3 = Negative(Value=panel_18)  # disabled
filter_4 = StreamFilter(Gate=toggle_3, Stream0=panel_18, Stream1=neg_3)  # disabled

number_slider_26 = Slider(300, range=0..1000)  # disabled
number_slider_27 = Slider(1.5, range=0..10)  # disabled

number_slider_28 = Slider(300, range=0..1000)  # disabled
number_slider_29 = Slider(1.5, range=0..10)  # disabled

number_slider_30 = Slider(300, range=0..1000)  # disabled
number_slider_31 = Slider(1.5, range=0..10)  # disabled

# ----
# 显示"False"时要选择线段延长
list_8 = ValueList({"线段不延长": 0, "线段延长": 1}, selected="线段延长")  # disabled

filter_5 = StreamFilter(Gate=list_8, Stream0=crv_20, Stream1=ext)  # disabled

disc_2 = Discontinuity(Curve=graft(filter_5), Level=1)  # -> Points, Parameters; disabled
crv_cp = CurveClosestPoint(Point=disc_2.Points, Curve=graft(filter_5))  # -> Point, Parameter, Distance; disabled
eval = EvaluateCurve(Curve=graft(filter_5), Parameter=crv_cp.Parameter)  # -> flatten(Point), Tangent, flatten(Angle); disabled
deg = Degrees(Radians=eval.Angle)  # disabled
offset_8 = OffsetCurve(Curve=filter_5, Distance=expr("-X", filter_2), Corners=1)  # disabled
panel_19 = Panel(deg)  # disabled
larger_2 = LargerThan(FirstNumber=deg, SecondNumber=number_slider_23)  # -> LargerThan, OrEqualTo; disabled
disc_3 = Discontinuity(Curve=offset_8, Level=1)  # -> flatten(Points), Parameters; disabled
dispatch_3 = Dispatch(List=eval.Point, DispatchPattern=larger_2.LargerThan)  # -> ListA, ListB; disabled
end = EndPoints(Curve=filter_5)  # -> Start, End; disabled
data_7 = Data(dispatch_3.ListA)  # disabled
pull_2 = PullPoint(Point=data_7, Geometry=flatten(offset_8), ClosestOnly=True)  # -> ClosestPoint, Distance; disabled
testpoint = TestPoint(archPoint=pull_2.ClosestPoint, crvPoint=disc_3.Points)  # -> out, specialPt; inputs archPoint: list of Point3d, crvPoint: list of Point3d; disabled
# ---------- testpoint: C# ----------
    List<int> passIndex = new List<int>();

    for(int i = 0; i < archPoint.Count; i++){
      foreach(Point3d t in crvPoint){
        if(archPoint[i].X == t.X && archPoint[i].Y == t.Y && archPoint[i].Z == t.Z){
          Print("pass");
          passIndex.Add(i);}
      }
    }

    specialPt = passIndex;
# ---------- end testpoint ----------

# ----
# 阴角
item = ListItem(List=data_7, Index=testpoint.specialPt, Wrap=True)  # disabled

# ----
# SmoothCurve-阴角&阳角
# 阳角
cull_i = CullIndex(List=data_7, Indices=testpoint.specialPt, Wrap=True)  # disabled

dist = Distance(PointA=pull.ClosestPoint, PointB=data_7)  # disabled
sort_2 = SortList(Keys=dist)  # -> Keys, ValuesA; disabled
panel_20 = Panel(sort_2.Keys)  # disabled
smaller = SmallerThan(FirstNumber=dist, SecondNumber=number_slider_24)  # -> SmallerThan, OrEqualTo; disabled
dispatch_4 = Dispatch(List=geo_2, DispatchPattern=smaller.SmallerThan)  # -> ListA, ListB; disabled
crv_22 = Curve(filter_5)  # disabled

data_8 = Data(dispatch_4.ListA)  # disabled
explode_2 = Explode(Curve=data_8, Recursive=True)  # -> Segments, Vertices; disabled
len_2 = Length(Curve=explode_2.Segments)  # disabled
sort_3 = SortList(Keys=reverse(len_2), ValuesA=explode_2.Segments)  # -> Keys, ValuesA; disabled
item_2 = ListItem(List=sort_3.ValuesA, Index=0, Wrap=True)  # -> flatten(Item); disabled
area_3 = Area(Geometry=data_8)  # -> Area, Centroid; disabled
midpt = CurveMiddle(Curve=item_2)  # disabled
move2pt = MoveToPoint(Geometry=item_2, PointA=midpt, PointB=area_3.Centroid)  # -> Moved, Vector, Transform; disabled
end_2 = EndPoints(Curve=move2pt.Moved)  # -> Start, End; disabled
ln = Line(StartPoint=end_2.Start, EndPoint=end_2.End)  # disabled
xy_15 = XYPlane(Origin=end_2.End)  # disabled
rotate = Rotate(Geometry=ln, Angle=filter_3, Plane=xy_15)  # -> Geometry, Transform; disabled
pl = ConstructPlane(Origin=end_2.End, XAxis=rotate.Geometry, YAxis=ln)  # disabled

data_9 = Data(dispatch_4.ListB)  # disabled
explode_3 = Explode(Curve=data_9, Recursive=True)  # -> Segments, Vertices; disabled
len_3 = Length(Curve=explode_3.Segments)  # disabled
sort_4 = SortList(Keys=reverse(len_3), ValuesA=explode_3.Segments)  # -> Keys, ValuesA; disabled
item_3 = ListItem(List=sort_4.ValuesA, Index=0, Wrap=True)  # -> flatten(Item); disabled
area_4 = Area(Geometry=data_9)  # -> Area, Centroid; disabled
midpt_2 = CurveMiddle(Curve=item_3)  # disabled
move2pt_2 = MoveToPoint(Geometry=item_3, PointA=midpt_2, PointB=area_4.Centroid)  # -> Moved, Vector, Transform; disabled
end_3 = EndPoints(Curve=move2pt_2.Moved)  # -> Start, End; disabled
ln_2 = Line(StartPoint=end_3.Start, EndPoint=end_3.End)  # disabled
xy_16 = XYPlane(Origin=end_3.End)  # disabled
rotate_2 = Rotate(Geometry=ln_2, Angle=filter_4, Plane=xy_16)  # -> Geometry, Transform; disabled
pl_2 = ConstructPlane(Origin=end_3.End, XAxis=rotate_2.Geometry, YAxis=ln_2)  # disabled

data_10 = Data(flatten(pl_2))  # disabled
deplane = DeconstructPlane(Plane=data_10)  # -> Origin, XAxis, YAxis, ZAxis; disabled
amp = Amplitude(Vector=deplane.YAxis, Amplitude=number_slider_28)  # disabled
move = Move(Geometry=deplane.Origin, Motion=amp)  # -> Geometry, Transform; disabled
ln_3 = Line(StartPoint=deplane.Origin, EndPoint=move.Geometry)  # disabled
midpt_3 = CurveMiddle(Curve=ln_3)  # disabled
scale = Scale(Geometry=ln_3, Center=midpt_3, Factor=number_slider_29)  # -> Geometry, Transform; disabled
ccx = CurveCurve(CurveA=scale.Geometry, CurveB=crv_22)  # -> Points, ParamsA, ParamsB; disabled

dist_2 = Distance(PointA=graft(end_2.End), PointB=cull_i)  # disabled
sort_5 = SortList(Keys=dist_2)  # -> Keys, ValuesA; disabled
item_4 = ListItem(List=sort_5.Keys, Index=0, Wrap=True)  # disabled
smaller_2 = SmallerThan(FirstNumber=item_4, SecondNumber=number_slider_25)  # -> SmallerThan, OrEqualTo; disabled
flatten = FlattenTree(Tree=item_4, Path="{0}")  # disabled
dispatch_5 = Dispatch(List=graft(pl), DispatchPattern=smaller_2.SmallerThan)  # -> ListA, ListB; disabled
panel_21 = Panel(flatten)  # disabled
flatten_2 = FlattenTree(Tree=ccx.Points, Path="{0}")  # disabled
lng = ListLength(List=scale.Geometry)  # disabled
lng_2 = ListLength(List=flatten_2)  # disabled

data_11 = Data(flatten(dispatch_5.ListA))  # disabled
deplane_2 = DeconstructPlane(Plane=data_11)  # -> Origin, XAxis, YAxis, ZAxis; disabled
amp_2 = Amplitude(Vector=deplane_2.YAxis, Amplitude=number_slider_26)  # disabled
move_2 = Move(Geometry=deplane_2.Origin, Motion=amp_2)  # -> Geometry, Transform; disabled
ln_4 = Line(StartPoint=deplane_2.Origin, EndPoint=move_2.Geometry)  # disabled
midpt_4 = CurveMiddle(Curve=ln_4)  # disabled
scale_2 = Scale(Geometry=ln_4, Center=midpt_4, Factor=number_slider_27)  # -> Geometry, Transform; disabled
ccx_2 = CurveCurve(CurveA=scale_2.Geometry, CurveB=crv_22)  # -> Points, ParamsA, ParamsB; disabled

data_12 = Data(flatten(dispatch_5.ListB))  # disabled
deplane_3 = DeconstructPlane(Plane=data_12)  # -> Origin, XAxis, YAxis, ZAxis; disabled
amp_3 = Amplitude(Vector=deplane_3.YAxis, Amplitude=number_slider_30)  # disabled
move_3 = Move(Geometry=deplane_3.Origin, Motion=amp_3)  # -> Geometry, Transform; disabled
ln_5 = Line(StartPoint=deplane_3.Origin, EndPoint=move_3.Geometry)  # disabled
midpt_5 = CurveMiddle(Curve=ln_5)  # disabled
scale_3 = Scale(Geometry=ln_5, Center=midpt_5, Factor=number_slider_31)  # -> Geometry, Transform; disabled
ccx_3 = CurveCurve(CurveA=scale_3.Geometry, CurveB=crv_22)  # -> Points, ParamsA, ParamsB; disabled

equals = Equality(FirstNumber=lng, SecondNumber=lng_2)  # -> Equality, Inequality; disabled
panel_22 = Panel(equals.Equality)  # disabled

# ----
# InsideCurve-大面
move2pt_3 = MoveToPoint(Geometry=data_10, PointA=flatten(deplane.Origin), PointB=flatten(ccx.Points))  # -> Moved, Vector, Transform; disabled

# ----
# InsideCurve-阳角
move2pt_4 = MoveToPoint(Geometry=data_11, PointA=deplane_2.Origin, PointB=ccx_2.Points)  # -> Moved, Vector, Transform; disabled

# ----
# InsideCurve-阴角
move2pt_5 = MoveToPoint(Geometry=data_12, PointA=deplane_3.Origin, PointB=ccx_3.Points)  # -> Moved, Vector, Transform; disabled

crv_23 = Curve(<curve referenced from the Rhino model>)
layer_2 = ObjectLayer(Guid=crv_23)  # -> LayerIndex, LayerPathName
panel_23 = Panel(layer_2.LayerPathName)
reflay_13 = ReferenceByLayer(LayerName=panel_23)
panel_24 = Panel(txt)
xy_17 = XYPlane(Origin=Point(0, 0, 0))

# ----
# 需要出图的钢结构编号
panel_25 = Panel(panel_23)

cluster_2 = Cluster_4(
    T=txt,
    D=panel_25,
    A=number_slider_4,
    A_2=number_slider_5,
    B=number_slider_5,
    B_2=number_slider_8,
    A_3=number_slider_4,
    B_3=number_slider_5,
    B_4=number_slider_5,
    B_5=number_slider_5)  # -> R, B_6, G
entwine_2 = Entwine(Branch00=cluster_2.B_6, Branch01=cluster_2.G, FlattenInputs=True)

project_15 = Project(Geometry=reflay_13, Plane=xy_17)  # -> Geometry, Transform
num = Number(cluster_2.R)
data_13 = Data(entwine_2)

crv_24 = Curve(<curve referenced from the Rhino model>)
layer_3 = ObjectLayer(Guid=crv_24)  # -> LayerIndex, LayerPathName
panel_26 = Panel(layer_3.LayerPathName)
reflay_14 = ReferenceByLayer(LayerName=panel_26)
panel_27 = Panel(txt_2)
xy_18 = XYPlane(Origin=Point(0, 0, 0))

# ----
# 需要出图的钢结构编号
panel_28 = Panel(panel_26)

cluster_3 = Cluster_4(
    T=txt_2,
    D=panel_28,
    A=number_slider_6,
    A_2=number_slider_7,
    B=number_slider_7,
    B_2=Slider(30, range=0..100),
    A_3=number_slider_6,
    B_3=number_slider_7,
    B_4=number_slider_7,
    B_5=number_slider_7)  # -> R, B_6, G
entwine_3 = Entwine(Branch00=cluster_3.B_6, Branch01=cluster_3.G, FlattenInputs=True)

project_16 = Project(Geometry=reflay_14, Plane=xy_18)  # -> Geometry, Transform
num_2 = Number(cluster_3.R)
data_14 = Data(entwine_3)

crv_25 = Curve(<curve referenced from the Rhino model>)
layer_4 = ObjectLayer(Guid=crv_25)  # -> LayerIndex, LayerPathName
panel_29 = Panel(layer_4.LayerPathName)
reflay_15 = ReferenceByLayer(LayerName=panel_29)
panel_30 = Panel(txt_3)
xy_19 = XYPlane(Origin=Point(0, 0, 0))

# ----
# 需要出图的钢结构编号
panel_31 = Panel(panel_29)

cluster_4 = Cluster_4(
    T=txt_3,
    D=panel_31,
    A=number_slider_9,
    A_2=number_slider_10,
    B=number_slider_10,
    B_2=number_slider_11,
    A_3=number_slider_9,
    B_3=number_slider_10,
    B_4=number_slider_10,
    B_5=number_slider_10)  # -> R, B_6, G
entwine_4 = Entwine(Branch00=cluster_4.B_6, Branch01=cluster_4.G, FlattenInputs=True)

project_17 = Project(Geometry=reflay_15, Plane=xy_19)  # -> Geometry, Transform
num_3 = Number(cluster_4.R)
data_15 = Data(entwine_4)

# ----
# 连接curve
entwine_5 = Entwine(Branch00=project_15.Geometry, Branch01=project_16.Geometry, Branch02=project_17.Geometry, FlattenInputs=True)

# ----
# 连接number
entwine_6 = Entwine(Branch00=num, Branch01=num_2, Branch02=num_3, FlattenInputs=True)

# ----
# 连接embed
entwine_7 = Entwine(Branch00=data_13, Branch01=data_14, Branch02=data_15, Branch03=data_4, FlattenInputs=True)

# ----
# 区分内外梁边线
crv_26 = Curve(entwine_5)
num_4 = Number(entwine_6)
crv_27 = Curve(filter)
offcrv = OffsetCurve(Curve=crv_26, Plane=PlaneXY(0, 0, 0), Distance=num_4, BothSides=expr("-x", num_4), Kinks=0, CapType="0")
midpt_6 = CurveMiddle(Curve=offcrv)
midpt_7 = CurveMiddle(Curve=crv_26)
crv_28 = Curve(offcrv)
offcrv_2 = OffsetCurve(Curve=crv_26, Plane=PlaneXY(0, 0, 0), Distance=num_4, BothSides=expr("-x", num_4), Kinks=0, CapType="1")
item_5 = ListItem(List=midpt_6, Index=0, Wrap=True)
item_6 = ListItem(List=crv_28, Index=0, Wrap=True)
item_7 = ListItem(List=crv_28, Index="-1", Wrap=True)
pull_3 = PullPoint(Point=midpt_7, Geometry=crv_27, ClosestOnly=True)  # -> ClosestPoint, Distance
ln_6 = Line(StartPoint=item_5, EndPoint=graft(pull_3.ClosestPoint))
graft = GraftTree(Tree=crv_26, IncludeEmptyLists=True, IncludeNullItems=True)
ccx_4 = CurveCurve(CurveA=ln_6, CurveB=graft)  # -> Points, ParamsA, ParamsB
null_2 = NullItem(Item=ccx_4.Points)  # -> NullFlags, InvalidFlags, Description
dispatch_6 = Dispatch(List=item_6, DispatchPattern=null_2.InvalidFlags)  # -> ListA, ListB
dispatch_7 = Dispatch(List=item_7, DispatchPattern=null_2.InvalidFlags)  # -> ListA, ListB

# ----
# 梁线闭合
shift = ShiftPaths(Data=offcrv_2, Offset=-1)

# ----
# 梁边线-内
merge = Merge(Data1=dispatch_6.ListB, Data2=dispatch_7.ListA)

# ----
# 梁边线-外
merge_2 = Merge(Data1=dispatch_6.ListA, Data2=dispatch_7.ListB)

crv_29 = Curve(shift)

data_16 = Data(entwine_7)
item_8 = ListItem(List=data_16, Index=0, Wrap=True)
item_9 = ListItem(List=data_16, Index="-1", Wrap=True)

crv_30 = Curve(shift)

crv_31 = Curve(shift)

data_17 = Data(entwine_7)
item_10 = ListItem(List=data_17, Index=0, Wrap=True)
item_11 = ListItem(List=data_17, Index="-1", Wrap=True)

crv_32 = Curve(shift)

crv_33 = Curve(shift)

data_18 = Data(entwine_7)
item_12 = ListItem(List=data_18, Index=0, Wrap=True)
item_13 = ListItem(List=data_18, Index="-1", Wrap=True)
rotate_3 = Rotate(Geometry=item_13, Angle="Pi", Plane=item_13)  # -> Geometry, Transform

crv_34 = Curve(shift)

crv_35 = Curve(shift)

crv_36 = Curve(shift)

crv_37 = Curve(shift)

data_19 = Data(entwine_7)
data_20 = Data(entwine_7)
item_14 = ListItem(List=data_19, Index=0, Wrap=True)
item_15 = ListItem(List=data_19, Index="-1", Wrap=True)
item_16 = ListItem(List=data_20, Index=0, Wrap=True)
item_17 = ListItem(List=data_20, Index="-1", Wrap=True)
rotate_4 = Rotate(Geometry=item_15, Angle="Pi", Plane=item_15)  # -> Geometry, Transform

crv_38 = Curve(shift)

crv_39 = Curve(shift)

max = Maximum(A=s_x, B=s_y)
filter_6 = StreamFilter(Gate=list, Stream0=7.2, Stream1=9.6, Stream2=11.9, Stream3=14.3, Stream4=16.7, Stream5=19.1)
filter_7 = StreamFilter(Gate=list_2, Stream0=270, Stream1=360)
filter_8 = StreamFilter(Gate=list_3, Stream0=10, Stream1=12, Stream2=16, Stream3=18, Stream4=20, Stream5=25)
filter_9 = StreamFilter(Gate=list, Stream0=0.91, Stream1=1.1, Stream2=1.27, Stream3=1.43, Stream4=1.57, Stream5=1.71)
filter_10 = StreamFilter(Gate=list_2, Stream0=0.16, Stream1=0.14)
addition = Addition(A=list_4, B=1)
addition_2 = Addition(A=list_5, B=1)
division = Division(A=max, B=8)
t = Integer(division)
panel_32 = Panel(filter_9)
panel_33 = Panel(filter_6)
panel_34 = Panel(filter_10)
min = Minimum(A=filter_7, B=300)
panel_35 = Panel(min)
expression = Expression(A=filter_10, fy=filter_7, ft=filter_9, d=filter_8, Expression="(int((0.6*1.1*A*fy/ft*d)/5)+1)*5")

# ----
# 测试Smooth Curve是否与每个Block相切
# blocks + smooth curves
# remove duplicate blocks
# blocks + special curves
deblock_4 = DeconstructBlock(Block=project_8.Geometry)  # -> Name, Plane, Geometry
pln_2 = Plane(flatten(deblock_4.Plane))
deplane_4 = DeconstructPlane(Plane=pln_2)  # -> Origin, XAxis, YAxis, ZAxis
cullduppoints_2 = RemoveDuplicatePoints(InputPoints=deplane_4.Origin, Tolerance=0.001)  # -> OutputPoints, FirstPointIndexes
null_3 = NullItem(Item=cullduppoints_2.FirstPointIndexes)  # -> NullFlags, InvalidFlags, Description
dispatch_8 = Dispatch(List=pln_2, DispatchPattern=null_3.InvalidFlags)  # -> ListA, ListB
dispatch_9 = Dispatch(List=flatten(project_8.Geometry), DispatchPattern=null_3.InvalidFlags)  # -> ListA, ListB
pln_3 = Plane(dispatch_8.ListA)
data_21 = Data(flatten(pln_3))
deplane_5 = DeconstructPlane(Plane=data_21)  # -> Origin, XAxis, YAxis, ZAxis
pln_4 = Plane(data_21)
amp_4 = Amplitude(Vector=deplane_5.YAxis, Amplitude=Slider(300, range=0..1000))
move_4 = Move(Geometry=deplane_5.Origin, Motion=amp_4)  # -> Geometry, Transform
ln_7 = Line(StartPoint=deplane_5.Origin, EndPoint=move_4.Geometry)
crv_40 = Curve(crv_11)
midpt_8 = CurveMiddle(Curve=ln_7)
scale_4 = Scale(Geometry=ln_7, Center=midpt_8, Factor=Slider(7.8, range=0..10))  # -> Geometry, Transform
merge_3 = Merge(Data1=scale_4.Geometry, Data2=crv_40)
mcx = MultipleCurves(Curves=flatten(merge_3))  # -> Points, IndexA, IndexB, ParamA, ParamB
cull_i_2 = CullIndex(List=flatten(pln_4), Indices=mcx.IndexA, Wrap=True)
item_18 = ListItem(List=pln_4, Index=mcx.IndexA, Wrap=True)
pln_5 = Plane(cull_i_2)
pln_6 = Plane(item_18)

deblock_5 = DeconstructBlock(Block=dispatch_9.ListA)  # -> Name, Plane, Geometry
data_22 = Data(dispatch_9.ListA)

cull_i_3 = CullIndex(List=flatten(data_22), Indices=mcx.IndexA, Wrap=True)
item_19 = ListItem(List=flatten(data_22), Index=mcx.IndexA, Wrap=True)
data_23 = Data(cull_i_3)
data_24 = Data(item_19)

# ----
# 第一层
# 
# Special Curves(architecture line)
crv_41 = Curve(crv_9)
pln_7 = Plane(pln_5)
deplane_6 = DeconstructPlane(Plane=pln_7)  # -> Origin, XAxis, YAxis, ZAxis
disc_4 = Discontinuity(Curve=crv_41, Level=1)  # -> Points, Parameters
pull_4 = PullPoint(Point=deplane_6.Origin, Geometry=disc_4.Points, ClosestOnly=True)  # -> ClosestPoint, Distance
sort_6 = SortList(Keys=pull_4.Distance)  # -> reverse(Keys), ValuesA
panel_36 = Panel(sort_6.Keys)
larger_3 = LargerThan(FirstNumber=pull_4.Distance, SecondNumber=Slider(300, range=0..1000))  # -> LargerThan, OrEqualTo
dispatch_10 = Dispatch(List=pln_7, DispatchPattern=larger_3.LargerThan)  # -> ListA, ListB
data_25 = Data(dispatch_10.ListB)
deplane_7 = DeconstructPlane(Plane=data_25)  # -> Origin, XAxis, YAxis, ZAxis
pull_5 = PullPoint(Point=deplane_7.Origin, Geometry=disc_4.Points, ClosestOnly=True)  # -> ClosestPoint, Distance
pl_3 = ConstructPlane(Origin=pull_5.ClosestPoint, XAxis=deplane_7.XAxis, YAxis=deplane_7.YAxis)

# ----
# 测试Smooth Curve是否与每个Block相切
# blocks + smooth curves
# remove duplicate blocks
# blocks + special curves
deblock_6 = DeconstructBlock(Block=project_7.Geometry)  # -> Name, Plane, Geometry
pln_8 = Plane(flatten(deblock_6.Plane))
deplane_8 = DeconstructPlane(Plane=pln_8)  # -> Origin, XAxis, YAxis, ZAxis
cullduppoints_3 = RemoveDuplicatePoints(InputPoints=deplane_8.Origin, Tolerance=0.001)  # -> OutputPoints, FirstPointIndexes
null_4 = NullItem(Item=cullduppoints_3.FirstPointIndexes)  # -> NullFlags, InvalidFlags, Description
dispatch_11 = Dispatch(List=pln_8, DispatchPattern=null_4.InvalidFlags)  # -> ListA, ListB
dispatch_12 = Dispatch(List=flatten(project_7.Geometry), DispatchPattern=null_4.InvalidFlags)  # -> ListA, ListB
pln_9 = Plane(dispatch_11.ListA)
data_26 = Data(flatten(pln_9))
deplane_9 = DeconstructPlane(Plane=data_26)  # -> Origin, XAxis, YAxis, ZAxis
pln_10 = Plane(data_26)
amp_5 = Amplitude(Vector=deplane_9.YAxis, Amplitude=Slider(300, range=0..1000))
move_5 = Move(Geometry=deplane_9.Origin, Motion=amp_5)  # -> Geometry, Transform
ln_8 = Line(StartPoint=deplane_9.Origin, EndPoint=move_5.Geometry)
crv_42 = Curve(crv_11)
midpt_9 = CurveMiddle(Curve=ln_8)
scale_5 = Scale(Geometry=ln_8, Center=midpt_9, Factor=Slider(7.8, range=0..10))  # -> Geometry, Transform
merge_4 = Merge(Data1=scale_5.Geometry, Data2=crv_42)
mcx_2 = MultipleCurves(Curves=flatten(merge_4))  # -> Points, IndexA, IndexB, ParamA, ParamB
cull_i_4 = CullIndex(List=flatten(pln_10), Indices=mcx_2.IndexA, Wrap=True)
item_20 = ListItem(List=pln_10, Index=mcx_2.IndexA, Wrap=True)
pln_11 = Plane(cull_i_4)
pln_12 = Plane(item_20)

deblock_7 = DeconstructBlock(Block=dispatch_12.ListA)  # -> Name, Plane, Geometry
data_27 = Data(dispatch_12.ListA)

cull_i_5 = CullIndex(List=flatten(data_27), Indices=mcx_2.IndexA, Wrap=True)
item_21 = ListItem(List=flatten(data_27), Index=mcx_2.IndexA, Wrap=True)
data_28 = Data(cull_i_5)
data_29 = Data(item_21)

# ----
# 板埋Modeling
multiplication = Multiplication(A=s_x, B=addition)
multiplication_2 = Multiplication(A=s_y, B=addition_2)
recgrid = Rectangular(Plane=PlaneXY(0, 0, 0), SizeX=s_x, SizeY=s_y, ExtentX=addition, ExtentY=addition_2)  # -> Cells, Points
直径 = Text(filter_8)
division_2 = Division(A=multiplication, B=2)
division_3 = Division(A=multiplication_2, B=2)
vec = VectorXYZ(XComponent=expr("-x", division_2), YComponent=expr("-x", division_3), ZComponent=0)  # -> Vector, Length
move_6 = Move(Geometry=recgrid.Points, Motion=vec.Vector)  # -> Geometry, Transform
division_4 = Division(A=直径, B=2)
cyl = Cylinder(Base=move_6.Geometry, Radius=division_4, Length=expr("-x", expression))
X = UnitX(Factor=直径)
multiplication_3 = Multiplication(A=直径, B=6)
edges = BrepEdges(Brep=cyl)  # -> Naked, Interior, NonManifold
item_22 = ListItem(List=edges.Naked, Index=0, Wrap=True)
max_2 = Maximum(A=multiplication_3, B=70)
move_7 = Move(Geometry=item_22, Motion=X)  # -> Geometry, Transform
multiplication_4 = Multiplication(A=max_2, B=2)
addition_3 = Addition(A=multiplication, B=multiplication_4)
addition_4 = Addition(A=multiplication_2, B=multiplication_4)
division_5 = Division(A=t, B=2)
expression_2 = Expression(x=addition_4, Expression="Ceiling(x/10)*10/2")
expression_3 = Expression(x=addition_3, Expression="Ceiling(x/10)*10/2")
round = Round(Number=division_5)  # -> Nearest, Floor, Ceiling
multiplication_5 = Multiplication(A=round.Ceiling, B=2)
dom = ConstructDomain(DomainStart=expr("-x", expression_2), DomainEnd=expression_2)
dom_2 = ConstructDomain(DomainStart=expr("-x", expression_3), DomainEnd=expression_3)
box = DomainBox(Base=PlaneXY(0, 0, 0), X=dom_2, Y=dom, Z=multiplication_5)
Z = UnitZ(Factor=expr("-x", multiplication_5))

multiplication_6 = Multiplication(A=直径, B=5)

Z_2 = UnitZ(Factor=multiplication_6)
extr = Extrude(Base=move_7.Geometry, Direction=Z_2)
cap = CapHoles(Brep=[extr, cyl])
merge_5 = Merge(Data1=cap, Data2=box)
flatten_3 = FlattenTree(Tree=merge_5, Path="{0}")
move_8 = Move(Geometry=flatten_3, Motion=Z)  # -> Geometry, Transform

# ----
# 三视图
# hidden lines of top+pers view
# move to center
# 如果无法完整的生成埋件的三视图，
# 建议选择埋件的3D在Rhino中将
# Top/Perspective/Front/Right 试图缩放至合适大小后重新运行
panel_37 = Panel("""Top
Perspective
Front
Right""")
m2d_rhino = Make2DRhinoView(Name=panel_37, Clip=True)
make2d = Make2D(Geometry=move_8.Geometry, View=m2d_rhino, TangentEdges=False, TangentSeams=False, AutoComputeMake2D=False)  # -> VisibleCurves, VisibleIndex, VisibleType, HiddenCurves, HiddenIndex, HiddenType
bang = ExplodeTree(Data=make2d.VisibleCurves)  # -> Branch0, Branch1, Branch2, Branch3, Branch4, Branch5, Branch6, Branch7
divdist = DivideDistance(Curve=make2d.HiddenCurves, Distance=Slider(1, range=0..10))  # -> Points, Tangents, Parameters
graft_2 = GraftTree(Tree=make2d.HiddenCurves, IncludeEmptyLists=True, IncludeNullItems=True)
shatter = Shatter(Curve=graft_2, Parameters=divdist.Parameters)
dispatch_13 = Dispatch(List=shatter, DispatchPattern=[True, False])  # -> ListA, ListB
crv_43 = Curve(dispatch_13.ListA)
pshift = ShiftPaths(Data=crv_43, Offset=-1)
pshift_2 = ShiftPaths(Data=pshift, Offset=-1)
bang_2 = ExplodeTree(Data=pshift_2)  # -> Branch0, Branch1, Branch2, Branch3, Branch4, Branch5, Branch6, Branch7
entwine_8 = Entwine(Branch00=bang_2.Branch0, Branch01=bang.Branch0, FlattenInputs=True)  # -> flatten(Result)
entwine_9 = Entwine(Branch00=bang_2.Branch1, Branch01=bang.Branch1, FlattenInputs=True)  # -> flatten(Result)
entwine_10 = Entwine(Branch00=entwine_8, Branch01=entwine_9, Branch02=bang.Branch2, Branch03=bang.Branch3, FlattenInputs=True)
group = Group(Objects=entwine_10)
pshift_3 = ShiftPaths(Data=group, Offset=-1)
pshift_4 = ShiftPaths(Data=group, Offset=-1)
number_slider_32 = Slider(1, range=0..10)
boxprop = BoxProperties(Box=pshift_3)  # -> Center, Diagonal, Area, Volume, Degeneracy
pt = Point(Point(957.9296072, 367.7685097, 0))
pt_2 = Point("0,0,0")
recgrid_2 = Rectangular(
    Plane=pt,
    SizeX=Slider(12, range=1..20, expression="X*50"),
    SizeY=Slider(10, range=1..20, expression="X*50"),
    ExtentX=number_slider_32,
    ExtentY=number_slider_32)  # -> Cells, Points
# Rhino 文件中导入的块名
vec2pt = Vector2Pt(PointA=boxprop.Center, PointB=pt_2, Unitize=False)  # -> Vector, Length
flatten_4 = FlattenTree(Tree=recgrid_2.Points, Path="{0}")
move_9 = Move(Geometry=pshift_4, Motion=vec2pt.Vector)  # -> flatten(Geometry), Transform
orient = Orient(Geometry=flatten(move_9.Geometry), Source=PlaneXY(0, 0, 0), Target=flatten_4)  # -> Geometry, Transform
cull_i_6 = CullIndex(List=orient.Geometry, Indices="-1", Wrap=True)
split = SplitList(List=cull_i_6, Index="4")  # -> ListA, ListB
geo_4 = Geometry(split.ListA)

# ---- group: 单体定Top/Side
item_23 = ListItem(List=geo_4, Index=Slider(0, range=0..10), Wrap=True)
item_24 = ListItem(List=geo_4, Index=2, Wrap=True)
cluster_5 = Cluster(G=item_23)
cluster_6 = Cluster(G=item_24)

# ----
geo_5 = Geometry(project_9.Geometry)
boundary_2 = BoundarySurfaces(Edges=geo_5)
area_5 = Area(Geometry=boundary_2)  # -> Area, Centroid
cullduppoints_4 = RemoveDuplicatePoints(InputPoints=area_5.Centroid, Tolerance=Slider(0.1, range=0..0.1))  # -> OutputPoints, FirstPointIndexes
null_5 = NullItem(Item=cullduppoints_4.FirstPointIndexes)  # -> NullFlags, InvalidFlags, Description
dispatch_14 = Dispatch(List=boundary_2, DispatchPattern=null_5.NullFlags)  # -> ListA, ListB
geo_6 = Geometry(dispatch_14.ListA)
crv_44 = Curve(crv_11)
area_6 = Area(Geometry=geo_6)  # -> Area, Centroid
pull_6 = PullPoint(Point=area_6.Centroid, Geometry=crv_44, ClosestOnly=True)  # -> ClosestPoint, Distance
neg_4 = Negative(Value="0.5 * Pi")
neg_5 = Negative(Value="1.5 * Pi")
filter_11 = StreamFilter(Gate=Toggle(True), Stream0="0.5 * Pi", Stream1=neg_4)
filter_12 = StreamFilter(Gate=Toggle(True), Stream0="1.5 * Pi", Stream1=neg_5)
crv_45 = Curve(crv_11)

# ----
# 第一层
# 
# Angular Curves(architecture line)
number_slider_33 = Slider(84, range=0..1000)
crv_46 = Curve(crv_13)
disc_5 = Discontinuity(Curve=crv_46, Level=1)  # -> Points, Parameters
end_4 = EndPoints(Curve=crv_46)  # -> Start, End
flatten_5 = FlattenTree(Tree=disc_5.Points, Path="{0}")

# ----
# 第一层
# 
# Angular Curves(architecture line)
crv_47 = Curve(crv_10)
disc_6 = Discontinuity(Curve=crv_47, Level=1)  # -> Points, Parameters
end_5 = EndPoints(Curve=crv_47)  # -> Start, End
flatten_6 = FlattenTree(Tree=disc_6.Points, Path="{0}")

# ----
# 第一层
# 
# Curves(location point)+ Smooth Curves(architecture line)
# remove duplicate curves
clscrv = CloseCurve(Curve=crv_12, CloseType=0, Bulge=0.5, Tolerance=0)  # -> Closed, R
crv_48 = Curve(crv_11)
disc_7 = Discontinuity(Curve=graft(crv_48), Level=1)  # -> Points, Parameters
crv_cp_2 = CurveClosestPoint(Point=disc_7.Points, Curve=graft(crv_48))  # -> Point, Parameter, Distance
eval_2 = EvaluateCurve(Curve=graft(crv_48), Parameter=crv_cp_2.Parameter)  # -> flatten(Point), Tangent, flatten(Angle)
deg_2 = Degrees(Radians=eval_2.Angle)
offset_9 = OffsetCurve(Curve=clscrv.Closed, Distance=expr("-X", Slider(300, range=0..1000)), Corners=1)
panel_38 = Panel(deg_2)
larger_4 = LargerThan(FirstNumber=deg_2, SecondNumber=Slider(60, range=0..100))  # -> LargerThan, OrEqualTo
disc_8 = Discontinuity(Curve=offset_9, Level=1)  # -> flatten(Points), Parameters
dispatch_15 = Dispatch(List=eval_2.Point, DispatchPattern=larger_4.LargerThan)  # -> ListA, ListB
data_30 = Data(dispatch_15.ListA)
pull_7 = PullPoint(Point=data_30, Geometry=flatten(offset_9), ClosestOnly=True)  # -> ClosestPoint, Distance
pull_8 = PullPoint(Point=flatten(pln_6), Geometry=crv_48, ClosestOnly=True)  # -> ClosestPoint, Distance
testpoint_2 = TestPoint(archPoint=pull_7.ClosestPoint, crvPoint=disc_8.Points)  # -> out, specialPt; inputs archPoint: list of Point3d, crvPoint: list of Point3d; same code as testpoint
pull_9 = PullPoint(Point=pull_8.ClosestPoint, Geometry=data_30, ClosestOnly=True)  # -> ClosestPoint, Distance
flatten_7 = FlattenTree(Tree=data_24, Path="{0}")
sort_7 = SortList(Keys=pull_9.Distance, ValuesA=flatten_7)  # -> Keys, ValuesA
panel_39 = Panel(sort_7.Keys)
smaller_3 = SmallerThan(FirstNumber=sort_7.Keys, SecondNumber=Slider(100, range=0..100))  # -> SmallerThan, OrEqualTo
dispatch_16 = Dispatch(List=sort_7.ValuesA, DispatchPattern=smaller_3.SmallerThan)  # -> ListA, ListB
data_31 = Data(dispatch_16.ListA)
deblock_8 = DeconstructBlock(Block=data_31)  # -> Name, Plane, Geometry
deplane_10 = DeconstructPlane(Plane=deblock_8.Plane)  # -> Origin, XAxis, YAxis, ZAxis
pt_3 = Point(data_30)
pull_10 = PullPoint(Point=deplane_10.Origin, Geometry=pt_3, ClosestOnly=True)  # -> ClosestPoint, Distance
cir = Circle(Plane=pull_10.ClosestPoint, Radius=Slider(300, range=0..1000))
crv_49 = Curve(crv_48)
amp_6 = Amplitude(Vector=deplane_10.YAxis, Amplitude=Slider(200, range=0..1000))
ccx_5 = CurveCurve(CurveA=cir, CurveB=crv_49)  # -> Points, ParamsA, ParamsB
move_10 = Move(Geometry=pull_10.ClosestPoint, Motion=amp_6)  # -> Geometry, Transform
item_25 = ListItem(List=ccx_5.Points, Index=0, Wrap=True)
clean = CleanTree(RemoveNulls=True, RemoveInvalid=True, RemoveEmpty=Toggle(True), Tree=item_25)
ln_9 = Line(StartPoint=pull_10.ClosestPoint, EndPoint=clean)
ln_10 = Line(StartPoint=pull_10.ClosestPoint, EndPoint=move_10.Geometry)
angle = Angle(VectorA=ln_10, VectorB=ln_9)  # -> Angle, Reflex
deg_3 = Degrees(Radians=angle.Angle)
flatten_8 = FlattenTree(Tree=deg_3, Path="{0}")
panel_40 = Panel(flatten_8)
c_script = CSharpScript(angle=flatten_8, minus=Slider(80, range=0..100))  # -> out, results; inputs angle: list of Double, minus: Double
# ---------- c_script: C# ----------
    List<double> MyAngle = new List<double>();
    for(int i = 0; i < angle.Count; i++){
      if (angle[i] > minus){
        angleEach = angle[i] - 90;
        Print("!!!!!!!!");
        MyAngle.Add(angleEach);
      }
      else{
        angleEach = angle[i];
        Print("00000");
        MyAngle.Add(angleEach);
      }

    }

    results = MyAngle;
# ---------- c_script: C# additional code ----------
  double angleEach = 0;
# ---------- end c_script ----------
larger_5 = LargerThan(FirstNumber=c_script.results, SecondNumber=Slider(30, range=0..100))  # -> LargerThan, OrEqualTo
panel_41 = Panel(c_script.results)
dispatch_17 = Dispatch(List=flatten(data_31), DispatchPattern=flatten(larger_5.LargerThan))  # -> ListA, ListB
data_32 = Data(dispatch_17.ListA)
deblock_9 = DeconstructBlock(Block=data_32)  # -> Name, Plane, Geometry
pln_13 = Plane(flatten(pln_6))
deplane_11 = DeconstructPlane(Plane=flatten(deblock_9.Plane))  # -> Origin, XAxis, YAxis, ZAxis
deplane_12 = DeconstructPlane(Plane=pln_13)  # -> Origin, XAxis, YAxis, ZAxis
testpoint_3 = TestPoint(archPoint=deplane_12.Origin, crvPoint=deplane_11.Origin)  # -> out, specialPt; inputs archPoint: list of Point3d, crvPoint: list of Point3d; same code as testpoint
cull_i_7 = CullIndex(List=pln_13, Indices=testpoint_3.specialPt, Wrap=True)
pln_14 = Plane(deblock_9.Plane)
crv_50 = Curve(crv_11)
pln_15 = Plane(cull_i_7)
data_33 = Data(flatten(pln_15))
deplane_13 = DeconstructPlane(Plane=data_33)  # -> Origin, XAxis, YAxis, ZAxis
amp_7 = Amplitude(Vector=deplane_13.YAxis, Amplitude=Slider(300, range=0..1000))
move_11 = Move(Geometry=deplane_13.Origin, Motion=amp_7)  # -> Geometry, Transform
ln_11 = Line(StartPoint=deplane_13.Origin, EndPoint=move_11.Geometry)
midpt_10 = CurveMiddle(Curve=ln_11)
scale_6 = Scale(Geometry=ln_11, Center=midpt_10, Factor=Slider(4.7, range=0..10))  # -> Geometry, Transform
ccx_6 = CurveCurve(CurveA=graft(scale_6.Geometry), CurveB=crv_50)  # -> flatten(Points), ParamsA, ParamsB
move2pt_6 = MoveToPoint(Geometry=data_33, PointA=deplane_13.Origin, PointB=ccx_6.Points)  # -> Moved, Vector, Transform

crv_51 = Curve(clscrv.Closed)
offset_10 = OffsetCurve(Curve=crv_51, Distance=expr("-x", number_slider_33), Corners=1)  # -> flatten(Curve)
pull_11 = PullPoint(Point=disc_5.Points, Geometry=offset_10, ClosestOnly=True)  # -> ClosestPoint, Distance
disc_9 = Discontinuity(Curve=offset_10, Level=1)  # -> Points, Parameters
pull_12 = PullPoint(Point=flatten(pull_11.ClosestPoint), Geometry=flatten(disc_9.Points), ClosestOnly=True)  # -> ClosestPoint, Distance
check_same_points = CheckSamePoints(archPoint=flatten(pull_11.ClosestPoint), crvPoint=flatten(pull_12.ClosestPoint))  # -> out, specialPt; inputs archPoint: list of Point3d, crvPoint: list of Point3d; same code as testpoint
cull_i_8 = CullIndex(List=flatten(disc_5.Points), Indices=check_same_points.specialPt, Wrap=True)
merge_6 = Merge(Data1=end_4.Start, Data2=end_4.End, Data3=cull_i_8)
check_same_points_2 = CheckSamePoints(archPoint=flatten(flatten_5), crvPoint=flatten(merge_6))  # -> out, specialPt; inputs archPoint: list of Point3d, crvPoint: list of Point3d; same code as testpoint
cull_i_9 = CullIndex(List=flatten(flatten_5), Indices=check_same_points_2.specialPt, Wrap=True)
pull_13 = PullPoint(Point=cull_i_9, Geometry=offset_10, ClosestOnly=True)  # -> ClosestPoint, Distance
ln_12 = Line(StartPoint=cull_i_9, EndPoint=pull_13.ClosestPoint)
rotate_5 = Rotate(Geometry=ln_12, Angle="Pi", Plane=cull_i_9)  # -> Geometry, Transform
rotate_6 = Rotate(Geometry=ln_12, Angle=1.570796327, Plane=cull_i_9)  # -> Geometry, Transform
pl_4 = ConstructPlane(Origin=cull_i_9, XAxis=rotate_5.Geometry, YAxis=rotate_6.Geometry)

crv_52 = Curve(clscrv.Closed)
offset_11 = OffsetCurve(Curve=crv_52, Distance=expr("-x", Slider(84, range=0..1000)), Corners=1)  # -> flatten(Curve)
pull_14 = PullPoint(Point=disc_6.Points, Geometry=offset_11, ClosestOnly=True)  # -> ClosestPoint, Distance
disc_10 = Discontinuity(Curve=offset_11, Level=1)  # -> Points, Parameters
pull_15 = PullPoint(Point=flatten(pull_14.ClosestPoint), Geometry=flatten(disc_10.Points), ClosestOnly=True)  # -> ClosestPoint, Distance
check_same_points_3 = CheckSamePoints(archPoint=flatten(pull_14.ClosestPoint), crvPoint=flatten(pull_15.ClosestPoint))  # -> out, specialPt; inputs archPoint: list of Point3d, crvPoint: list of Point3d; same code as testpoint
cull_i_10 = CullIndex(List=flatten(disc_6.Points), Indices=check_same_points_3.specialPt, Wrap=True)
merge_7 = Merge(Data1=end_5.Start, Data2=end_5.End, Data3=cull_i_10)
check_same_points_4 = CheckSamePoints(archPoint=flatten(flatten_6), crvPoint=flatten(merge_7))  # -> out, specialPt; inputs archPoint: list of Point3d, crvPoint: list of Point3d; same code as testpoint
cull_i_11 = CullIndex(List=flatten(flatten_6), Indices=check_same_points_4.specialPt, Wrap=True)
pull_16 = PullPoint(Point=cull_i_11, Geometry=offset_11, ClosestOnly=True)  # -> ClosestPoint, Distance
ln_13 = Line(StartPoint=cull_i_11, EndPoint=pull_16.ClosestPoint)
rotate_7 = Rotate(Geometry=ln_13, Angle="Pi", Plane=cull_i_11)  # -> Geometry, Transform
rotate_8 = Rotate(Geometry=rotate_7.Geometry, Angle=-1.570796327, Plane=cull_i_11)  # -> Geometry, Transform
pl_5 = ConstructPlane(Origin=cull_i_11, XAxis=rotate_7.Geometry, YAxis=rotate_8.Geometry)

# ----
# 阳角
item_26 = ListItem(List=data_30, Index=testpoint_2.specialPt, Wrap=True)

# ----
# 阴角
cull_i_12 = CullIndex(List=data_30, Indices=testpoint_2.specialPt, Wrap=True)

dist_3 = Distance(PointA=graft(deplane_11.Origin), PointB=item_26)
sort_8 = SortList(Keys=dist_3)  # -> Keys, ValuesA
item_27 = ListItem(List=sort_8.Keys, Index=0, Wrap=True)
flatten_9 = FlattenTree(Tree=item_27, Path="{0}")
smaller_4 = SmallerThan(FirstNumber=item_27, SecondNumber=Slider(100, range=0..300))  # -> SmallerThan, OrEqualTo
panel_42 = Panel(flatten_9)
dispatch_18 = Dispatch(List=graft(pln_14), DispatchPattern=smaller_4.SmallerThan)  # -> ListA, ListB
data_34 = Data(flatten(dispatch_18.ListA))
data_35 = Data(flatten(dispatch_18.ListB))
deplane_14 = DeconstructPlane(Plane=data_34)  # -> Origin, XAxis, YAxis, ZAxis
deplane_15 = DeconstructPlane(Plane=data_35)  # -> Origin, XAxis, YAxis, ZAxis
amp_8 = Amplitude(Vector=deplane_14.YAxis, Amplitude=Slider(300, range=0..1000))
amp_9 = Amplitude(Vector=deplane_15.YAxis, Amplitude=Slider(300, range=0..1000))
move_12 = Move(Geometry=deplane_14.Origin, Motion=amp_8)  # -> Geometry, Transform
move_13 = Move(Geometry=deplane_15.Origin, Motion=amp_9)  # -> Geometry, Transform
ln_14 = Line(StartPoint=deplane_14.Origin, EndPoint=move_12.Geometry)
ln_15 = Line(StartPoint=deplane_15.Origin, EndPoint=move_13.Geometry)
midpt_11 = CurveMiddle(Curve=ln_14)
midpt_12 = CurveMiddle(Curve=ln_15)
scale_7 = Scale(Geometry=ln_14, Center=midpt_11, Factor=Slider(1.5, range=0..10))  # -> Geometry, Transform
scale_8 = Scale(Geometry=ln_15, Center=midpt_12, Factor=Slider(1.5, range=0..10))  # -> Geometry, Transform
ccx_7 = CurveCurve(CurveA=graft(scale_7.Geometry), CurveB=crv_50)  # -> flatten(Points), ParamsA, ParamsB
ccx_8 = CurveCurve(CurveA=graft(scale_8.Geometry), CurveB=crv_50)  # -> flatten(Points), ParamsA, ParamsB
move2pt_7 = MoveToPoint(Geometry=data_34, PointA=deplane_14.Origin, PointB=ccx_7.Points)  # -> Moved, Vector, Transform
move2pt_8 = MoveToPoint(Geometry=data_35, PointA=deplane_15.Origin, PointB=ccx_8.Points)  # -> Moved, Vector, Transform

clscrv_2 = CloseCurve(Curve=crv_12, CloseType=0, Bulge=0.5, Tolerance=0)  # -> Closed, R
crv_53 = Curve(crv_11)
disc_11 = Discontinuity(Curve=graft(crv_53), Level=1)  # -> Points, Parameters
crv_cp_3 = CurveClosestPoint(Point=disc_11.Points, Curve=graft(crv_53))  # -> Point, Parameter, Distance
eval_3 = EvaluateCurve(Curve=graft(crv_53), Parameter=crv_cp_3.Parameter)  # -> flatten(Point), Tangent, flatten(Angle)
deg_4 = Degrees(Radians=eval_3.Angle)
offset_12 = OffsetCurve(Curve=clscrv_2.Closed, Distance=expr("-X", Slider(300, range=0..1000)), Corners=1)
panel_43 = Panel(deg_4)
larger_6 = LargerThan(FirstNumber=deg_4, SecondNumber=Slider(60, range=0..100))  # -> LargerThan, OrEqualTo
disc_12 = Discontinuity(Curve=offset_12, Level=1)  # -> flatten(Points), Parameters
dispatch_19 = Dispatch(List=eval_3.Point, DispatchPattern=larger_6.LargerThan)  # -> ListA, ListB
data_36 = Data(dispatch_19.ListA)
pull_17 = PullPoint(Point=data_36, Geometry=flatten(offset_12), ClosestOnly=True)  # -> ClosestPoint, Distance
testpoint_4 = TestPoint(archPoint=pull_17.ClosestPoint, crvPoint=disc_12.Points)  # -> out, specialPt; inputs archPoint: list of Point3d, crvPoint: list of Point3d; same code as testpoint
pull_18 = PullPoint(Point=flatten(pln_12), Geometry=crv_53, ClosestOnly=True)  # -> ClosestPoint, Distance
pull_19 = PullPoint(Point=pull_18.ClosestPoint, Geometry=data_36, ClosestOnly=True)  # -> ClosestPoint, Distance
flatten_10 = FlattenTree(Tree=data_29, Path="{0}")
sort_9 = SortList(Keys=pull_19.Distance, ValuesA=flatten_10)  # -> Keys, ValuesA
panel_44 = Panel(sort_9.Keys)
smaller_5 = SmallerThan(FirstNumber=sort_9.Keys, SecondNumber=Slider(100, range=0..100))  # -> SmallerThan, OrEqualTo
dispatch_20 = Dispatch(List=sort_9.ValuesA, DispatchPattern=smaller_5.SmallerThan)  # -> ListA, ListB
data_37 = Data(dispatch_20.ListA)
deblock_10 = DeconstructBlock(Block=data_37)  # -> Name, Plane, Geometry
deplane_16 = DeconstructPlane(Plane=deblock_10.Plane)  # -> Origin, XAxis, YAxis, ZAxis
pt_4 = Point(data_36)
pull_20 = PullPoint(Point=deplane_16.Origin, Geometry=pt_4, ClosestOnly=True)  # -> ClosestPoint, Distance
cir_2 = Circle(Plane=pull_20.ClosestPoint, Radius=Slider(300, range=0..1000))
crv_54 = Curve(crv_53)
amp_10 = Amplitude(Vector=deplane_16.YAxis, Amplitude=Slider(200, range=0..1000))
ccx_9 = CurveCurve(CurveA=cir_2, CurveB=crv_54)  # -> Points, ParamsA, ParamsB
move_14 = Move(Geometry=pull_20.ClosestPoint, Motion=amp_10)  # -> Geometry, Transform
item_28 = ListItem(List=ccx_9.Points, Index=0, Wrap=True)
clean_2 = CleanTree(RemoveNulls=True, RemoveInvalid=True, RemoveEmpty=Toggle(True), Tree=item_28)
item_29 = ListItem(List=data_36, Index=testpoint_4.specialPt, Wrap=True)
cull_i_13 = CullIndex(List=data_36, Indices=testpoint_4.specialPt, Wrap=True)
ln_16 = Line(StartPoint=pull_20.ClosestPoint, EndPoint=clean_2)
ln_17 = Line(StartPoint=pull_20.ClosestPoint, EndPoint=move_14.Geometry)
angle_2 = Angle(VectorA=ln_17, VectorB=ln_16)  # -> Angle, Reflex
deg_5 = Degrees(Radians=angle_2.Angle)
flatten_11 = FlattenTree(Tree=deg_5, Path="{0}")
# 阳角
# 阴角
panel_45 = Panel(flatten_11)
c_script_2 = CSharpScript(angle=flatten_11, minus=Slider(80, range=0..100))  # -> out, results; inputs angle: list of Double, minus: Double; same code as c_script
larger_7 = LargerThan(FirstNumber=c_script_2.results, SecondNumber=Slider(30, range=0..100))  # -> LargerThan, OrEqualTo
panel_46 = Panel(c_script_2.results)
dispatch_21 = Dispatch(List=flatten(data_37), DispatchPattern=flatten(larger_7.LargerThan))  # -> ListA, ListB
data_38 = Data(dispatch_21.ListA)
deblock_11 = DeconstructBlock(Block=data_38)  # -> Name, Plane, Geometry
pln_16 = Plane(flatten(pln_12))
deplane_17 = DeconstructPlane(Plane=flatten(deblock_11.Plane))  # -> Origin, XAxis, YAxis, ZAxis
deplane_18 = DeconstructPlane(Plane=pln_16)  # -> Origin, XAxis, YAxis, ZAxis
testpoint_5 = TestPoint(archPoint=deplane_18.Origin, crvPoint=deplane_17.Origin)  # -> out, specialPt; inputs archPoint: list of Point3d, crvPoint: list of Point3d; same code as testpoint
cull_i_14 = CullIndex(List=pln_16, Indices=testpoint_5.specialPt, Wrap=True)
pln_17 = Plane(deblock_11.Plane)
dist_4 = Distance(PointA=graft(deplane_17.Origin), PointB=item_29)
sort_10 = SortList(Keys=dist_4)  # -> Keys, ValuesA
item_30 = ListItem(List=sort_10.Keys, Index=0, Wrap=True)
flatten_12 = FlattenTree(Tree=item_30, Path="{0}")
smaller_6 = SmallerThan(FirstNumber=item_30, SecondNumber=Slider(100, range=0..300))  # -> SmallerThan, OrEqualTo
panel_47 = Panel(flatten_12)
dispatch_22 = Dispatch(List=graft(pln_17), DispatchPattern=smaller_6.SmallerThan)  # -> ListA, ListB
crv_55 = Curve(crv_11)
pln_18 = Plane(cull_i_14)

data_39 = Data(flatten(dispatch_22.ListB))
deplane_19 = DeconstructPlane(Plane=data_39)  # -> Origin, XAxis, YAxis, ZAxis
amp_11 = Amplitude(Vector=deplane_19.YAxis, Amplitude=Slider(300, range=0..1000))
move_15 = Move(Geometry=deplane_19.Origin, Motion=amp_11)  # -> Geometry, Transform
ln_18 = Line(StartPoint=deplane_19.Origin, EndPoint=move_15.Geometry)
midpt_13 = CurveMiddle(Curve=ln_18)
scale_9 = Scale(Geometry=ln_18, Center=midpt_13, Factor=Slider(1.5, range=0..10))  # -> Geometry, Transform
ccx_10 = CurveCurve(CurveA=graft(scale_9.Geometry), CurveB=crv_55)  # -> flatten(Points), ParamsA, ParamsB

data_40 = Data(flatten(dispatch_22.ListA))
deplane_20 = DeconstructPlane(Plane=data_40)  # -> Origin, XAxis, YAxis, ZAxis
amp_12 = Amplitude(Vector=deplane_20.YAxis, Amplitude=Slider(300, range=0..1000))
move_16 = Move(Geometry=deplane_20.Origin, Motion=amp_12)  # -> Geometry, Transform
ln_19 = Line(StartPoint=deplane_20.Origin, EndPoint=move_16.Geometry)
midpt_14 = CurveMiddle(Curve=ln_19)
scale_10 = Scale(Geometry=ln_19, Center=midpt_14, Factor=Slider(1.5, range=0..10))  # -> Geometry, Transform
ccx_11 = CurveCurve(CurveA=graft(scale_10.Geometry), CurveB=crv_55)  # -> flatten(Points), ParamsA, ParamsB

data_41 = Data(flatten(pln_18))
deplane_21 = DeconstructPlane(Plane=data_41)  # -> Origin, XAxis, YAxis, ZAxis
amp_13 = Amplitude(Vector=deplane_21.YAxis, Amplitude=Slider(300, range=0..1000))
move_17 = Move(Geometry=deplane_21.Origin, Motion=amp_13)  # -> Geometry, Transform
ln_20 = Line(StartPoint=deplane_21.Origin, EndPoint=move_17.Geometry)
midpt_15 = CurveMiddle(Curve=ln_20)
scale_11 = Scale(Geometry=ln_20, Center=midpt_15, Factor=Slider(4.7, range=0..10))  # -> Geometry, Transform
ccx_12 = CurveCurve(CurveA=graft(scale_11.Geometry), CurveB=crv_55)  # -> flatten(Points), ParamsA, ParamsB

move2pt_9 = MoveToPoint(Geometry=data_41, PointA=deplane_21.Origin, PointB=ccx_12.Points)  # -> Moved, Vector, Transform
move2pt_10 = MoveToPoint(Geometry=data_40, PointA=deplane_20.Origin, PointB=ccx_11.Points)  # -> Moved, Vector, Transform
move2pt_11 = MoveToPoint(Geometry=data_39, PointA=deplane_19.Origin, PointB=ccx_10.Points)  # -> Moved, Vector, Transform
xy_20 = XYPlane(Origin=move2pt_9.Moved)
xy_21 = XYPlane(Origin=move2pt_10.Moved)
xy_22 = XYPlane(Origin=move2pt_11.Moved)
rotate_9 = Rotate(Geometry=move2pt_9.Moved, Angle="Pi", Plane=xy_20)  # -> Geometry, Transform
rotate_10 = Rotate(Geometry=move2pt_10.Moved, Angle="Pi", Plane=xy_21)  # -> Geometry, Transform
rotate_11 = Rotate(Geometry=move2pt_11.Moved, Angle="Pi", Plane=xy_22)  # -> Geometry, Transform
filter_13 = StreamFilter(Gate=Toggle(True), Stream0=move2pt_10.Moved, Stream1=rotate_10.Geometry)
# SmoothCurve-阴角
# SmoothCurve-阳角
# SmoothCurve-阴角
# SmoothCurve-正常
# Angular Curve - All
# Special Curve(with location)- All
# Curve for this project only - All
filter_14 = StreamFilter(Gate=Toggle(True), Stream0=move2pt_11.Moved, Stream1=rotate_11.Geometry)
filter_15 = StreamFilter(Gate=Toggle(True), Stream0=move2pt_9.Moved, Stream1=rotate_9.Geometry)

dist_5 = Distance(PointA=pull_6.ClosestPoint, PointB=data_30)
sort_11 = SortList(Keys=dist_5)  # -> Keys, ValuesA
panel_48 = Panel(sort_11.Keys)
smaller_7 = SmallerThan(FirstNumber=dist_5, SecondNumber=Slider(200, range=0..1000))  # -> SmallerThan, OrEqualTo
dispatch_23 = Dispatch(List=geo_6, DispatchPattern=smaller_7.SmallerThan)  # -> ListA, ListB
data_42 = Data(dispatch_23.ListB)
explode_4 = Explode(Curve=data_42, Recursive=True)  # -> Segments, Vertices
len_4 = Length(Curve=explode_4.Segments)
sort_12 = SortList(Keys=reverse(len_4), ValuesA=explode_4.Segments)  # -> Keys, ValuesA
item_31 = ListItem(List=sort_12.ValuesA, Index=0, Wrap=True)  # -> flatten(Item)
area_7 = Area(Geometry=data_42)  # -> Area, Centroid
midpt_16 = CurveMiddle(Curve=item_31)
move2pt_12 = MoveToPoint(Geometry=item_31, PointA=midpt_16, PointB=area_7.Centroid)  # -> Moved, Vector, Transform
end_6 = EndPoints(Curve=move2pt_12.Moved)  # -> Start, End
pull_21 = PullPoint(Point=end_6.Start, Geometry=crv_44, ClosestOnly=True)  # -> ClosestPoint, Distance
crv_cp_4 = CurveClosestPoint(Point=graft(pull_21.ClosestPoint), Curve=crv_44)  # -> Point, Parameter, Distance
eval_4 = EvaluateCurve(Curve=crv_44, Parameter=crv_cp_4.Parameter)  # -> Point, Tangent, Angle
pull_22 = PullPoint(Point=eval_4.Point, Geometry=pull_21.ClosestPoint, ClosestOnly=True)  # -> ClosestPoint, Distance
sort_13 = SortList(Keys=pull_22.Distance, ValuesA=eval_4.Point)  # -> Keys, ValuesA
sort_14 = SortList(Keys=pull_22.Distance, ValuesA=eval_4.Tangent)  # -> Keys, ValuesA
item_32 = ListItem(List=sort_14.ValuesA, Index="0", Wrap=True)
item_33 = ListItem(List=sort_13.ValuesA, Index="0", Wrap=True)
amp_14 = Amplitude(Vector=item_32, Amplitude=Slider(100, range=0..100))
move_18 = Move(Geometry=item_33, Motion=amp_14)  # -> Geometry, Transform
xy_23 = XYPlane(Origin=item_33)
rotate_12 = Rotate(Geometry=move_18.Geometry, Angle="1 * Pi", Plane=xy_23)  # -> Geometry, Transform
ln_21 = Line(StartPoint=item_33, EndPoint=rotate_12.Geometry)
rotate_13 = Rotate(Geometry=ln_21, Angle=filter_12, Plane=xy_23)  # -> Geometry, Transform
pl_6 = ConstructPlane(Origin=move_18.Geometry, XAxis=ln_21, YAxis=rotate_13.Geometry)

# ----
# 转角点
data_43 = Data(dispatch_23.ListA)

explode_5 = Explode(Curve=data_43, Recursive=True)  # -> Segments, Vertices
len_5 = Length(Curve=explode_5.Segments)
sort_15 = SortList(Keys=reverse(len_5), ValuesA=explode_5.Segments)  # -> Keys, ValuesA
item_34 = ListItem(List=sort_15.ValuesA, Index=0, Wrap=True)  # -> flatten(Item)
area_8 = Area(Geometry=data_43)  # -> Area, Centroid
midpt_17 = CurveMiddle(Curve=item_34)
move2pt_13 = MoveToPoint(Geometry=item_34, PointA=midpt_17, PointB=area_8.Centroid)  # -> Moved, Vector, Transform
end_7 = EndPoints(Curve=move2pt_13.Moved)  # -> Start, End
ln_22 = Line(StartPoint=end_7.Start, EndPoint=end_7.End)
xy_24 = XYPlane(Origin=end_7.End)
rotate_14 = Rotate(Geometry=ln_22, Angle=filter_11, Plane=xy_24)  # -> Geometry, Transform
pl_7 = ConstructPlane(Origin=end_7.End, XAxis=rotate_14.Geometry, YAxis=ln_22)
dist_6 = Distance(PointA=graft(end_7.End), PointB=item_26)
sort_16 = SortList(Keys=dist_6)  # -> Keys, ValuesA
# 阳角
# 阴角
item_35 = ListItem(List=sort_16.Keys, Index=0, Wrap=True)
smaller_8 = SmallerThan(FirstNumber=item_35, SecondNumber=Slider(100, range=0..300))  # -> SmallerThan, OrEqualTo
flatten_13 = FlattenTree(Tree=item_35, Path="{0}")
dispatch_24 = Dispatch(List=graft(pl_7), DispatchPattern=smaller_8.SmallerThan)  # -> ListA, ListB
panel_49 = Panel(flatten_13)
data_44 = Data(flatten(dispatch_24.ListA))
data_45 = Data(flatten(dispatch_24.ListB))
deplane_22 = DeconstructPlane(Plane=data_44)  # -> Origin, XAxis, YAxis, ZAxis
deplane_23 = DeconstructPlane(Plane=data_45)  # -> Origin, XAxis, YAxis, ZAxis
amp_15 = Amplitude(Vector=deplane_22.YAxis, Amplitude=Slider(300, range=0..1000))
amp_16 = Amplitude(Vector=deplane_23.YAxis, Amplitude=Slider(300, range=0..1000))
move_19 = Move(Geometry=deplane_22.Origin, Motion=amp_15)  # -> Geometry, Transform
move_20 = Move(Geometry=deplane_23.Origin, Motion=amp_16)  # -> Geometry, Transform
ln_23 = Line(StartPoint=deplane_22.Origin, EndPoint=move_19.Geometry)
ln_24 = Line(StartPoint=deplane_23.Origin, EndPoint=move_20.Geometry)
midpt_18 = CurveMiddle(Curve=ln_23)
midpt_19 = CurveMiddle(Curve=ln_24)
scale_12 = Scale(Geometry=ln_23, Center=midpt_18, Factor=Slider(1.5, range=0..10))  # -> Geometry, Transform
scale_13 = Scale(Geometry=ln_24, Center=midpt_19, Factor=Slider(1.5, range=0..10))  # -> Geometry, Transform
ccx_13 = CurveCurve(CurveA=graft(scale_13.Geometry), CurveB=crv_45)  # -> flatten(Points), ParamsA, ParamsB
ccx_14 = CurveCurve(CurveA=graft(scale_12.Geometry), CurveB=crv_45)  # -> flatten(Points), ParamsA, ParamsB
move2pt_14 = MoveToPoint(Geometry=data_44, PointA=deplane_22.Origin, PointB=ccx_14.Points)  # -> Moved, Vector, Transform
move2pt_15 = MoveToPoint(Geometry=data_45, PointA=deplane_23.Origin, PointB=ccx_13.Points)  # -> Moved, Vector, Transform

# ----
# 阴阳角
number_slider_34 = Slider(1000, range=0..1000)
cir_3 = Circle(Plane=move2pt_7.Moved, Radius=number_slider_34)
cir_4 = Circle(Plane=move2pt_8.Moved, Radius=number_slider_34)
cir_5 = Circle(Plane=filter_13, Radius=1)
cir_6 = Circle(Plane=filter_13, Radius=number_slider_34)
cir_7 = Circle(Plane=move2pt_14.Moved, Radius=number_slider_34)
cir_8 = Circle(Plane=move2pt_15.Moved, Radius=number_slider_34)
merge_8 = Merge(Data1=cir_3, Data2=cir_4, Data3=cir_5, Data4=cir_6, Data5=cir_7, Data6=cir_8)

# ----
# SIte-所有的定位点
merge_9 = Merge(Data1=move2pt_6.Moved, Data2=filter_15, Data3=pl_6, Data4=pl_5, Data5=pl_3, Data6=pl_4)  # -> flatten(Result)

ungroup = Ungroup(Group=cluster_6)
ungroup_2 = Ungroup(Group=cluster_5)

# ---- group: Top/Side
filter_16 = StreamFilter(Gate=list_6, Stream0=ungroup_2, Stream1=ungroup)

# ---- group: Block
# 自定义块所在图层
# 自定义块所在图层颜色
# 自定义块名称
panel_50 = Panel("Embeded::Embeded Board")
layer_5 = DefineLayer(Name=panel_50, Color=ColourSwatch(SwatchColor=RGB(255, 0, 0)))
attributes = DefineObjectAttributes(Layer=layer_5)
block = DefineBlock(Geometry=ungroup_2, Attributes=attributes, BlockName="Board Plate", BasePlane=PlaneXY(0, 0, 0))

# ----
deblock_12 = DeconstructBlock(Block=block)  # -> Name, flatten(Plane), flatten(Geometry)
boundary_3 = BoundarySurfaces(Edges=deblock_12.Geometry)
deplane_24 = DeconstructPlane(Plane=deblock_12.Plane)  # -> Origin, XAxis, YAxis, ZAxis
area_9 = Area(Geometry=boundary_3)  # -> Area, Centroid
move2pt_16 = MoveToPoint(Geometry=flatten(deplane_24.Origin), PointA=flatten(deplane_24.Origin), PointB=flatten(area_9.Centroid))  # -> Moved, Vector, Transform
pl_8 = ConstructPlane(Origin=move2pt_16.Moved, XAxis=deplane_24.XAxis, YAxis=deplane_24.YAxis)  # -> graft(Plane)
# 这里如果跑红也不要紧，
# 说明单体没有出现相撞的情况
entwine_11 = Entwine(Branch00=block, Branch01=pl_8, FlattenInputs=True)

flip = FlipMatrix(Data=entwine_11)
item_36 = ListItem(List=flip, Index=0, Wrap=True)
item_37 = ListItem(List=flip, Index="-1", Wrap=True)

# ----
# 1.是否有檐口线
toggle_4 = BooleanToggle(True)
clean_3 = CleanTree(RemoveNulls=True, RemoveInvalid=True, RemoveEmpty=toggle_4, Tree=merge_9)
crv_56 = Curve(crv_2)
deplane_25 = DeconstructPlane(Plane=clean_3)  # -> Origin, XAxis, YAxis, ZAxis
incurve = PointInCurve(Point=deplane_25.Origin, Curve=crv_56)  # -> Relationship, Point
equals_2 = Equality(FirstNumber=incurve.Relationship, SecondNumber="2")  # -> Equality, Inequality
dispatch_25 = Dispatch(List=clean_3, DispatchPattern=equals_2.Equality)  # -> ListA, ListB
crv_57 = Curve(crv_3)
crv_58 = Curve(crv_7)
merge_10 = Merge(Data1=crv_58, Data2=crv_57)

# ----
# Site - 无檐口线的定位点
pln_19 = Plane(dispatch_25.ListB)

# ----
# Site - 有檐口线的定位点
pln_20 = Plane(dispatch_25.ListA)

incurves = PointInCurves(Point=pln_20, Curves=crv_57)  # -> Relationship, Index, Point
incurves_2 = PointInCurves(Point=pln_20, Curves=merge_10)  # -> Relationship, Index, Point
equals_3 = Equality(FirstNumber=incurves_2.Relationship, SecondNumber="2")  # -> Equality, Inequality
equals_4 = Equality(FirstNumber=incurves.Relationship, SecondNumber="0")  # -> Equality, Inequality
dispatch_26 = Dispatch(List=pln_20, DispatchPattern=equals_3.Equality)  # -> ListA, ListB
dispatch_27 = Dispatch(List=pln_20, DispatchPattern=equals_4.Inequality)  # -> ListA, ListB
pln_21 = Plane(dispatch_26.ListB)

# ----
# 檐口出特殊处理:
# 比如作为吊顶处理
# +车道处特殊处理
pln_22 = Plane(dispatch_26.ListA)

# ----
# 车道处特殊处理
pln_23 = Plane(dispatch_27.ListA)

# ----
# 1.1有檐口线
pln_24 = Plane(pln_21)

# ----
# 1.0无檐口线初筛
pln_25 = Plane(pln_19)

deplane_26 = DeconstructPlane(Plane=pln_25)  # -> Origin, XAxis, YAxis, ZAxis
crv_59 = Curve(crv_27)
incurves_3 = PointInCurves(Point=deplane_26.Origin, Curves=flatten(crv_59))  # -> Relationship, Index, Point
equals_5 = Equality(FirstNumber=incurves_3.Relationship, SecondNumber="2")  # -> Equality, Inequality
dispatch_28 = Dispatch(List=pln_25, DispatchPattern=equals_5.Equality)  # -> ListA, ListB
crv_60 = Curve(crv_58)
data_46 = Data(dispatch_28.ListB)

# ----
# 1.1.1布埋件
pln_26 = Plane(pln_24)

# ----
# 0.有檐口-整个site一起处理
deplane_27 = DeconstructPlane(Plane=pln_26)  # -> Origin, XAxis, YAxis, ZAxis
amp_17 = Amplitude(Vector=deplane_27.YAxis, Amplitude=number_slider_17)
move_21 = Move(Geometry=deplane_27.Origin, Motion=amp_17)  # -> Geometry, Transform
ln_25 = Line(StartPoint=deplane_27.Origin, EndPoint=move_21.Geometry)
ccx_15 = CurveCurve(CurveA=graft(ln_25), CurveB=flatten(merge_2))  # -> Points, ParamsA, ParamsB
shift_2 = ShiftPaths(Data=ccx_15.Points, Offset=-1)
sort_17 = SortList(Keys=shift_2, ValuesA=shift_2)  # -> Keys, ValuesA
pull_23 = PullPoint(Point=sort_17.ValuesA, Geometry=graft(deplane_27.Origin), ClosestOnly=True)  # -> ClosestPoint, Distance
sort_18 = SortList(Keys=pull_23.Distance, ValuesA=sort_17.ValuesA)  # -> Keys, ValuesA
item_38 = ListItem(List=sort_18.ValuesA, Index="-1", Wrap=True)
null_6 = NullItem(Item=flatten(item_38))  # -> NullFlags, InvalidFlags, Description
crv_61 = Curve(shift)
dispatch_29 = Dispatch(List=item_38, DispatchPattern=item_38)  # -> ListA, ListB
dispatch_30 = Dispatch(List=pln_26, DispatchPattern=null_6.InvalidFlags)  # -> ListA, ListB
data_47 = Data(dispatch_29.ListA)
data_48 = Data(dispatch_30.ListB)
check_same_points_5 = CheckSamePoints(archPoint=pln_26, crvPoint=data_48)  # -> out, specialPt; inputs archPoint: list of Point3d, crvPoint: list of Point3d; same code as testpoint

pln_27 = Plane(dispatch_28.ListA)
incurves_4 = PointInCurves(Point=pln_27, Curves=flatten(crv_60))  # -> Relationship, Index, Point
equals_6 = Equality(FirstNumber=incurves_4.Relationship, SecondNumber="0")  # -> Equality, Inequality
dispatch_31 = Dispatch(List=pln_27, DispatchPattern=equals_6.Equality)  # -> ListA, ListB
pln_28 = Plane(dispatch_31.ListB)

# ----
# 1.0无檐口线
pln_29 = Plane(dispatch_31.ListA)

# ----
# 1.0无檐口线+上下层幕墙边线连续
crv_62 = Curve(crv)
pln_30 = Plane(pln_29)
crv_63 = Curve(crv_5)
deplane_28 = DeconstructPlane(Plane=pln_30)  # -> Origin, XAxis, YAxis, ZAxis
number_slider_35 = Slider(3584, range=0..10000)
amp_18 = Amplitude(Vector=deplane_28.YAxis, Amplitude=number_slider_35)
amp_19 = Amplitude(Vector=deplane_28.YAxis, Amplitude=expr("-x", number_slider_35))
move_22 = Move(Geometry=deplane_28.Origin, Motion=amp_18)  # -> Geometry, Transform
move_23 = Move(Geometry=deplane_28.Origin, Motion=amp_19)  # -> Geometry, Transform
ln_26 = Line(StartPoint=move_23.Geometry, EndPoint=move_22.Geometry)
ccx_16 = CurveCurve(CurveA=ln_26, CurveB=crv_63)  # -> flatten(Points), ParamsA, ParamsB
ccx_17 = CurveCurve(CurveA=ln_26, CurveB=crv_62)  # -> flatten(Points), ParamsA, ParamsB
pull_24 = PullPoint(Point=ccx_17.Points, Geometry=ccx_16.Points, ClosestOnly=True)  # -> ClosestPoint, Distance
sort_19 = SortList(Keys=pull_24.Distance, ValuesA=pull_24.ClosestPoint)  # -> Keys, ValuesA
pln_31 = Plane(pln_30)
panel_51 = Panel(sort_19.Keys)
larger_8 = LargerThan(FirstNumber=sort_19.Keys, SecondNumber=Slider(1.1, range=0..10))  # -> LargerThan, OrEqualTo
dispatch_32 = Dispatch(List=sort_19.ValuesA, DispatchPattern=larger_8.LargerThan)  # -> ListA, ListB
pt_5 = Point(dispatch_32.ListB)
pt_6 = Point(dispatch_32.ListA)
pull_25 = PullPoint(Point=deplane_28.Origin, Geometry=graft(pt_5), ClosestOnly=True)  # -> ClosestPoint, Distance
sort_20 = SortList(Keys=pull_25.Distance, ValuesA=pln_31)  # -> Keys, ValuesA
item_39 = ListItem(List=sort_20.ValuesA, Index=0, Wrap=True)
check_same_points_6 = CheckSamePoints(archPoint=pln_31, crvPoint=flatten(item_39))  # -> out, specialPt; inputs archPoint: list of Point3d, crvPoint: list of Point3d; same code as testpoint
item_40 = ListItem(List=pln_31, Index=check_same_points_6.specialPt, Wrap=True)
deplane_29 = DeconstructPlane(Plane=item_40)  # -> Origin, XAxis, YAxis, ZAxis
amp_20 = Amplitude(Vector=deplane_29.YAxis, Amplitude=expr("-x", Slider(2756, range=0..10000)))
crv_64 = Curve(merge_2)
move_24 = Move(Geometry=deplane_29.Origin, Motion=amp_20)  # -> Geometry, Transform
ln_27 = Line(StartPoint=deplane_29.Origin, EndPoint=move_24.Geometry)
ccx_18 = CurveCurve(CurveA=graft(ln_27), CurveB=flatten(crv_64))  # -> Points, ParamsA, ParamsB
shift_3 = ShiftPaths(Data=ccx_18.Points, Offset=-1)
pull_26 = PullPoint(Point=deplane_29.Origin, Geometry=shift_3, ClosestOnly=True)  # -> ClosestPoint, Distance
sort_21 = SortList(Keys=pull_26.Distance, ValuesA=pull_26.ClosestPoint)  # -> Keys, ValuesA
item_41 = ListItem(List=sort_21.ValuesA, Index=0, Wrap=True)
null_7 = NullItem(Item=flatten(item_41))  # -> NullFlags, InvalidFlags, Description
dispatch_33 = Dispatch(List=item_40, DispatchPattern=null_7.InvalidFlags)  # -> ListA, ListB
dispatch_34 = Dispatch(List=item_41, DispatchPattern=item_41)  # -> ListA, ListB
data_49 = Data(dispatch_33.ListB)
data_50 = Data(dispatch_34.ListA)
flatten_14 = FlattenTree(Tree=data_50, Path="{0}")
ln_28 = Line(StartPoint=data_49, EndPoint=flatten_14)
len_6 = Length(Curve=ln_28)
sort_22 = SortList(Keys=len_6)  # -> reverse(Keys), ValuesA
move2pt_17 = MoveToPoint(Geometry=data_49, PointA=data_49, PointB=flatten(data_50))  # -> Moved, Vector, Transform

# ----
# 按照梁分类定位点
pt_7 = Point(data_47)
incurves_5 = PointInCurves(Point=flatten(pt_7), Curves=crv_61)  # -> Relationship, Index, Point
equals_7 = Equality(FirstNumber=incurves_5.Relationship, SecondNumber="0")  # -> Equality, Inequality
dispatch_35 = Dispatch(List=flatten(pt_7), DispatchPattern=equals_7.Inequality)  # -> ListA, ListB
data_51 = Data(dispatch_35.ListA)

# ----
# 按照梁分类定位点
pt_8 = Point(data_47)
incurves_6 = PointInCurves(Point=flatten(pt_8), Curves=crv_61)  # -> Relationship, Index, Point
equals_8 = Equality(FirstNumber=incurves_6.Relationship, SecondNumber="0")  # -> Equality, Inequality
dispatch_36 = Dispatch(List=flatten(data_48), DispatchPattern=equals_8.Inequality)  # -> ListA, ListB
data_52 = Data(dispatch_36.ListA)

move2pt_18 = MoveToPoint(Geometry=data_52, PointA=data_52, PointB=data_51)  # -> Moved, Vector, Transform
null_8 = NullItem(Item=move2pt_18.Moved)  # -> NullFlags, InvalidFlags, Description
dispatch_37 = Dispatch(List=move2pt_18.Moved, DispatchPattern=null_8.InvalidFlags)  # -> ListA, ListB

# ----
# 0无檐口线
# 与梁不相交
cull_i_15 = CullIndex(List=pln_26, Indices=check_same_points_5.specialPt, Wrap=True)

# ----
# 0 檐口出定位点
# 与结构无交点
pln_32 = Plane(cull_i_15)

# ----
# 0.Missing Point
# 埋件定位点Offset，没有找到和梁的交点
number_slider_36 = Slider(5000, range=0..10000)
deplane_30 = DeconstructPlane(Plane=pln_32)  # -> Origin, XAxis, YAxis, ZAxis
amp_21 = Amplitude(Vector=deplane_30.YAxis, Amplitude=number_slider_36)
move_25 = Move(Geometry=deplane_30.Origin, Motion=amp_21)  # -> Geometry, Transform
ln_29 = Line(StartPoint=move_25.Geometry, EndPoint=deplane_30.Origin)
amp_22 = Amplitude(Vector=deplane_30.XAxis, Amplitude=number_slider_3)
amp_23 = Amplitude(Vector=deplane_30.XAxis, Amplitude=expr("-x", number_slider_3))
move_26 = Move(Geometry=ln_29, Motion=amp_22)  # -> Geometry, Transform
move_27 = Move(Geometry=ln_29, Motion=amp_23)  # -> Geometry, Transform

ccx_19 = CurveCurve(CurveA=graft(move_27.Geometry), CurveB=flatten(merge_2))  # -> Points, ParamsA, ParamsB
shift_4 = ShiftPaths(Data=ccx_19.Points, Offset=-1)
sort_23 = SortList(Keys=shift_4, ValuesA=shift_4)  # -> Keys, ValuesA
pull_27 = PullPoint(Point=sort_23.ValuesA, Geometry=graft(pln_32), ClosestOnly=True)  # -> ClosestPoint, Distance
sort_24 = SortList(Keys=pull_27.Distance, ValuesA=sort_23.ValuesA)  # -> Keys, ValuesA
item_42 = ListItem(List=sort_24.ValuesA, Index="-1", Wrap=True)
null_9 = NullItem(Item=flatten(item_42))  # -> NullFlags, InvalidFlags, Description
dispatch_38 = Dispatch(List=simplify(item_42), DispatchPattern=simplify(graft(null_9.InvalidFlags)))  # -> ListA, ListB
dispatch_39 = Dispatch(List=pln_32, DispatchPattern=null_9.InvalidFlags)  # -> ListA, ListB
pln_33 = Plane(dispatch_39.ListB)
pt_9 = Point(dispatch_38.ListB)

ccx_20 = CurveCurve(CurveA=graft(move_26.Geometry), CurveB=flatten(merge_2))  # -> Points, ParamsA, ParamsB
shift_5 = ShiftPaths(Data=ccx_20.Points, Offset=-1)
sort_25 = SortList(Keys=shift_5, ValuesA=shift_5)  # -> Keys, ValuesA
pull_28 = PullPoint(Point=sort_25.ValuesA, Geometry=graft(pln_32), ClosestOnly=True)  # -> ClosestPoint, Distance
sort_26 = SortList(Keys=pull_28.Distance, ValuesA=sort_25.ValuesA)  # -> Keys, ValuesA
item_43 = ListItem(List=sort_26.ValuesA, Index="-1", Wrap=True)
null_10 = NullItem(Item=flatten(item_43))  # -> NullFlags, InvalidFlags, Description
dispatch_40 = Dispatch(List=simplify(item_43), DispatchPattern=simplify(graft(null_10.InvalidFlags)))  # -> ListA, ListB
dispatch_41 = Dispatch(List=pln_32, DispatchPattern=null_10.InvalidFlags)  # -> ListA, ListB
pln_34 = Plane(dispatch_41.ListB)
pt_10 = Point(dispatch_40.ListB)

# ----
# 按照梁分类定位点
pln_35 = Plane(pln_33)
pt_11 = Point(pt_9)
incurves_7 = PointInCurves(Point=flatten(pt_11), Curves=crv_29)  # -> Relationship, Index, Point
equals_9 = Equality(FirstNumber=incurves_7.Relationship, SecondNumber="0")  # -> Equality, Inequality
dispatch_42 = Dispatch(List=flatten(pln_35), DispatchPattern=equals_9.Inequality)  # -> ListA, ListB
data_53 = Data(dispatch_42.ListA)

# ----
# 按照梁分类定位点
pt_12 = Point(pt_9)
incurves_8 = PointInCurves(Point=flatten(pt_12), Curves=crv_29)  # -> Relationship, Index, Point
equals_10 = Equality(FirstNumber=incurves_8.Relationship, SecondNumber="0")  # -> Equality, Inequality
dispatch_43 = Dispatch(List=flatten(pt_12), DispatchPattern=equals_10.Inequality)  # -> ListA, ListB
data_54 = Data(dispatch_43.ListA)

# ----
# 按照梁分类定位点
pln_36 = Plane(pln_34)
pt_13 = Point(pt_10)
incurves_9 = PointInCurves(Point=flatten(pt_13), Curves=crv_29)  # -> Relationship, Index, Point
equals_11 = Equality(FirstNumber=incurves_9.Relationship, SecondNumber="0")  # -> Equality, Inequality
dispatch_44 = Dispatch(List=flatten(pln_36), DispatchPattern=equals_11.Inequality)  # -> ListA, ListB
data_55 = Data(dispatch_44.ListA)

# ----
# 按照梁分类定位点
pt_14 = Point(pt_10)
incurves_10 = PointInCurves(Point=flatten(pt_14), Curves=crv_29)  # -> Relationship, Index, Point
equals_12 = Equality(FirstNumber=incurves_10.Relationship, SecondNumber="0")  # -> Equality, Inequality
dispatch_45 = Dispatch(List=flatten(pt_14), DispatchPattern=equals_12.Inequality)  # -> ListA, ListB
data_56 = Data(dispatch_45.ListA)

move2pt_19 = MoveToPoint(Geometry=data_53, PointA=data_53, PointB=data_54)  # -> Moved, Vector, Transform
null_11 = NullItem(Item=move2pt_19.Moved)  # -> NullFlags, InvalidFlags, Description
dispatch_46 = Dispatch(List=move2pt_19.Moved, DispatchPattern=null_11.InvalidFlags)  # -> ListA, ListB
pln_37 = Plane(dispatch_46.ListB)

move2pt_20 = MoveToPoint(Geometry=data_55, PointA=data_55, PointB=data_56)  # -> Moved, Vector, Transform
null_12 = NullItem(Item=move2pt_20.Moved)  # -> NullFlags, InvalidFlags, Description
dispatch_47 = Dispatch(List=move2pt_20.Moved, DispatchPattern=null_12.InvalidFlags)  # -> ListA, ListB
pln_38 = Plane(dispatch_47.ListB)

# ----
# 撞到梁交点
pln_39 = Plane(pln_38)
pln_40 = Plane(pln_37)

# ----
# 0 檐口出特殊处理
# 比如作为吊顶处理
pln_41 = Plane(pln_22)
pt_15 = Point(pln_41)

# ----
# 0.檐口处侧埋，钢板焊
# 02：钢板焊埋件[钢梁外侧]
# @钢边梁宽@钢边梁高
pln_42 = Plane(dispatch_37.ListB)

merge_11 = Merge(Data1=pln_42, Data2=pln_39, Data3=pln_40)
orient_2 = Orient(Geometry=item_8, Source=item_9, Target=merge_11)  # -> Geometry, Transform

# ----
# 与梁无交点的定位点
pln_43 = Plane(dispatch_33.ListA)

cull_i_16 = CullIndex(List=pln_31, Indices=check_same_points_6.specialPt, Wrap=True)
pln_44 = Plane(pln_24)
merge_12 = Merge(Data1=cull_i_16, Data2=pln_44)  # -> flatten(Result)

# ----
# 和下层楼板发生关系的定位点
pln_45 = Plane(pln_44)

pln_46 = Plane(pln_45)

number_slider_37 = Slider(3584, range=0..10000)
deplane_31 = DeconstructPlane(Plane=pln_46)  # -> Origin, XAxis, YAxis, ZAxis
amp_24 = Amplitude(Vector=deplane_31.YAxis, Amplitude=number_slider_37)
amp_25 = Amplitude(Vector=deplane_31.YAxis, Amplitude=expr("-x", number_slider_37))
boundary_4 = BoundarySurfaces(Edges=[offset_4, offset_5])
crv_65 = Curve(merge)
move_28 = Move(Geometry=deplane_31.Origin, Motion=amp_25)  # -> Geometry, Transform
move_29 = Move(Geometry=deplane_31.Origin, Motion=amp_24)  # -> Geometry, Transform
scx = SurfaceCurve(Surface=boundary_4, Curve=crv_65)  # -> flatten(Curves), Points, UVPoints, Normals, Parameters, Tangents
ln_30 = Line(StartPoint=move_28.Geometry, EndPoint=move_29.Geometry)
ccx_21 = CurveCurve(CurveA=graft(ln_30), CurveB=scx.Curves)  # -> Points, ParamsA, ParamsB
shift_6 = ShiftPaths(Data=ccx_21.Points, Offset=-1)
pull_29 = PullPoint(Point=graft(pln_46), Geometry=shift_6, ClosestOnly=True)  # -> ClosestPoint, Distance
sort_27 = SortList(Keys=pull_29.Distance, ValuesA=pull_29.ClosestPoint)  # -> Keys, ValuesA
null_13 = NullItem(Item=sort_27.ValuesA)  # -> NullFlags, simplify(InvalidFlags), Description
item_44 = ListItem(List=sort_27.ValuesA, Index=0, Wrap=True)
dispatch_48 = Dispatch(List=simplify(graft(pln_46)), DispatchPattern=null_13.InvalidFlags)  # -> ListA, ListB
dispatch_49 = Dispatch(List=simplify(graft(item_44)), DispatchPattern=null_13.InvalidFlags)  # -> ListA, ListB
pt_16 = Point(dispatch_49.ListB)
pln_47 = Plane(dispatch_48.ListA)
pln_48 = Plane(dispatch_48.ListB)

pln_49 = Plane(pln_46)
number_slider_38 = Slider(3584, range=0..10000)
deplane_32 = DeconstructPlane(Plane=pln_49)  # -> Origin, XAxis, YAxis, ZAxis
crv_66 = Curve(merge_2)
boundary_5 = BoundarySurfaces(Edges=[offset_3, offset_2])
scx_2 = SurfaceCurve(Surface=boundary_5, Curve=crv_66)  # -> flatten(Curves), Points, UVPoints, Normals, Parameters, Tangents
amp_26 = Amplitude(Vector=deplane_32.YAxis, Amplitude=number_slider_38)
amp_27 = Amplitude(Vector=deplane_32.YAxis, Amplitude=expr("-x", number_slider_38))
move_30 = Move(Geometry=deplane_32.Origin, Motion=amp_27)  # -> Geometry, Transform
move_31 = Move(Geometry=deplane_32.Origin, Motion=amp_26)  # -> Geometry, Transform
ln_31 = Line(StartPoint=move_30.Geometry, EndPoint=move_31.Geometry)
ccx_22 = CurveCurve(CurveA=graft(ln_31), CurveB=scx_2.Curves)  # -> Points, ParamsA, ParamsB
shift_7 = ShiftPaths(Data=ccx_22.Points, Offset=-1)
pull_30 = PullPoint(Point=graft(pln_49), Geometry=shift_7, ClosestOnly=True)  # -> ClosestPoint, Distance
sort_28 = SortList(Keys=pull_30.Distance, ValuesA=pull_30.ClosestPoint)  # -> Keys, ValuesA
item_45 = ListItem(List=sort_28.ValuesA, Index=0, Wrap=True)
null_14 = NullItem(Item=item_45)  # -> NullFlags, simplify(InvalidFlags), Description
null_15 = NullItem(Item=sort_28.ValuesA)  # -> NullFlags, simplify(InvalidFlags), Description
dispatch_50 = Dispatch(List=simplify(graft(pln_49)), DispatchPattern=null_15.InvalidFlags)  # -> ListA, ListB
dispatch_51 = Dispatch(List=simplify(graft(item_45)), DispatchPattern=null_14.InvalidFlags)  # -> ListA, ListB
pln_50 = Plane(dispatch_50.ListB)
pln_51 = Plane(dispatch_50.ListA)
pt_17 = Point(dispatch_51.ListB)

# ----
# 按照梁分类定位点
pt_18 = Point(pt_16)
pln_52 = Plane(pln_48)
incurves_11 = PointInCurves(Point=flatten(pt_18), Curves=crv_34)  # -> Relationship, Index, Point
equals_13 = Equality(FirstNumber=incurves_11.Relationship, SecondNumber="0")  # -> Equality, Inequality
dispatch_52 = Dispatch(List=flatten(pln_52), DispatchPattern=equals_13.Inequality)  # -> ListA, ListB
data_57 = Data(dispatch_52.ListA)

incurves_12 = PointInCurves(Point=flatten(pt_18), Curves=crv_34)  # -> Relationship, Index, Point
equals_14 = Equality(FirstNumber=incurves_12.Relationship, SecondNumber="0")  # -> Equality, Inequality
dispatch_53 = Dispatch(List=flatten(pt_18), DispatchPattern=equals_14.Inequality)  # -> ListA, ListB
data_58 = Data(dispatch_53.ListA)

# ----
# 按照梁分类定位点
pt_19 = Point(pt_17)
pln_53 = Plane(pln_50)
incurves_13 = PointInCurves(Point=flatten(pt_19), Curves=crv_35)  # -> Relationship, Index, Point
equals_15 = Equality(FirstNumber=incurves_13.Relationship, SecondNumber="0")  # -> Equality, Inequality
dispatch_54 = Dispatch(List=flatten(pln_53), DispatchPattern=equals_15.Inequality)  # -> ListA, ListB
data_59 = Data(dispatch_54.ListA)

incurves_14 = PointInCurves(Point=flatten(pt_19), Curves=crv_35)  # -> Relationship, Index, Point
equals_16 = Equality(FirstNumber=incurves_14.Relationship, SecondNumber="0")  # -> Equality, Inequality
dispatch_55 = Dispatch(List=flatten(pt_19), DispatchPattern=equals_16.Inequality)  # -> ListA, ListB
data_60 = Data(dispatch_55.ListA)

move2pt_21 = MoveToPoint(Geometry=data_57, PointA=data_57, PointB=data_58)  # -> Moved, Vector, Transform
null_16 = NullItem(Item=move2pt_21.Moved)  # -> NullFlags, InvalidFlags, Description
dispatch_56 = Dispatch(List=move2pt_21.Moved, DispatchPattern=null_16.InvalidFlags)  # -> ListA, ListB
pln_54 = Plane(dispatch_56.ListB)

move2pt_22 = MoveToPoint(Geometry=data_59, PointA=data_59, PointB=data_60)  # -> Moved, Vector, Transform
null_17 = NullItem(Item=move2pt_22.Moved)  # -> NullFlags, InvalidFlags, Description
dispatch_57 = Dispatch(List=move2pt_22.Moved, DispatchPattern=null_17.InvalidFlags)  # -> ListA, ListB
pln_55 = Plane(dispatch_57.ListB)

# ----
# 可能的结构交点-大量
pln_56 = Plane(pln_51)

# ----
# 可能的结构交点-大量
pln_57 = Plane(pln_47)

# ----
# 0 檐口出定位点
# 与结构无交点
pln_58 = Plane(flatten(pln_57))

# ----
# 0 檐口出定位点
# 与结构无交点
pln_59 = Plane(flatten(pln_56))

# ----
# 1.2.2
# 下层建筑边线外侧50-350mm
# 03：钢板焊埋件[钢梁内侧]
# @钢边梁宽@钢边梁高
pln_60 = Plane(pln_54)

# ----
# 1.2.3
# 下层建筑边线内侧300-600mm范围
# 03：钢板焊埋件[钢梁外侧]
# @钢边梁宽@钢边梁高
pln_61 = Plane(pln_55)

# ----
# 3.3上层建筑边线,
# 默认建筑提供上翻，如主结构提供示意则使用结构定位【该项目无】，
# 如无则使用建筑边线向内50mm作为埋件定位
merge_13 = Merge(Data1=pln_23, Data2=pln_46)
crv_67 = Curve(crv_5)
offset_13 = OffsetCurve(Curve=crv_67, Distance=expr("-x", Slider(50, range=0..100)), Corners=1)
pln_62 = Plane(merge_13)
number_slider_39 = Slider(3584, range=0..10000)
deplane_33 = DeconstructPlane(Plane=pln_62)  # -> Origin, XAxis, YAxis, ZAxis
amp_28 = Amplitude(Vector=deplane_33.YAxis, Amplitude=number_slider_39)
amp_29 = Amplitude(Vector=deplane_33.YAxis, Amplitude=expr("-x", number_slider_39))
move_32 = Move(Geometry=deplane_33.Origin, Motion=amp_29)  # -> Geometry, Transform
move_33 = Move(Geometry=deplane_33.Origin, Motion=amp_28)  # -> Geometry, Transform
ln_32 = Line(StartPoint=move_32.Geometry, EndPoint=move_33.Geometry)
ccx_23 = CurveCurve(CurveA=ln_32, CurveB=offset_13)  # -> simplify(Points), ParamsA, ParamsB
ln_33 = Line(StartPoint=ccx_23.Points, EndPoint=simplify(graft(pln_62)))
len_7 = Length(Curve=ln_33)
null_18 = NullItem(Item=ccx_23.Points)  # -> NullFlags, InvalidFlags, Description
sort_29 = SortList(Keys=len_7, ValuesA=simplify(ccx_23.Points))  # -> Keys, ValuesA
dispatch_58 = Dispatch(List=simplify(graft(pln_62)), DispatchPattern=null_18.NullFlags)  # -> ListA, ListB
item_46 = ListItem(List=sort_29.ValuesA, Index=0, Wrap=True)

# ----
# 可能的双点
pln_63 = Plane(dispatch_58.ListA)

# ----
# 0 檐口出定位点
# 与结构无交点
pln_64 = Plane(flatten(pln_63))

# ----
# 3.3上层建筑边线,
# 默认建筑提供上翻
# 04：板埋埋件[混凝土楼板上侧]
# @板埋参数xn
move2pt_23 = MoveToPoint(Geometry=simplify(graft(pln_62)), PointA=simplify(graft(pln_62)), PointB=item_46)  # -> flatten(Moved), Vector, Transform

orient_3 = Orient(Geometry=item_36, Source=item_37, Target=move2pt_23.Moved)  # -> Geometry, Transform

number = NumberGroups(Number=sort_22.Keys, Difference=Slider(50, range=0..100))  # -> simplify(Groups), Indices
panel_52 = Panel(number.Groups)
tstat = TreeStatistics(Tree=number.Groups)  # -> Paths, Length, Count
lng_3 = ListLength(List=tstat.Paths)
smaller_9 = SmallerThan(FirstNumber=lng_3, SecondNumber="2")  # -> SmallerThan, OrEqualTo
dispatch_59 = Dispatch(List=smaller_9.SmallerThan, DispatchPattern=[True, False])  # -> ListA, ListB
filter_17 = StreamFilter(Gate=dispatch_59.ListA, Stream0="-2", Stream1="-1")
item_47 = ListItem(List=tstat.Paths, Index=filter_17, Wrap=True)
branch = TreeBranch(Tree=number.Groups, Path=item_47, MaintainPaths=True)
sort_30 = SortList(Keys=branch)  # -> reverse(Keys), ValuesA
round_2 = Round(Number=sort_30.Keys)  # -> Nearest, Floor, Ceiling
item_48 = ListItem(List=round_2.Ceiling, Index=0, Wrap=True)

# ----
# 挑出反常点-交点距离起始点过远
list_9 = ValueList({"自己输入Value": 0, "GH Defaut Value": 1}, selected="GH Defaut Value")
panel_53 = Panel(item_48)
filter_18 = StreamFilter(Gate=list_9, Stream0=Slider(1000, range=0..10000), Stream1=panel_53)

larger_9 = LargerThan(FirstNumber=len_6, SecondNumber=filter_18)  # -> LargerThan, OrEqualTo
dispatch_60 = Dispatch(List=flatten_14, DispatchPattern=larger_9.LargerThan)  # -> ListA, ListB
dispatch_61 = Dispatch(List=data_49, DispatchPattern=larger_9.LargerThan)  # -> ListA, ListB
data_61 = Data(dispatch_61.ListB)
data_62 = Data(dispatch_60.ListB)

# ----
# 按照梁分类定位点
pt_20 = Point(data_62)
pln_65 = Plane(data_61)
incurves_15 = PointInCurves(Point=flatten(pt_20), Curves=crv_30)  # -> Relationship, Index, Point
equals_17 = Equality(FirstNumber=incurves_15.Relationship, SecondNumber="0")  # -> Equality, Inequality
dispatch_62 = Dispatch(List=flatten(pln_65), DispatchPattern=equals_17.Inequality)  # -> ListA, ListB
data_63 = Data(dispatch_62.ListA)

incurves_16 = PointInCurves(Point=flatten(pt_20), Curves=crv_30)  # -> Relationship, Index, Point
equals_18 = Equality(FirstNumber=incurves_16.Relationship, SecondNumber="0")  # -> Equality, Inequality
dispatch_63 = Dispatch(List=flatten(pt_20), DispatchPattern=equals_18.Inequality)  # -> ListA, ListB
data_64 = Data(dispatch_63.ListA)

move2pt_24 = MoveToPoint(Geometry=data_63, PointA=data_63, PointB=data_64)  # -> Moved, Vector, Transform
null_19 = NullItem(Item=move2pt_24.Moved)  # -> NullFlags, InvalidFlags, Description
dispatch_64 = Dispatch(List=move2pt_24.Moved, DispatchPattern=null_19.InvalidFlags)  # -> ListA, ListB
pln_66 = Plane(dispatch_64.ListB)

# ----
# 离梁过远的定位点
pln_67 = Plane(dispatch_61.ListA)

# ----
# 1.0无檐口线
# 与梁不相交
merge_14 = Merge(Data1=pln_43, Data2=pln_67)

# ----
# 0 檐口出定位点
# 与结构无交点
pln_68 = Plane(flatten(merge_14))

# ----
# 0.Missing Point
# 埋件定位点Offset，没有找到和梁的交点
number_slider_40 = Slider(5000, range=0..10000)
deplane_34 = DeconstructPlane(Plane=pln_68)  # -> Origin, XAxis, YAxis, ZAxis
amp_30 = Amplitude(Vector=deplane_34.YAxis, Amplitude=expr("-x", number_slider_40))
move_34 = Move(Geometry=deplane_34.Origin, Motion=amp_30)  # -> Geometry, Transform
ln_34 = Line(StartPoint=move_34.Geometry, EndPoint=deplane_34.Origin)
crv_68 = Curve(crv_64)
amp_31 = Amplitude(Vector=deplane_34.XAxis, Amplitude=number_slider_3)
amp_32 = Amplitude(Vector=deplane_34.XAxis, Amplitude=expr("-x", number_slider_3))
move_35 = Move(Geometry=ln_34, Motion=amp_32)  # -> Geometry, Transform
move_36 = Move(Geometry=ln_34, Motion=amp_31)  # -> Geometry, Transform

ccx_24 = CurveCurve(CurveA=graft(move_35.Geometry), CurveB=flatten(crv_68))  # -> Points, ParamsA, ParamsB
shift_8 = ShiftPaths(Data=ccx_24.Points, Offset=-1)
sort_31 = SortList(Keys=shift_8, ValuesA=shift_8)  # -> Keys, ValuesA
pull_31 = PullPoint(Point=sort_31.ValuesA, Geometry=graft(pln_68), ClosestOnly=True)  # -> ClosestPoint, Distance
sort_32 = SortList(Keys=pull_31.Distance, ValuesA=sort_31.ValuesA)  # -> Keys, ValuesA
item_49 = ListItem(List=sort_32.ValuesA, Index="0", Wrap=True)
null_20 = NullItem(Item=flatten(item_49))  # -> NullFlags, InvalidFlags, Description
dispatch_65 = Dispatch(List=simplify(item_49), DispatchPattern=simplify(graft(null_20.InvalidFlags)))  # -> ListA, ListB
dispatch_66 = Dispatch(List=pln_68, DispatchPattern=null_20.InvalidFlags)  # -> ListA, ListB
pln_69 = Plane(dispatch_66.ListB)
pt_21 = Point(dispatch_65.ListB)

ccx_25 = CurveCurve(CurveA=graft(move_36.Geometry), CurveB=flatten(crv_68))  # -> Points, ParamsA, ParamsB
shift_9 = ShiftPaths(Data=ccx_25.Points, Offset=-1)
sort_33 = SortList(Keys=shift_9, ValuesA=shift_9)  # -> Keys, ValuesA
pull_32 = PullPoint(Point=sort_33.ValuesA, Geometry=graft(pln_68), ClosestOnly=True)  # -> ClosestPoint, Distance
sort_34 = SortList(Keys=pull_32.Distance, ValuesA=sort_33.ValuesA)  # -> Keys, ValuesA
item_50 = ListItem(List=sort_34.ValuesA, Index="0", Wrap=True)
null_21 = NullItem(Item=flatten(item_50))  # -> NullFlags, InvalidFlags, Description
dispatch_67 = Dispatch(List=simplify(item_50), DispatchPattern=simplify(graft(null_21.InvalidFlags)))  # -> ListA, ListB
dispatch_68 = Dispatch(List=pln_68, DispatchPattern=null_21.InvalidFlags)  # -> ListA, ListB
pt_22 = Point(dispatch_67.ListB)
pln_70 = Plane(dispatch_68.ListB)

# ----
# 按照梁分类定位点
pln_71 = Plane(pln_70)
pt_23 = Point(pt_22)
incurves_17 = PointInCurves(Point=flatten(pt_23), Curves=crv_31)  # -> Relationship, Index, Point
equals_19 = Equality(FirstNumber=incurves_17.Relationship, SecondNumber="0")  # -> Equality, Inequality
dispatch_69 = Dispatch(List=flatten(pln_71), DispatchPattern=equals_19.Inequality)  # -> ListA, ListB
data_65 = Data(dispatch_69.ListA)

# ----
# 按照梁分类定位点
pln_72 = Plane(pln_69)
pt_24 = Point(pt_21)
incurves_18 = PointInCurves(Point=flatten(pt_24), Curves=crv_31)  # -> Relationship, Index, Point
equals_20 = Equality(FirstNumber=incurves_18.Relationship, SecondNumber="0")  # -> Equality, Inequality
dispatch_70 = Dispatch(List=flatten(pln_72), DispatchPattern=equals_20.Inequality)  # -> ListA, ListB
data_66 = Data(dispatch_70.ListA)

incurves_19 = PointInCurves(Point=flatten(pt_24), Curves=crv_31)  # -> Relationship, Index, Point
equals_21 = Equality(FirstNumber=incurves_19.Relationship, SecondNumber="0")  # -> Equality, Inequality
dispatch_71 = Dispatch(List=flatten(pt_24), DispatchPattern=equals_21.Inequality)  # -> ListA, ListB
data_67 = Data(dispatch_71.ListA)

incurves_20 = PointInCurves(Point=flatten(pt_23), Curves=crv_31)  # -> Relationship, Index, Point
equals_22 = Equality(FirstNumber=incurves_20.Relationship, SecondNumber="0")  # -> Equality, Inequality
dispatch_72 = Dispatch(List=flatten(pt_23), DispatchPattern=equals_22.Inequality)  # -> ListA, ListB
data_68 = Data(dispatch_72.ListA)

move2pt_25 = MoveToPoint(Geometry=data_65, PointA=data_65, PointB=data_68)  # -> Moved, Vector, Transform
null_22 = NullItem(Item=move2pt_25.Moved)  # -> NullFlags, InvalidFlags, Description
dispatch_73 = Dispatch(List=move2pt_25.Moved, DispatchPattern=null_22.InvalidFlags)  # -> ListA, ListB
pln_73 = Plane(dispatch_73.ListB)

move2pt_26 = MoveToPoint(Geometry=data_66, PointA=data_66, PointB=data_67)  # -> Moved, Vector, Transform
null_23 = NullItem(Item=move2pt_26.Moved)  # -> NullFlags, InvalidFlags, Description
dispatch_74 = Dispatch(List=move2pt_26.Moved, DispatchPattern=null_23.InvalidFlags)  # -> ListA, ListB
pln_74 = Plane(dispatch_74.ListB)

# ----
# 1.0无檐口线+上下层幕墙边线连续
# 01：钢板焊埋件[钢梁外侧]
# @钢边梁宽@钢边梁高
pln_75 = Plane(pln_66)

# ----
# 撞到梁交点
merge_15 = Merge(Data1=pln_73, Data2=pln_74)

merge_16 = Merge(Data1=pln_75, Data2=merge_15)
orient_4 = Orient(Geometry=item_10, Source=item_11, Target=merge_16)  # -> Geometry, Transform

# ----
# 1.2是否有吊顶
deplane_35 = DeconstructPlane(Plane=pln_45)  # -> Origin, XAxis, YAxis, ZAxis
number_slider_41 = Slider(5000, range=0..10000)
amp_33 = Amplitude(Vector=deplane_35.YAxis, Amplitude=expr("-x", number_slider_41))
amp_34 = Amplitude(Vector=deplane_35.YAxis, Amplitude=number_slider_41)
move_37 = Move(Geometry=deplane_35.Origin, Motion=amp_34)  # -> Geometry, Transform
move_38 = Move(Geometry=deplane_35.Origin, Motion=amp_33)  # -> Geometry, Transform
ln_35 = Line(StartPoint=move_37.Geometry, EndPoint=move_38.Geometry)
crv_69 = Curve(crv)
ccx_26 = CurveCurve(CurveA=ln_35, CurveB=crv_69)  # -> Points, ParamsA, ParamsB
null_24 = NullItem(Item=ccx_26.Points)  # -> NullFlags, InvalidFlags, Description
dispatch_75 = Dispatch(List=simplify(graft(pln_45)), DispatchPattern=simplify(null_24.NullFlags))  # -> ListA, ListB
pln_76 = Plane(flatten(dispatch_75.ListB))
flatten_15 = FlattenTree(Tree=ccx_26.Points, Path="{0}")
ln_36 = Line(StartPoint=pln_76, EndPoint=flatten_15)
crv_70 = Curve(merge)

# ----
# 定位点Project到下层建筑线
move2pt_27 = MoveToPoint(Geometry=pln_76, PointA=pln_76, PointB=flatten_15)  # -> Moved, Vector, Transform

deplane_36 = DeconstructPlane(Plane=move2pt_27.Moved)  # -> Origin, XAxis, YAxis, ZAxis
amp_35 = Amplitude(Vector=deplane_36.YAxis, Amplitude=Slider(5000, range=0..10000))
move_39 = Move(Geometry=deplane_36.Origin, Motion=amp_35)  # -> Geometry, Transform
ln_37 = Line(StartPoint=move_39.Geometry, EndPoint=deplane_36.Origin)
ccx_27 = CurveCurve(CurveA=graft(ln_37), CurveB=flatten(crv_70))  # -> simplify(Points), ParamsA, ParamsB
shift_10 = ShiftPaths(Data=ccx_27.Points, Offset=-1)
null_25 = NullItem(Item=shift_10)  # -> NullFlags, InvalidFlags, Description
dispatch_76 = Dispatch(List=simplify(graft(move2pt_27.Moved)), DispatchPattern=null_25.NullFlags)  # -> ListA, ListB
dispatch_77 = Dispatch(List=simplify(graft(ln_37)), DispatchPattern=null_25.NullFlags)  # -> ListA, ListB
pln_77 = Plane(dispatch_76.ListA)
pln_78 = Plane(dispatch_76.ListB)
crv_71 = Curve(dispatch_77.ListB)
ccx_28 = CurveCurve(CurveA=graft(crv_71), CurveB=flatten(crv_70))  # -> Points, ParamsA, ParamsB
shift_11 = ShiftPaths(Data=simplify(ccx_28.Points), Offset=-1)
pull_33 = PullPoint(Point=pln_78, Geometry=shift_11, ClosestOnly=True)  # -> ClosestPoint, Distance
sort_35 = SortList(Keys=pull_33.Distance, ValuesA=pull_33.ClosestPoint)  # -> Keys, ValuesA
item_51 = ListItem(List=sort_35.ValuesA, Index=0, Wrap=True)
ln_38 = Line(StartPoint=pln_78, EndPoint=item_51)
len_8 = Length(Curve=ln_38)
larger_10 = LargerThan(FirstNumber=len_8, SecondNumber=number_slider_18)  # -> LargerThan, OrEqualTo
panel_54 = Panel(len_8)
dispatch_78 = Dispatch(List=pln_78, DispatchPattern=larger_10.LargerThan)  # -> ListA, ListB
pln_79 = Plane(dispatch_78.ListA)
pln_80 = Plane(dispatch_78.ListB)

dispatch_79 = Dispatch(List=item_51, DispatchPattern=larger_10.LargerThan)  # -> ListA, ListB
pt_25 = Point(dispatch_79.ListA)

# ----
# 按照梁分类定位点
pt_26 = Point(pt_25)
pln_81 = Plane(pln_79)
incurves_21 = PointInCurves(Point=flatten(pt_26), Curves=crv_32)  # -> Relationship, Index, Point
equals_23 = Equality(FirstNumber=incurves_21.Relationship, SecondNumber="0")  # -> Equality, Inequality
dispatch_80 = Dispatch(List=flatten(pln_81), DispatchPattern=equals_23.Inequality)  # -> ListA, ListB
data_69 = Data(dispatch_80.ListA)

incurves_22 = PointInCurves(Point=flatten(pt_26), Curves=crv_32)  # -> Relationship, Index, Point
equals_24 = Equality(FirstNumber=incurves_22.Relationship, SecondNumber="0")  # -> Equality, Inequality
dispatch_81 = Dispatch(List=flatten(pt_26), DispatchPattern=equals_24.Inequality)  # -> ListA, ListB
data_70 = Data(dispatch_81.ListA)

move2pt_28 = MoveToPoint(Geometry=data_69, PointA=data_69, PointB=data_70)  # -> Moved, Vector, Transform
null_26 = NullItem(Item=move2pt_28.Moved)  # -> NullFlags, InvalidFlags, Description
dispatch_82 = Dispatch(List=move2pt_28.Moved, DispatchPattern=null_26.InvalidFlags)  # -> ListA, ListB
pln_82 = Plane(dispatch_82.ListB)

# ----
# 可能的点-离结构很远
pln_83 = Plane(dispatch_75.ListA)

# ----
# 可能的结构交点-大量
pln_84 = Plane(pln_77)

# ----
# 可能的结构交点
pln_85 = Plane(pln_80)

merge_17 = Merge(Data1=pln_83, Data2=pln_85, Data3=pln_84)

# ----
# 0 檐口出定位点
# 与结构无交点
pln_86 = Plane(flatten(merge_17))

# ----
# 1.2 Missing Point
# 埋件定位点Offset，没有找到和梁的交点
number_slider_42 = Slider(5000, range=0..10000)
deplane_37 = DeconstructPlane(Plane=pln_86)  # -> Origin, XAxis, YAxis, ZAxis
amp_36 = Amplitude(Vector=deplane_37.YAxis, Amplitude=number_slider_42)
crv_72 = Curve(crv_70)
move_40 = Move(Geometry=deplane_37.Origin, Motion=amp_36)  # -> Geometry, Transform
ln_39 = Line(StartPoint=move_40.Geometry, EndPoint=deplane_37.Origin)
amp_37 = Amplitude(Vector=deplane_37.XAxis, Amplitude=number_slider_3)
amp_38 = Amplitude(Vector=deplane_37.XAxis, Amplitude=expr("-x", number_slider_3))
move_41 = Move(Geometry=ln_39, Motion=amp_37)  # -> Geometry, Transform
move_42 = Move(Geometry=ln_39, Motion=amp_38)  # -> Geometry, Transform

ccx_29 = CurveCurve(CurveA=graft(move_42.Geometry), CurveB=flatten(crv_72))  # -> Points, ParamsA, ParamsB
shift_12 = ShiftPaths(Data=ccx_29.Points, Offset=-1)
sort_36 = SortList(Keys=shift_12, ValuesA=shift_12)  # -> Keys, ValuesA
pull_34 = PullPoint(Point=sort_36.ValuesA, Geometry=graft(pln_86), ClosestOnly=True)  # -> ClosestPoint, Distance
sort_37 = SortList(Keys=pull_34.Distance, ValuesA=sort_36.ValuesA)  # -> Keys, ValuesA
item_52 = ListItem(List=sort_37.ValuesA, Index="-1", Wrap=True)
null_27 = NullItem(Item=flatten(item_52))  # -> NullFlags, InvalidFlags, Description
dispatch_83 = Dispatch(List=simplify(item_52), DispatchPattern=simplify(graft(null_27.InvalidFlags)))  # -> ListA, ListB
dispatch_84 = Dispatch(List=pln_86, DispatchPattern=null_27.InvalidFlags)  # -> ListA, ListB
pt_27 = Point(dispatch_83.ListB)
pln_87 = Plane(dispatch_84.ListB)

ccx_30 = CurveCurve(CurveA=graft(move_41.Geometry), CurveB=flatten(crv_72))  # -> Points, ParamsA, ParamsB
shift_13 = ShiftPaths(Data=ccx_30.Points, Offset=-1)
sort_38 = SortList(Keys=shift_13, ValuesA=shift_13)  # -> Keys, ValuesA
pull_35 = PullPoint(Point=sort_38.ValuesA, Geometry=graft(pln_86), ClosestOnly=True)  # -> ClosestPoint, Distance
sort_39 = SortList(Keys=pull_35.Distance, ValuesA=sort_38.ValuesA)  # -> Keys, ValuesA
item_53 = ListItem(List=sort_39.ValuesA, Index="-1", Wrap=True)
null_28 = NullItem(Item=flatten(item_53))  # -> NullFlags, InvalidFlags, Description
dispatch_85 = Dispatch(List=simplify(item_53), DispatchPattern=simplify(graft(null_28.InvalidFlags)))  # -> ListA, ListB
dispatch_86 = Dispatch(List=pln_86, DispatchPattern=null_28.InvalidFlags)  # -> ListA, ListB
pt_28 = Point(dispatch_85.ListB)
pln_88 = Plane(dispatch_86.ListB)

# ----
# 按照梁分类定位点
pln_89 = Plane(pln_88)
pt_29 = Point(pt_28)
incurves_23 = PointInCurves(Point=flatten(pt_29), Curves=crv_33)  # -> Relationship, Index, Point
equals_25 = Equality(FirstNumber=incurves_23.Relationship, SecondNumber="0")  # -> Equality, Inequality
dispatch_87 = Dispatch(List=flatten(pln_89), DispatchPattern=equals_25.Inequality)  # -> ListA, ListB
data_71 = Data(dispatch_87.ListA)

# ----
# 按照梁分类定位点
pln_90 = Plane(pln_87)
pt_30 = Point(pt_27)
incurves_24 = PointInCurves(Point=flatten(pt_30), Curves=crv_33)  # -> Relationship, Index, Point
equals_26 = Equality(FirstNumber=incurves_24.Relationship, SecondNumber="0")  # -> Equality, Inequality
dispatch_88 = Dispatch(List=flatten(pln_90), DispatchPattern=equals_26.Inequality)  # -> ListA, ListB
data_72 = Data(dispatch_88.ListA)

incurves_25 = PointInCurves(Point=flatten(pt_30), Curves=crv_33)  # -> Relationship, Index, Point
equals_27 = Equality(FirstNumber=incurves_25.Relationship, SecondNumber="0")  # -> Equality, Inequality
dispatch_89 = Dispatch(List=flatten(pt_30), DispatchPattern=equals_27.Inequality)  # -> ListA, ListB
data_73 = Data(dispatch_89.ListA)

incurves_26 = PointInCurves(Point=flatten(pt_29), Curves=crv_33)  # -> Relationship, Index, Point
equals_28 = Equality(FirstNumber=incurves_26.Relationship, SecondNumber="0")  # -> Equality, Inequality
dispatch_90 = Dispatch(List=flatten(pt_29), DispatchPattern=equals_28.Inequality)  # -> ListA, ListB
data_74 = Data(dispatch_90.ListA)

move2pt_29 = MoveToPoint(Geometry=data_71, PointA=data_71, PointB=data_74)  # -> Moved, Vector, Transform
null_29 = NullItem(Item=move2pt_29.Moved)  # -> NullFlags, InvalidFlags, Description
dispatch_91 = Dispatch(List=move2pt_29.Moved, DispatchPattern=null_29.InvalidFlags)  # -> ListA, ListB
pln_91 = Plane(dispatch_91.ListB)

move2pt_30 = MoveToPoint(Geometry=data_72, PointA=data_72, PointB=data_73)  # -> Moved, Vector, Transform
null_30 = NullItem(Item=move2pt_30.Moved)  # -> NullFlags, InvalidFlags, Description
dispatch_92 = Dispatch(List=move2pt_30.Moved, DispatchPattern=null_30.InvalidFlags)  # -> ListA, ListB
pln_92 = Plane(dispatch_92.ListB)

# ----
# 1.2.1梁以内>350
# 
# 侧埋，钢板焊
# 03：钢板焊埋件[钢梁内侧]
# @钢边梁宽@钢边梁高
pln_93 = Plane(pln_82)

# ----
# 撞到梁交点
merge_18 = Merge(Data1=pln_91, Data2=pln_92)

merge_19 = Merge(Data1=pln_93, Data2=merge_18)
orient_5 = Orient(Geometry=item_12, Source=rotate_3.Geometry, Target=merge_19)  # -> Geometry, Transform

# ----
# 2.1 Missing Point
# 埋件定位点Offset，没有找到和梁的交点
number_slider_43 = Slider(5000, range=0..10000)
deplane_38 = DeconstructPlane(Plane=pln_58)  # -> Origin, XAxis, YAxis, ZAxis
amp_39 = Amplitude(Vector=deplane_38.YAxis, Amplitude=number_slider_43)
crv_73 = Curve(scx.Curves)
move_43 = Move(Geometry=deplane_38.Origin, Motion=amp_39)  # -> Geometry, Transform
ln_40 = Line(StartPoint=move_43.Geometry, EndPoint=deplane_38.Origin)
amp_40 = Amplitude(Vector=deplane_38.XAxis, Amplitude=number_slider_3)
amp_41 = Amplitude(Vector=deplane_38.XAxis, Amplitude=expr("-x", number_slider_3))
move_44 = Move(Geometry=ln_40, Motion=amp_40)  # -> Geometry, Transform
move_45 = Move(Geometry=ln_40, Motion=amp_41)  # -> Geometry, Transform
pln_94 = Plane(pln_47)

ccx_31 = CurveCurve(CurveA=graft(move_45.Geometry), CurveB=flatten(crv_73))  # -> Points, ParamsA, ParamsB
shift_14 = ShiftPaths(Data=ccx_31.Points, Offset=-1)
sort_40 = SortList(Keys=shift_14, ValuesA=shift_14)  # -> Keys, ValuesA
pull_36 = PullPoint(Point=sort_40.ValuesA, Geometry=graft(pln_58), ClosestOnly=True)  # -> ClosestPoint, Distance
sort_41 = SortList(Keys=pull_36.Distance, ValuesA=sort_40.ValuesA)  # -> Keys, ValuesA
item_54 = ListItem(List=sort_41.ValuesA, Index="-1", Wrap=True)
null_31 = NullItem(Item=flatten(item_54))  # -> NullFlags, InvalidFlags, Description
dispatch_93 = Dispatch(List=flatten(item_54), DispatchPattern=null_31.InvalidFlags)  # -> ListA, ListB
dispatch_94 = Dispatch(List=pln_58, DispatchPattern=null_31.InvalidFlags)  # -> ListA, ListB
pt_31 = Point(dispatch_93.ListB)
pln_95 = Plane(dispatch_94.ListB)

ccx_32 = CurveCurve(CurveA=graft(move_44.Geometry), CurveB=flatten(crv_73))  # -> Points, ParamsA, ParamsB
shift_15 = ShiftPaths(Data=ccx_32.Points, Offset=-1)
sort_42 = SortList(Keys=shift_15, ValuesA=shift_15)  # -> Keys, ValuesA
pull_37 = PullPoint(Point=sort_42.ValuesA, Geometry=graft(pln_58), ClosestOnly=True)  # -> ClosestPoint, Distance
sort_43 = SortList(Keys=pull_37.Distance, ValuesA=sort_42.ValuesA)  # -> Keys, ValuesA
item_55 = ListItem(List=sort_43.ValuesA, Index="-1", Wrap=True)
null_32 = NullItem(Item=flatten(item_55))  # -> NullFlags, InvalidFlags, Description
dispatch_95 = Dispatch(List=flatten(item_55), DispatchPattern=null_32.InvalidFlags)  # -> ListA, ListB
dispatch_96 = Dispatch(List=pln_58, DispatchPattern=null_32.InvalidFlags)  # -> ListA, ListB
pln_96 = Plane(dispatch_96.ListB)
pt_32 = Point(dispatch_95.ListB)

merge_20 = Merge(Data1=pln_96, Data2=pln_95)  # -> flatten(Result)
check_same_points_7 = CheckSamePoints(archPoint=flatten(pln_94), crvPoint=merge_20)  # -> out, specialPt; inputs archPoint: list of Point3d, crvPoint: list of Point3d; same code as testpoint

# ----
# pass
cull_i_17 = CullIndex(List=flatten(pln_94), Indices=check_same_points_7.specialPt, Wrap=True)

# ----
# 按照梁分类定位点
pln_97 = Plane(pln_96)
pt_33 = Point(pt_32)
incurves_27 = PointInCurves(Point=flatten(pt_33), Curves=crv_36)  # -> Relationship, Index, Point
equals_29 = Equality(FirstNumber=incurves_27.Relationship, SecondNumber="0")  # -> Equality, Inequality
dispatch_97 = Dispatch(List=flatten(pln_97), DispatchPattern=equals_29.Inequality)  # -> ListA, ListB
data_75 = Data(dispatch_97.ListA)

# ----
# 按照梁分类定位点
pln_98 = Plane(pln_95)
pt_34 = Point(pt_31)
incurves_28 = PointInCurves(Point=flatten(pt_34), Curves=crv_36)  # -> Relationship, Index, Point
equals_30 = Equality(FirstNumber=incurves_28.Relationship, SecondNumber="0")  # -> Equality, Inequality
dispatch_98 = Dispatch(List=flatten(pln_98), DispatchPattern=equals_30.Inequality)  # -> ListA, ListB
data_76 = Data(dispatch_98.ListA)

incurves_29 = PointInCurves(Point=flatten(pt_34), Curves=crv_36)  # -> Relationship, Index, Point
equals_31 = Equality(FirstNumber=incurves_29.Relationship, SecondNumber="0")  # -> Equality, Inequality
dispatch_99 = Dispatch(List=flatten(pt_34), DispatchPattern=equals_31.Inequality)  # -> ListA, ListB
data_77 = Data(dispatch_99.ListA)

incurves_30 = PointInCurves(Point=flatten(pt_33), Curves=crv_36)  # -> Relationship, Index, Point
equals_32 = Equality(FirstNumber=incurves_30.Relationship, SecondNumber="0")  # -> Equality, Inequality
dispatch_100 = Dispatch(List=flatten(pt_33), DispatchPattern=equals_32.Inequality)  # -> ListA, ListB
data_78 = Data(dispatch_100.ListA)

move2pt_31 = MoveToPoint(Geometry=data_75, PointA=data_75, PointB=data_78)  # -> Moved, Vector, Transform
null_33 = NullItem(Item=move2pt_31.Moved)  # -> NullFlags, InvalidFlags, Description
dispatch_101 = Dispatch(List=move2pt_31.Moved, DispatchPattern=null_33.InvalidFlags)  # -> ListA, ListB
pln_99 = Plane(dispatch_101.ListB)

move2pt_32 = MoveToPoint(Geometry=data_76, PointA=data_76, PointB=data_77)  # -> Moved, Vector, Transform
null_34 = NullItem(Item=move2pt_32.Moved)  # -> NullFlags, InvalidFlags, Description
dispatch_102 = Dispatch(List=move2pt_32.Moved, DispatchPattern=null_34.InvalidFlags)  # -> ListA, ListB
pln_100 = Plane(dispatch_102.ListB)

# ----
# 撞到梁交点
merge_21 = Merge(Data1=pln_99, Data2=pln_100)

merge_22 = Merge(Data1=pln_60, Data2=merge_21)
orient_6 = Orient(Geometry=item_14, Source=rotate_4.Geometry, Target=merge_22)  # -> Geometry, Transform

# ----
# 2.2  Missing Point
# 埋件定位点Offset，没有找到和梁的交点
number_slider_44 = Slider(5000, range=0..10000)
crv_74 = Curve(scx_2.Curves)
deplane_39 = DeconstructPlane(Plane=pln_59)  # -> Origin, XAxis, YAxis, ZAxis
amp_42 = Amplitude(Vector=deplane_39.YAxis, Amplitude=number_slider_44)
move_46 = Move(Geometry=deplane_39.Origin, Motion=amp_42)  # -> Geometry, Transform
ln_41 = Line(StartPoint=move_46.Geometry, EndPoint=deplane_39.Origin)
amp_43 = Amplitude(Vector=deplane_39.XAxis, Amplitude=number_slider_3)
amp_44 = Amplitude(Vector=deplane_39.XAxis, Amplitude=expr("-x", number_slider_3))
move_47 = Move(Geometry=ln_41, Motion=amp_43)  # -> Geometry, Transform
move_48 = Move(Geometry=ln_41, Motion=amp_44)  # -> Geometry, Transform
pln_101 = Plane(pln_51)

ccx_33 = CurveCurve(CurveA=graft(move_48.Geometry), CurveB=flatten(crv_74))  # -> Points, ParamsA, ParamsB
shift_16 = ShiftPaths(Data=ccx_33.Points, Offset=-1)
sort_44 = SortList(Keys=shift_16, ValuesA=shift_16)  # -> Keys, ValuesA
pull_38 = PullPoint(Point=sort_44.ValuesA, Geometry=graft(pln_59), ClosestOnly=True)  # -> ClosestPoint, Distance
sort_45 = SortList(Keys=pull_38.Distance, ValuesA=sort_44.ValuesA)  # -> Keys, ValuesA
item_56 = ListItem(List=sort_45.ValuesA, Index="-1", Wrap=True)
null_35 = NullItem(Item=flatten(item_56))  # -> NullFlags, InvalidFlags, Description
dispatch_103 = Dispatch(List=flatten(item_56), DispatchPattern=null_35.InvalidFlags)  # -> ListA, ListB
dispatch_104 = Dispatch(List=pln_59, DispatchPattern=null_35.InvalidFlags)  # -> ListA, ListB
pt_35 = Point(dispatch_103.ListB)
pln_102 = Plane(dispatch_104.ListB)

ccx_34 = CurveCurve(CurveA=graft(move_47.Geometry), CurveB=flatten(crv_74))  # -> Points, ParamsA, ParamsB
shift_17 = ShiftPaths(Data=ccx_34.Points, Offset=-1)
sort_46 = SortList(Keys=shift_17, ValuesA=shift_17)  # -> Keys, ValuesA
pull_39 = PullPoint(Point=sort_46.ValuesA, Geometry=graft(pln_59), ClosestOnly=True)  # -> ClosestPoint, Distance
sort_47 = SortList(Keys=pull_39.Distance, ValuesA=sort_46.ValuesA)  # -> Keys, ValuesA
item_57 = ListItem(List=sort_47.ValuesA, Index="-1", Wrap=True)
null_36 = NullItem(Item=flatten(item_57))  # -> NullFlags, InvalidFlags, Description
dispatch_105 = Dispatch(List=flatten(item_57), DispatchPattern=null_36.InvalidFlags)  # -> ListA, ListB
dispatch_106 = Dispatch(List=pln_59, DispatchPattern=null_36.InvalidFlags)  # -> ListA, ListB
pln_103 = Plane(dispatch_106.ListB)
pt_36 = Point(dispatch_105.ListB)

merge_23 = Merge(Data1=pln_103, Data2=pln_102)  # -> flatten(Result)
check_same_points_8 = CheckSamePoints(archPoint=flatten(pln_101), crvPoint=merge_23)  # -> out, specialPt; inputs archPoint: list of Point3d, crvPoint: list of Point3d; same code as testpoint

# ----
# pass
cull_i_18 = CullIndex(List=flatten(pln_101), Indices=check_same_points_8.specialPt, Wrap=True)

# ----
# 按照梁分类定位点
pln_104 = Plane(pln_103)
pt_37 = Point(pt_36)
incurves_31 = PointInCurves(Point=flatten(pt_37), Curves=crv_37)  # -> Relationship, Index, Point
equals_33 = Equality(FirstNumber=incurves_31.Relationship, SecondNumber="0")  # -> Equality, Inequality
dispatch_107 = Dispatch(List=flatten(pln_104), DispatchPattern=equals_33.Inequality)  # -> ListA, ListB
data_79 = Data(dispatch_107.ListA)

# ----
# 按照梁分类定位点
pln_105 = Plane(pln_102)
pt_38 = Point(pt_35)
incurves_32 = PointInCurves(Point=flatten(pt_38), Curves=crv_37)  # -> Relationship, Index, Point
equals_34 = Equality(FirstNumber=incurves_32.Relationship, SecondNumber="0")  # -> Equality, Inequality
dispatch_108 = Dispatch(List=flatten(pln_105), DispatchPattern=equals_34.Inequality)  # -> ListA, ListB
data_80 = Data(dispatch_108.ListA)

incurves_33 = PointInCurves(Point=flatten(pt_38), Curves=crv_37)  # -> Relationship, Index, Point
equals_35 = Equality(FirstNumber=incurves_33.Relationship, SecondNumber="0")  # -> Equality, Inequality
dispatch_109 = Dispatch(List=flatten(pt_38), DispatchPattern=equals_35.Inequality)  # -> ListA, ListB
data_81 = Data(dispatch_109.ListA)

incurves_34 = PointInCurves(Point=flatten(pt_37), Curves=crv_37)  # -> Relationship, Index, Point
equals_36 = Equality(FirstNumber=incurves_34.Relationship, SecondNumber="0")  # -> Equality, Inequality
dispatch_110 = Dispatch(List=flatten(pt_37), DispatchPattern=equals_36.Inequality)  # -> ListA, ListB
data_82 = Data(dispatch_110.ListA)

move2pt_33 = MoveToPoint(Geometry=data_79, PointA=data_79, PointB=data_82)  # -> Moved, Vector, Transform
null_37 = NullItem(Item=move2pt_33.Moved)  # -> NullFlags, InvalidFlags, Description
dispatch_111 = Dispatch(List=move2pt_33.Moved, DispatchPattern=null_37.InvalidFlags)  # -> ListA, ListB
pln_106 = Plane(dispatch_111.ListB)

move2pt_34 = MoveToPoint(Geometry=data_80, PointA=data_80, PointB=data_81)  # -> Moved, Vector, Transform
null_38 = NullItem(Item=move2pt_34.Moved)  # -> NullFlags, InvalidFlags, Description
dispatch_112 = Dispatch(List=move2pt_34.Moved, DispatchPattern=null_38.InvalidFlags)  # -> ListA, ListB
pln_107 = Plane(dispatch_112.ListB)

# ----
# 撞到梁交点
merge_24 = Merge(Data1=pln_106, Data2=pln_107)

# ----
# 定位点中可能遗漏
# 上一层筛选中
# 和结构交叉出的点
pln_108 = Plane(cull_i_17)
pln_109 = Plane(cull_i_18)

merge_25 = Merge(Data1=pln_61, Data2=merge_24)

# ----
# 3.1下层建筑内侧到300到外侧50内是否有钢结构
deplane_40 = DeconstructPlane(Plane=pln_108)  # -> Origin, XAxis, YAxis, ZAxis
deplane_41 = DeconstructPlane(Plane=pln_109)  # -> Origin, XAxis, YAxis, ZAxis
check_same_points_9 = CheckSamePoints(archPoint=deplane_41.Origin, crvPoint=deplane_40.Origin)  # -> out, specialPt; inputs archPoint: list of Point3d, crvPoint: list of Point3d; same code as testpoint

orient_7 = Orient(Geometry=item_16, Source=item_17, Target=merge_25)  # -> Geometry, Transform

# ----
# 同时满足N
item_58 = ListItem(List=pln_109, Index=check_same_points_9.specialPt, Wrap=True)

pln_110 = Plane(item_58)
flatten_16 = FlattenTree(Tree=crv_26, Path="{0}")
number_slider_45 = Slider(3584, range=0..10000)
deplane_42 = DeconstructPlane(Plane=pln_110)  # -> Origin, XAxis, YAxis, ZAxis
boundary_6 = BoundarySurfaces(Edges=[offset_7, offset_6])
crv_75 = Curve(flatten_16)
amp_45 = Amplitude(Vector=deplane_42.YAxis, Amplitude=number_slider_45)
amp_46 = Amplitude(Vector=deplane_42.YAxis, Amplitude=expr("-x", number_slider_45))
scx_3 = SurfaceCurve(Surface=boundary_6, Curve=crv_75)  # -> flatten(Curves), Points, UVPoints, Normals, Parameters, Tangents
move_49 = Move(Geometry=deplane_42.Origin, Motion=amp_46)  # -> Geometry, Transform
move_50 = Move(Geometry=deplane_42.Origin, Motion=amp_45)  # -> Geometry, Transform
ln_42 = Line(StartPoint=move_49.Geometry, EndPoint=move_50.Geometry)
ccx_35 = CurveCurve(CurveA=graft(ln_42), CurveB=scx_3.Curves)  # -> Points, ParamsA, ParamsB
shift_18 = ShiftPaths(Data=ccx_35.Points, Offset=-1)
pull_40 = PullPoint(Point=graft(pln_110), Geometry=shift_18, ClosestOnly=True)  # -> ClosestPoint, Distance
sort_48 = SortList(Keys=pull_40.Distance, ValuesA=pull_40.ClosestPoint)  # -> Keys, ValuesA
item_59 = ListItem(List=sort_48.ValuesA, Index=0, Wrap=True)
null_39 = NullItem(Item=sort_48.ValuesA)  # -> NullFlags, simplify(InvalidFlags), Description
dispatch_113 = Dispatch(List=simplify(graft(pln_110)), DispatchPattern=null_39.InvalidFlags)  # -> ListA, ListB
pln_111 = Plane(dispatch_113.ListB)
pln_112 = Plane(dispatch_113.ListA)

dispatch_114 = Dispatch(List=simplify(graft(item_59)), DispatchPattern=null_39.InvalidFlags)  # -> ListA, ListB
pt_39 = Point(dispatch_114.ListB)

# ----
# 按照梁分类定位点
pt_40 = Point(pt_39)
pln_113 = Plane(pln_111)
incurves_35 = PointInCurves(Point=flatten(pt_40), Curves=crv_38)  # -> Relationship, Index, Point
equals_37 = Equality(FirstNumber=incurves_35.Relationship, SecondNumber="0")  # -> Equality, Inequality
dispatch_115 = Dispatch(List=flatten(pln_113), DispatchPattern=equals_37.Inequality)  # -> ListA, ListB
data_83 = Data(dispatch_115.ListA)

incurves_36 = PointInCurves(Point=flatten(pt_40), Curves=crv_38)  # -> Relationship, Index, Point
equals_38 = Equality(FirstNumber=incurves_36.Relationship, SecondNumber="0")  # -> Equality, Inequality
dispatch_116 = Dispatch(List=flatten(pt_40), DispatchPattern=equals_38.Inequality)  # -> ListA, ListB
data_84 = Data(dispatch_116.ListA)

move2pt_35 = MoveToPoint(Geometry=data_83, PointA=data_83, PointB=data_84)  # -> Moved, Vector, Transform
null_40 = NullItem(Item=move2pt_35.Moved)  # -> NullFlags, InvalidFlags, Description
dispatch_117 = Dispatch(List=move2pt_35.Moved, DispatchPattern=null_40.InvalidFlags)  # -> ListA, ListB
pln_114 = Plane(dispatch_117.ListB)

# ----
# 可能的结构交点-大量
pln_115 = Plane(pln_112)

# ----
# 0 檐口出定位点
# 与结构无交点
pln_116 = Plane(flatten(pln_115))

# ----
# Sort Text
# 3.1下层建筑内侧到300到外侧50内
# 底埋，钢板焊
srf = Surface(pln_114)

# ----
# 2.2  Missing Point
# 埋件定位点Offset，没有找到和梁的交点
number_slider_46 = Slider(5000, range=0..10000)
deplane_43 = DeconstructPlane(Plane=pln_116)  # -> Origin, XAxis, YAxis, ZAxis
crv_76 = Curve(scx_3.Curves)
amp_47 = Amplitude(Vector=deplane_43.YAxis, Amplitude=number_slider_46)
move_51 = Move(Geometry=deplane_43.Origin, Motion=amp_47)  # -> Geometry, Transform
ln_43 = Line(StartPoint=move_51.Geometry, EndPoint=deplane_43.Origin)
amp_48 = Amplitude(Vector=deplane_43.XAxis, Amplitude=number_slider_3)
amp_49 = Amplitude(Vector=deplane_43.XAxis, Amplitude=expr("-x", number_slider_3))
move_52 = Move(Geometry=ln_43, Motion=amp_48)  # -> Geometry, Transform
move_53 = Move(Geometry=ln_43, Motion=amp_49)  # -> Geometry, Transform
pln_117 = Plane(pln_116)

ccx_36 = CurveCurve(CurveA=graft(move_53.Geometry), CurveB=flatten(crv_76))  # -> Points, ParamsA, ParamsB
shift_19 = ShiftPaths(Data=ccx_36.Points, Offset=-1)
sort_49 = SortList(Keys=shift_19, ValuesA=shift_19)  # -> Keys, ValuesA
pull_41 = PullPoint(Point=sort_49.ValuesA, Geometry=graft(pln_116), ClosestOnly=True)  # -> ClosestPoint, Distance
sort_50 = SortList(Keys=pull_41.Distance, ValuesA=sort_49.ValuesA)  # -> Keys, ValuesA
item_60 = ListItem(List=sort_50.ValuesA, Index="-1", Wrap=True)
null_41 = NullItem(Item=flatten(item_60))  # -> NullFlags, InvalidFlags, Description
dispatch_118 = Dispatch(List=flatten(item_60), DispatchPattern=null_41.InvalidFlags)  # -> ListA, ListB
dispatch_119 = Dispatch(List=pln_116, DispatchPattern=null_41.InvalidFlags)  # -> ListA, ListB
pln_118 = Plane(dispatch_119.ListB)
pt_41 = Point(dispatch_118.ListB)

ccx_37 = CurveCurve(CurveA=graft(move_52.Geometry), CurveB=flatten(crv_76))  # -> Points, ParamsA, ParamsB
shift_20 = ShiftPaths(Data=ccx_37.Points, Offset=-1)
sort_51 = SortList(Keys=shift_20, ValuesA=shift_20)  # -> Keys, ValuesA
pull_42 = PullPoint(Point=sort_51.ValuesA, Geometry=graft(pln_116), ClosestOnly=True)  # -> ClosestPoint, Distance
sort_52 = SortList(Keys=pull_42.Distance, ValuesA=sort_51.ValuesA)  # -> Keys, ValuesA
item_61 = ListItem(List=sort_52.ValuesA, Index="-1", Wrap=True)
null_42 = NullItem(Item=flatten(item_61))  # -> NullFlags, InvalidFlags, Description
dispatch_120 = Dispatch(List=pln_116, DispatchPattern=null_42.InvalidFlags)  # -> ListA, ListB
dispatch_121 = Dispatch(List=flatten(item_61), DispatchPattern=null_42.InvalidFlags)  # -> ListA, ListB
pt_42 = Point(dispatch_121.ListB)
pln_119 = Plane(dispatch_120.ListB)

merge_26 = Merge(Data1=pln_119, Data2=pln_118)  # -> flatten(Result)
check_same_points_10 = CheckSamePoints(archPoint=flatten(pln_117), crvPoint=merge_26)  # -> out, specialPt; inputs archPoint: list of Point3d, crvPoint: list of Point3d; same code as testpoint

# ----
# pass
cull_i_19 = CullIndex(List=flatten(pln_117), Indices=check_same_points_10.specialPt, Wrap=True)  # -> simplify(graft(List))

# ----
# 按照梁分类定位点
pln_120 = Plane(pln_119)
pt_43 = Point(pt_42)
incurves_37 = PointInCurves(Point=flatten(pt_43), Curves=crv_39)  # -> Relationship, Index, Point
equals_39 = Equality(FirstNumber=incurves_37.Relationship, SecondNumber="0")  # -> Equality, Inequality
dispatch_122 = Dispatch(List=flatten(pln_120), DispatchPattern=equals_39.Inequality)  # -> ListA, ListB
data_85 = Data(dispatch_122.ListA)

# ----
# 按照梁分类定位点
pln_121 = Plane(pln_118)
pt_44 = Point(pt_41)
incurves_38 = PointInCurves(Point=flatten(pt_44), Curves=crv_39)  # -> Relationship, Index, Point
equals_40 = Equality(FirstNumber=incurves_38.Relationship, SecondNumber="0")  # -> Equality, Inequality
dispatch_123 = Dispatch(List=flatten(pln_121), DispatchPattern=equals_40.Inequality)  # -> ListA, ListB
data_86 = Data(dispatch_123.ListA)

incurves_39 = PointInCurves(Point=flatten(pt_44), Curves=crv_39)  # -> Relationship, Index, Point
equals_41 = Equality(FirstNumber=incurves_39.Relationship, SecondNumber="0")  # -> Equality, Inequality
dispatch_124 = Dispatch(List=flatten(pt_44), DispatchPattern=equals_41.Inequality)  # -> ListA, ListB
data_87 = Data(dispatch_124.ListA)

incurves_40 = PointInCurves(Point=flatten(pt_43), Curves=crv_39)  # -> Relationship, Index, Point
equals_42 = Equality(FirstNumber=incurves_40.Relationship, SecondNumber="0")  # -> Equality, Inequality
dispatch_125 = Dispatch(List=flatten(pt_43), DispatchPattern=equals_42.Inequality)  # -> ListA, ListB
data_88 = Data(dispatch_125.ListA)

move2pt_36 = MoveToPoint(Geometry=data_85, PointA=data_85, PointB=data_88)  # -> Moved, Vector, Transform
null_43 = NullItem(Item=move2pt_36.Moved)  # -> NullFlags, InvalidFlags, Description
dispatch_126 = Dispatch(List=move2pt_36.Moved, DispatchPattern=null_43.InvalidFlags)  # -> ListA, ListB
pln_122 = Plane(dispatch_126.ListB)

move2pt_37 = MoveToPoint(Geometry=data_86, PointA=data_86, PointB=data_87)  # -> Moved, Vector, Transform
null_44 = NullItem(Item=move2pt_37.Moved)  # -> NullFlags, InvalidFlags, Description
dispatch_127 = Dispatch(List=move2pt_37.Moved, DispatchPattern=null_44.InvalidFlags)  # -> ListA, ListB
pln_123 = Plane(dispatch_127.ListB)

# ----
# 3.2下层建筑内侧到300到外侧50内
# 无钢结构
# 要求主体结构提供钢结构梁，默认位置为建筑边线向内300mm
number_slider_47 = Slider(300, range=0..1000)
crv_77 = Curve(crv_16)
pln_124 = Plane(cull_i_19)
offset_14 = OffsetCurve(Curve=crv_77, Distance=expr("-x", number_slider_47), Corners=1)
pull_43 = PullPoint(Point=pln_124, Geometry=offset_14, ClosestOnly=True)  # -> ClosestPoint, Distance
sort_53 = SortList(Keys=pull_43.Distance)  # -> Keys, ValuesA
larger_11 = LargerThan(FirstNumber=pull_43.Distance, SecondNumber=Slider(400, range=0..1000))  # -> LargerThan, OrEqualTo
dispatch_128 = Dispatch(List=pln_124, DispatchPattern=larger_11.LargerThan)  # -> ListA, ListB
panel_55 = Panel(sort_53.Keys)
pln_125 = Plane(flatten(dispatch_128.ListB))
number_slider_48 = Slider(3584, range=0..10000)
deplane_44 = DeconstructPlane(Plane=pln_125)  # -> Origin, XAxis, YAxis, ZAxis
amp_50 = Amplitude(Vector=deplane_44.YAxis, Amplitude=number_slider_48)
amp_51 = Amplitude(Vector=deplane_44.YAxis, Amplitude=expr("-x", number_slider_48))
move_54 = Move(Geometry=deplane_44.Origin, Motion=amp_51)  # -> Geometry, Transform
move_55 = Move(Geometry=deplane_44.Origin, Motion=amp_50)  # -> Geometry, Transform
ln_44 = Line(StartPoint=move_54.Geometry, EndPoint=move_55.Geometry)
ccx_38 = CurveCurve(CurveA=ln_44, CurveB=offset_14)  # -> Points, ParamsA, ParamsB
null_45 = NullItem(Item=simplify(ccx_38.Points))  # -> NullFlags, InvalidFlags, Description
flatten_17 = FlattenTree(Tree=ccx_38.Points, Path="{0}")
dispatch_129 = Dispatch(List=simplify(graft(pln_125)), DispatchPattern=null_45.NullFlags)  # -> ListA, ListB
pull_44 = PullPoint(Point=deplane_44.Origin, Geometry=flatten_17, ClosestOnly=True)  # -> ClosestPoint, Distance

# ----
# 撞到梁交点
merge_27 = Merge(Data1=pln_122, Data2=pln_123)

# ----
# 可能的双点
pln_126 = Plane(dispatch_129.ListA)

# ----
# 离结构太远
pln_127 = Plane(dispatch_128.ListA)

merge_28 = Merge(Data1=pln_127, Data2=pln_126)

# ----
# 0 檐口出定位点
# 与结构无交点
pln_128 = Plane(flatten(merge_28))

# ----
# 3.2默认位置为建筑边线向内300mm
# 侧埋，钢板焊
# 03：钢板焊埋件[钢梁外侧]@钢边梁宽@钢边梁高
move2pt_38 = MoveToPoint(Geometry=pln_125, PointA=deplane_44.Origin, PointB=pull_44.ClosestPoint)  # -> Moved, Vector, Transform

# ----
# 3.3  Missing Point
# 埋件定位点Offset，没有找到和梁的交点
number_slider_49 = Slider(5000, range=0..10000)
deplane_45 = DeconstructPlane(Plane=pln_64)  # -> Origin, XAxis, YAxis, ZAxis
crv_78 = Curve(crv_67)
amp_52 = Amplitude(Vector=deplane_45.YAxis, Amplitude=number_slider_49)
move_56 = Move(Geometry=deplane_45.Origin, Motion=amp_52)  # -> Geometry, Transform
ln_45 = Line(StartPoint=move_56.Geometry, EndPoint=deplane_45.Origin)
amp_53 = Amplitude(Vector=deplane_45.XAxis, Amplitude=number_slider_3)
amp_54 = Amplitude(Vector=deplane_45.XAxis, Amplitude=expr("-x", number_slider_3))
move_57 = Move(Geometry=ln_45, Motion=amp_53)  # -> Geometry, Transform
move_58 = Move(Geometry=ln_45, Motion=amp_54)  # -> Geometry, Transform
pln_129 = Plane(pln_64)

ccx_39 = CurveCurve(CurveA=graft(move_58.Geometry), CurveB=flatten(crv_78))  # -> Points, ParamsA, ParamsB
shift_21 = ShiftPaths(Data=ccx_39.Points, Offset=-1)
sort_54 = SortList(Keys=shift_21, ValuesA=shift_21)  # -> Keys, ValuesA
pull_45 = PullPoint(Point=sort_54.ValuesA, Geometry=graft(pln_64), ClosestOnly=True)  # -> ClosestPoint, Distance
sort_55 = SortList(Keys=pull_45.Distance, ValuesA=sort_54.ValuesA)  # -> Keys, ValuesA
item_62 = ListItem(List=sort_55.ValuesA, Index="-1", Wrap=True)
null_46 = NullItem(Item=flatten(item_62))  # -> NullFlags, InvalidFlags, Description
dispatch_130 = Dispatch(List=simplify(item_62), DispatchPattern=simplify(graft(null_46.InvalidFlags)))  # -> ListA, ListB
dispatch_131 = Dispatch(List=pln_64, DispatchPattern=null_46.InvalidFlags)  # -> ListA, ListB
pln_130 = Plane(dispatch_131.ListB)
pt_45 = Point(dispatch_130.ListB)

ccx_40 = CurveCurve(CurveA=graft(move_57.Geometry), CurveB=flatten(crv_78))  # -> Points, ParamsA, ParamsB
shift_22 = ShiftPaths(Data=ccx_40.Points, Offset=-1)
sort_56 = SortList(Keys=shift_22, ValuesA=shift_22)  # -> Keys, ValuesA
pull_46 = PullPoint(Point=sort_56.ValuesA, Geometry=graft(pln_64), ClosestOnly=True)  # -> ClosestPoint, Distance
sort_57 = SortList(Keys=pull_46.Distance, ValuesA=sort_56.ValuesA)  # -> Keys, ValuesA
item_63 = ListItem(List=sort_57.ValuesA, Index="-1", Wrap=True)
null_47 = NullItem(Item=flatten(item_63))  # -> NullFlags, InvalidFlags, Description
dispatch_132 = Dispatch(List=simplify(item_63), DispatchPattern=simplify(graft(null_47.InvalidFlags)))  # -> ListA, ListB
dispatch_133 = Dispatch(List=pln_64, DispatchPattern=null_47.InvalidFlags)  # -> ListA, ListB
pln_131 = Plane(dispatch_133.ListB)
pt_46 = Point(dispatch_132.ListB)

merge_29 = Merge(Data1=pln_131, Data2=pln_130)  # -> flatten(Result)
check_same_points_11 = CheckSamePoints(archPoint=flatten(pln_129), crvPoint=merge_29)  # -> out, specialPt; inputs archPoint: list of Point3d, crvPoint: list of Point3d; same code as testpoint

# ----
# 撞到结构
move2pt_39 = MoveToPoint(Geometry=flatten(pln_131), PointA=flatten(pln_131), PointB=flatten(pt_46))  # -> Moved, Vector, Transform
move2pt_40 = MoveToPoint(Geometry=flatten(pln_130), PointA=flatten(pln_130), PointB=flatten(pt_45))  # -> Moved, Vector, Transform

# ----
# pass
cull_i_20 = CullIndex(List=flatten(pln_129), Indices=check_same_points_11.specialPt, Wrap=True)  # -> simplify(graft(List))

# ----
# 撞到梁交点
merge_30 = Merge(Data1=move2pt_39.Moved, Data2=move2pt_40.Moved)

# ----
# 3.2  Missing Point
# 埋件定位点Offset，没有找到和梁的交点
number_slider_50 = Slider(5000, range=0..10000)
deplane_46 = DeconstructPlane(Plane=pln_128)  # -> Origin, XAxis, YAxis, ZAxis
crv_79 = Curve(scx_3.Curves)
amp_55 = Amplitude(Vector=deplane_46.YAxis, Amplitude=number_slider_50)
move_59 = Move(Geometry=deplane_46.Origin, Motion=amp_55)  # -> Geometry, Transform
ln_46 = Line(StartPoint=move_59.Geometry, EndPoint=deplane_46.Origin)
amp_56 = Amplitude(Vector=deplane_46.XAxis, Amplitude=number_slider_3)
amp_57 = Amplitude(Vector=deplane_46.XAxis, Amplitude=expr("-x", number_slider_3))
move_60 = Move(Geometry=ln_46, Motion=amp_56)  # -> Geometry, Transform
move_61 = Move(Geometry=ln_46, Motion=amp_57)  # -> Geometry, Transform
pln_132 = Plane(pln_128)

ccx_41 = CurveCurve(CurveA=graft(move_61.Geometry), CurveB=flatten(crv_79))  # -> Points, ParamsA, ParamsB
shift_23 = ShiftPaths(Data=ccx_41.Points, Offset=-1)
sort_58 = SortList(Keys=shift_23, ValuesA=shift_23)  # -> Keys, ValuesA
pull_47 = PullPoint(Point=sort_58.ValuesA, Geometry=graft(pln_128), ClosestOnly=True)  # -> ClosestPoint, Distance
sort_59 = SortList(Keys=pull_47.Distance, ValuesA=sort_58.ValuesA)  # -> Keys, ValuesA
item_64 = ListItem(List=sort_59.ValuesA, Index="-1", Wrap=True)
null_48 = NullItem(Item=flatten(item_64))  # -> NullFlags, InvalidFlags, Description
dispatch_134 = Dispatch(List=simplify(item_64), DispatchPattern=simplify(graft(null_48.InvalidFlags)))  # -> ListA, ListB
dispatch_135 = Dispatch(List=pln_128, DispatchPattern=null_48.InvalidFlags)  # -> ListA, ListB
pln_133 = Plane(dispatch_135.ListB)
pt_47 = Point(dispatch_134.ListB)

ccx_42 = CurveCurve(CurveA=graft(move_60.Geometry), CurveB=flatten(crv_79))  # -> Points, ParamsA, ParamsB
shift_24 = ShiftPaths(Data=ccx_42.Points, Offset=-1)
sort_60 = SortList(Keys=shift_24, ValuesA=shift_24)  # -> Keys, ValuesA
pull_48 = PullPoint(Point=sort_60.ValuesA, Geometry=graft(pln_128), ClosestOnly=True)  # -> ClosestPoint, Distance
sort_61 = SortList(Keys=pull_48.Distance, ValuesA=sort_60.ValuesA)  # -> Keys, ValuesA
item_65 = ListItem(List=sort_61.ValuesA, Index="-1", Wrap=True)
null_49 = NullItem(Item=flatten(item_65))  # -> NullFlags, InvalidFlags, Description
dispatch_136 = Dispatch(List=simplify(item_65), DispatchPattern=simplify(graft(null_49.InvalidFlags)))  # -> ListA, ListB
dispatch_137 = Dispatch(List=pln_128, DispatchPattern=null_49.InvalidFlags)  # -> ListA, ListB
pln_134 = Plane(dispatch_137.ListB)
pt_48 = Point(dispatch_136.ListB)

merge_31 = Merge(Data1=pln_134, Data2=pln_133)  # -> flatten(Result)
check_same_points_12 = CheckSamePoints(archPoint=flatten(pln_132), crvPoint=merge_31)  # -> out, specialPt; inputs archPoint: list of Point3d, crvPoint: list of Point3d; same code as testpoint

# ----
# 撞到结构
move2pt_41 = MoveToPoint(Geometry=flatten(pln_134), PointA=flatten(pln_134), PointB=flatten(pt_48))  # -> Moved, Vector, Transform
move2pt_42 = MoveToPoint(Geometry=flatten(pln_133), PointA=flatten(pln_133), PointB=flatten(pt_47))  # -> Moved, Vector, Transform

# ----
# 撞到梁交点
merge_32 = Merge(Data1=move2pt_41.Moved, Data2=move2pt_42.Moved)

# ----
# pass
cull_i_21 = CullIndex(List=flatten(pln_132), Indices=check_same_points_12.specialPt, Wrap=True)  # -> simplify(graft(List))

# ==== cluster Cluster
G = ClusterInput()
rotate = Rotate(Geometry=G, Angle=3.141592654, Plane=PlaneXY(0, 0, 0))  # -> Geometry, Transform
boxprop = BoxProperties(Box=rotate.Geometry)  # -> Center, Diagonal, Area, Volume, Degeneracy
bbox = BoundingBox(Content=rotate.Geometry, Plane=PlaneXY(0, 0, 0))  # -> Box, Box_2
debox = DeconstructBox(Box=bbox.Box)  # -> Plane, X, Y, Z
pdecon = Deconstruct(Point=boxprop.Center)  # -> XComponent, YComponent, ZComponent
dedomain = DeconstructDomain(Domain=debox.Y)  # -> Start, End
pt = ConstructPoint(XCoordinate=pdecon.XComponent, YCoordinate=dedomain.Start, ZCoordinate=pdecon.ZComponent)
xy = XYPlane(Origin=Point(0, 0, 0))
pl_origin = PlaneOrigin(Base=xy, Origin=pt)
orient = Orient(Geometry=rotate.Geometry, Source=pl_origin, Target=xy)  # -> Geometry, Transform
G_2 = ClusterOutput(orient.Geometry)

# ==== cluster Cluster_4
A = ClusterInput()
A_2 = ClusterInput()
T = ClusterInput()

# ----
# 列表文字以空格进行分割
panel = Panel(" ")
split = TextSplit(Text=T, Separators=panel)

A_3 = ClusterInput()

钢埋板长度_2 = Division(A=A, B=2)
neg = Negative(Value=钢埋板长度_2)
dom = ConstructDomain(DomainStart=neg, DomainEnd=钢埋板长度_2)
panel_2 = Panel(dom)

钢埋板厚度_2 = Division(A=A_2, B=2)
neg_2 = Negative(Value=钢埋板厚度_2)
dom_2 = ConstructDomain(DomainStart=neg_2, DomainEnd=钢埋板厚度_2)
panel_3 = Panel(dom_2)

# ----
# 钢埋板肋板位置 1/4处
panel_4 = Panel("4")
division = Division(A=A_3, B=panel_4)

# ----
# 编号和截面尺寸分区
panel_5 = Panel("1")
split_2 = SplitList(List=split, Index=panel_5)  # -> flatten(ListA), flatten(ListB)

D = ClusterInput()

# ----
# 求出对应输入编号的钢结构截面尺寸
fsim = FindSimilarMember(Data=D, Set=split_2.ListA)  # -> Hit, Index
item = ListItem(List=split_2.ListB, Index=fsim.Index, Wrap=True)

addition = Addition(A=neg_2, B=division)
addition_2 = Addition(A=钢埋板厚度_2, B=division)
panel_6 = Panel(split_2.ListB)
dom_3 = ConstructDomain(DomainStart=addition, DomainEnd=addition_2)
钢结构截面尺寸 = 钢结构截面尺寸(T=item)
cluster = Cluster_2(L=钢结构截面尺寸, L_2=钢结构截面尺寸, L_4=钢结构截面尺寸, L_3=钢结构截面尺寸)  # -> i, i_2, i_4, i_3
B = ClusterInput()
B_2 = ClusterInput()
B_3 = ClusterInput()
B_4 = ClusterInput()
B_5 = ClusterInput()

# ----
# 钢埋板高度，工字钢尺寸决定
panel_7 = Panel("2")
division_2 = Division(A=cluster.i, B=panel_7)
subtraction = Subtraction(A=division_2, B=cluster.i_3)

钢肋板_侧视图 = 钢肋板侧视图_2(
    B_11=B,
    A_7=cluster.i_2,
    Y=dom_3,
    B_12=cluster.i_4,
    B_13=钢埋板厚度_2,
    B=B_2,
    A=addition,
    B_2=addition_2,
    A_2=division,
    B_3=钢埋板厚度_2,
    x=钢埋板厚度_2,
    A_3=division,
    B_4=B_3,
    B_5=钢埋板厚度_2,
    x_2=钢埋板厚度_2,
    A_4=division,
    B_6=B_4,
    B_7=钢埋板厚度_2,
    x_3=钢埋板厚度_2,
    B_8=B_5,
    x_4=钢埋板厚度_2,
    A_5=division,
    B_9=钢埋板厚度_2,
    A_6=division,
    B_10=钢埋板厚度_2,
    x_5=钢埋板厚度_2)  # -> R, G, R_2
钢埋板_侧视图 = Rectangle(Plane=PlaneXY(0, 0, 0), XSize=dom_2, YSize=dom, Radius=0)  # -> Rectangle, Length
division_3 = Division(A=cluster.i_2, B=2)

侧视图 = Entwine(Branch00=钢埋板_侧视图.Rectangle, Branch01=钢肋板_侧视图.R_2, Branch02=钢肋板_侧视图.G, FlattenInputs=True)
cluster_2 = Cluster_3(G=侧视图, A=subtraction, B=Slider(200, range=0..1000), B_2=钢肋板_侧视图.R)

R = ClusterOutput(division_3)
split_tree = SplitTree(Data=cluster_2, Masks=flatten("{0;0}"))  # -> Positive, Negative
dispatch = Dispatch(List=split_tree.Negative, DispatchPattern=[True, False])  # -> flatten(ListA), ListB
merge = Merge(Data1=split_tree.Positive, Data2=dispatch.ListA)
entwine = Entwine(Branch00=merge, Branch01=dispatch.ListB, FlattenInputs=True)
flatten = FlattenTree(Tree=entwine, Path="{0}")
group = Group(Objects=flatten)
cluster_3 = Cluster(G=group)
ungroup = Ungroup(Group=cluster_3)

# ---- group: Block
layer = DefineLayer(Name="Embeded::Embeded Steel", Color=ColourSwatch(SwatchColor=RGB(255, 140, 140)))
attributes = DefineObjectAttributes(Layer=layer)
block = DefineBlock(Geometry=ungroup, Attributes=attributes, BlockName="Steel Plate", BasePlane=PlaneXY(0, 0, 0))

# ----
B_6 = ClusterOutput(block)
deblock = DeconstructBlock(Block=block)  # -> Name, flatten(Plane), flatten(Geometry)
group_2 = Group(Objects=deblock.Geometry)
bbox = BoundingBox(Content=group_2, Plane=PlaneXY(0, 0, 0))  # -> Box, Box_2
deplane = DeconstructPlane(Plane=deblock.Plane)  # -> Origin, XAxis, YAxis, ZAxis
area = Area(Geometry=bbox.Box)  # -> Area, Centroid
move2pt = MoveToPoint(Geometry=flatten(deplane.Origin), PointA=flatten(deplane.Origin), PointB=flatten(area.Centroid))  # -> Moved, Vector, Transform
pl = ConstructPlane(Origin=move2pt.Moved, XAxis=deplane.YAxis, YAxis=deplane.XAxis)  # -> graft(Plane)
rotate = Rotate(Geometry=pl, Angle="Pi", Plane=pl)  # -> Geometry, Transform
G = ClusterOutput(rotate.Geometry)

# ==== cluster 钢结构截面尺寸
T = ClusterInput()
split = TextSplit(Text=T, Separators="x")
split_2 = TextSplit(Text=split, Separators="Q")
item = ListItem(List=split_2, Index="0", Wrap=True)  # -> flatten(Item)
i = ClusterOutput(item)

# ==== cluster Cluster_2
L = ClusterInput()
L_2 = ClusterInput()
L_3 = ClusterInput()
L_4 = ClusterInput()
工字钢_h = ListItem(List=L, Index=0, Wrap=True)
工字钢_b = ListItem(List=L_2, Index=1, Wrap=True)
工字钢_tf = ListItem(List=L_3, Index=3, Wrap=True)
工字钢_tw = ListItem(List=L_4, Index=2, Wrap=True)
i = ClusterOutput(工字钢_h)
i_2 = ClusterOutput(工字钢_b)
i_3 = ClusterOutput(工字钢_tf)
i_4 = ClusterOutput(工字钢_tw)

# ==== cluster 钢肋板侧视图_2
B = ClusterInput()
A = ClusterInput()
B_2 = ClusterInput()
A_2 = ClusterInput()
B_3 = ClusterInput()
x = ClusterInput()
A_3 = ClusterInput()
B_4 = ClusterInput()
B_5 = ClusterInput()
x_2 = ClusterInput()
A_4 = ClusterInput()
B_6 = ClusterInput()
B_7 = ClusterInput()
x_3 = ClusterInput()
B_8 = ClusterInput()
x_4 = ClusterInput()
A_5 = ClusterInput()
B_9 = ClusterInput()
A_6 = ClusterInput()
B_10 = ClusterInput()
x_5 = ClusterInput()
B_11 = ClusterInput()
A_7 = ClusterInput()
Y = ClusterInput()
B_12 = ClusterInput()
B_13 = ClusterInput()
侧视图_焊缝截面 = 侧视图焊缝截面(
    A_4=A_2,
    B_4=B_3,
    x_4=x,
    A=A_3,
    B_5=B_4,
    B=B_5,
    x_5=x_2,
    A_2=A_4,
    B_6=B_6,
    B_2=B_7,
    x=x_3,
    B_7=B_8,
    x_2=x_4,
    A_5=A_5,
    B_8=B_9,
    A_3=A_6,
    B_3=B_10,
    x_3=x_5)
钢肋板_侧视图 = 钢肋板侧视图(B_2=B_11, A=A_7, Y=Y, B=B_12, B_3=B_13)  # -> R_3, R, y, R_2
钢肋板倒角_侧视图 = 钢肋板倒角侧视图(A=钢肋板_侧视图.y, B=钢肋板_侧视图.R_2, B_2=B, A_2=A, B_3=B_2)
R = ClusterOutput(钢肋板_侧视图.R)
merge = Merge(Data1=钢肋板_侧视图.R_3, Data2=侧视图_焊缝截面, Data3=钢肋板倒角_侧视图)
xz = XZPlane(Origin=Point(0, 0, 0))
mirror = Mirror(Geometry=merge, Plane=xz)  # -> Geometry, Transform
R_2 = ClusterOutput(merge)
G = ClusterOutput(mirror.Geometry)

# ==== cluster Cluster_3
A = ClusterInput()
B = ClusterInput()
B_2 = ClusterInput()
addition = Addition(A=A, B=B)
addition_2 = Addition(A=addition, B=B_2)
G = ClusterInput()
X = UnitX(Factor=addition_2)
move = Move(Geometry=G, Motion=X)  # -> Geometry, Transform
G_2 = ClusterOutput(move.Geometry)

# ==== cluster 钢肋板侧视图
A = ClusterInput()
B = ClusterInput()
subtraction = Subtraction(A=A, B=B)
division = Division(A=subtraction, B="2")
R = ClusterOutput(division)
division_2 = Division(A=division, B="2")
B_2 = ClusterInput()
B_3 = ClusterInput()
subtraction_2 = Subtraction(A=division_2, B=B_2)
subtraction_3 = Subtraction(A=division_2, B=B_3)
neg = Negative(Value=division_2)
y = ClusterOutput(neg)
R_2 = ClusterOutput(subtraction_3)
subtraction_4 = Subtraction(A=subtraction_2, B=subtraction_3)
subtraction_5 = Subtraction(A=neg, B=subtraction_3)
dom = ConstructDomain(DomainStart=subtraction_4, DomainEnd=subtraction_5)
Y = ClusterInput()
钢肋板_侧视图 = Rectangle(Plane=PlaneXY(0, 0, 0), XSize=dom, YSize=Y, Radius=0)  # -> Rectangle, Length
R_3 = ClusterOutput(钢肋板_侧视图.Rectangle)

# ==== cluster 侧视图焊缝截面
A = ClusterInput()
B = ClusterInput()
A_2 = ClusterInput()
B_2 = ClusterInput()
A_3 = ClusterInput()
B_3 = ClusterInput()
x = ClusterInput()
x_2 = ClusterInput()
x_3 = ClusterInput()
A_4 = ClusterInput()
B_4 = ClusterInput()
B_5 = ClusterInput()
B_6 = ClusterInput()
B_7 = ClusterInput()
A_5 = ClusterInput()
B_8 = ClusterInput()
x_4 = ClusterInput()
x_5 = ClusterInput()
subtraction = Subtraction(A=A, B=B)
subtraction_2 = Subtraction(A=A_2, B=B_2)
subtraction_3 = Subtraction(A=A_3, B=B_3)
neg = Negative(Value=x)
neg_2 = Negative(Value=x_2)
neg_3 = Negative(Value=x_3)
subtraction_4 = Subtraction(A=A_4, B=B_4)
addition = Addition(A=subtraction, B=B_5)
addition_2 = Addition(A=subtraction_2, B=B_6)
subtraction_5 = Subtraction(A=neg, B=B_7)
subtraction_6 = Subtraction(A=neg_2, B="2")
subtraction_7 = Subtraction(A=A_5, B=B_8)
addition_3 = Addition(A=subtraction_3, B="2")
subtraction_8 = Subtraction(A=neg_3, B="2")
neg_4 = Negative(Value=x_4)
neg_5 = Negative(Value=x_5)
pt = ConstructPoint(XCoordinate=neg_4, YCoordinate=subtraction_4, ZCoordinate=0)
pt_2 = ConstructPoint(XCoordinate=neg_5, YCoordinate=addition, ZCoordinate=0)
pt_3 = ConstructPoint(XCoordinate=subtraction_5, YCoordinate=addition_2, ZCoordinate=0)
pt_4 = ConstructPoint(XCoordinate=subtraction_6, YCoordinate=subtraction_7, ZCoordinate=0)
pt_5 = ConstructPoint(XCoordinate=subtraction_8, YCoordinate=addition_3, ZCoordinate=0)
merge = Merge(Data1=pt, Data2=pt_2, Data3=pt_3, Data4=pt_5, Data5=pt_4)
pline = PolyLine(Vertices=merge, Closed=True)
pl = ClusterOutput(pline)

# ==== cluster 钢肋板倒角侧视图
A = ClusterInput()
B = ClusterInput()
B_2 = ClusterInput()
subtraction = Subtraction(A=A, B=B)
A_2 = ClusterInput()
B_3 = ClusterInput()
addition = Addition(A=subtraction, B=B_2)
dom = ConstructDomain(DomainStart=addition, DomainEnd=subtraction)
dom_2 = ConstructDomain(DomainStart=A_2, DomainEnd=B_3)
钢肋板倒角_侧视图 = Rectangle(Plane=PlaneXY(0, 0, 0), XSize=dom, YSize=dom_2, Radius=0)  # -> Rectangle, Length
R = ClusterOutput(钢肋板倒角_侧视图.Rectangle)
