# Grasshopper definition FacadeEmbed_JinQiao_Podium1123.gh (Grasshopper 1.0.7)
# Copyright: Arup
# plug-ins: EleFront, treesloth01, Pufferfish, Hare, HFTidyCanvas

# ---- group: 下层定位点颜色
# (1)  根据颜色自动导入所以埋件定位点的circle
# 下层、上层、檐口处定位点用不同颜色表示
panel = Panel("Magenta")

# ---- group: 上层定位点颜色
panel_2 = Panel("Yellow")

# ---- group: 檐口定位点颜色
panel_3 = Panel("Cyan")

# ---- group: 檐口线-外侧
crv = Curve(<curve referenced from the Rhino model>)

# ---- group: 檐口线-内侧：没有则清空
crv_2 = Curve([<curve referenced from the Rhino model> x2])

# ---- group: 上层-内部幕墙线: 没有则清空
# 导入下层幕墙线
crv_3 = Curve(<curve referenced from the Rhino model>)

# ---- group: 楼板线
# 导入上层楼板线
# 导入上层幕墙线
crv_4 = Curve(<curve referenced from the Rhino model>)

# ---- group: 导入上层单体幕墙线
crv_5 = Curve(<curve referenced from the Rhino model>)

# ---- group: 导入下层单体幕墙线
crv_6 = Curve(<curve referenced from the Rhino model>)

# ---- group: 导入上层All-外部幕墙线
crv_7 = Curve([<curve referenced from the Rhino model> x3])

# ---- group: 下层All幕墙线
crv_8 = Curve([<curve referenced from the Rhino model> x3])

# ----
# 钢埋板长度（按需设定）
number_slider = Slider(350, range=0..1000)

# ----
# 肋板倒角距离（按需设定）
number_slider_2 = Slider(30, range=0..100)

# ----
# 钢埋板厚度（按需设定）
number_slider_3 = Slider(16, range=0..100)

# ----
# Dimension Style
panel_4 = Panel("图例2-地上$0$XD100$0")

# ---- group: 输入梁编号Texts所在图层
panel_5 = Panel("text-def")

# ----
# 埋件编号tag的Offset - 所有钢埋件
number_slider_4 = Slider(190, range=0..1000)

# ----
# 钢结构截面列表
txt = Text(["GKL4-1\tH 400x250x16x20", "GKL4-2\tH 400x350x12x30", "GKL4-3\tH 400x350x16x35", "GKL5-1\tH 500x200x14x25", "GKL5-2\tH 500x300x14x20", "GKL5a-1\tH 550x250x12x25", "GKL6-1\tH 600x200x12x18", "GKL6-2\tH 600x300x14x20", "GKL6-3\tH 600x350x12x25", "GKL6-4\tH 600x350x16x35", "GKL7-1\tH 700x300x16x25", "GKL7-2\tH 700x350x14x25", "GKL7-3\tH 700x350x14x30", "GKL7-4\tH 700x350x14x35", "GKL8-1\tH 800x300x20x25", "GKL8-2\tH 800x300x20x40", "GKL8-3\tH 800x400x25x30", "GKL8-4\tH 800x400x25x35", "GKL9-1\tH 900x300x20x30", "GKL9-2\tH 900x400x20x40", "GKL9-3\tH 900x500x20x40", "GKL9-4\tH 900x300x20x40", "GKL10-1\tH 1000x500x20x30", "GKL10-2\tH 1000x500x20x40", "GKL10-3\tH 1000x500x20x35", "GKL10-4\tH 1000x600x20x40", "GKL12-1\tH 1200x400x20x50", "GKL12-2\tH 1200x600x25x50", "GL2A-1\tHN 250x125x6x9", "GL3-1\tHN 300x150x6.5x9", "GL3-2\tH 300x100x8x10", "GL3-3\tH 300x200x8x16", "GL3-4\tHW 300x300x10x15", "GL4-1\tHN 400x200x8x13", "GL4-2\tH 400x200x10x16", "GL4-3\tH 400x250x10x20", "GL4-4\tH 400x350x16x35", "GL4a-1\tH 450x200x9x14", "GL5-1\tHN 500x200x10x16", "GL5-2\tH 500x200x10x20", "GL5-3\tH 500x300x14x20", "GL5a-1\tH 550x250x10x25", "GL5a-2\tH 550x300x14x25", "GL6-1\tHN 600x200x11x17", "GL6-2\tH 600x300x12x20", "GL6-3\tH 600x350x12x25", "GL6-4\tH 600x350x16x35", "GL7-1\tHN 700x300x13x24", "GL7-2\tH 700x350x14x30", "GL7-3\tH 700x350x14x35", "GL8-1\tHN 800x300x14x26", "GL8-2\tH 800x300x20x40", "GL9-1\tH 900x300x20x30", "GL9-2\tH 900x400x20x40", "GL10-1\tH 1000x400x20x30", "GL10-2\tH 1000x500x20x30", "GL10-3\tH 1000x500x20x35", "GL10-4\tH 1000x400x20x40", "GL10-5\tH 1000x500x20x40", "GL12-1\tH 1200x400x25x50"])

# ---- group: 导入一条梁中线
# （4）导入梁中线+结构编号，生成对应的钢板焊埋件
crv_9 = Curve(<curve referenced from the Rhino model>)

# ----
# 手动输入埋件Tag
panel_6 = Panel("""1-1
2-2""")

refcol = ReferenceByColor(Color=panel)
area = Area(Geometry=refcol)  # -> Area, Centroid
null = NullItem(Item=area.Area)  # -> NullFlags, InvalidFlags, Description
dispatch = Dispatch(List=refcol, DispatchPattern=null.NullFlags)  # -> ListA, ListB
crv_10 = Curve(dispatch.ListB)

refcol_2 = ReferenceByColor(Color=panel_2)
area_2 = Area(Geometry=refcol_2)  # -> Area, Centroid
null_2 = NullItem(Item=area_2.Area)  # -> NullFlags, InvalidFlags, Description
dispatch_2 = Dispatch(List=refcol_2, DispatchPattern=null_2.NullFlags)  # -> ListA, ListB
crv_11 = Curve(dispatch_2.ListB)

refcol_3 = ReferenceByColor(Color=panel_3)
area_3 = Area(Geometry=refcol_3)  # -> Area, Centroid
null_3 = NullItem(Item=area_3.Area)  # -> NullFlags, InvalidFlags, Description
dispatch_3 = Dispatch(List=refcol_3, DispatchPattern=null_3.NullFlags)  # -> ListA, ListB
crv_12 = Curve(dispatch_3.ListB)

# ----
# （2）导入单体建筑的参考线
clscrv = CloseCurve(Curve=crv, CloseType=0, Bulge=0.5, Tolerance=0)  # -> Closed, R
clscrv_2 = CloseCurve(Curve=crv_6, CloseType=0, Bulge=0.5, Tolerance=0)  # -> Closed, R
clscrv_3 = CloseCurve(Curve=crv_8, CloseType=0, Bulge=0.5, Tolerance=0)  # -> Closed, R
clscrv_4 = CloseCurve(Curve=crv_4, CloseType=0, Bulge=0.5, Tolerance=0)  # -> Closed, R
clscrv_5 = CloseCurve(Curve=crv_5, CloseType=0, Bulge=0.5, Tolerance=0)  # -> Closed, R
clscrv_6 = CloseCurve(Curve=crv_7, CloseType=0, Bulge=0.5, Tolerance=0)  # -> Closed, R
xy = XYPlane(Origin=Point(0, 0, 0))
xy_2 = XYPlane(Origin=Point(0, 0, 0))
xy_3 = XYPlane(Origin=Point(0, 0, 0))
xy_4 = XYPlane(Origin=Point(0, 0, 0))
xy_5 = XYPlane(Origin=Point(0, 0, 0))
project = Project(Geometry=clscrv_2.Closed, Plane=xy_2)  # -> Geometry, Transform
project_2 = Project(Geometry=clscrv_3.Closed, Plane=xy)  # -> Geometry, Transform
project_3 = Project(Geometry=clscrv_4.Closed, Plane=xy_4)  # -> Geometry, Transform
project_4 = Project(Geometry=clscrv_5.Closed, Plane=xy_3)  # -> Geometry, Transform
project_5 = Project(Geometry=clscrv_6.Closed, Plane=xy_5)  # -> Geometry, Transform

# ----
# Embed Layer Color
swatch = ColourSwatch(SwatchColor=RGB(136, 235, 148))

# ----
# （5）导入Default Embed
# 输入
# 
# 1.Embed的结构编号
# 2.Embed的Tag命名
# 需要出图的钢结构编号
panel_7 = Panel("GL3-3H")

# ----
# 导入梁中线+结构编号
# 注意：
# 导入完之后可能要点一下Update确保导入成功
layer = ObjectLayer(Guid=crv_9)  # -> LayerIndex, LayerPathName
reflay = ReferenceByLayer(LayerName=layer.LayerPathName)
reflay_2 = ReferenceByLayer(LayerName=panel_5)

# ----
# 埋件编号tag
panel_8 = Panel("0-0")

# ----
# 导入檐口线
# 注意：如果没有檐口线或没有内测檐口线，一定要确保对应需要导入檐口线curve的区域为空data
xy_6 = XYPlane(Origin=Point(0, 0, 0))
project_6 = Project(Geometry=clscrv.Closed, Plane=xy_6)  # -> Geometry, Transform

clscrv_7 = CloseCurve(Curve=crv_3, CloseType=0, Bulge=0.5, Tolerance=0)  # -> Closed, R

# ---- group: 混凝土
list = ValueList({"C15": 0, "C20": 1, "C25": 2, "C30": 3, "C35": 4, "C40": 5}, selected="C35")

# ---- group: 钢筋牌号
list_2 = ValueList({"HPB300": 0, "HRB400": 1}, selected="HPB300")

# ---- group: 直径
list_3 = ValueList({"10": 0, "12": 1, "16": 2, "18": 3, "20": 4, "25": 5}, selected="12")

# ---- group: 列
list_4 = ValueList({"2X": 0, "3X": 1, "4X": 2}, selected="3X")

# ---- group: 行
# 第二层-阴阳角
# 第二层
# 
# Curves(location point)+ Smooth Curves(architecture line)
list_5 = ValueList({"2Y": 0, "3Y": 1, "4Y": 2}, selected="2Y")

# ---- group: 锚筋间距
s_y = Slider(22, range=14..60, expression="X*5")
s_x = Slider(22, range=14..60, expression="X*5")

# ----
# 第二层-区分阴阳角
# 长
# InsideCurve-阳角
# remove duplicate curves
# 第二层-大面定位
panel_9 = Panel("-175 To 175")

# ----
# 埋件编号tag的Offset
number_slider_5 = Slider(353, range=0..1000)

# ----
# 宽
# InsideCurve-阴角
panel_10 = Panel("-125 To 125")

# ----
# 埋件编号tag
# 板埋几何INPUT
panel_11 = Panel("6-6")

# ----
# (8) 撞到梁交点-Offset
# InsideCurve-大面
# 求内部曲线转折点
# 显示"False"时要选择线段延长
# SmoothCurve-阴角&阳角
# 阳角
# 线段延长长度
# 阴角
# 调换阴阳角设定
number_slider_6 = Slider(450, range=0..1000)

# ----
# （7）生成底埋钢埋件
# 输入
# 
# Embed的Tag命名
# 埋件编号
panel_12 = Panel("5-5")

# ---- group: 参考线起点
number_slider_7 = Slider(0.806, range=0..1)

# ---- group: Dimension Offset Input 2
number_slider_8 = Slider(1000, range=0..1000)

# ---- group: 移除重复位置点-容差
number_slider_9 = Slider(200, range=0..1000)

# ---- group: Dimension Offset Input 1
number_slider_10 = Slider(2000, range=0..10000)

# ---- group: 标注区域-单一轴网
标准范围_符合单一轴网方向 = Curve(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)

# ---- group: 轴网XY2个方向的线
crv_13 = Curve(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)
crv_14 = Curve(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)

# ---- group: 移除重复位置点-容差
number_slider_11 = Slider(200, range=0..1000)

# ---- group: 参考线起点
number_slider_12 = Slider(0.548, range=0..1)

# ---- group: Dimension Offset Input 2
number_slider_13 = Slider(1000, range=0..1000)

# ---- group: Dimension Offset Input 1
number_slider_14 = Slider(2000, range=0..10000)

# ---- group: 标注区域-单一轴网
标准范围_符合单一轴网方向_2 = Curve(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)

# ---- group: 轴网XY2个方向的线
crv_15 = Curve(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)
crv_16 = Curve(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)

# ---- group: 参考线: 符合轴网方向+囊括整个建筑
# (9)Bake Me!!
# 上层图纸-单一区域
crv_17 = Curve(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)

# (9)Bake Me!!
# 下层图纸-单一区域
crv_18 = Curve(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)

# ----
panel_13 = Panel(txt)

xy_7 = XYPlane(Origin=Point(0, 0, 0))
project_7 = Project(Geometry=clscrv_7.Closed, Plane=xy_7)  # -> Geometry, Transform

# ---- group: the Dimension Reference Curve
seam = Seam(Curve=reparameterize(crv_18), Seam=number_slider_7)

# ---- group: The Start Point of the Dimension Reference Curve
eval = EvaluateCurve(Curve=reparameterize(crv_18), Parameter=number_slider_7)  # -> Point, Tangent, Angle

# ---- group: Dimension Style
panel_14 = Panel("图例2-地上$0$XD100$0")

# ---- group: The Start Point of the Dimension Reference Curve
eval_2 = EvaluateCurve(Curve=reparameterize(crv_17), Parameter=number_slider_12)  # -> Point, Tangent, Angle

# ---- group: the Dimension Reference Curve
seam_2 = Seam(Curve=reparameterize(crv_17), Seam=number_slider_12)

# ---- group: Dimension Style
panel_15 = Panel("图例2-地上$0$XD100$0")

# ---- group: Plan B - 根据图层导入 / 定位点的circle
circle = Curve(<curve referenced from the Rhino model>)

# ---- group: Plan B - 根据图层导入
layer_2 = ObjectLayer(Guid=circle)  # -> LayerIndex, LayerPathName

# ---- group: Plan B - 根据图层导入 / Click Me after Input
reflay_3 = ReferenceByLayer(LayerName=layer_2.LayerPathName)

# ----
# 生成Default Embed
cluster = Cluster_3(
    structure_number=panel_7,
    tag_text=panel_8,
    text_offset=number_slider_4,
    embed_color=swatch,
    T=txt,
    A=number_slider,
    A_2=number_slider_3,
    B=number_slider_2,
    dimension_style=panel_4)  # -> R, G_2, R_2
data = Data(flatten(cluster.R_2))
item = ListItem(List=data, Index=0, Wrap=True)  # -> Item, Item1
ungroup = Ungroup(Group=item.Item)
item_2 = ListItem(List=ungroup, Index=0, Wrap=True)
bbox = BoundingBox(Content=item_2, Plane=PlaneXY(0, 0, 0))  # -> Box, Box_2
debrep = DeconstructBrep(Brep=bbox.Box)  # -> Faces, Edges, Vertices
len = Length(Curve=debrep.Edges)
sort = SortList(Keys=len, ValuesA=debrep.Edges)  # -> Keys, ValuesA
pln = Plane(item.Item1)
item_3 = ListItem(List=sort.ValuesA, Index=0, Wrap=True)
deplane = DeconstructPlane(Plane=pln)  # -> Origin, XAxis, YAxis, ZAxis
amp = Amplitude(Vector=deplane.YAxis, Amplitude=item_3)
move = Move(Geometry=deplane.Origin, Motion=amp)  # -> Geometry, Transform
move2pt = MoveToPoint(Geometry=pln, PointA=deplane.Origin, PointB=move.Geometry)  # -> Moved, Vector, Transform

# ---- group: All-下-幕墙线
# 生成下层定位平面
crv_19 = Curve(project_2.Geometry)

# ---- group: 上-幕墙线 - 有内部线
merge = Merge(Data1=project_5.Geometry, Data2=project_7.Geometry)

# ---- group: 上-幕墙线 - 无内部线
# 生成上层定位平面
crv_20 = Curve(project_5.Geometry)

# ---- group: 上层局部幕墙线
crv_21 = Curve(project_4.Geometry)

# ---- group: All-檐口线
# 生成檐口定位平面
merge_2 = Merge(Data1=project_6.Geometry, Data2=crv_2)

# ---- group: 筛选阴阳角的点
crv_22 = Curve(merge_2)
disc = Discontinuity(Curve=graft(crv_22), Level=1)  # -> Points, Parameters
crv_cp = CurveClosestPoint(Point=disc.Points, Curve=graft(crv_22))  # -> Point, Parameter, Distance
eval_3 = EvaluateCurve(Curve=graft(crv_22), Parameter=crv_cp.Parameter)  # -> flatten(Point), Tangent, flatten(Angle)
offset = OffsetCurve(Curve=crv_22, Distance=expr("-X", Slider(300, range=0..1000)), Corners=1)
deg = Degrees(Radians=eval_3.Angle)
larger = LargerThan(FirstNumber=deg, SecondNumber=Slider(70, range=0..100))  # -> LargerThan, OrEqualTo
disc_2 = Discontinuity(Curve=offset, Level=1)  # -> flatten(Points), Parameters
dispatch_4 = Dispatch(List=eval_3.Point, DispatchPattern=larger.LargerThan)  # -> ListA, ListB
dispatch_5 = Dispatch(List=deg, DispatchPattern=larger.LargerThan)  # -> ListA, ListB
data_2 = Data(dispatch_4.ListA)
smaller = SmallerThan(FirstNumber=dispatch_5.ListA, SecondNumber=Slider(100, range=0..100))  # -> SmallerThan, OrEqualTo
dispatch_6 = Dispatch(List=data_2, DispatchPattern=smaller.SmallerThan)  # -> ListA, ListB
data_3 = Data(dispatch_6.ListA)
pull = PullPoint(Point=data_3, Geometry=flatten(offset), ClosestOnly=True)  # -> ClosestPoint, Distance
testpoint = TestPoint(archPoint=pull.ClosestPoint, crvPoint=disc_2.Points)  # -> out, specialPt; inputs archPoint: list of Point3d, crvPoint: list of Point3d
# ---------- testpoint: C# ----------
    List<int> passIndex = new List<int>();

    for(int i = 0; i < archPoint.Count; i++){
      foreach(Point3d t in crvPoint){
        if(archPoint[i].X == t.X && archPoint[i].Y == t.Y && archPoint[i].Z == t.Z){
          Print("pass");
          passIndex.Add(i);}
      }
    }

    specialPt = passIndex;
# ---------- end testpoint ----------

crv_23 = Curve(crv_20)
disc_3 = Discontinuity(Curve=graft(crv_23), Level=1)  # -> Points, Parameters
crv_cp_2 = CurveClosestPoint(Point=disc_3.Points, Curve=graft(crv_23))  # -> Point, Parameter, Distance
eval_4 = EvaluateCurve(Curve=graft(crv_23), Parameter=crv_cp_2.Parameter)  # -> flatten(Point), Tangent, flatten(Angle)
deg_2 = Degrees(Radians=eval_4.Angle)
offset_2 = OffsetCurve(Curve=merge, Distance=expr("-X", Slider(300, range=0..1000)), Corners=1)
larger_2 = LargerThan(FirstNumber=deg_2, SecondNumber=Slider(70, range=0..100))  # -> LargerThan, OrEqualTo
dispatch_7 = Dispatch(List=deg_2, DispatchPattern=larger_2.LargerThan)  # -> ListA, ListB
dispatch_8 = Dispatch(List=eval_4.Point, DispatchPattern=larger_2.LargerThan)  # -> ListA, ListB
disc_4 = Discontinuity(Curve=offset_2, Level=1)  # -> flatten(Points), Parameters
data_4 = Data(dispatch_8.ListA)
smaller_2 = SmallerThan(FirstNumber=dispatch_7.ListA, SecondNumber=Slider(100, range=0..100))  # -> SmallerThan, OrEqualTo
dispatch_9 = Dispatch(List=data_4, DispatchPattern=smaller_2.SmallerThan)  # -> ListA, ListB
data_5 = Data(dispatch_9.ListA)
pull_2 = PullPoint(Point=data_5, Geometry=flatten(offset_2), ClosestOnly=True)  # -> ClosestPoint, Distance
testpoint_2 = TestPoint(archPoint=pull_2.ClosestPoint, crvPoint=disc_4.Points)  # -> out, specialPt; inputs archPoint: list of Point3d, crvPoint: list of Point3d; same code as testpoint

disc_5 = Discontinuity(Curve=graft(crv_19), Level=1)  # -> Points, Parameters
crv_cp_3 = CurveClosestPoint(Point=disc_5.Points, Curve=graft(crv_19))  # -> Point, Parameter, Distance
eval_5 = EvaluateCurve(Curve=graft(crv_19), Parameter=crv_cp_3.Parameter)  # -> flatten(Point), Tangent, flatten(Angle)
offset_3 = OffsetCurve(Curve=crv_19, Distance=expr("-X", Slider(300, range=0..1000)), Corners=1)
deg_3 = Degrees(Radians=eval_5.Angle)
disc_6 = Discontinuity(Curve=offset_3, Level=1)  # -> flatten(Points), Parameters
larger_3 = LargerThan(FirstNumber=deg_3, SecondNumber=Slider(70, range=0..100))  # -> LargerThan, OrEqualTo
dispatch_10 = Dispatch(List=eval_5.Point, DispatchPattern=larger_3.LargerThan)  # -> ListA, ListB
dispatch_11 = Dispatch(List=deg_3, DispatchPattern=larger_3.LargerThan)  # -> ListA, ListB
data_6 = Data(dispatch_10.ListA)
smaller_3 = SmallerThan(FirstNumber=dispatch_11.ListA, SecondNumber=Slider(100, range=0..100))  # -> SmallerThan, OrEqualTo
dispatch_12 = Dispatch(List=data_6, DispatchPattern=smaller_3.SmallerThan)  # -> ListA, ListB

# ---- group: default 钢埋件单体
merge_3 = Merge(Data1=item.Item, Data2=move2pt.Moved)

# ---- group: 阴阳角的点
# 阳角
# 阴角
data_7 = Data(dispatch_12.ListA)

# ---- group: 下层定位点
movetoplane = MoveToPlane(Geometry=crv_10, Plane=PlaneXY(0, 0, 0), Above=True, Below=True)  # -> Geometry, Transform
area_4 = Area(Geometry=movetoplane.Geometry)  # -> Area, Centroid
pt = Point(area_4.Centroid)

# ---- group: 筛选阴阳角的点
# 阳角
item_4 = ListItem(List=data_5, Index=testpoint_2.specialPt, Wrap=True)

# 阴角
cull_i = CullIndex(List=data_5, Indices=testpoint_2.specialPt, Wrap=True)

# 阴角
cull_i_2 = CullIndex(List=data_3, Indices=testpoint.specialPt, Wrap=True)

# 阳角
item_5 = ListItem(List=data_3, Index=testpoint.specialPt, Wrap=True)

# ----
movetoplane_2 = MoveToPlane(Geometry=crv_12, Plane=PlaneXY(0, 0, 0), Above=True, Below=True)  # -> Geometry, Transform
area_5 = Area(Geometry=movetoplane_2.Geometry)  # -> Area, Centroid
pt_2 = Point(area_5.Centroid)

# ---- group: 上层定位点
movetoplane_3 = MoveToPlane(Geometry=crv_11, Plane=PlaneXY(0, 0, 0), Above=True, Below=True)  # -> Geometry, Transform
area_6 = Area(Geometry=movetoplane_3.Geometry)  # -> Area, Centroid
pt_3 = Point(area_6.Centroid)

# ---- group: 阴阳角的点
merge_4 = Merge(Data1=item_4, Data2=cull_i)  # -> flatten(Result)

merge_5 = Merge(Data1=item_5, Data2=cull_i_2)  # -> flatten(Result)

# ----
xy_8 = XYPlane(Origin=Point(0, 0, 0))
xy_9 = XYPlane(Origin=Point(0, 0, 0))
xy_10 = XYPlane(Origin=Point(0, 0, 0))

# ----
# 单体选型
list_6 = ValueList({"顶埋": 0, "侧埋": 1}, selected="顶埋")

# ---- group: F2 Arch Outline
crv_24 = Curve(crv_21)

# ---- group: 檐口线Input
crv_25 = Curve(project_6.Geometry)

crv_26 = Curve(project_6.Geometry)

crv_27 = Curve(project_6.Geometry)

# ----
# 选要重塑的线段长度
number_slider_15 = Slider(1200, range=0..10000)

# ----
# 调整重塑线段的平滑度
number_slider_16 = Slider(11, range=0..11)

# ----
# 区分内外梁边线
# 1.根据F2建筑线制作轮廓线
explode = Explode(Curve=crv_24, Recursive=True)  # -> Segments, Vertices
len_2 = Length(Curve=explode.Segments)
sort_2 = SortList(Keys=len_2)  # -> Keys, ValuesA
larger_4 = LargerThan(FirstNumber=len_2, SecondNumber=number_slider_15)  # -> LargerThan, OrEqualTo
panel_16 = Panel(sort_2.Keys)
dispatch_13 = Dispatch(List=explode.Segments, DispatchPattern=larger_4.LargerThan)  # -> ListA, ListB
join = JoinCurves(Curves=dispatch_13.ListB, Preserve=False)
disc_7 = Discontinuity(Curve=join, Level=1)  # -> Points, Parameters
nurbs = NurbsCurve(Vertices=disc_7.Points, Degree=number_slider_16, Periodic=False)  # -> flatten(Curve), Length, Domain
join_2 = JoinCurves(Curves=flatten([dispatch_13.ListA, nurbs.Curve]), Preserve=False)
offset_4 = OffsetCurve(Curve=join_2, Distance=Slider(10000, range=0..10000), Corners=1)

# ---- group: F2 Archline - Smoothed
reb = RebuildCurve(Curve=offset_4, Count=Slider(17, range=0..100), Tangents=invert(False))

# ----
# InputCurve
crv_28 = Curve()

# ----
# Curve-框住要分析的建筑单体
# 如果要用自己导入Curve作为分析线，
# 请在InputCurve那里导入curve,
# 然后在上方的选型列表选择Input Curve。
# 
# 如果要用Grasshopper自动生成的Curve,
# 请在上方的选型列表选择Default Curve。
list_7 = ValueList({"Default Curve": 0, "Input Curve": 1}, selected="Default Curve")
filter = StreamFilter(Gate=list_7, Stream0=reb, Stream1=crv_28)

data_8 = Data(filter)
crv_29 = Curve(data_8)

# ---- group: 楼板线
crv_30 = Curve(project_3.Geometry)

# ----
# 埋件向内探索最远出的梁的距离
number_slider_17 = Slider(800, range=0..10000)

# ---- group: 檐口线外侧
crv_31 = Curve(project_6.Geometry)

# ---- group: 檐口线内测
crv_32 = Curve(crv_2)

# ---- group: 下层幕墙线
crv_33 = Curve(project.Geometry)

# ---- group: 上层幕墙线
crv_34 = Curve(crv_21)

# ---- group: 檐口线外侧
crv_35 = Curve(crv_27)

# ---- group: 上下幕墙有效点 / 容差
number_slider_18 = Slider(150, range=0..1000)

# ---- group: 檐口线
crv_36 = Curve(crv_27)

# ---- group: 上层幕墙线
crv_37 = Curve(crv_34)

crv_38 = Curve(crv_34)

# ---- group: 下层幕墙线
crv_39 = Curve(crv_33)

# ---- group: 下层Arch Line
# 3.2下层建筑边线内侧300-600mm范围内
crv_40 = Curve(crv_39)

# ---- group: 下层建筑线
# 4.0下层建筑内侧到300到外侧50内
# 无钢结构
# 要求主体结构提供钢结构梁，默认位置为建筑边线向内300mm
crv_41 = Curve(crv_40)

# ----
# 4.0 -初筛： 下层建筑边线内侧600mm到外侧350内没有钢梁
number_slider_19 = Slider(600, range=0..1000)
offset_5 = OffsetCurve(Curve=crv_41, Distance=expr("-x", number_slider_19), Corners=1)
offset_6 = OffsetCurve(Curve=crv_41, Distance=Slider(350, range=0..1000), Corners=1)

crv_42 = Curve(crv_40)
offset_7 = OffsetCurve(Curve=crv_42, Distance=Slider(350, range=0..1000), Corners=1)
offset_8 = OffsetCurve(Curve=crv_42, Distance=Slider(50, range=0..100), Corners=1)

# ---- group: 上层幕墙线
crv_43 = Curve(crv_21)

# ---- group: Arch outline
crv_44 = Curve(data_8)

# ----
# 是否有吊顶：
# 下层幕墙边线在结构边梁以内>350
# 
# （最外层结构线）
number_slider_20 = Slider(350, range=0..1000)

# ---- group: Arch outline
crv_45 = Curve(data_8)

crv_46 = Curve(data_8)

crv_47 = Curve(data_8)

# ---- group: All檐口线
crv_48 = Curve(crv_47)

# ---- group: Arch outline
crv_49 = Curve(crv_47)

# ----
crv_50 = Curve(crv_43)

# ---- group: 建筑线
crv_51 = Curve(filter)

crv_52 = Curve(filter)

# ----
# 生成埋件编号
# 注意：
# 可以选择机动生成or手动输入埋件Tag可以参考下方右侧的”涉及到的梁编号“来手动输入对应的埋件编号
list_8 = ValueList({"机动生成埋件Tags": 0, "手动输入埋件Tags": 1}, selected="机动生成埋件Tags")

# ---- group: 上下幕墙连续
swatch_2 = ColourSwatch(SwatchColor=RGB(255, 242, 66))
panel_17 = Panel("Tag::1-0-01钢板焊埋件")
panel_18 = Panel("Embed::1-0-01钢板焊埋件")

# ----
swatch_3 = ColourSwatch(SwatchColor=RGB(140, 140, 140))
# (9)Bake Me!!
# 埋件和阴阳角定位
panel_19 = Panel("阴阳角定位-F1+F2")

layer_3 = DefineLayer(Name=panel_19, Color=swatch_3)
attributes = DefineObjectAttributes(Layer=layer_3, Color=swatch_3)

# ---- group: 檐口埋件
panel_20 = Panel("Embed::1-1-02钢板焊埋件")
panel_21 = Panel("Tag::1-1-02钢板焊埋件")
swatch_4 = ColourSwatch(SwatchColor=RGB(255, 212, 0))

# ---- group: 有吊顶的范围，檐口处内侧埋件
panel_22 = Panel("Embed::2-1-03钢板焊埋件")
panel_23 = Panel("Tag::2-1-03钢板焊埋件")
swatch_5 = ColourSwatch(SwatchColor=RGB(255, 242, 66))

# ---- group: 框架顶部，埋件在幕墙线外侧
panel_24 = Panel("Embed::3-1-03钢板焊埋件")
panel_25 = Panel("Tag::3-1-03钢板焊埋件")
swatch_6 = ColourSwatch(SwatchColor=RGB(180, 255, 66))

# ---- group: 框架顶部，埋件在幕墙线内侧
panel_26 = Panel("Embed::3-2-03钢板焊埋件")
panel_27 = Panel("Tag::3-2-03钢板焊埋件")
swatch_7 = ColourSwatch(SwatchColor=RGB(66, 255, 69))

# ---- group: 钢结构下底埋
panel_28 = Panel("Embed::4-1钢板焊底埋")
panel_29 = Panel("Tag::4-1钢板焊底埋")
swatch_8 = ColourSwatch(SwatchColor=RGB(66, 255, 236))

# ---- group: 范围内没有钢梁，默认幕墙线向内300有一个埋件
panel_30 = Panel("Embed::4-0-03默认钢板焊")
panel_31 = Panel("Tag::4-0-03默认钢板焊")
swatch_9 = ColourSwatch(SwatchColor=RGB(66, 167, 255))

# ---- group: 幕墙底部接地埋件
panel_32 = Panel("Embed::5-04板埋")
panel_33 = Panel("Tag::5-04板埋")
swatch_10 = ColourSwatch(SwatchColor=RGB(66, 98, 255))

# ----
# 1.1-掩口出侧埋遗漏
panel_34 = Panel("1.1-掩口出侧埋遗漏")
layer_4 = DefineLayer(Name=panel_34)
attributes_2 = DefineObjectAttributes(Layer=layer_4)

layer_5 = DefineLayer(Name=panel_21, Color=swatch_4)
layer_6 = DefineLayer(Name=panel_20, Color=swatch_4)
entwine = Entwine(Branch00=layer_6, Branch01=layer_5, FlattenInputs=True)
attributes_3 = DefineObjectAttributes(Layer=entwine, Color=swatch_4)

layer_7 = DefineLayer(Name=panel_23, Color=swatch_5)
layer_8 = DefineLayer(Name=panel_22, Color=swatch_5)
entwine_2 = Entwine(Branch00=layer_8, Branch01=layer_7, FlattenInputs=True)
attributes_4 = DefineObjectAttributes(Layer=entwine_2, Color=swatch_5)

layer_9 = DefineLayer(Name=panel_17, Color=swatch_2)
layer_10 = DefineLayer(Name=panel_18, Color=swatch_2)
entwine_3 = Entwine(Branch00=layer_10, Branch01=layer_9, FlattenInputs=True)
attributes_5 = DefineObjectAttributes(Layer=entwine_3, Color=swatch_2)

layer_11 = DefineLayer(Name=panel_25, Color=swatch_6)
layer_12 = DefineLayer(Name=panel_24, Color=swatch_6)
entwine_4 = Entwine(Branch00=layer_12, Branch01=layer_11, FlattenInputs=True)
attributes_6 = DefineObjectAttributes(Layer=entwine_4, Color=swatch_6)

layer_13 = DefineLayer(Name=panel_27, Color=swatch_7)
layer_14 = DefineLayer(Name=panel_26, Color=swatch_7)
entwine_5 = Entwine(Branch00=layer_14, Branch01=layer_13, FlattenInputs=True)
attributes_7 = DefineObjectAttributes(Layer=entwine_5, Color=swatch_7)

layer_15 = DefineLayer(Name=panel_29, Color=swatch_8)
layer_16 = DefineLayer(Name=panel_28, Color=swatch_8)
entwine_6 = Entwine(Branch00=layer_16, Branch01=layer_15, FlattenInputs=True)
attributes_8 = DefineObjectAttributes(Layer=entwine_6, Color=swatch_8)

layer_17 = DefineLayer(Name=panel_33, Color=swatch_10)
layer_18 = DefineLayer(Name=panel_32, Color=swatch_10)
entwine_7 = Entwine(Branch00=layer_18, Branch01=layer_17, FlattenInputs=True)
attributes_9 = DefineObjectAttributes(Layer=entwine_7, Color=swatch_10)

layer_19 = DefineLayer(Name=panel_31, Color=swatch_9)
layer_20 = DefineLayer(Name=panel_30, Color=swatch_9)
entwine_8 = Entwine(Branch00=layer_20, Branch01=layer_19, FlattenInputs=True)
attributes_10 = DefineObjectAttributes(Layer=entwine_8, Color=swatch_9)

# ----
# 板埋：制作板埋三视图
max = Maximum(A=s_x, B=s_y)
filter_2 = StreamFilter(Gate=list, Stream0=7.2, Stream1=9.6, Stream2=11.9, Stream3=14.3, Stream4=16.7, Stream5=19.1)
filter_3 = StreamFilter(Gate=list_2, Stream0=270, Stream1=360)
filter_4 = StreamFilter(Gate=list_3, Stream0=10, Stream1=12, Stream2=16, Stream3=18, Stream4=20, Stream5=25)
filter_5 = StreamFilter(Gate=list, Stream0=0.91, Stream1=1.1, Stream2=1.27, Stream3=1.43, Stream4=1.57, Stream5=1.71)
filter_6 = StreamFilter(Gate=list_2, Stream0=0.16, Stream1=0.14)
addition = Addition(A=list_4, B=1)
addition_2 = Addition(A=list_5, B=1)
division = Division(A=max, B=8)
t = Integer(division)
panel_35 = Panel(filter_5)
panel_36 = Panel(filter_2)
panel_37 = Panel(filter_6)
min = Minimum(A=filter_3, B=300)
panel_38 = Panel(min)
expression = Expression(A=filter_6, fy=filter_3, ft=filter_5, d=filter_4, Expression="(int((0.6*1.1*A*fy/ft*d)/5)+1)*5")

# ----
# 生成底埋钢埋件
rectangle = Rectangle(Plane=PlaneXY(0, 0, 0), XSize=panel_9, YSize=panel_10, Radius=0)  # -> Rectangle, Length
pln_2 = Plane(rectangle.Rectangle)
rec = Rectangle(rectangle.Rectangle)

deplane_2 = DeconstructPlane(Plane=pln_2)  # -> Origin, XAxis, YAxis, ZAxis
dedomain = DeconstructDomain(Domain=panel_10)  # -> Start, End
amp_2 = Amplitude(Vector=deplane_2.YAxis, Amplitude=dedomain.End)
move_2 = Move(Geometry=deplane_2.Origin, Motion=amp_2)  # -> Geometry, Transform
ln = Line(StartPoint=deplane_2.Origin, EndPoint=move_2.Geometry)
amp_3 = Amplitude(Vector=ln, Amplitude=Slider(190, range=0..1000))
move_3 = Move(Geometry=deplane_2.Origin, Motion=amp_3)  # -> Geometry, Transform

text = DefineTextObject(Text=panel_12, Plane=move_3.Geometry, DimensionStyle=panel_4, OutputType="Text")
group = Group(Objects=[rec, text])

# ---- group: 底埋埋件单体
merge_6 = Merge(Data1=group, Data2=pln_2)

# ----
crv_53 = Curve(project_4.Geometry)
panel_39 = Panel("""Dimension::Dim1
Dimension::Dim2
Dimension::Dim3
Dimension::Dim4""")
layer_21 = DefineLayer(Name=panel_39)  # -> graft(Layer)
attributes_11 = DefineObjectAttributes(Layer=layer_21)

crv_54 = Curve(project_4.Geometry)
panel_40 = Panel("""Dimension::Dim1
Dimension::Dim2
Dimension::Dim3
Dimension::Dim4""")
layer_22 = DefineLayer(Name=panel_40)  # -> graft(Layer)
attributes_12 = DefineObjectAttributes(Layer=layer_22)

# ---- group: 根据color分类梁和tags
rhatt = GetRhinoAttributes(Geometry=reflay)  # -> Name, Layer, Color
C = CreateSet(Data=rhatt.Color)  # -> Data, Map, Number
panel_41 = Panel(C.Data)
filtercolor = FilterByColor(Geometry=reflay_2, Color=C.Data)  # -> simplify(Geometry)
detext = DeconstructText(TextObject=filtercolor)  # -> Text, Plane, Height, Justification

# ---- group: 根据color分类梁和tags / Beam
filtercolor_2 = FilterByColor(Geometry=reflay, Color=C.Data)  # -> simplify(Geometry)

# ---- group: 根据color分类梁和tags (continued)
crv_55 = Curve(filtercolor_2)

# ---- group: Create Tags
tstat = TreeStatistics(Tree=detext.Text)  # -> Paths, Length, Count
series = Series(Start="1", Step=1, Count=tstat.Count)
concat = Concatenate(FragmentA=series, FragmentB="-")
concat_2 = Concatenate(FragmentA=concat, FragmentB=series)  # -> simplify(graft(Result))

# ----
filter_7 = StreamFilter(Gate=list_8, Stream0=concat_2, Stream1=simplify(graft(panel_6)))

# ----
# 埋件Tag预览
panel_42 = Panel(filter_7)

# ---- group: Text
item_6 = ListItem(List=detext.Text, Index=0, Wrap=True)

# ----
# 涉及到的梁编号
panel_43 = Panel(item_6)

cluster_2 = Cluster_4(
    T=txt,
    T_2=item_6,
    A=number_slider,
    B=number_slider_3,
    A_2=number_slider_3,
    B_2=number_slider_2,
    A_3=number_slider,
    B_3=number_slider_3,
    B_4=number_slider_3,
    B_5=number_slider_3)  # -> i, relay, i_2, R, i_3, I_2, I, I_4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

# ---- group: 筛选定位点里的阴阳角
pull_3 = PullPoint(Point=flatten(pt), Geometry=graft(data_7), ClosestOnly=True)  # -> ClosestPoint, Distance
sort_3 = SortList(Keys=pull_3.Distance, ValuesA=flatten(pt))  # -> Keys, ValuesA
item_7 = ListItem(List=sort_3.Keys, Index=0, Wrap=True)  # -> Item, Item1
item_8 = ListItem(List=sort_3.ValuesA, Index=0, Wrap=True)  # -> Item, Item1
merge_7 = Merge(Data1=item_7.Item, Data2=item_7.Item1)
merge_8 = Merge(Data1=item_8.Item, Data2=item_8.Item1)
panel_44 = Panel(merge_7)
smaller_4 = SmallerThan(FirstNumber=merge_7, SecondNumber="100")  # -> SmallerThan, OrEqualTo
dispatch_14 = Dispatch(List=merge_8, DispatchPattern=smaller_4.SmallerThan)  # -> ListA, ListB
crv_56 = Curve(flatten(offset_3))

# ---- group: 筛选定位点里的阴阳角 / F1-阴阳角-点
data_9 = Data(dispatch_14.ListA)

# ---- group: 下-阴阳角
data_10 = Data(data_9)

# ---- group: 筛选定位点里的阴阳角 (continued)
check_same_points = CheckSamePoints(archPoint=flatten(pt), crvPoint=flatten(data_9))  # -> out, specialPt; inputs archPoint: list of Point3d, crvPoint: list of Point3d; same code as testpoint
cull_i_3 = CullIndex(List=flatten(pt), Indices=check_same_points.specialPt, Wrap=True)
pull_4 = PullPoint(Point=cull_i_3, Geometry=crv_56, ClosestOnly=True)  # -> ClosestPoint, Distance
ln_2 = Line(StartPoint=pull_4.ClosestPoint, EndPoint=cull_i_3)
rotate = Rotate(Geometry=ln_2, Angle=1.570796327, Plane=cull_i_3)  # -> Geometry, Transform
pl = ConstructPlane(Origin=cull_i_3, XAxis=rotate.Geometry, YAxis=ln_2)

# ----
project_8 = Project(Geometry=pl, Plane=xy_8)  # -> Geometry, Transform

# ---- group: 下层定位点Plane-去阴阳角
pln_3 = Plane(project_8.Geometry)

# ---- group: 下层定位平面-All
pln_4 = Plane(pln_3)

# ----
# 1.是否有檐口线-下层定位点
toggle = BooleanToggle(True)
clean = CleanTree(RemoveNulls=True, RemoveInvalid=True, RemoveEmpty=toggle, Tree=pln_4)
deplane_3 = DeconstructPlane(Plane=clean)  # -> Origin, XAxis, YAxis, ZAxis
incurve = PointInCurve(Point=deplane_3.Origin, Curve=crv_25)  # -> Relationship, Point
equals = Equality(FirstNumber=incurve.Relationship, SecondNumber="2")  # -> Equality, Inequality
dispatch_15 = Dispatch(List=clean, DispatchPattern=equals.Equality)  # -> ListA, ListB

# ----
# Site - 有檐口线的定位点
pln_5 = Plane(dispatch_15.ListA)

# ----
# Site - 无檐口线的定位点
pln_6 = Plane(dispatch_15.ListB)

# ---- group: 檐口线-Site
pln_7 = Plane(pln_5)

# ----
incurve_2 = PointInCurve(Point=pln_7, Curve=crv_29)  # -> Relationship, Point
equals_2 = Equality(FirstNumber=incurve_2.Relationship, SecondNumber="2")  # -> Equality, Inequality
dispatch_16 = Dispatch(List=pln_7, DispatchPattern=equals_2.Equality)  # -> ListA, ListB

incurve_3 = PointInCurve(Point=pln_6, Curve=crv_29)  # -> Relationship, Point
equals_3 = Equality(FirstNumber=incurve_3.Relationship, SecondNumber="2")  # -> Equality, Inequality
dispatch_17 = Dispatch(List=pln_6, DispatchPattern=equals_3.Equality)  # -> ListA, ListB

# ---- group: 建筑单体-下层-有檐口线定位点
pln_8 = Plane(dispatch_16.ListA)

# ---- group: 建筑单体-下层-无檐口线定位点
pln_9 = Plane(dispatch_17.ListA)

# ----
# 1.0无檐口线初筛-下层定位点
pln_10 = Plane(pln_9)

# ----
# 板埋Modeling
multiplication = Multiplication(A=s_x, B=addition)
multiplication_2 = Multiplication(A=s_y, B=addition_2)
recgrid = Rectangular(Plane=PlaneXY(0, 0, 0), SizeX=s_x, SizeY=s_y, ExtentX=addition, ExtentY=addition_2)  # -> Cells, Points
直径 = Text(filter_4)
division_2 = Division(A=multiplication, B=2)
division_3 = Division(A=multiplication_2, B=2)
vec = VectorXYZ(XComponent=expr("-x", division_2), YComponent=expr("-x", division_3), ZComponent=0)  # -> Vector, Length
move_4 = Move(Geometry=recgrid.Points, Motion=vec.Vector)  # -> Geometry, Transform
division_4 = Division(A=直径, B=2)
cyl = Cylinder(Base=move_4.Geometry, Radius=division_4, Length=expr("-x", expression))
X = UnitX(Factor=直径)
multiplication_3 = Multiplication(A=直径, B=6)
edges = BrepEdges(Brep=cyl)  # -> Naked, Interior, NonManifold
item_9 = ListItem(List=edges.Naked, Index=0, Wrap=True)
max_2 = Maximum(A=multiplication_3, B=70)
move_5 = Move(Geometry=item_9, Motion=X)  # -> Geometry, Transform
multiplication_4 = Multiplication(A=max_2, B=2)
addition_3 = Addition(A=multiplication, B=multiplication_4)
addition_4 = Addition(A=multiplication_2, B=multiplication_4)
division_5 = Division(A=t, B=2)
expression_2 = Expression(x=addition_4, Expression="Ceiling(x/10)*10/2")
expression_3 = Expression(x=addition_3, Expression="Ceiling(x/10)*10/2")
round = Round(Number=division_5)  # -> Nearest, Floor, Ceiling
multiplication_5 = Multiplication(A=round.Ceiling, B=2)
dom = ConstructDomain(DomainStart=expr("-x", expression_2), DomainEnd=expression_2)
dom_2 = ConstructDomain(DomainStart=expr("-x", expression_3), DomainEnd=expression_3)
box = DomainBox(Base=PlaneXY(0, 0, 0), X=dom_2, Y=dom, Z=multiplication_5)
Z = UnitZ(Factor=expr("-x", multiplication_5))

# ----
# 生成All Embed - Steel
tstat_2 = TreeStatistics(Tree=cluster_2.i)  # -> Paths, Length, Count
钢肋板倒角_侧视图 = Rectangle(Plane=PlaneXY(0, 0, 0), XSize=cluster_2.I_5, YSize=cluster_2.I_6, Radius=0)  # -> Rectangle, Length
钢肋板_侧视图 = Rectangle(Plane=PlaneXY(0, 0, 0), XSize=cluster_2.I_4, YSize=cluster_2.I_3, Radius=0)  # -> Rectangle, Length
repeat = RepeatData(Data=cluster_2.pl, Length=tstat_2.Length)  # -> simplify(Data)
merge_9 = Merge(Data1=simplify(钢肋板_侧视图.Rectangle), Data2=simplify(repeat), Data3=simplify(钢肋板倒角_侧视图.Rectangle))
钢埋板_侧视图 = Rectangle(Plane=PlaneXY(0, 0, 0), XSize=cluster_2.I, YSize=cluster_2.I_2, Radius=0)  # -> Rectangle, Length
division_6 = Division(A=cluster_2.relay, B="2")
subtraction = Subtraction(A=division_6, B=cluster_2.i_3)
xz = XZPlane(Origin=Point(0, 0, 0))
division_7 = Division(A=cluster_2.i_2, B=2)
repeat_2 = RepeatData(Data=钢埋板_侧视图.Rectangle, Length=tstat_2.Length)  # -> simplify(Data)
mirror = Mirror(Geometry=merge_9, Plane=xz)  # -> Geometry, Transform
addition_5 = Addition(A=subtraction, B=Slider(200, range=0..1000))
addition_6 = Addition(A=addition_5, B=cluster_2.R)
merge_10 = Merge(Data1=repeat_2, Data2=merge_9, Data3=mirror.Geometry)
X_2 = UnitX(Factor=addition_6)
txt_2 = Text(item_6)
col = Colour(simplify(graft(C.Data)))
concat_3 = Concatenate(FragmentA="Embed", FragmentB=txt_2)
attributes_13 = DefineObjectAttributes(Color=col)
xy_11 = XYPlane(Origin=Point(0, 0, 0))
dedomain_2 = DeconstructDomain(Domain=cluster_2.I_2)  # -> Start, End
multiplication_6 = Multiplication(A=dedomain_2.Start, B=dedomain_2.Start)
txt_3 = Text(filter_7)
project_9 = Project(Geometry=crv_55, Plane=xy_11)  # -> Geometry, Transform

# ---- group: 所以钢埋件geo
move_6 = Move(Geometry=merge_10, Motion=X_2)  # -> Geometry, Transform

# ---- group: 对齐geo
group_2 = Group(Objects=move_6.Geometry)
rotate_2 = Rotate(Geometry=group_2, Angle=3.141592654, Plane=PlaneXY(0, 0, 0))  # -> Geometry, Transform
boxprop = BoxProperties(Box=rotate_2.Geometry)  # -> Center, Diagonal, Area, Volume, Degeneracy
bbox_2 = BoundingBox(Content=rotate_2.Geometry, Plane=PlaneXY(0, 0, 0))  # -> Box, Box_2
debox = DeconstructBox(Box=bbox_2.Box)  # -> Plane, X, Y, Z
pdecon = Deconstruct(Point=boxprop.Center)  # -> XComponent, YComponent, ZComponent
dedomain_3 = DeconstructDomain(Domain=debox.Y)  # -> Start, End
pt_4 = ConstructPoint(XCoordinate=pdecon.XComponent, YCoordinate=dedomain_3.Start, ZCoordinate=pdecon.ZComponent)
xy_12 = XYPlane(Origin=Point(0, 0, 0))
pl_origin = PlaneOrigin(Base=xy_12, Origin=pt_4)
orient = Orient(Geometry=rotate_2.Geometry, Source=pl_origin, Target=xy_12)  # -> Geometry, Transform
ungroup_2 = Ungroup(Group=orient.Geometry)  # -> simplify(Objects)

# ----
# 要连接的梁中线Offest值
num = Number(simplify(division_7))

# ----
# 要连接的梁中线curve
crv_57 = Curve(project_9.Geometry)

# ---- group: 梁Offset
num_2 = Number(num)

# ---- group: 梁中线
crv_58 = Curve(crv_57)

# ---- group: 梁中线-中点
midpt = CurveMiddle(Curve=crv_58)

# ---- group: 梁中线
crv_59 = Curve(crv_58)

crv_60 = Curve(crv_59)

# ----
multiplication_7 = Multiplication(A=直径, B=5)

Z_2 = UnitZ(Factor=multiplication_7)
extr = Extrude(Base=move_5.Geometry, Direction=Z_2)
cap = CapHoles(Brep=[extr, cyl])
merge_11 = Merge(Data1=cap, Data2=box)
flatten = FlattenTree(Tree=merge_11, Path="{0}")
move_7 = Move(Geometry=flatten, Motion=Z)  # -> Geometry, Transform

# ---- group: 筛选阴阳角
pull_5 = PullPoint(Point=flatten(pt_2), Geometry=graft(merge_5), ClosestOnly=True)  # -> ClosestPoint, Distance
sort_4 = SortList(Keys=pull_5.Distance, ValuesA=flatten(pt_2))  # -> Keys, ValuesA
item_10 = ListItem(List=sort_4.Keys, Index=0, Wrap=True)  # -> Item, Item1
item_11 = ListItem(List=sort_4.ValuesA, Index=0, Wrap=True)  # -> Item, Item1
merge_12 = Merge(Data1=item_10.Item, Data2=item_10.Item1)
merge_13 = Merge(Data1=item_11.Item, Data2=item_11.Item1)
panel_45 = Panel(merge_12)
smaller_5 = SmallerThan(FirstNumber=merge_12, SecondNumber="100")  # -> SmallerThan, OrEqualTo
dispatch_18 = Dispatch(List=merge_13, DispatchPattern=smaller_5.SmallerThan)  # -> ListA, ListB
crv_61 = Curve(flatten(offset))

# ---- group: 筛选阴阳角 / F1-阴阳角-点
data_11 = Data(dispatch_18.ListA)

# ---- group: 筛选阴阳角 (continued)
check_same_points_2 = CheckSamePoints(archPoint=flatten(pt_2), crvPoint=flatten(data_11))  # -> out, specialPt; inputs archPoint: list of Point3d, crvPoint: list of Point3d; same code as testpoint
cull_i_4 = CullIndex(List=flatten(pt_2), Indices=check_same_points_2.specialPt, Wrap=True)
pull_6 = PullPoint(Point=cull_i_4, Geometry=crv_61, ClosestOnly=True)  # -> ClosestPoint, Distance
ln_3 = Line(StartPoint=pull_6.ClosestPoint, EndPoint=cull_i_4)
rotate_3 = Rotate(Geometry=ln_3, Angle=1.570796327, Plane=cull_i_4)  # -> Geometry, Transform
pl_2 = ConstructPlane(Origin=cull_i_4, XAxis=rotate_3.Geometry, YAxis=ln_3)

# ----
project_10 = Project(Geometry=pl_2, Plane=xy_9)  # -> Geometry, Transform

# ---- group: 檐口定位点Plane-去阴阳角
pln_11 = Plane(project_10.Geometry)

# ---- group: 檐口定位平面-All
pln_12 = Plane(pln_11)

# ---- group: 筛选定位点里的阴阳角
pull_7 = PullPoint(Point=flatten(pt_3), Geometry=graft(merge_4), ClosestOnly=True)  # -> ClosestPoint, Distance
sort_5 = SortList(Keys=pull_7.Distance, ValuesA=flatten(pt_3))  # -> Keys, ValuesA
item_12 = ListItem(List=sort_5.Keys, Index=0, Wrap=True)  # -> Item, Item1
item_13 = ListItem(List=sort_5.ValuesA, Index=0, Wrap=True)  # -> Item, Item1
merge_14 = Merge(Data1=item_12.Item, Data2=item_12.Item1)
merge_15 = Merge(Data1=item_13.Item, Data2=item_13.Item1)
panel_46 = Panel(merge_14)
smaller_6 = SmallerThan(FirstNumber=merge_14, SecondNumber="100")  # -> SmallerThan, OrEqualTo
dispatch_19 = Dispatch(List=merge_15, DispatchPattern=smaller_6.SmallerThan)  # -> ListA, ListB
crv_62 = Curve(flatten(offset_2))

# ---- group: 筛选定位点里的阴阳角 / F1-阴阳角-点
data_12 = Data(dispatch_19.ListA)

# ---- group: 上-阴阳角
pt_5 = Point(data_12)

# ----
merge_16 = Merge(Data1=data_10, Data2=pt_5)

bake = BakeObjects(Geometry=merge_16, Attributes=attributes, BakeName=panel_19, Bake=False)

# ---- group: 筛选定位点里的阴阳角 (continued)
check_same_points_3 = CheckSamePoints(archPoint=flatten(pt_3), crvPoint=flatten(data_12))  # -> out, specialPt; inputs archPoint: list of Point3d, crvPoint: list of Point3d; same code as testpoint
cull_i_5 = CullIndex(List=flatten(pt_3), Indices=check_same_points_3.specialPt, Wrap=True)
pull_8 = PullPoint(Point=cull_i_5, Geometry=crv_62, ClosestOnly=True)  # -> ClosestPoint, Distance
ln_4 = Line(StartPoint=pull_8.ClosestPoint, EndPoint=cull_i_5)
rotate_4 = Rotate(Geometry=ln_4, Angle=1.570796327, Plane=cull_i_5)  # -> Geometry, Transform
pl_3 = ConstructPlane(Origin=cull_i_5, XAxis=rotate_4.Geometry, YAxis=ln_4)

# ----
project_11 = Project(Geometry=pl_3, Plane=xy_10)  # -> Geometry, Transform

# ---- group: 上层定位点Plane-去阴阳角
pln_13 = Plane(project_11.Geometry)

# ---- group: 上层定位平面-All
pln_14 = Plane(pln_13)

# ----
# 三视图
# hidden lines of top+pers view
# move to center
# 如果无法完整的生成埋件的三视图，
# 建议选择埋件的3D在Rhino中将
# Top/Perspective/Front/Right 试图缩放至合适大小后重新运行
panel_47 = Panel("""Top
Perspective
Front
Right""")
m2d_rhino = Make2DRhinoView(Name=panel_47, Clip=True)
number_slider_21 = Slider(1, range=0..10)
pt_6 = Point(Point(957.9296072, 367.7685097, 0))
pt_7 = Point("0,0,0")
recgrid_2 = Rectangular(
    Plane=pt_6,
    SizeX=Slider(12, range=1..20, expression="X*50"),
    SizeY=Slider(10, range=1..20, expression="X*50"),
    ExtentX=number_slider_21,
    ExtentY=number_slider_21)  # -> Cells, Points
flatten_2 = FlattenTree(Tree=recgrid_2.Points, Path="{0}")

# ----
# （6）生成板埋埋件
# 注意：
# 1.记得点一下Compute按钮
# 2.如果无法完整的生成埋件的三视图，
# 建议选择埋件的3D在Rhino中将
# Top/Perspective/Front/Right 试图缩放至合适大小后重新运行
make2d = Make2D(Geometry=move_7.Geometry, View=m2d_rhino, TangentEdges=False, TangentSeams=False, AutoComputeMake2D=False)  # -> VisibleCurves, VisibleIndex, VisibleType, HiddenCurves, HiddenIndex, HiddenType

bang = ExplodeTree(Data=make2d.VisibleCurves)  # -> Branch0, Branch1, Branch2, Branch3, Branch4, Branch5, Branch6, Branch7
divdist = DivideDistance(Curve=make2d.HiddenCurves, Distance=Slider(1, range=0..10))  # -> Points, Tangents, Parameters
graft = GraftTree(Tree=make2d.HiddenCurves, IncludeEmptyLists=True, IncludeNullItems=True)
shatter = Shatter(Curve=graft, Parameters=divdist.Parameters)
dispatch_20 = Dispatch(List=shatter, DispatchPattern=[True, False])  # -> ListA, ListB
crv_63 = Curve(dispatch_20.ListA)
pshift = ShiftPaths(Data=crv_63, Offset=-1)
pshift_2 = ShiftPaths(Data=pshift, Offset=-1)
bang_2 = ExplodeTree(Data=pshift_2)  # -> Branch0, Branch1, Branch2, Branch3, Branch4, Branch5, Branch6, Branch7
entwine_9 = Entwine(Branch00=bang_2.Branch0, Branch01=bang.Branch0, FlattenInputs=True)  # -> flatten(Result)
entwine_10 = Entwine(Branch00=bang_2.Branch1, Branch01=bang.Branch1, FlattenInputs=True)  # -> flatten(Result)
entwine_11 = Entwine(Branch00=entwine_9, Branch01=entwine_10, Branch02=bang.Branch2, Branch03=bang.Branch3, FlattenInputs=True)
group_3 = Group(Objects=entwine_11)
pshift_3 = ShiftPaths(Data=group_3, Offset=-1)
pshift_4 = ShiftPaths(Data=group_3, Offset=-1)
boxprop_2 = BoxProperties(Box=pshift_3)  # -> Center, Diagonal, Area, Volume, Degeneracy
vec2pt = Vector2Pt(PointA=boxprop_2.Center, PointB=pt_7, Unitize=False)  # -> Vector, Length
move_8 = Move(Geometry=pshift_4, Motion=vec2pt.Vector)  # -> flatten(Geometry), Transform
orient_2 = Orient(Geometry=flatten(move_8.Geometry), Source=PlaneXY(0, 0, 0), Target=flatten_2)  # -> Geometry, Transform
cull_i_6 = CullIndex(List=orient_2.Geometry, Indices="-1", Wrap=True)
split = SplitList(List=cull_i_6, Index="4")  # -> ListA, ListB
geo = Geometry(split.ListA)

# ---- group: 单体定Top/Side
item_14 = ListItem(List=geo, Index=Slider(0, range=0..10), Wrap=True)
item_15 = ListItem(List=geo, Index=2, Wrap=True)
cluster_3 = Cluster(G=item_14)
cluster_4 = Cluster(G=item_15)

# ----
block = DefineBlock(Geometry=ungroup_2, Attributes=attributes_13, BlockName=concat_3, BasePlane=PlaneXY(0, 0, 0))
deblock = DeconstructBlock(Block=block)  # -> Name, Plane, Geometry
group_4 = Group(Objects=deblock.Geometry)
bbox_3 = BoundingBox(Content=group_4, Plane=PlaneXY(0, 0, 0))  # -> Box, Box_2
deplane_4 = DeconstructPlane(Plane=deblock.Plane)  # -> Origin, XAxis, YAxis, ZAxis
area_7 = Area(Geometry=bbox_3.Box)  # -> Area, Centroid
move2pt_2 = MoveToPoint(Geometry=deplane_4.Origin, PointA=deplane_4.Origin, PointB=area_7.Centroid)  # -> Moved, Vector, Transform
pl_4 = ConstructPlane(Origin=move2pt_2.Moved, XAxis=deplane_4.YAxis, YAxis=deplane_4.XAxis)
deplane_5 = DeconstructPlane(Plane=pl_4)  # -> Origin, XAxis, YAxis, ZAxis
rotate_5 = Rotate(Geometry=pl_4, Angle="Pi", Plane=pl_4)  # -> Geometry, Transform
amp_4 = Amplitude(Vector=deplane_5.YAxis, Amplitude=multiplication_6)
move_9 = Move(Geometry=deplane_5.Origin, Motion=amp_4)  # -> Geometry, Transform
srf = Surface(bbox_3.Box)
crv_64 = Curve(srf)
ln_5 = Line(StartPoint=move_9.Geometry, EndPoint=deplane_5.Origin)
ccx = CurveCurve(CurveA=ln_5, CurveB=crv_64)  # -> Points, ParamsA, ParamsB
ln_6 = Line(StartPoint=deplane_5.Origin, EndPoint=ccx.Points)
move_10 = Move(Geometry=rotate_5.Geometry, Motion=ln_6)  # -> simplify(Geometry), Transform
amp_5 = Amplitude(Vector=ln_6, Amplitude=expr("-x", number_slider_4))
move_11 = Move(Geometry=move_10.Geometry, Motion=amp_5)  # -> Geometry, Transform

# ---- group: 生成埋件定位plane
neg = Negative(Value=multiplication_6)
amp_6 = Amplitude(Vector=deplane_5.YAxis, Amplitude=neg)
move_12 = Move(Geometry=deplane_5.Origin, Motion=amp_6)  # -> Geometry, Transform
ln_7 = Line(StartPoint=move_12.Geometry, EndPoint=deplane_5.Origin)
ccx_2 = CurveCurve(CurveA=ln_7, CurveB=crv_64)  # -> Points, ParamsA, ParamsB
ln_8 = Line(StartPoint=deplane_5.Origin, EndPoint=ccx_2.Points)
move_13 = Move(Geometry=rotate_5.Geometry, Motion=ln_8)  # -> simplify(Geometry), Transform

# ---- group: tag
text_2 = DefineTextObject(Text=txt_3, Plane=simplify(move_11.Geometry), DimensionStyle=panel_4, OutputType="Text")
group_5 = Group(Objects=[block, text_2])

# ----
merge_17 = Merge(Data1=group_5, Data2=move_13.Geometry)

# ----
# 要连接的embed
data_13 = Data(merge_17)

# ----
# 要连接的梁中线Offest值
# 要连接的梁中线curve
# 要连接的embed
data_14 = Data(data_13)
item_16 = ListItem(List=data_14, Index=0, Wrap=True)
item_17 = ListItem(List=data_14, Index="-1", Wrap=True)
data_15 = Data(data_13)
item_18 = ListItem(List=data_15, Index="-1", Wrap=True)
# 第一层
# 
# Curves(location point)+ Smooth Curves(architecture line)
# 测试Smooth Curve是否与每个Block相切
# blocks + smooth curves
# remove duplicate blocks
# blocks + special curves
# 测试Smooth Curve是否与每个Block相切
# blocks + smooth curves
# remove duplicate blocks
# blocks + special curves
# 第一层
# 
# Angular Curves(architecture line)
# 第一层
# 
# Special Curves(architecture line)
# 第一层
# 
# Angular Curves(architecture line)
item_19 = ListItem(List=data_15, Index=0, Wrap=True)
data_16 = Data(data_13)
# 阳角
# 阴角
# 转角点
item_20 = ListItem(List=data_16, Index=0, Wrap=True)
item_21 = ListItem(List=data_16, Index="-1", Wrap=True)
rotate_6 = Rotate(Geometry=item_21, Angle="Pi", Plane=item_21)  # -> Geometry, Transform
data_17 = Data(data_13)
data_18 = Data(data_13)
item_22 = ListItem(List=data_17, Index=0, Wrap=True)
item_23 = ListItem(List=data_17, Index="-1", Wrap=True)
item_24 = ListItem(List=data_18, Index=0, Wrap=True)
item_25 = ListItem(List=data_18, Index="-1", Wrap=True)
rotate_7 = Rotate(Geometry=item_23, Angle="Pi", Plane=item_23)  # -> Geometry, Transform

ungroup_3 = Ungroup(Group=cluster_4)
ungroup_4 = Ungroup(Group=cluster_3)

# ---- group: Top/Side
filter_8 = StreamFilter(Gate=list_6, Stream0=ungroup_4, Stream1=ungroup_3)

# ---- group: Block
attributes_14 = DefineObjectAttributes(Color=ColourSwatch(SwatchColor=RGB(255, 0, 0)))
block_2 = DefineBlock(Geometry=ungroup_4, Attributes=attributes_14, BlockName="Board Plate", BasePlane=PlaneXY(0, 0, 0))

# ----
deblock_2 = DeconstructBlock(Block=block_2)  # -> Name, flatten(Plane), flatten(Geometry)
boundary = BoundarySurfaces(Edges=deblock_2.Geometry)
deplane_6 = DeconstructPlane(Plane=deblock_2.Plane)  # -> Origin, XAxis, YAxis, ZAxis
area_8 = Area(Geometry=boundary)  # -> Area, Centroid
move2pt_3 = MoveToPoint(Geometry=flatten(deplane_6.Origin), PointA=flatten(deplane_6.Origin), PointB=flatten(area_8.Centroid))  # -> Moved, Vector, Transform
pl_5 = ConstructPlane(Origin=move2pt_3.Moved, XAxis=deplane_6.XAxis, YAxis=deplane_6.YAxis)  # -> graft(Plane)

deplane_7 = DeconstructPlane(Plane=deblock_2.Plane)  # -> Origin, XAxis, YAxis, ZAxis
amp_7 = Amplitude(Vector=deplane_7.YAxis, Amplitude=number_slider_5)
move_14 = Move(Geometry=deplane_7.Origin, Motion=amp_7)  # -> Geometry, Transform

text_3 = DefineTextObject(Text=panel_11, Plane=move_14.Geometry, DimensionStyle=panel_4, OutputType="Text")
group_6 = Group(Objects=flatten([block_2, text_3]))

# ---- group: 板埋埋件单体
entwine_12 = Entwine(Branch00=group_6, Branch01=pl_5, FlattenInputs=True)

# ----
data_19 = Data(flatten(entwine_12))
item_26 = ListItem(List=data_19, Index=0, Wrap=True)
item_27 = ListItem(List=data_19, Index="-1", Wrap=True)

ungroup_5 = Ungroup(Group=item_26)
item_28 = ListItem(List=ungroup_5, Index="-1", Wrap=True)
deblock_3 = DeconstructBlock(Block=item_28)  # -> Name, Plane, Geometry
boundary_2 = BoundarySurfaces(Edges=deblock_3.Geometry)
debrep_2 = DeconstructBrep(Brep=boundary_2)  # -> Faces, Edges, Vertices
len_3 = Length(Curve=debrep_2.Edges)
# 阴阳角
sort_6 = SortList(Keys=len_3, ValuesA=debrep_2.Edges)  # -> Keys, ValuesA
item_29 = ListItem(List=sort_6.ValuesA, Index=0, Wrap=True)
len_4 = Length(Curve=item_29)  # -> expr("x/2", Length)

# ----
# 1.是否有檐口线-上层定位点
toggle_2 = BooleanToggle(True)
clean_2 = CleanTree(RemoveNulls=True, RemoveInvalid=True, RemoveEmpty=toggle_2, Tree=pln_14)

# ---- group: Input ???
deplane_8 = DeconstructPlane(Plane=clean_2)  # -> Origin, XAxis, YAxis, ZAxis

# ----
incurve_4 = PointInCurve(Point=deplane_8.Origin, Curve=crv_26)  # -> Relationship, Point
equals_4 = Equality(FirstNumber=incurve_4.Relationship, SecondNumber="2")  # -> Equality, Inequality
dispatch_21 = Dispatch(List=clean_2, DispatchPattern=equals_4.Equality)  # -> ListA, ListB

# ----
# Site - 无檐口线的定位点
pln_15 = Plane(dispatch_21.ListB)

incurve_5 = PointInCurve(Point=pln_15, Curve=crv_29)  # -> Relationship, Point
equals_5 = Equality(FirstNumber=incurve_5.Relationship, SecondNumber="2")  # -> Equality, Inequality
dispatch_22 = Dispatch(List=pln_15, DispatchPattern=equals_5.Equality)  # -> ListA, ListB
pln_16 = Plane(dispatch_22.ListB)

# ---- group: 建筑单体-上层-无檐口线定位点
pln_17 = Plane(dispatch_22.ListA)

# ----
# 1.0无檐口线初筛-上层定位点
pln_18 = Plane(pln_17)

# ----
# 1.是否有檐口线-檐口线定位点
toggle_3 = BooleanToggle(True)
clean_3 = CleanTree(RemoveNulls=True, RemoveInvalid=True, RemoveEmpty=toggle_3, Tree=pln_12)

# ---- group: Input ???
deplane_9 = DeconstructPlane(Plane=clean_3)  # -> Origin, XAxis, YAxis, ZAxis

# ----
incurve_6 = PointInCurve(Point=deplane_9.Origin, Curve=crv_27)  # -> Relationship, Point
equals_6 = Equality(FirstNumber=incurve_6.Relationship, SecondNumber="2")  # -> Equality, Inequality
dispatch_23 = Dispatch(List=clean_3, DispatchPattern=equals_6.Equality)  # -> ListA, ListB

# ----
# Site - 檐口线的定位点
pln_19 = Plane(dispatch_23.ListB)

incurve_7 = PointInCurve(Point=pln_19, Curve=crv_29)  # -> Relationship, Point
equals_7 = Equality(FirstNumber=incurve_7.Relationship, SecondNumber="2")  # -> Equality, Inequality
dispatch_24 = Dispatch(List=pln_19, DispatchPattern=equals_7.Equality)  # -> ListA, ListB
pln_20 = Plane(dispatch_24.ListB)

# ---- group: 建筑单体-檐口定位点
pln_21 = Plane(dispatch_24.ListA)

# ---- group: 檐口处定位点
pln_22 = Plane(pln_21)

# ----
# 区分内外梁边线
# 2.根据是否相交判定内外梁(平行于建筑边线方向）
crv_65 = Curve(data_8)
offcrv = OffsetCurve(Curve=crv_58, Plane=PlaneXY(0, 0, 0), Distance=num_2, BothSides=expr("-x", num_2), Kinks=0, CapType="0")
midpt_2 = CurveMiddle(Curve=offcrv)
offcrv_2 = OffsetCurve(Curve=crv_58, Plane=PlaneXY(0, 0, 0), Distance=num_2, BothSides=expr("-x", num_2), Kinks=0, CapType="1")
crv_66 = Curve(offcrv)
item_30 = ListItem(List=midpt_2, Index=0, Wrap=True)
item_31 = ListItem(List=crv_66, Index=0, Wrap=True)
item_32 = ListItem(List=crv_66, Index="-1", Wrap=True)
graft_2 = GraftTree(Tree=crv_58, IncludeEmptyLists=True, IncludeNullItems=True)
panel_48 = Panel(num_2)

# ---- group: Pull到轮廓线
pull_9 = PullPoint(Point=midpt, Geometry=flatten(crv_65), ClosestOnly=True)  # -> ClosestPoint, Distance

# ----
# 梁线闭合
shift = ShiftPaths(Data=offcrv_2, Offset=-1)

# ---- group: 和某组梁边线相连
ln_9 = Line(StartPoint=item_30, EndPoint=graft(pull_9.ClosestPoint))

# ---- group: 有交点为内
ccx_3 = CurveCurve(CurveA=ln_9, CurveB=graft_2)  # -> Points, ParamsA, ParamsB

# ----
null_4 = NullItem(Item=ccx_3.Points)  # -> NullFlags, InvalidFlags, Description
dispatch_25 = Dispatch(List=item_31, DispatchPattern=null_4.InvalidFlags)  # -> ListA, ListB
dispatch_26 = Dispatch(List=item_32, DispatchPattern=null_4.InvalidFlags)  # -> ListA, ListB

# ----
# 梁边线-内
merge_18 = Merge(Data1=dispatch_25.ListB, Data2=dispatch_26.ListA)

# ----
# 梁边线-外
merge_19 = Merge(Data1=dispatch_25.ListA, Data2=dispatch_26.ListB)

# ---- group: 梁-外侧
crv_67 = Curve(merge_19)

# ---- group: 梁外侧
crv_68 = Curve(merge_19)

# ---- group: 梁中线
crv_69 = Curve(shift)

# ---- group: 梁内测
crv_70 = Curve(merge_18)

# ---- group: 梁外侧
crv_71 = Curve(merge_19)

# ---- group: 梁-内线
crv_72 = Curve(merge_18)

# ---- group: 梁内侧
crv_73 = Curve(merge_18)

crv_74 = Curve(merge_18)

# ---- group: 梁外侧
crv_75 = Curve(merge_19)

# ---- group: 内侧梁线
crv_76 = Curve(merge_18)

# ---- group: 梁外侧
crv_77 = Curve(merge_19)

# ---- group: 内侧梁线
crv_78 = Curve(merge_18)

# ----
crv_79 = Curve([crv_77, crv_76])
flatten_3 = FlattenTree(Tree=crv_79, Path="{0}")
boundary_3 = BoundarySurfaces(Edges=[offset_5, offset_6])
scx = SurfaceCurve(Surface=boundary_3, Curve=flatten_3)  # -> simplify(Curves), Points, UVPoints, Normals, Parameters, Tangents

# ---- group: 梁内测
crv_80 = Curve(merge_18)

# ---- group: 梁内侧
crv_81 = Curve(crv_78)

# ---- group: All BEAMS
crv_82 = Curve(scx.Curves)

# ---- group: 梁外侧
crv_83 = Curve(merge_19)

crv_84 = Curve(merge_19)

# ---- group: 梁闭合offset
crv_85 = Curve(shift)

# ---- group: 梁外侧
crv_86 = Curve(merge_19)

crv_87 = Curve(crv_86)

# ---- group: 梁内测线
crv_88 = Curve(crv_80)

# ---- group: 梁内侧
crv_89 = Curve(crv_78)

# ---- group: 梁外侧
crv_90 = Curve(crv_86)

# ---- group: 梁offset
crv_91 = Curve(shift)

# ---- group: 梁外侧
crv_92 = Curve(merge_19)

# ---- group: 梁内侧
crv_93 = Curve(crv_78)

crv_94 = Curve(crv_78)

# ----
project_12 = Project(Geometry=crv_30, Plane=PlaneXY(0, 0, 0))  # -> Geometry, Transform
project_13 = Project(Geometry=pln_10, Plane=PlaneXY(0, 0, 0))  # -> Geometry, Transform
reb_2 = RebuildCurve(Curve=project_12.Geometry, Count=Slider(5000, range=0..10000), Tangents=False)

# ---- group: 楼板线以外的定位点
deplane_10 = DeconstructPlane(Plane=pln_18)  # -> Origin, XAxis, YAxis, ZAxis
incurves = PointInCurves(Point=deplane_10.Origin, Curves=flatten(reb_2))  # -> Relationship, Index, Point
equals_8 = Equality(FirstNumber=incurves.Relationship, SecondNumber="2")  # -> Equality, Inequality
dispatch_27 = Dispatch(List=pln_18, DispatchPattern=equals_8.Equality)  # -> ListA, ListB
pln_23 = Plane(dispatch_27.ListA)
data_20 = Data(dispatch_27.ListB)

# ----
# 1.0无檐口线-上层定位点
pln_24 = Plane(data_20)

deplane_11 = DeconstructPlane(Plane=pln_22)  # -> Origin, XAxis, YAxis, ZAxis
amp_8 = Amplitude(Vector=deplane_11.YAxis, Amplitude=number_slider_17)
move_15 = Move(Geometry=deplane_11.Origin, Motion=expr("-x", amp_8))  # -> Geometry, Transform
ln_10 = Line(StartPoint=move_15.Geometry, EndPoint=deplane_11.Origin)
project_14 = Project(Geometry=crv_67, Plane=PlaneXY(0, 0, 0))  # -> Geometry, Transform
project_15 = Project(Geometry=ln_10, Plane=PlaneXY(0, 0, 0))  # -> Geometry, Transform
merge_20 = Merge(Data1=crv_31, Data2=crv_32)
ccx_4 = CurveCurve(CurveA=graft(project_15.Geometry), CurveB=flatten(project_14.Geometry))  # -> Points, ParamsA, ParamsB
project_16 = Project(Geometry=merge_20, Plane=PlaneXY(0, 0, 0))  # -> Geometry, Transform

# ---- group: 找距离梁最近的点
shift_2 = ShiftPaths(Data=ccx_4.Points, Offset=-1)
pull_10 = PullPoint(Point=shift_2, Geometry=flatten(project_16.Geometry), ClosestOnly=True)  # -> ClosestPoint, Distance
sort_7 = SortList(Keys=pull_10.Distance, ValuesA=shift_2)  # -> Keys, ValuesA
item_33 = ListItem(List=sort_7.ValuesA, Index=0, Wrap=True)
null_5 = NullItem(Item=flatten(item_33))  # -> NullFlags, InvalidFlags, Description
dispatch_28 = Dispatch(List=flatten(item_33), DispatchPattern=null_5.InvalidFlags)  # -> ListA, ListB
dispatch_29 = Dispatch(List=pln_22, DispatchPattern=null_5.InvalidFlags)  # -> ListA, ListB

# ---- group: 交点Point
data_21 = Data(dispatch_28.ListB)

# ---- group: 交点对应的初始Plane
data_22 = Data(dispatch_29.ListB)

# ----
# 按照梁分类定位点
pt_8 = Point(data_21)
cluster_5 = Cluster_11(L=pt_8, P=pt_8, C=crv_69)

check_same_points_4 = CheckSamePoints(archPoint=pln_22, crvPoint=data_22)  # -> out, specialPt; inputs archPoint: list of Point3d, crvPoint: list of Point3d; same code as testpoint

# ---- group: 交点-属于哪个梁
data_23 = Data(cluster_5)

# ----
# 0无檐口线 与梁不相交
cull_i_7 = CullIndex(List=pln_22, Indices=check_same_points_4.specialPt, Wrap=True)

# ----
# 按照梁分类定位PLANE
cluster_6 = Cluster_10(P=data_23, D=crv_70, G=crv_35)

# ---- group: 檐口-首次筛选的有效起始Plane
data_24 = Data(cluster_6)

# ----
# 0 檐口出定位点
# 与结构无交点
pln_25 = Plane(cull_i_7)

# ----
# 二次筛选檐口处
# 埋件定位点Offset，没有找到和梁的交点
deplane_12 = DeconstructPlane(Plane=pln_25)  # -> Origin, XAxis, YAxis, ZAxis
amp_9 = Amplitude(Vector=deplane_12.YAxis, Amplitude=expr("-X", number_slider_17))
move_16 = Move(Geometry=deplane_12.Origin, Motion=amp_9)  # -> Geometry, Transform
ln_11 = Line(StartPoint=move_16.Geometry, EndPoint=deplane_12.Origin)
amp_10 = Amplitude(Vector=deplane_12.XAxis, Amplitude=expr("-x", number_slider_6))
amp_11 = Amplitude(Vector=deplane_12.XAxis, Amplitude=number_slider_6)

# ---- group: 2条Offset的探针找交点
move_17 = Move(Geometry=ln_11, Motion=amp_11)  # -> Geometry, Transform
move_18 = Move(Geometry=ln_11, Motion=amp_10)  # -> Geometry, Transform

# ----
geometry = DataDescription(pln_25)
geometry_2 = DataDescription(pln_25)

# ----
# 1.1 檐口处侧埋，钢板焊
# 02：钢板焊埋件[钢梁外侧]
# @钢边梁宽@钢边梁高
pln_26 = Plane(data_24)

# ---- group: 楼板线以外的定位点
deplane_13 = DeconstructPlane(Plane=project_13.Geometry)  # -> Origin, XAxis, YAxis, ZAxis

# ----
pt_9 = Point(deplane_13.Origin)

# ---- group: 楼板线以外的定位点 (continued)
incurves_2 = PointInCurves(Point=pt_9, Curves=flatten(reb_2))  # -> Relationship, Index, Point
equals_9 = Equality(FirstNumber=incurves_2.Relationship, SecondNumber="2")  # -> Equality, Inequality
dispatch_30 = Dispatch(List=project_13.Geometry, DispatchPattern=equals_9.Equality)  # -> ListA, ListB
data_25 = Data(dispatch_30.ListB)

# ----
# 1.0无檐口线-下层定位点
pln_27 = Plane(data_25)

# ---- group: 上下幕墙有效点
pln_28 = Plane(pln_24)
pln_29 = Plane(pln_27)
number_slider_22 = Slider(3584, range=0..10000)
deplane_14 = DeconstructPlane(Plane=pln_29)  # -> Origin, XAxis, YAxis, ZAxis
deplane_15 = DeconstructPlane(Plane=pln_28)  # -> Origin, XAxis, YAxis, ZAxis
number_slider_23 = Slider(3584, range=0..10000)
amp_12 = Amplitude(Vector=deplane_14.YAxis, Amplitude=expr("-x", number_slider_23))
amp_13 = Amplitude(Vector=deplane_14.YAxis, Amplitude=number_slider_23)
amp_14 = Amplitude(Vector=deplane_15.YAxis, Amplitude=expr("-x", number_slider_22))
amp_15 = Amplitude(Vector=deplane_15.YAxis, Amplitude=number_slider_22)
move_19 = Move(Geometry=deplane_14.Origin, Motion=amp_12)  # -> Geometry, Transform
move_20 = Move(Geometry=deplane_14.Origin, Motion=amp_13)  # -> Geometry, Transform
move_21 = Move(Geometry=deplane_15.Origin, Motion=amp_14)  # -> Geometry, Transform
move_22 = Move(Geometry=deplane_15.Origin, Motion=amp_15)  # -> Geometry, Transform
ln_12 = Line(StartPoint=move_21.Geometry, EndPoint=move_22.Geometry)
ln_13 = Line(StartPoint=move_19.Geometry, EndPoint=move_20.Geometry)
number_slider_24 = Slider(20, range=0..100)

# ---- group: 上下幕墙有效点 / 下层点+上层线
ccx_5 = CurveCurve(CurveA=graft(ln_13), CurveB=crv_34)  # -> Points, ParamsA, ParamsB

# ---- group: 上下幕墙有效点 / 下层点+下层线
ccx_6 = CurveCurve(CurveA=graft(ln_13), CurveB=crv_33)  # -> Points, ParamsA, ParamsB

# ---- group: 上下幕墙有效点 / 上层点+上层线
ccx_7 = CurveCurve(CurveA=graft(ln_12), CurveB=crv_34)  # -> Points, ParamsA, ParamsB

# ---- group: 上下幕墙有效点 / 上层点+下层线
ccx_8 = CurveCurve(CurveA=graft(ln_12), CurveB=crv_33)  # -> Points, ParamsA, ParamsB

# ---- group: 上下幕墙有效点 (continued)
pull_11 = PullPoint(Point=ccx_7.Points, Geometry=ccx_8.Points, ClosestOnly=True)  # -> ClosestPoint, Distance
pull_12 = PullPoint(Point=ccx_6.Points, Geometry=ccx_5.Points, ClosestOnly=True)  # -> ClosestPoint, Distance
panel_49 = Panel(pull_12.Distance)
smaller_7 = SmallerThan(FirstNumber=pull_12.Distance, SecondNumber=number_slider_24)  # -> SmallerThan, OrEqualTo
smaller_8 = SmallerThan(FirstNumber=pull_11.Distance, SecondNumber=number_slider_24)  # -> SmallerThan, OrEqualTo
dispatch_31 = Dispatch(List=pln_29, DispatchPattern=flatten(smaller_7.SmallerThan))  # -> ListA, ListB
dispatch_32 = Dispatch(List=pln_28, DispatchPattern=flatten(smaller_8.SmallerThan))  # -> ListA, ListB

# ----
list_a = DataDescription(dispatch_31.ListA)
list_b = DataDescription(dispatch_31.ListB)

# ---- group: 上下幕墙有效点 / 上层有效点
pln_30 = Plane(dispatch_32.ListA)

# ---- group: 上下幕墙有效点 / 下层有效点
pln_31 = Plane(list_a)

# ---- group: 上下幕墙有效点 (continued)
pt_10 = Point(pln_30)
pt_11 = Point(pln_31)
pull_13 = PullPoint(Point=pt_10, Geometry=pt_11, ClosestOnly=True)  # -> ClosestPoint, Distance
larger_5 = LargerThan(FirstNumber=pull_13.Distance, SecondNumber=number_slider_18)  # -> LargerThan, OrEqualTo
dispatch_33 = Dispatch(List=pln_30, DispatchPattern=larger_5.LargerThan)  # -> ListA, ListB
pln_32 = Plane(dispatch_33.ListA)

# ---- group: 上下层共同有效点
merge_21 = Merge(Data1=pln_31, Data2=pln_32)

# ----
ccx_9 = CurveCurve(CurveA=graft(move_18.Geometry), CurveB=flatten(crv_71))  # -> Points, ParamsA, ParamsB
shift_3 = ShiftPaths(Data=ccx_9.Points, Offset=-1)
pull_14 = PullPoint(Point=shift_3, Geometry=graft(geometry_2), ClosestOnly=True)  # -> ClosestPoint, Distance
sort_8 = SortList(Keys=pull_14.Distance, ValuesA=pull_14.ClosestPoint)  # -> Keys, ValuesA

# ---- group: 最远交点
item_34 = ListItem(List=sort_8.ValuesA, Index="-1", Wrap=True)

# ----
null_6 = NullItem(Item=flatten(item_34))  # -> NullFlags, InvalidFlags, Description
dispatch_34 = Dispatch(List=simplify(item_34), DispatchPattern=simplify(graft(null_6.InvalidFlags)))  # -> ListA, ListB
dispatch_35 = Dispatch(List=pln_25, DispatchPattern=null_6.InvalidFlags)  # -> ListA, ListB
pt_12 = Point(dispatch_34.ListB)
pln_33 = Plane(dispatch_35.ListB)

ccx_10 = CurveCurve(CurveA=graft(move_17.Geometry), CurveB=flatten(crv_71))  # -> Points, ParamsA, ParamsB
shift_4 = ShiftPaths(Data=ccx_10.Points, Offset=-1)
pull_15 = PullPoint(Point=shift_4, Geometry=graft(geometry), ClosestOnly=True)  # -> ClosestPoint, Distance
sort_9 = SortList(Keys=pull_15.Distance, ValuesA=pull_15.ClosestPoint)  # -> Keys, ValuesA

# ---- group: 最远交点
item_35 = ListItem(List=sort_9.ValuesA, Index="-1", Wrap=True)

# ----
null_7 = NullItem(Item=flatten(item_35))  # -> NullFlags, InvalidFlags, Description
dispatch_36 = Dispatch(List=simplify(item_35), DispatchPattern=simplify(graft(null_7.InvalidFlags)))  # -> ListA, ListB
dispatch_37 = Dispatch(List=pln_25, DispatchPattern=null_7.InvalidFlags)  # -> ListA, ListB
pt_13 = Point(dispatch_36.ListB)
pln_34 = Plane(dispatch_37.ListB)

# ----
# 1.1 有檐口
pln_35 = Plane(dispatch_35.ListA)
pln_36 = Plane(dispatch_37.ListA)
check_same_points_5 = CheckSamePoints(archPoint=pln_36, crvPoint=pln_35)  # -> out, specialPt; inputs archPoint: list of Point3d, crvPoint: list of Point3d; same code as testpoint
crv_95 = Curve(shift)
cset = CreateSet(List=check_same_points_5.specialPt)  # -> Set, Map

# ----
# 按照梁分类定位点
cluster_7 = Cluster_5(pt=pt_13, C=crv_95)

# ----
# 按照梁分类定位点
cluster_8 = Cluster_5(pt=pt_12, C=crv_95)

# ---- group: 未生成檐口埋件
item_36 = ListItem(List=pln_36, Index=cset.Set, Wrap=True)

# ----
# 未生成檐口线
pt_14 = Point(item_36)

# ----
# （10）需人工排布
pt_15 = Point(pt_14)
bake_2 = BakeObjects(Geometry=pt_15, Attributes=attributes_2, BakeName=panel_34, Bake=False)

# ---- group: 交点-属于哪个梁
data_26 = Data(cluster_8)

# ----
# 按照梁分类定位PLANE
crv_96 = Curve(merge_18)
crv_97 = Curve(crv_27)
cluster_9 = Cluster_13(B=data_26, D=crv_96, P=data_26, G=crv_97)

# ---- group: 交点-属于哪个梁
data_27 = Data(cluster_7)

# ----
# 按照梁分类定位PLANE
cluster_10 = Cluster_12(P=data_27, B=data_27, D=crv_72, G=crv_36)

# ---- group: 檐口处-二次筛选-plane
shift_5 = ShiftPaths(Data=cluster_10, Offset=-1)  # -> simplify(Data)

shift_6 = ShiftPaths(Data=cluster_9, Offset=-1)  # -> simplify(Data)

# ----
# 撞到梁交点
pln_37 = Plane(shift_6)
pln_38 = Plane(shift_5)

merge_22 = Merge(Data1=pln_26, Data2=pln_38, Data3=pln_37)
orient_3 = Orient(Geometry=item_16, Source=item_17, Target=merge_22)  # -> Geometry, Transform

data_28 = Data(orient_3.Geometry)
ungroup_6 = Ungroup(Group=data_28)
item_37 = ListItem(List=ungroup_6, Index=0, Wrap=True)  # -> flatten(Item)
item_38 = ListItem(List=ungroup_6, Index="-1", Wrap=True)  # -> flatten(Item)

# ---- group: 檐口埋件 (continued)
entwine_13 = Entwine(Branch00=item_37, Branch01=item_38, FlattenInputs=True)
bake_3 = BakeObjects(Geometry=entwine_13, Attributes=attributes_3, BakeName=panel_20, Bake=False)

# ----
deplane_16 = DeconstructPlane(Plane=merge_21)  # -> Origin, XAxis, YAxis, ZAxis
amp_16 = Amplitude(Vector=deplane_16.YAxis, Amplitude=expr("-x", Slider(2756, range=0..10000)))
move_23 = Move(Geometry=deplane_16.Origin, Motion=amp_16)  # -> Geometry, Transform

# ---- group: 相内探索
ln_14 = Line(StartPoint=deplane_16.Origin, EndPoint=move_23.Geometry)

# ----
ccx_11 = CurveCurve(CurveA=graft(ln_14), CurveB=flatten(crv_68))  # -> Points, ParamsA, ParamsB
shift_7 = ShiftPaths(Data=ccx_11.Points, Offset=-1)
pull_16 = PullPoint(Point=deplane_16.Origin, Geometry=shift_7, ClosestOnly=True)  # -> ClosestPoint, Distance
sort_10 = SortList(Keys=pull_16.Distance, ValuesA=pull_16.ClosestPoint)  # -> Keys, ValuesA

# ---- group: 与梁最近交点
item_39 = ListItem(List=sort_10.ValuesA, Index=0, Wrap=True)

# ----
null_8 = NullItem(Item=flatten(item_39))  # -> NullFlags, InvalidFlags, Description
dispatch_38 = Dispatch(List=flatten(item_39), DispatchPattern=null_8.InvalidFlags)  # -> ListA, ListB
dispatch_39 = Dispatch(List=merge_21, DispatchPattern=null_8.InvalidFlags)  # -> ListA, ListB

# ---- group: 去除Null的交点
data_29 = Data(dispatch_38.ListB)

# ----
# 按照梁分类定位点
data_30 = Data(data_29)
crv_98 = Curve(shift)
cluster_11 = Cluster_5(pt=data_30, C=crv_98)

# ---- group: 交点-属于哪个梁
data_31 = Data(cluster_11)

# ----
# 1.0无檐口线
# 与梁不相交
pln_39 = Plane(dispatch_39.ListA)

# ----
# 按照梁分类定位PLANE
cluster_12 = Cluster_14(B=data_31, D=crv_73, P=data_31, G=crv_37)
shift_8 = ShiftPaths(Data=cluster_12, Offset=-1)

# ----
# 0 檐口出定位点
# 与结构无交点
pln_40 = Plane(flatten(pln_39))

# ----
# 1.0无檐口线+上下层幕墙边线连续
# 01：钢板焊埋件[钢梁外侧]
# @钢边梁宽@钢边梁高
pln_41 = Plane(shift_8)

# ----
# 1.0.Missing Point
# 埋件定位点Offset，没有找到和梁的交点
crv_99 = Curve(crv_68)
deplane_17 = DeconstructPlane(Plane=pln_40)  # -> Origin, XAxis, YAxis, ZAxis
amp_17 = Amplitude(Vector=deplane_17.YAxis, Amplitude=expr("-x", Slider(5000, range=0..10000)))
move_24 = Move(Geometry=deplane_17.Origin, Motion=amp_17)  # -> Geometry, Transform
ln_15 = Line(StartPoint=move_24.Geometry, EndPoint=deplane_17.Origin)
amp_18 = Amplitude(Vector=deplane_17.XAxis, Amplitude=number_slider_6)
amp_19 = Amplitude(Vector=deplane_17.XAxis, Amplitude=expr("-x", number_slider_6))

# ---- group: 2组探索针
move_25 = Move(Geometry=ln_15, Motion=amp_18)  # -> Geometry, Transform
move_26 = Move(Geometry=ln_15, Motion=amp_19)  # -> Geometry, Transform

# ----
ccx_12 = CurveCurve(CurveA=graft(move_26.Geometry), CurveB=flatten(crv_99))  # -> Points, ParamsA, ParamsB
shift_9 = ShiftPaths(Data=ccx_12.Points, Offset=-1)
sort_11 = SortList(Keys=shift_9, ValuesA=shift_9)  # -> Keys, ValuesA
pull_17 = PullPoint(Point=sort_11.ValuesA, Geometry=graft(pln_40), ClosestOnly=True)  # -> ClosestPoint, Distance
sort_12 = SortList(Keys=pull_17.Distance, ValuesA=sort_11.ValuesA)  # -> Keys, ValuesA
item_40 = ListItem(List=sort_12.ValuesA, Index="0", Wrap=True)
null_9 = NullItem(Item=flatten(item_40))  # -> NullFlags, InvalidFlags, Description
dispatch_40 = Dispatch(List=simplify(item_40), DispatchPattern=simplify(graft(null_9.InvalidFlags)))  # -> ListA, ListB
dispatch_41 = Dispatch(List=pln_40, DispatchPattern=null_9.InvalidFlags)  # -> ListA, ListB
pln_42 = Plane(dispatch_41.ListB)
pt_16 = Point(dispatch_40.ListB)
move2pt_4 = MoveToPoint(Geometry=pln_42, PointA=pln_42, PointB=pt_16)  # -> Moved, Vector, Transform

ccx_13 = CurveCurve(CurveA=graft(move_25.Geometry), CurveB=flatten(crv_99))  # -> Points, ParamsA, ParamsB
shift_10 = ShiftPaths(Data=ccx_13.Points, Offset=-1)
sort_13 = SortList(Keys=shift_10, ValuesA=shift_10)  # -> Keys, ValuesA
pull_18 = PullPoint(Point=sort_13.ValuesA, Geometry=graft(pln_40), ClosestOnly=True)  # -> ClosestPoint, Distance
sort_14 = SortList(Keys=pull_18.Distance, ValuesA=sort_13.ValuesA)  # -> Keys, ValuesA
item_41 = ListItem(List=sort_14.ValuesA, Index="0", Wrap=True)
null_10 = NullItem(Item=flatten(item_41))  # -> NullFlags, InvalidFlags, Description
dispatch_42 = Dispatch(List=simplify(item_41), DispatchPattern=simplify(graft(null_10.InvalidFlags)))  # -> ListA, ListB
dispatch_43 = Dispatch(List=pln_40, DispatchPattern=null_10.InvalidFlags)  # -> ListA, ListB
pt_17 = Point(dispatch_42.ListB)
pln_43 = Plane(dispatch_43.ListB)
move2pt_5 = MoveToPoint(Geometry=pln_43, PointA=pln_43, PointB=pt_17)  # -> Moved, Vector, Transform

pln_44 = Plane([dispatch_43.ListA, dispatch_41.ListA])

# ----
# 1.0 无檐口线+上下层幕墙边线连续
merge_23 = Merge(Data1=pln_43, Data2=pln_42)
check_same_points_6 = CheckSamePoints(archPoint=pln_39, crvPoint=flatten(merge_23))  # -> out, specialPt; inputs archPoint: list of Point3d, crvPoint: list of Point3d; same code as testpoint
cull_i_8 = CullIndex(List=pln_39, Indices=check_same_points_6.specialPt, Wrap=True)

# ----
# 按照梁分类定位点
merge_24 = Merge(Data1=move2pt_5.Moved, Data2=move2pt_4.Moved)
crv_100 = Curve(crv_98)
cluster_13 = Cluster_5(pt=merge_24, C=crv_100)

# ---- group: 交点-属于哪个梁
data_32 = Data(cluster_13)

# ----
# 按照梁分类定位PLANE
cluster_14 = Cluster_7(B=data_32, D=crv_74, P=data_32, G=crv_38)

merge_25 = Merge(Data1=list_b, Data2=cull_i_8)

# ---- group: 檐口-2次筛选的有效起始Plane
data_33 = Data(cluster_14)

# ----
# 撞到梁交点
data_34 = Data(data_33)

merge_26 = Merge(Data1=pln_41, Data2=data_34)
orient_4 = Orient(Geometry=item_19, Source=item_18, Target=merge_26)  # -> Geometry, Transform

data_35 = Data(orient_4.Geometry)
ungroup_7 = Ungroup(Group=data_35)
item_42 = ListItem(List=ungroup_7, Index=0, Wrap=True)  # -> flatten(Item)
item_43 = ListItem(List=ungroup_7, Index="-1", Wrap=True)  # -> flatten(Item)

# ---- group: 上下幕墙连续 (continued)
entwine_14 = Entwine(Branch00=item_42, Branch01=item_43, FlattenInputs=True)
bake_4 = BakeObjects(Geometry=entwine_14, Attributes=attributes_5, BakeName=panel_18, Bake=False)

# ---- group: All-下层定位点
# 1.1有檐口线
pln_45 = Plane(merge_25)
# 2是否有吊顶
# 梁以内>350
pln_46 = Plane(pln_8)

# ----
# 1.0无檐口线初筛-上层定位点
crv_101 = Curve(reb_2)
pln_47 = Plane(pln_14)
project_17 = Project(Geometry=crv_101, Plane=PlaneXY(0, 0, 0))  # -> Geometry, Transform
clscrv_8 = CloseCurve(Curve=project_17.Geometry, CloseType=0, Bulge=0.5, Tolerance=0)  # -> Closed, R

# ----
# 初筛： 最近的梁到定位点距离在300-600间保留
number_slider_25 = Slider(2000, range=0..10000)

merge_27 = Merge(Data1=pln_46, Data2=pln_45)
pln_48 = Plane(merge_27)
number_slider_26 = Slider(5000, range=0..10000)
deplane_18 = DeconstructPlane(Plane=pln_48)  # -> Origin, XAxis, YAxis, ZAxis
amp_20 = Amplitude(Vector=deplane_18.YAxis, Amplitude=expr("-x", number_slider_26))
amp_21 = Amplitude(Vector=deplane_18.YAxis, Amplitude=number_slider_26)
move_27 = Move(Geometry=deplane_18.Origin, Motion=amp_21)  # -> Geometry, Transform
move_28 = Move(Geometry=deplane_18.Origin, Motion=amp_20)  # -> Geometry, Transform
ln_16 = Line(StartPoint=move_27.Geometry, EndPoint=move_28.Geometry)

# ---- group: 起始Plane
pln_49 = Plane(pln_48)

# ----
pln_50 = Plane(merge_27)
deplane_19 = DeconstructPlane(Plane=pln_50)  # -> Origin, XAxis, YAxis, ZAxis
amp_22 = Amplitude(Vector=deplane_19.YAxis, Amplitude=expr("-x", Slider(5000, range=0..10000)))
move_29 = Move(Geometry=deplane_19.Origin, Motion=amp_22)  # -> Geometry, Transform
ln_17 = Line(StartPoint=move_29.Geometry, EndPoint=deplane_19.Origin)
amp_23 = Amplitude(Vector=deplane_19.XAxis, Amplitude=number_slider_6)
amp_24 = Amplitude(Vector=deplane_19.XAxis, Amplitude=expr("-x", number_slider_6))
move_30 = Move(Geometry=ln_17, Motion=amp_23)  # -> Geometry, Transform
move_31 = Move(Geometry=ln_17, Motion=amp_24)  # -> Geometry, Transform
move_32 = Move(Geometry=pln_50, Motion=amp_23)  # -> Geometry, Transform
ccx_14 = CurveCurve(CurveA=flatten(crv_82), CurveB=simplify(graft(move_31.Geometry)))  # -> Points, ParamsA, ParamsB
ccx_15 = CurveCurve(CurveA=flatten(crv_82), CurveB=simplify(graft(ln_17)))  # -> Points, ParamsA, ParamsB
ccx_16 = CurveCurve(CurveA=flatten(crv_82), CurveB=simplify(graft(move_30.Geometry)))  # -> Points, ParamsA, ParamsB
shift_11 = ShiftPaths(Data=ccx_16.Points, Offset=-1)
shift_12 = ShiftPaths(Data=ccx_14.Points, Offset=-1)
shift_13 = ShiftPaths(Data=ccx_15.Points, Offset=-1)
merge_28 = Merge(Data1=shift_11, Data2=shift_12, Data3=shift_13)
item_44 = ListItem(List=merge_28, Index=0, Wrap=True)
null_11 = NullItem(Item=item_44)  # -> flatten(NullFlags), InvalidFlags, Description
pln_51 = Plane(pln_50)
dispatch_44 = Dispatch(List=pln_51, DispatchPattern=null_11.NullFlags)  # -> ListA, ListB
pln_52 = Plane(dispatch_44.ListA)
panel_50 = Panel(null_11.NullFlags)
deplane_20 = DeconstructPlane(Plane=pln_52)  # -> Origin, XAxis, YAxis, ZAxis
amp_25 = Amplitude(Vector=deplane_20.YAxis, Amplitude="-300")
move_33 = Move(Geometry=deplane_20.Origin, Motion=amp_25)  # -> Geometry, Transform
move2pt_6 = MoveToPoint(Geometry=pln_52, PointA=deplane_20.Origin, PointB=move_33.Geometry)  # -> Moved, Vector, Transform

# ---- group: 和下层建筑的交点
ccx_17 = CurveCurve(CurveA=ln_16, CurveB=crv_39)  # -> Points, ParamsA, ParamsB

# ---- group: 起始Plane
pln_53 = Plane(pln_50)

# ----
# 4.0 默认位置为建筑边线向内300mm
# 侧埋，钢板焊
# 03：钢板焊埋件[钢梁外侧]@钢边梁宽@钢边梁高
data_36 = Data(flatten(merge_3))
pln_54 = Plane(move2pt_6.Moved)
item_45 = ListItem(List=data_36, Index=0, Wrap=True)
item_46 = ListItem(List=data_36, Index="-1", Wrap=True)
orient_5 = Orient(Geometry=item_45, Source=item_46, Target=pln_54)  # -> Geometry, Transform

data_37 = Data(orient_5.Geometry)
ungroup_8 = Ungroup(Group=data_37)
item_47 = ListItem(List=ungroup_8, Index=0, Wrap=True)  # -> flatten(Item)
item_48 = ListItem(List=ungroup_8, Index="-1", Wrap=True)  # -> flatten(Item)

# ---- group: 范围内没有钢梁，默认幕墙线向内300有一个埋件 (continued)
entwine_15 = Entwine(Branch00=item_47, Branch01=item_48, FlattenInputs=True)
bake_5 = BakeObjects(Geometry=entwine_15, Attributes=attributes_10, BakeName=panel_30, Bake=False)

# ----
pln_55 = Plane(pln_49)
deplane_21 = DeconstructPlane(Plane=pln_55)  # -> Origin, XAxis, YAxis, ZAxis
amp_26 = Amplitude(Vector=deplane_21.YAxis, Amplitude=expr("-x", number_slider_25))
move_34 = Move(Geometry=deplane_21.Origin, Motion=amp_26)  # -> Geometry, Transform
ln_18 = Line(StartPoint=deplane_21.Origin, EndPoint=move_34.Geometry)
ccx_18 = CurveCurve(CurveA=flatten(crv_75), CurveB=simplify(graft(ln_18)))  # -> Points, ParamsA, ParamsB
shift_14 = ShiftPaths(Data=ccx_18.Points, Offset=-1)
graft_3 = GraftTree(Tree=deplane_21.Origin, IncludeEmptyLists=True, IncludeNullItems=True)  # -> simplify(Tree)
pull_19 = PullPoint(Point=shift_14, Geometry=graft_3, ClosestOnly=True)  # -> ClosestPoint, Distance
sort_15 = SortList(Keys=pull_19.Distance, ValuesA=shift_14)  # -> Keys, ValuesA
graft_4 = GraftTree(Tree=pln_55, IncludeEmptyLists=True, IncludeNullItems=True)  # -> flatten(Tree)
item_49 = ListItem(List=sort_15.Keys, Index=0, Wrap=True)  # -> flatten(Item)
c_script = CSharpScript(num=item_49, Max="600", Min="300")  # -> out, A, Distance; inputs num: list of Double, Max: Double
# ---------- c_script: C# ----------
    for(int i = 0; i < num.Count; i++){
      if(num[i] > 300 && num[i] < 600){
        Print(i.ToString());
        index.Add(i);
        dist.Add(num[i]);

      }
    }

    A = index;
    Distance = dist;
# ---------- c_script: C# additional code ----------
  List<double> index = new List<double>();
  List<double> dist = new List<double>();
# ---------- end c_script ----------
item_50 = ListItem(List=graft_4, Index=c_script.A, Wrap=True)

item_51 = ListItem(List=sort_15.ValuesA, Index=0, Wrap=True)  # -> flatten(Item)
item_52 = ListItem(List=item_51, Index=c_script.A, Wrap=True)

pt_18 = Point(item_52)

# ----
# 按照梁分类定位点
pt_19 = Point(pt_18)
crv_102 = Curve(shift)
cluster_15 = Cluster_11(L=pt_19, P=pt_19, C=crv_102)

# ---- group: 交点-属于哪个梁
data_38 = Data(cluster_15)

# ----
# 可能的结构交点-大量
null_12 = NullItem(Item=item_51)  # -> NullFlags, InvalidFlags, Description
dispatch_45 = Dispatch(List=pln_55, DispatchPattern=null_12.NullFlags)  # -> ListA, ListB
pln_56 = Plane(dispatch_45.ListA)

# ----
# 按照梁分类定位PLANE
cluster_16 = Cluster_7(B=data_38, D=crv_81, P=data_38, G=crv_48)

# ---- group: 檐口-首次筛选的有效起始Plane
data_39 = Data(cluster_16)

# ----
# 0 檐口出定位点
# 与结构无交点
pln_57 = Plane(flatten(pln_56))

# ----
# 3.2
# 下层建筑边线内侧300-600mm范围
# 03：钢板焊埋件[钢梁外侧]
# @钢边梁宽@钢边梁高
pln_58 = Plane(data_39)

deplane_22 = DeconstructPlane(Plane=pln_49)  # -> Origin, XAxis, YAxis, ZAxis
number_slider_27 = Slider(3584, range=0..10000)
boundary_4 = BoundarySurfaces(Edges=[offset_8, offset_7])
amp_27 = Amplitude(Vector=deplane_22.YAxis, Amplitude=number_slider_27)
amp_28 = Amplitude(Vector=deplane_22.YAxis, Amplitude=expr("-x", number_slider_27))
move_35 = Move(Geometry=deplane_22.Origin, Motion=amp_28)  # -> Geometry, Transform
move_36 = Move(Geometry=deplane_22.Origin, Motion=amp_27)  # -> Geometry, Transform
ln_19 = Line(StartPoint=move_35.Geometry, EndPoint=move_36.Geometry)

# ---- group: 50-350建筑结构交点
scx_2 = SurfaceCurve(Surface=boundary_4, Curve=crv_78)  # -> flatten(Curves), Points, UVPoints, Normals, Parameters, Tangents

# ---- group: 该区间的定位点
ccx_19 = CurveCurve(CurveA=graft(ln_19), CurveB=scx_2.Curves)  # -> Points, ParamsA, ParamsB

# ----
shift_15 = ShiftPaths(Data=ccx_19.Points, Offset=-1)
pull_20 = PullPoint(Point=graft(pln_49), Geometry=shift_15, ClosestOnly=True)  # -> ClosestPoint, Distance
sort_16 = SortList(Keys=pull_20.Distance, ValuesA=pull_20.ClosestPoint)  # -> Keys, ValuesA
null_13 = NullItem(Item=sort_16.ValuesA)  # -> NullFlags, simplify(InvalidFlags), Description
item_53 = ListItem(List=sort_16.ValuesA, Index=0, Wrap=True)
dispatch_46 = Dispatch(List=simplify(graft(pln_49)), DispatchPattern=null_13.InvalidFlags)  # -> ListA, ListB
dispatch_47 = Dispatch(List=simplify(graft(item_53)), DispatchPattern=null_13.InvalidFlags)  # -> ListA, ListB
pln_59 = Plane(dispatch_46.ListA)
pln_60 = Plane(dispatch_46.ListB)
pt_20 = Point(dispatch_47.ListB)

# ----
# 按照梁分类定位点
cluster_17 = Cluster_15(pt=pt_20, crv=shift)

# ---- group: 交点-属于哪个梁
data_40 = Data(cluster_17)

# ----
# 按照梁分类定位PLANE
cluster_18 = Cluster_16(B=data_40, D=crv_87, P=data_40, G=crv_44)

# ---- group: 檐口-首次筛选的有效起始Plane
data_41 = Data(cluster_18)

# ----
# 可能的结构交点-大量
pln_61 = Plane(pln_59)

# ----
# 0 檐口出定位点
# 与结构无交点
pln_62 = Plane(flatten(pln_61))

# ----
# 3.1
# 下层建筑边线外侧50-350mm
# 03：钢板焊埋件[钢梁内侧]
# @钢边梁宽@钢边梁高
pln_63 = Plane(data_41)

deplane_23 = DeconstructPlane(Plane=pln_47)  # -> Origin, XAxis, YAxis, ZAxis

pt_21 = Point(deplane_23.Origin)
incurve_8 = PointInCurve(Point=pt_21, Curve=clscrv_8.Closed)  # -> Relationship, Point

equals_10 = Equality(FirstNumber=incurve_8.Relationship, SecondNumber="2")  # -> Equality, Inequality
dispatch_48 = Dispatch(List=pln_47, DispatchPattern=equals_10.Equality)  # -> ListA, ListB
data_42 = Data(dispatch_48.ListB)

# ----
# 5 上层建筑边线,
# 默认建筑提供上翻，如主结构提供示意则使用结构定位【该项目无】，
# 如无则使用建筑边线向内50mm作为埋件定位
panel_51 = Panel(incurve_8.Relationship)
pln_64 = Plane(dispatch_48.ListA)

# ---- group: 1.0N的情况的Plane
pln_65 = Plane(pln_64)

# ----
deplane_24 = DeconstructPlane(Plane=pln_65)  # -> Origin, XAxis, YAxis, ZAxis
number_slider_28 = Slider(3584, range=0..10000)
amp_29 = Amplitude(Vector=deplane_24.YAxis, Amplitude=number_slider_28)
amp_30 = Amplitude(Vector=deplane_24.YAxis, Amplitude=expr("-x", number_slider_28))
move_37 = Move(Geometry=deplane_24.Origin, Motion=amp_30)  # -> Geometry, Transform
move_38 = Move(Geometry=deplane_24.Origin, Motion=amp_29)  # -> Geometry, Transform
ln_20 = Line(StartPoint=move_37.Geometry, EndPoint=move_38.Geometry)
ccx_20 = CurveCurve(CurveA=ln_20, CurveB=crv_43)  # -> simplify(Points), ParamsA, ParamsB
ln_21 = Line(StartPoint=ccx_20.Points, EndPoint=simplify(graft(pln_65)))
len_5 = Length(Curve=ln_21)
null_14 = NullItem(Item=ccx_20.Points)  # -> NullFlags, InvalidFlags, Description
sort_17 = SortList(Keys=len_5, ValuesA=simplify(ccx_20.Points))  # -> Keys, ValuesA
dispatch_49 = Dispatch(List=simplify(graft(pln_65)), DispatchPattern=null_14.NullFlags)  # -> ListA, ListB
item_54 = ListItem(List=sort_17.ValuesA, Index=0, Wrap=True)

# ----
# 可能的双点
pln_66 = Plane(dispatch_49.ListA)

# ----
# 0 檐口出定位点
# 与结构无交点
pln_67 = Plane(flatten(pln_66))

# ----
# 5  Missing Point
# 埋件定位点Offset，没有找到和梁的交点
number_slider_29 = Slider(5000, range=0..10000)
deplane_25 = DeconstructPlane(Plane=pln_67)  # -> Origin, XAxis, YAxis, ZAxis
crv_103 = Curve(crv_43)
amp_31 = Amplitude(Vector=deplane_25.YAxis, Amplitude=number_slider_29)
move_39 = Move(Geometry=deplane_25.Origin, Motion=amp_31)  # -> Geometry, Transform
ln_22 = Line(StartPoint=move_39.Geometry, EndPoint=deplane_25.Origin)
amp_32 = Amplitude(Vector=deplane_25.XAxis, Amplitude=number_slider_6)
amp_33 = Amplitude(Vector=deplane_25.XAxis, Amplitude=expr("-x", number_slider_6))
move_40 = Move(Geometry=ln_22, Motion=amp_32)  # -> Geometry, Transform
move_41 = Move(Geometry=ln_22, Motion=amp_33)  # -> Geometry, Transform

ccx_21 = CurveCurve(CurveA=graft(move_41.Geometry), CurveB=flatten(crv_103))  # -> Points, ParamsA, ParamsB
shift_16 = ShiftPaths(Data=ccx_21.Points, Offset=-1)
sort_18 = SortList(Keys=shift_16, ValuesA=shift_16)  # -> Keys, ValuesA
pull_21 = PullPoint(Point=sort_18.ValuesA, Geometry=graft(pln_67), ClosestOnly=True)  # -> ClosestPoint, Distance
sort_19 = SortList(Keys=pull_21.Distance, ValuesA=sort_18.ValuesA)  # -> Keys, ValuesA
item_55 = ListItem(List=sort_19.ValuesA, Index="-1", Wrap=True)
null_15 = NullItem(Item=flatten(item_55))  # -> NullFlags, InvalidFlags, Description
dispatch_50 = Dispatch(List=simplify(item_55), DispatchPattern=simplify(graft(null_15.InvalidFlags)))  # -> ListA, ListB
dispatch_51 = Dispatch(List=pln_67, DispatchPattern=null_15.InvalidFlags)  # -> ListA, ListB
pln_68 = Plane(dispatch_51.ListB)
pt_22 = Point(dispatch_50.ListB)

ccx_22 = CurveCurve(CurveA=graft(move_40.Geometry), CurveB=flatten(crv_103))  # -> Points, ParamsA, ParamsB
shift_17 = ShiftPaths(Data=ccx_22.Points, Offset=-1)
sort_20 = SortList(Keys=shift_17, ValuesA=shift_17)  # -> Keys, ValuesA
pull_22 = PullPoint(Point=sort_20.ValuesA, Geometry=graft(pln_67), ClosestOnly=True)  # -> ClosestPoint, Distance
sort_21 = SortList(Keys=pull_22.Distance, ValuesA=sort_20.ValuesA)  # -> Keys, ValuesA
item_56 = ListItem(List=sort_21.ValuesA, Index="-1", Wrap=True)
null_16 = NullItem(Item=flatten(item_56))  # -> NullFlags, InvalidFlags, Description
dispatch_52 = Dispatch(List=simplify(item_56), DispatchPattern=simplify(graft(null_16.InvalidFlags)))  # -> ListA, ListB
dispatch_53 = Dispatch(List=pln_67, DispatchPattern=null_16.InvalidFlags)  # -> ListA, ListB
pln_69 = Plane(dispatch_53.ListB)
pt_23 = Point(dispatch_52.ListB)

# ----
# 撞到结构
move2pt_7 = MoveToPoint(Geometry=flatten(pln_69), PointA=flatten(pln_69), PointB=flatten(pt_23))  # -> Moved, Vector, Transform
move2pt_8 = MoveToPoint(Geometry=flatten(pln_68), PointA=flatten(pln_68), PointB=flatten(pt_22))  # -> Moved, Vector, Transform

# ----
# 撞到梁交点
merge_29 = Merge(Data1=flatten(move2pt_7.Moved), Data2=flatten(move2pt_8.Moved))

# ----
# 5 上层建筑边线,
# 默认建筑提供上翻
# 04：板埋埋件[混凝土楼板上侧]
# @板埋参数xn
move2pt_9 = MoveToPoint(Geometry=simplify(graft(pln_65)), PointA=simplify(graft(pln_65)), PointB=item_54)  # -> flatten(Moved), Vector, Transform

merge_30 = Merge(Data1=flatten(move2pt_9.Moved), Data2=flatten(merge_29))

# ---- group: All Location Point
merge_31 = Merge(Data1=merge_22, Data2=merge_26, Data3=merge_30)

# ----
deplane_26 = DeconstructPlane(Plane=merge_30)  # -> Origin, XAxis, YAxis, ZAxis
amp_34 = Amplitude(Vector=deplane_26.YAxis, Amplitude=len_4)
move_42 = Move(Geometry=merge_30, Motion=amp_34)  # -> Geometry, Transform
incurve_9 = PointInCurve(Point=move_42.Geometry, Curve=crv_50)  # -> Relationship, Point
panel_52 = Panel(incurve_9.Relationship)
equals_11 = Equality(FirstNumber=incurve_9.Relationship, SecondNumber="0")  # -> Equality, Inequality
dispatch_54 = Dispatch(List=move_42.Geometry, DispatchPattern=equals_11.Equality)  # -> ListA, ListB
data_43 = Data(dispatch_54.ListB)
data_44 = Data(dispatch_54.ListA)
deplane_27 = DeconstructPlane(Plane=data_44)  # -> Origin, XAxis, YAxis, ZAxis
amp_35 = Amplitude(Vector=deplane_27.YAxis, Amplitude=len_4)
move_43 = Move(Geometry=data_44, Motion=expr("-X", amp_35))  # -> Geometry, Transform
move_44 = Move(Geometry=move_43.Geometry, Motion=expr("-X", amp_35))  # -> Geometry, Transform
orient_6 = Orient(Geometry=item_26, Source=item_27, Target=move_44.Geometry)  # -> Geometry, Transform

data_45 = Data(orient_6.Geometry)
ungroup_9 = Ungroup(Group=data_45)
item_57 = ListItem(List=ungroup_9, Index=0, Wrap=True)  # -> flatten(Item)
item_58 = ListItem(List=ungroup_9, Index="-1", Wrap=True)  # -> flatten(Item)

# ---- group: 幕墙底部接地埋件 (continued)
entwine_16 = Entwine(Branch00=item_57, Branch01=item_58, FlattenInputs=True)
bake_6 = BakeObjects(Geometry=entwine_16, Attributes=attributes_9, BakeName=panel_32, Bake=False)

# ----
null_17 = NullItem(Item=merge_31)  # -> NullFlags, InvalidFlags, Description
dispatch_55 = Dispatch(List=merge_31, DispatchPattern=null_17.InvalidFlags)  # -> ListA, ListB

# ---- group: 下层图纸-标注定位点
pt_24 = Point(dispatch_55.ListB)

# ----
cluster_19 = Cluster_2(
    outline_curve=标准范围_符合单一轴网方向_2,
    dim_offset_1=number_slider_14,
    dim_offset_2=number_slider_13,
    axis_direction_crv1=crv_15,
    axis_direction_crv2=crv_16,
    f2_arch_outline=crv_54,
    location_point=pt_24,
    dim_style=panel_15,
    directed_outline=seam_2,
    移除重复位置点_容差=number_slider_11)  # -> D_3, D_4, D, D_2
dimension1 = Data(cluster_19.D_3)

# ---- group: Dimension2
data_46 = Data(cluster_19.D_4)

# ---- group: Dimension4
data_47 = Data(cluster_19.D_2)

# ---- group: Dimension3
data_48 = Data(cluster_19.D)

# ----
entwine_17 = Entwine(Branch00=dimension1, Branch01=data_46, Branch02=data_48, Branch03=data_47, FlattenInputs=True)

# ---- group: Refrash Data
# 将所有Input都输入完后要Refresh data
dam = DataDam(DataA=entwine_17, BufferDelay=10000000, BufferMode=0)

# ----
dedim = DeconstructDimension(DimensionObject=dam)  # -> Value, Text, Plane, Points, Style
shift_18 = ShiftPaths(Data=dedim.Text, Offset=-1)
smaller_9 = SmallerThan(FirstNumber=shift_18, SecondNumber=Slider(1, range=0..10))  # -> SmallerThan, OrEqualTo
dispatch_56 = Dispatch(List=dam, DispatchPattern=smaller_9.SmallerThan)  # -> ListA, ListB

# ---- group: Bake Me
bake_7 = BakeObjects(Geometry=dispatch_56.ListB, Attributes=attributes_12, Bake=False)

# ----
data_49 = Data(dispatch_56.ListB)

null_18 = NullItem(Item=ccx_17.Points)  # -> NullFlags, InvalidFlags, Description
dispatch_57 = Dispatch(List=simplify(ccx_17.Points), DispatchPattern=simplify(null_18.NullFlags))  # -> ListA, ListB
dispatch_58 = Dispatch(List=simplify(graft(pln_48)), DispatchPattern=simplify(null_18.NullFlags))  # -> ListA, ListB
pln_70 = Plane(flatten(dispatch_58.ListB))
pt_25 = Point(dispatch_57.ListB)
pt_26 = Point(pln_70)
pull_23 = PullPoint(Point=flatten(pt_26), Geometry=flatten(pt_25), ClosestOnly=True)  # -> ClosestPoint, Distance
ln_23 = Line(StartPoint=pln_70, EndPoint=pull_23.ClosestPoint)

# ----
# 定位点Project到下层建筑线
move2pt_10 = MoveToPoint(Geometry=pln_70, PointA=pln_70, PointB=pull_23.ClosestPoint)  # -> Moved, Vector, Transform

# ----
# 可能的点-离结构很远
pln_71 = Plane(dispatch_58.ListA)

deplane_28 = DeconstructPlane(Plane=move2pt_10.Moved)  # -> Origin, XAxis, YAxis, ZAxis
amp_36 = Amplitude(Vector=deplane_28.YAxis, Amplitude=Slider(5000, range=0..10000))
move_45 = Move(Geometry=deplane_28.Origin, Motion=amp_36)  # -> Geometry, Transform
ln_24 = Line(StartPoint=move_45.Geometry, EndPoint=deplane_28.Origin)

# ---- group: 和内测梁交点
ccx_23 = CurveCurve(CurveA=graft(ln_24), CurveB=flatten(crv_80))  # -> simplify(Points), ParamsA, ParamsB

# ----
# 3.2  Missing Point
# 埋件定位点Offset，没有找到和梁的交点
number_slider_30 = Slider(5000, range=0..10000)
deplane_29 = DeconstructPlane(Plane=pln_57)  # -> Origin, XAxis, YAxis, ZAxis
amp_37 = Amplitude(Vector=deplane_29.YAxis, Amplitude=expr("-x", number_slider_30))
move_46 = Move(Geometry=deplane_29.Origin, Motion=amp_37)  # -> Geometry, Transform
ln_25 = Line(StartPoint=move_46.Geometry, EndPoint=deplane_29.Origin)
amp_38 = Amplitude(Vector=deplane_29.XAxis, Amplitude=expr("-x", number_slider_6))
amp_39 = Amplitude(Vector=deplane_29.XAxis, Amplitude=number_slider_6)
move_47 = Move(Geometry=ln_25, Motion=amp_39)  # -> Geometry, Transform
move_48 = Move(Geometry=ln_25, Motion=amp_38)  # -> Geometry, Transform
move_49 = Move(Geometry=pln_57, Motion=amp_39)  # -> Geometry, Transform
move_50 = Move(Geometry=pln_57, Motion=amp_38)  # -> Geometry, Transform

pln_72 = Plane(move_49.Geometry)
deplane_30 = DeconstructPlane(Plane=pln_72)  # -> Origin, XAxis, YAxis, ZAxis
amp_40 = Amplitude(Vector=deplane_30.YAxis, Amplitude=expr("-x", Slider(2000, range=0..10000)))
move_51 = Move(Geometry=deplane_30.Origin, Motion=amp_40)  # -> Geometry, Transform
ln_26 = Line(StartPoint=deplane_30.Origin, EndPoint=move_51.Geometry)
ccx_24 = CurveCurve(CurveA=flatten(crv_84), CurveB=simplify(graft(move_47.Geometry)))  # -> Points, ParamsA, ParamsB
shift_19 = ShiftPaths(Data=ccx_24.Points, Offset=-1)
graft_5 = GraftTree(Tree=deplane_30.Origin, IncludeEmptyLists=True, IncludeNullItems=True)  # -> simplify(Tree)
pull_24 = PullPoint(Point=shift_19, Geometry=graft_5, ClosestOnly=True)  # -> ClosestPoint, Distance
sort_22 = SortList(Keys=pull_24.Distance, ValuesA=shift_19)  # -> Keys, ValuesA
graft_6 = GraftTree(Tree=pln_72, IncludeEmptyLists=True, IncludeNullItems=True)  # -> flatten(Tree)
item_59 = ListItem(List=sort_22.Keys, Index=0, Wrap=True)  # -> flatten(Item)
c_script_2 = CSharpScript(num=item_59, Max="600", Min="300")  # -> out, A, Distance; inputs num: list of Double, Max: Double; same code as c_script
item_60 = ListItem(List=graft_6, Index=c_script_2.out, Wrap=True)

pln_73 = Plane(move_50.Geometry)
deplane_31 = DeconstructPlane(Plane=pln_73)  # -> Origin, XAxis, YAxis, ZAxis
amp_41 = Amplitude(Vector=deplane_31.YAxis, Amplitude=expr("-x", Slider(2000, range=0..10000)))
move_52 = Move(Geometry=deplane_31.Origin, Motion=amp_41)  # -> Geometry, Transform
ln_27 = Line(StartPoint=deplane_31.Origin, EndPoint=move_52.Geometry)
ccx_25 = CurveCurve(CurveA=flatten(crv_83), CurveB=simplify(graft(move_48.Geometry)))  # -> Points, ParamsA, ParamsB
shift_20 = ShiftPaths(Data=ccx_25.Points, Offset=-1)
graft_7 = GraftTree(Tree=deplane_31.Origin, IncludeEmptyLists=True, IncludeNullItems=True)  # -> simplify(Tree)
pull_25 = PullPoint(Point=shift_20, Geometry=graft_7, ClosestOnly=True)  # -> ClosestPoint, Distance
sort_23 = SortList(Keys=pull_25.Distance, ValuesA=shift_20)  # -> Keys, ValuesA
graft_8 = GraftTree(Tree=pln_73, IncludeEmptyLists=True, IncludeNullItems=True)  # -> flatten(Tree)
item_61 = ListItem(List=sort_23.Keys, Index=0, Wrap=True)  # -> flatten(Item)
c_script_3 = CSharpScript(num=item_61, Max="600", Min="300")  # -> out, A, Distance; inputs num: list of Double, Max: Double; same code as c_script
item_62 = ListItem(List=graft_8, Index=c_script_3.out, Wrap=True)

item_63 = ListItem(List=sort_22.ValuesA, Index=0, Wrap=True)  # -> flatten(Item)
item_64 = ListItem(List=sort_23.ValuesA, Index=0, Wrap=True)  # -> flatten(Item)
item_65 = ListItem(List=item_63, Index=c_script_2.out, Wrap=True)
item_66 = ListItem(List=item_64, Index=c_script_3.out, Wrap=True)

merge_32 = Merge(Data1=item_65, Data2=item_66)

# ----
# 按照梁分类定位点
crv_104 = Curve(shift)
cluster_20 = Cluster_8(result=merge_32, C=crv_104)
data_50 = Data(cluster_20)

# ----
# 使用过的点
item_67 = ListItem(List=pln_57, Index=c_script_2.out, Wrap=True)
item_68 = ListItem(List=pln_57, Index=c_script_3.out, Wrap=True)
item_69 = ListItem(List=pln_55, Index=c_script.A, Wrap=True)
merge_33 = Merge(Data1=item_67, Data2=item_68, Data3=item_69)

# ---- group: 交点-属于哪个梁
data_51 = Data(data_50)

# ----
# 按照梁分类定位PLANE
cluster_21 = Cluster_9(B=data_51, D=crv_89, P=data_51, G=crv_49)

# ---- group: 檐口-首次筛选的有效起始Plane
data_52 = Data(cluster_21)

# ----
# 撞到梁交点
merge_34 = Merge(Data1=data_52)

merge_35 = Merge(Data1=pln_58, Data2=merge_34)
orient_7 = Orient(Geometry=item_24, Source=item_25, Target=merge_35)  # -> Geometry, Transform

data_53 = Data(orient_7.Geometry)
ungroup_10 = Ungroup(Group=data_53)
item_70 = ListItem(List=ungroup_10, Index=0, Wrap=True)  # -> flatten(Item)
item_71 = ListItem(List=ungroup_10, Index="-1", Wrap=True)  # -> flatten(Item)

# ---- group: 框架顶部，埋件在幕墙线内侧 (continued)
entwine_18 = Entwine(Branch00=item_70, Branch01=item_71, FlattenInputs=True)
bake_8 = BakeObjects(Geometry=entwine_18, Attributes=attributes_7, BakeName=panel_26, Bake=False)

# ----
shift_21 = ShiftPaths(Data=ccx_23.Points, Offset=-1)
null_19 = NullItem(Item=shift_21)  # -> NullFlags, InvalidFlags, Description
dispatch_59 = Dispatch(List=simplify(graft(move2pt_10.Moved)), DispatchPattern=null_19.NullFlags)  # -> ListA, ListB
dispatch_60 = Dispatch(List=simplify(graft(ln_24)), DispatchPattern=null_19.NullFlags)  # -> ListA, ListB
crv_105 = Curve(dispatch_60.ListB)
pln_74 = Plane(dispatch_59.ListA)
pln_75 = Plane(dispatch_59.ListB)
ccx_26 = CurveCurve(CurveA=graft(crv_105), CurveB=flatten(crv_80))  # -> Points, ParamsA, ParamsB
shift_22 = ShiftPaths(Data=simplify(ccx_26.Points), Offset=-1)
pull_26 = PullPoint(Point=pln_75, Geometry=shift_22, ClosestOnly=True)  # -> ClosestPoint, Distance
sort_24 = SortList(Keys=pull_26.Distance, ValuesA=pull_26.ClosestPoint)  # -> Keys, ValuesA

# ---- group: 交点对应的起始定位点
item_72 = ListItem(List=sort_24.ValuesA, Index=0, Wrap=True)

# ----
ln_28 = Line(StartPoint=pln_75, EndPoint=item_72)
len_6 = Length(Curve=ln_28)
larger_6 = LargerThan(FirstNumber=len_6, SecondNumber=number_slider_20)  # -> LargerThan, OrEqualTo
panel_53 = Panel(len_6)
dispatch_61 = Dispatch(List=pln_75, DispatchPattern=larger_6.LargerThan)  # -> ListA, ListB
dispatch_62 = Dispatch(List=item_72, DispatchPattern=larger_6.LargerThan)  # -> ListA, ListB
pln_76 = Plane(dispatch_61.ListB)

# ---- group: 起始点
pt_27 = Point(dispatch_62.ListA)

# ----
# 按照梁分类定位点
cluster_22 = Cluster_6(pt=pt_27, C=crv_85)

# ---- group: 交点-属于哪个梁
data_54 = Data(cluster_22)

# ----
# 按照梁分类定位PLANE
cluster_23 = Cluster_7(B=data_54, D=crv_86, P=data_54, G=crv_45)

# ---- group: 檐口-首次筛选的有效起始Plane
data_55 = Data(simplify(cluster_23))

# ----
# 2.1 梁以内>350
# 
# 侧埋，钢板焊
# 03：钢板焊埋件[钢梁内侧]
# @钢边梁宽@钢边梁高
pln_77 = Plane(data_55)

# ----
# 可能的结构交点-大量
pln_78 = Plane(pln_74)

# ----
# 可能的结构交点
pln_79 = Plane(pln_76)

# ----
# 3.1 Missing Point
# 埋件定位点Offset，没有找到和梁的交点
number_slider_31 = Slider(5000, range=0..10000)
deplane_32 = DeconstructPlane(Plane=pln_62)  # -> Origin, XAxis, YAxis, ZAxis
amp_42 = Amplitude(Vector=deplane_32.YAxis, Amplitude=number_slider_31)
crv_106 = Curve(scx_2.Curves)
move_53 = Move(Geometry=deplane_32.Origin, Motion=amp_42)  # -> Geometry, Transform
ln_29 = Line(StartPoint=move_53.Geometry, EndPoint=deplane_32.Origin)
amp_43 = Amplitude(Vector=deplane_32.XAxis, Amplitude=expr("-x", number_slider_6))
amp_44 = Amplitude(Vector=deplane_32.XAxis, Amplitude=number_slider_6)
move_54 = Move(Geometry=ln_29, Motion=amp_44)  # -> Geometry, Transform
move_55 = Move(Geometry=ln_29, Motion=amp_43)  # -> Geometry, Transform
move_56 = Move(Geometry=pln_62, Motion=amp_43)  # -> Geometry, Transform
move_57 = Move(Geometry=pln_62, Motion=amp_44)  # -> Geometry, Transform

ccx_27 = CurveCurve(CurveA=graft(move_55.Geometry), CurveB=flatten(crv_106))  # -> Points, ParamsA, ParamsB
shift_23 = ShiftPaths(Data=ccx_27.Points, Offset=-1)
pull_27 = PullPoint(Point=shift_23, Geometry=graft(pln_62), ClosestOnly=True)  # -> ClosestPoint, Distance
sort_25 = SortList(Keys=pull_27.Distance, ValuesA=shift_23)  # -> Keys, ValuesA
item_73 = ListItem(List=sort_25.ValuesA, Index="-1", Wrap=True)
null_20 = NullItem(Item=flatten(item_73))  # -> NullFlags, InvalidFlags, Description
dispatch_63 = Dispatch(List=flatten(item_73), DispatchPattern=null_20.InvalidFlags)  # -> ListA, ListB
dispatch_64 = Dispatch(List=pln_62, DispatchPattern=null_20.InvalidFlags)  # -> ListA, ListB
pt_28 = Point(dispatch_63.ListB)
pln_80 = Plane(dispatch_64.ListB)

ccx_28 = CurveCurve(CurveA=graft(move_54.Geometry), CurveB=flatten(crv_106))  # -> Points, ParamsA, ParamsB
shift_24 = ShiftPaths(Data=ccx_28.Points, Offset=-1)
pull_28 = PullPoint(Point=shift_24, Geometry=graft(pln_62), ClosestOnly=True)  # -> ClosestPoint, Distance
sort_26 = SortList(Keys=pull_28.Distance, ValuesA=shift_24)  # -> Keys, ValuesA
item_74 = ListItem(List=sort_26.ValuesA, Index="-1", Wrap=True)
null_21 = NullItem(Item=flatten(item_74))  # -> NullFlags, InvalidFlags, Description
dispatch_65 = Dispatch(List=flatten(item_74), DispatchPattern=null_21.InvalidFlags)  # -> ListA, ListB
dispatch_66 = Dispatch(List=pln_62, DispatchPattern=null_21.InvalidFlags)  # -> ListA, ListB
pln_81 = Plane(dispatch_66.ListB)
pt_29 = Point(dispatch_65.ListB)

merge_36 = Merge(Data1=pln_81, Data2=pln_80)  # -> flatten(Result)

# ----
# 按照梁分类定位点
crv_107 = Curve(shift)
merge_37 = Merge(Data1=pt_29, Data2=pt_28)
cluster_24 = Cluster_8(result=merge_37, C=crv_107)

# ---- group: 交点-属于哪个梁
data_56 = Data(cluster_24)

# ----
# 按照梁分类定位PLANE
cluster_25 = Cluster_7(B=data_56, D=crv_90, P=data_56, G=crv_46)

# ----
# 3.1下层建筑边线外侧50-350mm范围内
pln_82 = Plane(pln_60)
data_57 = Data(cluster_25)

# ----
# 撞到梁交点
merge_38 = Merge(Data1=data_57)

merge_39 = Merge(Data1=pln_63, Data2=merge_38)
orient_8 = Orient(Geometry=item_22, Source=rotate_7.Geometry, Target=merge_39)  # -> Geometry, Transform

data_58 = Data(orient_8.Geometry)
ungroup_11 = Ungroup(Group=data_58)
item_75 = ListItem(List=ungroup_11, Index=0, Wrap=True)  # -> flatten(Item)
item_76 = ListItem(List=ungroup_11, Index="-1", Wrap=True)  # -> flatten(Item)

# ---- group: 框架顶部，埋件在幕墙线外侧 (continued)
entwine_19 = Entwine(Branch00=item_75, Branch01=item_76, FlattenInputs=True)
bake_9 = BakeObjects(Geometry=entwine_19, Attributes=attributes_6, BakeName=panel_24, Bake=False)

# ----
# 使用过的点
merge_40 = Merge(Data1=merge_36, Data2=pln_82)

# ----
# 3.1下层建筑内侧到300到外侧50内是否有钢结构
merge_41 = Merge(Data1=flatten(merge_40), Data2=flatten(merge_33), Data3=flatten(pln_52))
deplane_33 = DeconstructPlane(Plane=merge_41)  # -> Origin, XAxis, YAxis, ZAxis
deplane_34 = DeconstructPlane(Plane=pln_53)  # -> Origin, XAxis, YAxis, ZAxis
check_same_points_7 = CheckSamePoints(archPoint=deplane_34.Origin, crvPoint=deplane_33.Origin)  # -> out, specialPt; inputs archPoint: list of Point3d, crvPoint: list of Point3d; same code as testpoint

# ---- group: 有效筛选点
cull_i_9 = CullIndex(List=pln_53, Indices=check_same_points_7.specialPt, Wrap=True)

# ----
# 2.1 Missing Point
# 埋件定位点Offset，没有找到和梁的交点
number_slider_32 = Slider(5000, range=0..10000)
merge_42 = Merge(Data1=pln_71, Data2=pln_79, Data3=pln_78)

# ----
# 0 檐口出定位点
# 与结构无交点
pln_83 = Plane(flatten(merge_42))

deplane_35 = DeconstructPlane(Plane=pln_83)  # -> Origin, XAxis, YAxis, ZAxis
amp_45 = Amplitude(Vector=deplane_35.YAxis, Amplitude=number_slider_32)
move_58 = Move(Geometry=deplane_35.Origin, Motion=amp_45)  # -> Geometry, Transform
ln_30 = Line(StartPoint=move_58.Geometry, EndPoint=deplane_35.Origin)
amp_46 = Amplitude(Vector=deplane_35.XAxis, Amplitude=number_slider_6)
amp_47 = Amplitude(Vector=deplane_35.XAxis, Amplitude=expr("-x", number_slider_6))
move_59 = Move(Geometry=ln_30, Motion=amp_46)  # -> Geometry, Transform
move_60 = Move(Geometry=ln_30, Motion=amp_47)  # -> Geometry, Transform

ccx_29 = CurveCurve(CurveA=graft(move_60.Geometry), CurveB=flatten(crv_88))  # -> Points, ParamsA, ParamsB
shift_25 = ShiftPaths(Data=ccx_29.Points, Offset=-1)
pull_29 = PullPoint(Point=shift_25, Geometry=graft(pln_83), ClosestOnly=True)  # -> ClosestPoint, Distance
sort_27 = SortList(Keys=pull_29.Distance, ValuesA=shift_25)  # -> Keys, ValuesA
item_77 = ListItem(List=sort_27.ValuesA, Index="-1", Wrap=True)
null_22 = NullItem(Item=flatten(item_77))  # -> NullFlags, InvalidFlags, Description
end = EndPoints(Curve=move_60.Geometry)  # -> Start, End
dispatch_67 = Dispatch(List=simplify(item_77), DispatchPattern=simplify(graft(null_22.InvalidFlags)))  # -> ListA, ListB
dispatch_68 = Dispatch(List=graft(pln_83), DispatchPattern=flatten(null_22.InvalidFlags))  # -> ListA, ListB
dispatch_69 = Dispatch(List=simplify(graft(end.End)), DispatchPattern=simplify(graft(null_22.InvalidFlags)))  # -> ListA, ListB
pln_84 = Plane(dispatch_68.ListB)
pt_30 = Point(dispatch_67.ListB)
pt_31 = Point(dispatch_69.ListB)
ln_31 = Line(StartPoint=pt_31, EndPoint=pt_30)
len_7 = Length(Curve=ln_31)
larger_7 = LargerThan(FirstNumber=len_7, SecondNumber=Slider(350, range=0..1000))  # -> LargerThan, OrEqualTo
dispatch_70 = Dispatch(List=pln_84, DispatchPattern=larger_7.LargerThan)  # -> ListA, ListB
dispatch_71 = Dispatch(List=pt_30, DispatchPattern=larger_7.LargerThan)  # -> ListA, ListB
pln_85 = Plane(dispatch_70.ListA)
pt_32 = Point(dispatch_71.ListA)
move2pt_11 = MoveToPoint(Geometry=pln_85, PointA=pln_85, PointB=pt_32)  # -> Moved, Vector, Transform

ccx_30 = CurveCurve(CurveA=graft(move_59.Geometry), CurveB=flatten(crv_88))  # -> Points, ParamsA, ParamsB
shift_26 = ShiftPaths(Data=ccx_30.Points, Offset=-1)
pull_30 = PullPoint(Point=shift_26, Geometry=graft(pln_83), ClosestOnly=True)  # -> ClosestPoint, Distance
sort_28 = SortList(Keys=pull_30.Distance, ValuesA=shift_26)  # -> Keys, ValuesA
item_78 = ListItem(List=sort_28.ValuesA, Index="-1", Wrap=True)
null_23 = NullItem(Item=flatten(item_78))  # -> NullFlags, InvalidFlags, Description
dispatch_72 = Dispatch(List=graft(pln_83), DispatchPattern=graft(null_23.InvalidFlags))  # -> ListA, ListB
dispatch_73 = Dispatch(List=simplify(item_78), DispatchPattern=simplify(graft(null_23.InvalidFlags)))  # -> ListA, ListB
end_2 = EndPoints(Curve=move_59.Geometry)  # -> Start, End
pt_33 = Point(dispatch_73.ListB)
pln_86 = Plane(dispatch_72.ListB)
dispatch_74 = Dispatch(List=simplify(graft(end_2.End)), DispatchPattern=simplify(graft(null_23.InvalidFlags)))  # -> ListA, ListB
pt_34 = Point(dispatch_74.ListB)
ln_32 = Line(StartPoint=pt_34, EndPoint=pt_33)
len_8 = Length(Curve=ln_32)
larger_8 = LargerThan(FirstNumber=len_8, SecondNumber=Slider(350, range=0..1000))  # -> LargerThan, OrEqualTo
dispatch_75 = Dispatch(List=pln_86, DispatchPattern=larger_8.LargerThan)  # -> ListA, ListB
dispatch_76 = Dispatch(List=pt_33, DispatchPattern=larger_8.LargerThan)  # -> ListA, ListB
pln_87 = Plane(dispatch_75.ListA)
pt_35 = Point(dispatch_76.ListA)
move2pt_12 = MoveToPoint(Geometry=pln_87, PointA=pln_87, PointB=pt_35)  # -> Moved, Vector, Transform

# ---- group: 有效plane-2次
merge_43 = Merge(Data1=move2pt_12.Moved, Data2=move2pt_11.Moved)

# ----
# 按照梁分类定位点
cluster_26 = Cluster_8(result=merge_43, C=crv_91)

# ---- group: 交点-属于哪个梁
data_59 = Data(cluster_26)

# ----
# 按照梁分类定位PLANE
cluster_27 = Cluster_9(B=data_59, D=crv_92, P=data_59, G=crv_47)

# ---- group: 檐口-首次筛选的有效起始Plane
data_60 = Data(cluster_27)

# ----
# 撞到梁交点
merge_44 = Merge(Data1=data_60)

merge_45 = Merge(Data1=pln_77, Data2=merge_44)
orient_9 = Orient(Geometry=item_20, Source=rotate_6.Geometry, Target=merge_45)  # -> Geometry, Transform

data_61 = Data(orient_9.Geometry)
ungroup_12 = Ungroup(Group=data_61)
item_79 = ListItem(List=ungroup_12, Index=0, Wrap=True)  # -> flatten(Item)
item_80 = ListItem(List=ungroup_12, Index="-1", Wrap=True)  # -> flatten(Item)

# ---- group: 有吊顶的范围，檐口处内侧埋件 (continued)
entwine_20 = Entwine(Branch00=item_79, Branch01=item_80, FlattenInputs=True)
bake_10 = BakeObjects(Geometry=entwine_20, Attributes=attributes_4, BakeName=panel_22, Bake=False)

# ----
pln_88 = Plane(cull_i_9)
number_slider_33 = Slider(3584, range=0..10000)
deplane_36 = DeconstructPlane(Plane=pln_88)  # -> Origin, XAxis, YAxis, ZAxis
amp_48 = Amplitude(Vector=deplane_36.YAxis, Amplitude=number_slider_33)
amp_49 = Amplitude(Vector=deplane_36.YAxis, Amplitude=expr("-x", number_slider_33))
move_61 = Move(Geometry=deplane_36.Origin, Motion=amp_49)  # -> Geometry, Transform
move_62 = Move(Geometry=deplane_36.Origin, Motion=amp_48)  # -> Geometry, Transform
ln_33 = Line(StartPoint=move_61.Geometry, EndPoint=move_62.Geometry)

# ----
# 4下层建筑内侧到300到外侧50内
# 有钢结构
ccx_31 = CurveCurve(CurveA=graft(ln_33), CurveB=flatten(crv_59))  # -> Points, ParamsA, ParamsB

shift_27 = ShiftPaths(Data=ccx_31.Points, Offset=-1)
pull_31 = PullPoint(Point=graft(pln_88), Geometry=shift_27, ClosestOnly=True)  # -> ClosestPoint, Distance
sort_29 = SortList(Keys=pull_31.Distance, ValuesA=pull_31.ClosestPoint)  # -> Keys, ValuesA
item_81 = ListItem(List=sort_29.ValuesA, Index=0, Wrap=True)
null_24 = NullItem(Item=sort_29.ValuesA)  # -> NullFlags, simplify(InvalidFlags), Description
dispatch_77 = Dispatch(List=simplify(graft(pln_88)), DispatchPattern=null_24.InvalidFlags)  # -> ListA, ListB
pln_89 = Plane(dispatch_77.ListB)
pln_90 = Plane(dispatch_77.ListA)
move2pt_13 = MoveToPoint(Geometry=pln_89, PointA=pln_89, PointB=simplify(item_81))  # -> flatten(Moved), Vector, Transform

# ---- group: 交点-属于哪个梁
data_62 = Data(move2pt_13.Moved)

# ----
# 按照梁分类定位点
crv_108 = Curve(shift)
cluster_28 = Cluster_17(data=data_62, C=crv_108)

# ----
# 按照梁分类定位PLANE
pt_36 = Point(cluster_28)
cluster_29 = Cluster_18(relay=pt_36, D=crv_93, G=crv_51)

# ---- group: 檐口-首次筛选的有效起始Plane
data_63 = Data(cluster_29)

# ----
# 可能的结构交点-大量
pln_91 = Plane(pln_90)

# ----
# 0 檐口出定位点
# 与结构无交点
pln_92 = Plane(flatten(pln_91))

# ----
# 4 Missing Point
# 埋件定位点Offset，没有找到和梁的交点
number_slider_34 = Slider(5000, range=0..10000)
deplane_37 = DeconstructPlane(Plane=pln_92)  # -> Origin, XAxis, YAxis, ZAxis
amp_50 = Amplitude(Vector=deplane_37.YAxis, Amplitude=expr("-x", number_slider_34))
move_63 = Move(Geometry=deplane_37.Origin, Motion=amp_50)  # -> Geometry, Transform
ln_34 = Line(StartPoint=move_63.Geometry, EndPoint=deplane_37.Origin)
amp_51 = Amplitude(Vector=deplane_37.XAxis, Amplitude=number_slider_6)
amp_52 = Amplitude(Vector=deplane_37.XAxis, Amplitude=expr("-x", number_slider_6))
move_64 = Move(Geometry=ln_34, Motion=amp_51)  # -> Geometry, Transform
move_65 = Move(Geometry=ln_34, Motion=amp_52)  # -> Geometry, Transform

ccx_32 = CurveCurve(CurveA=graft(move_65.Geometry), CurveB=flatten(crv_60))  # -> Points, ParamsA, ParamsB
shift_28 = ShiftPaths(Data=ccx_32.Points, Offset=-1)
sort_30 = SortList(Keys=shift_28, ValuesA=shift_28)  # -> Keys, ValuesA
pull_32 = PullPoint(Point=sort_30.ValuesA, Geometry=graft(pln_92), ClosestOnly=True)  # -> ClosestPoint, Distance
sort_31 = SortList(Keys=pull_32.Distance, ValuesA=sort_30.ValuesA)  # -> Keys, ValuesA
item_82 = ListItem(List=sort_31.ValuesA, Index="-1", Wrap=True)
null_25 = NullItem(Item=flatten(item_82))  # -> NullFlags, InvalidFlags, Description
dispatch_78 = Dispatch(List=flatten(item_82), DispatchPattern=null_25.InvalidFlags)  # -> ListA, ListB
dispatch_79 = Dispatch(List=pln_92, DispatchPattern=null_25.InvalidFlags)  # -> ListA, ListB
pt_37 = Point(dispatch_78.ListB)
pln_93 = Plane(dispatch_79.ListB)
move2pt_14 = MoveToPoint(Geometry=pln_93, PointA=pln_93, PointB=pt_37)  # -> Moved, Vector, Transform

ccx_33 = CurveCurve(CurveA=graft(move_64.Geometry), CurveB=flatten(crv_60))  # -> Points, ParamsA, ParamsB
shift_29 = ShiftPaths(Data=ccx_33.Points, Offset=-1)
sort_32 = SortList(Keys=shift_29, ValuesA=shift_29)  # -> Keys, ValuesA
pull_33 = PullPoint(Point=sort_32.ValuesA, Geometry=graft(pln_92), ClosestOnly=True)  # -> ClosestPoint, Distance
sort_33 = SortList(Keys=pull_33.Distance, ValuesA=sort_32.ValuesA)  # -> Keys, ValuesA
item_83 = ListItem(List=sort_33.ValuesA, Index="-1", Wrap=True)
null_26 = NullItem(Item=flatten(item_83))  # -> NullFlags, InvalidFlags, Description
dispatch_80 = Dispatch(List=pln_92, DispatchPattern=null_26.InvalidFlags)  # -> ListA, ListB
dispatch_81 = Dispatch(List=flatten(item_83), DispatchPattern=null_26.InvalidFlags)  # -> ListA, ListB
pln_94 = Plane(dispatch_80.ListB)
pt_38 = Point(dispatch_81.ListB)
move2pt_15 = MoveToPoint(Geometry=pln_94, PointA=pln_94, PointB=pt_38)  # -> Moved, Vector, Transform

merge_46 = Merge(Data1=move2pt_15.Moved, Data2=move2pt_14.Moved)

# ----
# 按照梁分类定位点
cluster_30 = Cluster_19(data=merge_46, crv=shift)

# ----
# 按照梁分类定位PLANE
pt_39 = Point(cluster_30)
cluster_31 = Cluster_20(relay=pt_39, D=crv_94, G=crv_52)

# ---- group: 檐口-首次筛选的有效起始Plane
# 阳角
# 阴角
# 阳角
# 阴角
# SmoothCurve-阴角
# SmoothCurve-阳角
# SmoothCurve-阴角
# SmoothCurve-正常
# Angular Curve - All
# Special Curve(with location)- All
# Curve for this project only - All
data_64 = Data(cluster_31)

# ----
# 撞到梁交点
pln_95 = Plane(data_64)

# ----
# 4.1下层建筑内侧300到外侧50内
# 03底埋，钢板焊
data_65 = Data(merge_6)
pln_96 = Plane(data_63)
item_84 = ListItem(List=data_65, Index=0, Wrap=True)  # -> Item, Item1
merge_47 = Merge(Data1=pln_96, Data2=pln_95)

# ---- group: All Location Point
merge_48 = Merge(Data1=merge_45, Data2=merge_39, Data3=merge_35, Data4=merge_47)

# ----
# 这里如果跑红也不要紧，
# 说明单体没有出现相撞的情况
# Sort Text
# curve
# （3.1）导入轴线
# Rhino 文件中导入的块名
orient_10 = Orient(Geometry=item_84.Item, Source=item_84.Item1, Target=merge_47)  # -> Geometry, Transform

data_66 = Data(orient_10.Geometry)
ungroup_13 = Ungroup(Group=data_66)
item_85 = ListItem(List=ungroup_13, Index=0, Wrap=True)  # -> flatten(Item)
item_86 = ListItem(List=ungroup_13, Index="-1", Wrap=True)  # -> flatten(Item)

# ---- group: 钢结构下底埋 (continued)
entwine_21 = Entwine(Branch00=item_85, Branch01=item_86, FlattenInputs=True)
bake_11 = BakeObjects(Geometry=entwine_21, Attributes=attributes_8, BakeName=panel_28, Bake=False)

# ----
null_27 = NullItem(Item=merge_48)  # -> NullFlags, InvalidFlags, Description
dispatch_82 = Dispatch(List=merge_48, DispatchPattern=null_27.InvalidFlags)  # -> ListA, ListB

# ---- group: 下层图纸-标注定位点
pt_40 = Point(dispatch_82.ListB)

# ----
cluster_32 = Cluster_2(
    outline_curve=标准范围_符合单一轴网方向,
    dim_offset_1=number_slider_10,
    dim_offset_2=number_slider_8,
    axis_direction_crv1=crv_13,
    axis_direction_crv2=crv_14,
    f2_arch_outline=crv_53,
    location_point=pt_40,
    dim_style=panel_14,
    directed_outline=seam,
    移除重复位置点_容差=number_slider_9)  # -> D_3, D_4, D, D_2
dimension1_2 = Data(cluster_32.D_3)

# ---- group: Dimension4
data_67 = Data(cluster_32.D_2)

# ---- group: Dimension2
data_68 = Data(cluster_32.D_4)

# ---- group: Dimension3
data_69 = Data(cluster_32.D)

# ----
entwine_22 = Entwine(Branch00=dimension1_2, Branch01=data_68, Branch02=data_69, Branch03=data_67, FlattenInputs=True)

# ---- group: Refrash Data
# 将所有Input都输入完后要Refresh data
dam_2 = DataDam(DataA=entwine_22, BufferDelay=10000000, BufferMode=0)

# ----
dedim_2 = DeconstructDimension(DimensionObject=dam_2)  # -> Value, Text, Plane, Points, Style
shift_30 = ShiftPaths(Data=dedim_2.Text, Offset=-1)
smaller_10 = SmallerThan(FirstNumber=shift_30, SecondNumber=Slider(1, range=0..10))  # -> SmallerThan, OrEqualTo
dispatch_83 = Dispatch(List=dam_2, DispatchPattern=smaller_10.SmallerThan)  # -> ListA, ListB

# ---- group: Bake Me
bake_12 = BakeObjects(Geometry=dispatch_83.ListB, Attributes=attributes_11, Bake=False)

# ----
data_70 = Data(dispatch_83.ListB)

# ==== cluster Cluster
G = ClusterInput()
rotate = Rotate(Geometry=G, Angle=3.141592654, Plane=PlaneXY(0, 0, 0))  # -> Geometry, Transform
boxprop = BoxProperties(Box=rotate.Geometry)  # -> Center, Diagonal, Area, Volume, Degeneracy
bbox = BoundingBox(Content=rotate.Geometry, Plane=PlaneXY(0, 0, 0))  # -> Box, Box_2
debox = DeconstructBox(Box=bbox.Box)  # -> Plane, X, Y, Z
pdecon = Deconstruct(Point=boxprop.Center)  # -> XComponent, YComponent, ZComponent
dedomain = DeconstructDomain(Domain=debox.Y)  # -> Start, End
pt = ConstructPoint(XCoordinate=pdecon.XComponent, YCoordinate=dedomain.Start, ZCoordinate=pdecon.ZComponent)
xy = XYPlane(Origin=Point(0, 0, 0))
pl_origin = PlaneOrigin(Base=xy, Origin=pt)
orient = Orient(Geometry=rotate.Geometry, Source=pl_origin, Target=xy)  # -> Geometry, Transform
G_2 = ClusterOutput(orient.Geometry)

# ==== cluster Cluster_2
f2_arch_outline = ClusterInput()
directed_outline = ClusterInput()
location_point = ClusterInput()
移除重复位置点_容差 = ClusterInput()
dim_offset_1 = ClusterInput()
dim_offset_2 = ClusterInput()
axis_direction_crv1 = ClusterInput()
axis_direction_crv2 = ClusterInput()
dim_style = ClusterInput()
outline_curve = ClusterInput()
pt = Point(location_point)
merge = Merge(Data1=axis_direction_crv1, Data2=axis_direction_crv2)
crv = Curve(f2_arch_outline)
number_slider = Slider(61, range=0..100)

incurve = PointInCurve(Point=flatten(pt), Curve=outline_curve)  # -> Relationship, Point
equals = Equality(FirstNumber=incurve.Relationship, SecondNumber="0")  # -> Equality, Inequality
dispatch = Dispatch(List=flatten(pt), DispatchPattern=equals.Inequality)  # -> ListA, ListB
pt_2 = Point(dispatch.ListA)
crv_cp = CurveClosestPoint(Point=pt_2, Curve=directed_outline)  # -> Point, Parameter, Distance
sort = SortList(Keys=crv_cp.Parameter, ValuesA=pt_2)  # -> Keys, ValuesA
pt_3 = Point(sort.ValuesA)
item = ListItem(List=merge, Index=0, Wrap=True)  # -> Item, Item1

# ----
# remove重复定位点生成的2个点
pt_4 = Point(pt_3)
shift = ShiftList(List=pt_4, Shift=1, Wrap=invert(True))
pt_5 = Point(pt_3)
pt_6 = Point(shift)
dist = Distance(PointA=pt_5, PointB=pt_6)
larger = LargerThan(FirstNumber=dist, SecondNumber=移除重复位置点_容差)  # -> LargerThan, OrEqualTo
dispatch_2 = Dispatch(List=pt_5, DispatchPattern=larger.LargerThan)  # -> ListA, ListB
pt_7 = Point(dispatch_2.ListA)
pt_8 = Point(dispatch_2.ListB)

dispatch_3 = Dispatch(List=pt_7, DispatchPattern=[True, False])  # -> ListA, ListB
pt_9 = Point(dispatch_3.ListB)
pt_10 = Point(dispatch_3.ListA)
pl = ConstructPlane(Origin=pt_10, XAxis=item.Item1, YAxis=item.Item)
pl_2 = ConstructPlane(Origin=pt_10, XAxis=item.Item, YAxis=item.Item1)

item_2 = ListItem(List=pt_7, Index=number_slider, Wrap=True)
shift_2 = ShiftList(List=pt_7, Shift=1, Wrap=invert(True))
item_3 = ListItem(List=shift_2, Index=number_slider, Wrap=True)

dispatch_4 = Dispatch(List=shift_2, DispatchPattern=[True, False])  # -> ListA, ListB
item_4 = ListItem(List=merge, Index=0, Wrap=True)  # -> Item, Item1
pt_11 = Point(dispatch_4.ListB)
pt_12 = Point(dispatch_4.ListA)
pl_3 = ConstructPlane(Origin=pt_12, XAxis=item_4.Item1, YAxis=item_4.Item)
pl_4 = ConstructPlane(Origin=pt_12, XAxis=item_4.Item, YAxis=item_4.Item1)

ln = Line(StartPoint=pt_10, EndPoint=pt_9)
ln_2 = Line(StartPoint=pt_12, EndPoint=pt_11)

crv_2 = Curve(crv)
deplane = DeconstructPlane(Plane=pl_3)  # -> Origin, XAxis, YAxis, ZAxis
amp = Amplitude(Vector=deplane.YAxis, Amplitude=Slider(3000, range=0..10000))
move = Move(Geometry=deplane.Origin, Motion=amp)  # -> Geometry, Transform
clscrv = CloseCurve(Curve=crv_2, CloseType=0, Bulge=0.5, Tolerance=0)  # -> Closed, R
pt_13 = Point(move.Geometry)
incurve_2 = PointInCurve(Point=pt_13, Curve=clscrv.Closed)  # -> Relationship, Point
equals_2 = Equality(FirstNumber=incurve_2.Relationship, SecondNumber="2")  # -> Equality, Inequality
lng = ListLength(List=equals_2.Equality)
lng_2 = ListLength(List=equals_2.Equality)
neg = Negative(Value=dim_offset_1)
repeat = RepeatData(Data=graft(neg), Length=lng)
repeat_2 = RepeatData(Data=graft(dim_offset_1), Length=lng_2)
panel = Panel(equals_2.Equality)
dispatch_5 = Dispatch(List=graft(repeat_2), DispatchPattern=graft(equals_2.Equality))  # -> ListA, ListB
dispatch_6 = Dispatch(List=graft(repeat), DispatchPattern=graft(equals_2.Equality))  # -> ListA, ListB
merge_2 = Merge(Data1=dispatch_5.ListA, Data2=dispatch_6.ListB)  # -> flatten(Result)

crv_3 = Curve(crv)
deplane_2 = DeconstructPlane(Plane=pl_4)  # -> Origin, XAxis, YAxis, ZAxis
amp_2 = Amplitude(Vector=deplane_2.YAxis, Amplitude=Slider(3000, range=0..10000))
move_2 = Move(Geometry=deplane_2.Origin, Motion=amp_2)  # -> Geometry, Transform
clscrv_2 = CloseCurve(Curve=crv_3, CloseType=0, Bulge=0.5, Tolerance=0)  # -> Closed, R
pt_14 = Point(move_2.Geometry)
incurve_3 = PointInCurve(Point=pt_14, Curve=clscrv_2.Closed)  # -> Relationship, Point
equals_3 = Equality(FirstNumber=incurve_3.Relationship, SecondNumber="2")  # -> Equality, Inequality
lng_3 = ListLength(List=equals_3.Equality)
neg_2 = Negative(Value=dim_offset_1)
lng_4 = ListLength(List=equals_3.Equality)
repeat_3 = RepeatData(Data=graft(neg_2), Length=lng_4)
repeat_4 = RepeatData(Data=graft(dim_offset_1), Length=lng_3)
panel_2 = Panel(equals_3.Equality)
dispatch_7 = Dispatch(List=graft(repeat_4), DispatchPattern=graft(equals_3.Equality))  # -> ListA, ListB
dispatch_8 = Dispatch(List=graft(repeat_3), DispatchPattern=graft(equals_3.Equality))  # -> ListA, ListB
merge_3 = Merge(Data1=dispatch_7.ListA, Data2=dispatch_8.ListB)  # -> flatten(Result)

crv_4 = Curve(crv)
deplane_3 = DeconstructPlane(Plane=pl)  # -> Origin, XAxis, YAxis, ZAxis
amp_3 = Amplitude(Vector=deplane_3.YAxis, Amplitude=Slider(3000, range=0..10000))
move_3 = Move(Geometry=deplane_3.Origin, Motion=amp_3)  # -> Geometry, Transform
clscrv_3 = CloseCurve(Curve=crv_4, CloseType=0, Bulge=0.5, Tolerance=0)  # -> Closed, R
pt_15 = Point(move_3.Geometry)
incurve_4 = PointInCurve(Point=pt_15, Curve=clscrv_3.Closed)  # -> Relationship, Point
equals_4 = Equality(FirstNumber=incurve_4.Relationship, SecondNumber="2")  # -> Equality, Inequality
lng_5 = ListLength(List=equals_4.Equality)
neg_3 = Negative(Value=dim_offset_2)
lng_6 = ListLength(List=equals_4.Equality)
repeat_5 = RepeatData(Data=graft(neg_3), Length=lng_6)
repeat_6 = RepeatData(Data=graft(dim_offset_2), Length=lng_5)
panel_3 = Panel(equals_4.Equality)
dispatch_9 = Dispatch(List=graft(repeat_6), DispatchPattern=graft(equals_4.Equality))  # -> ListA, ListB
dispatch_10 = Dispatch(List=graft(repeat_5), DispatchPattern=graft(equals_4.Equality))  # -> ListA, ListB
merge_4 = Merge(Data1=dispatch_9.ListA, Data2=dispatch_10.ListB)  # -> flatten(Result)

crv_5 = Curve(crv)
deplane_4 = DeconstructPlane(Plane=pl_2)  # -> Origin, XAxis, YAxis, ZAxis
amp_4 = Amplitude(Vector=deplane_4.YAxis, Amplitude=Slider(3000, range=0..10000))
move_4 = Move(Geometry=deplane_4.Origin, Motion=amp_4)  # -> Geometry, Transform
clscrv_4 = CloseCurve(Curve=crv_5, CloseType=0, Bulge=0.5, Tolerance=0)  # -> Closed, R
pt_16 = Point(move_4.Geometry)
incurve_5 = PointInCurve(Point=pt_16, Curve=clscrv_4.Closed)  # -> Relationship, Point
equals_5 = Equality(FirstNumber=incurve_5.Relationship, SecondNumber="2")  # -> Equality, Inequality
lng_7 = ListLength(List=equals_5.Equality)
neg_4 = Negative(Value=dim_offset_2)
lng_8 = ListLength(List=equals_5.Equality)
repeat_7 = RepeatData(Data=graft(neg_4), Length=lng_8)
repeat_8 = RepeatData(Data=graft(dim_offset_2), Length=lng_7)
panel_4 = Panel(equals_5.Equality)
dispatch_11 = Dispatch(List=graft(repeat_8), DispatchPattern=graft(equals_5.Equality))  # -> ListA, ListB
dispatch_12 = Dispatch(List=graft(repeat_7), DispatchPattern=graft(equals_5.Equality))  # -> ListA, ListB
merge_5 = Merge(Data1=dispatch_11.ListA, Data2=dispatch_12.ListB)  # -> flatten(Result)

lineardim = DefineLinearDimension(
    Point1=simplify(pt_12),
    Point2=simplify(pt_11),
    DimensionPlane=simplify(pl_3),
    Offset=expr("-x", merge_2),
    DimensionStyle=dim_style)
lineardim_2 = DefineLinearDimension(
    Point1=simplify(pt_12),
    Point2=simplify(pt_11),
    DimensionPlane=simplify(pl_4),
    Offset=expr("-x", merge_3),
    DimensionStyle=dim_style)
lineardim_3 = DefineLinearDimension(
    Point1=simplify(pt_10),
    Point2=simplify(pt_9),
    DimensionPlane=simplify(pl),
    Offset=expr("-x", merge_4),
    DimensionStyle=dim_style)
lineardim_4 = DefineLinearDimension(
    Point1=simplify(pt_10),
    Point2=simplify(pt_9),
    DimensionPlane=simplify(pl_2),
    Offset=expr("-x", merge_5),
    DimensionStyle=dim_style)
D = ClusterOutput(lineardim)
D_2 = ClusterOutput(lineardim_2)
D_3 = ClusterOutput(lineardim_3)
D_4 = ClusterOutput(lineardim_4)

# ==== cluster Cluster_3
structure_number = ClusterInput()
tag_text = ClusterInput()
text_offset = ClusterInput()
embed_color = ClusterInput()
T = ClusterInput()
G = ClusterInput()
A = ClusterInput()
A_2 = ClusterInput()
B = ClusterInput()
dimension_style = ClusterInput()

# ----
# 列表文字以空格进行分割
panel = Panel(" ")
split = TextSplit(Text=T, Separators=panel)

钢埋板长度_2 = Division(A=A, B=2)
neg = Negative(Value=钢埋板长度_2)
dom = ConstructDomain(DomainStart=neg, DomainEnd=钢埋板长度_2)
panel_2 = Panel(dom)

钢埋板厚度_2 = Division(A=A_2, B=2)
neg_2 = Negative(Value=钢埋板厚度_2)
dom_2 = ConstructDomain(DomainStart=neg_2, DomainEnd=钢埋板厚度_2)
panel_3 = Panel(dom_2)

# ----
# 钢埋板肋板位置 1/4处
panel_4 = Panel("4")
division = Division(A=A, B=panel_4)

# ----
# 编号和截面尺寸分区
panel_5 = Panel("1")
split_2 = SplitList(List=split, Index=panel_5)  # -> flatten(ListA), flatten(ListB)

# ----
# 求出对应输入编号的钢结构截面尺寸
fsim = FindSimilarMember(Data=structure_number, Set=split_2.ListA)  # -> Hit, Index
item = ListItem(List=split_2.ListB, Index=fsim.Index, Wrap=True)

addition = Addition(A=neg_2, B=division)
addition_2 = Addition(A=钢埋板厚度_2, B=division)
dom_3 = ConstructDomain(DomainStart=addition, DomainEnd=addition_2)
panel_6 = Panel(split_2.ListB)
split_3 = TextSplit(Text=item, Separators="x")
split_4 = TextSplit(Text=split_3, Separators="Q")
item_2 = ListItem(List=split_4, Index="0", Wrap=True)  # -> flatten(Item)
subtraction = Subtraction(A=division, B=钢埋板厚度_2)
subtraction_2 = Subtraction(A=division, B=钢埋板厚度_2)
subtraction_3 = Subtraction(A=division, B=钢埋板厚度_2)
neg_3 = Negative(Value=钢埋板厚度_2)
neg_4 = Negative(Value=钢埋板厚度_2)
neg_5 = Negative(Value=钢埋板厚度_2)
subtraction_4 = Subtraction(A=division, B=钢埋板厚度_2)
addition_3 = Addition(A=subtraction, B=A_2)
addition_4 = Addition(A=subtraction_2, B=A_2)
subtraction_5 = Subtraction(A=neg_3, B=A_2)
subtraction_6 = Subtraction(A=neg_4, B="2")
subtraction_7 = Subtraction(A=division, B=钢埋板厚度_2)
addition_5 = Addition(A=subtraction_3, B="2")
subtraction_8 = Subtraction(A=neg_5, B="2")
neg_6 = Negative(Value=钢埋板厚度_2)
neg_7 = Negative(Value=钢埋板厚度_2)
工字钢_h = ListItem(List=item_2, Index=0, Wrap=True)
工字钢_b = ListItem(List=item_2, Index=1, Wrap=True)
工字钢_tf = ListItem(List=item_2, Index=3, Wrap=True)
工字钢_tw = ListItem(List=item_2, Index=2, Wrap=True)
pt = ConstructPoint(XCoordinate=neg_6, YCoordinate=subtraction_4, ZCoordinate=0)
pt_2 = ConstructPoint(XCoordinate=neg_7, YCoordinate=addition_3, ZCoordinate=0)
pt_3 = ConstructPoint(XCoordinate=subtraction_5, YCoordinate=addition_4, ZCoordinate=0)
pt_4 = ConstructPoint(XCoordinate=subtraction_6, YCoordinate=subtraction_7, ZCoordinate=0)
pt_5 = ConstructPoint(XCoordinate=subtraction_8, YCoordinate=addition_5, ZCoordinate=0)
subtraction_9 = Subtraction(A=工字钢_b, B=工字钢_tw)
division_2 = Division(A=subtraction_9, B="2")
merge = Merge(Data1=pt, Data2=pt_2, Data3=pt_3, Data4=pt_5, Data5=pt_4)
pline = PolyLine(Vertices=merge, Closed=True)
division_3 = Division(A=division_2, B="2")
subtraction_10 = Subtraction(A=division_3, B=A_2)
subtraction_11 = Subtraction(A=division_3, B=钢埋板厚度_2)
neg_8 = Negative(Value=division_3)
subtraction_12 = Subtraction(A=neg_8, B=subtraction_11)
addition_6 = Addition(A=subtraction_12, B=B)
dom_4 = ConstructDomain(DomainStart=addition_6, DomainEnd=subtraction_12)
dom_5 = ConstructDomain(DomainStart=addition, DomainEnd=addition_2)
钢肋板倒角_侧视图 = Rectangle(Plane=PlaneXY(0, 0, 0), XSize=dom_4, YSize=dom_5, Radius=0)  # -> Rectangle, Length
subtraction_13 = Subtraction(A=subtraction_10, B=subtraction_11)
subtraction_14 = Subtraction(A=neg_8, B=subtraction_11)
dom_6 = ConstructDomain(DomainStart=subtraction_13, DomainEnd=subtraction_14)
钢肋板_侧视图 = Rectangle(Plane=PlaneXY(0, 0, 0), XSize=dom_6, YSize=dom_3, Radius=0)  # -> Rectangle, Length
merge_2 = Merge(Data1=钢肋板_侧视图.Rectangle, Data2=pline, Data3=钢肋板倒角_侧视图.Rectangle)
xz = XZPlane(Origin=Point(0, 0, 0))
mirror = Mirror(Geometry=merge_2, Plane=xz)  # -> Geometry, Transform
钢埋板_侧视图 = Rectangle(Plane=PlaneXY(0, 0, 0), XSize=dom_2, YSize=dom, Radius=0)  # -> Rectangle, Length
division_4 = Division(A=工字钢_b, B=2)
侧视图 = Entwine(Branch00=钢埋板_侧视图.Rectangle, Branch01=merge_2, Branch02=mirror.Geometry, FlattenInputs=True)
R = ClusterOutput(division_4)
division_5 = Division(A=工字钢_h, B="2")
subtraction_15 = Subtraction(A=division_5, B=工字钢_tf)
addition_7 = Addition(A=subtraction_15, B=Slider(200, range=0..1000))
addition_8 = Addition(A=addition_7, B=division_2)
X = UnitX(Factor=addition_8)
move = Move(Geometry=侧视图, Motion=X)  # -> Geometry, Transform
split_tree = SplitTree(Data=move.Geometry, Masks=flatten("{0;0}"))  # -> Positive, Negative
dispatch = Dispatch(List=split_tree.Negative, DispatchPattern=[True, False])  # -> flatten(ListA), ListB
merge_3 = Merge(Data1=split_tree.Positive, Data2=dispatch.ListA)
entwine = Entwine(Branch00=merge_3, Branch01=dispatch.ListB, FlattenInputs=True)
flatten = FlattenTree(Tree=entwine, Path="{0}")
group = Group(Objects=flatten)
rotate = Rotate(Geometry=group, Angle=3.141592654, Plane=PlaneXY(0, 0, 0))  # -> Geometry, Transform
boxprop = BoxProperties(Box=rotate.Geometry)  # -> Center, Diagonal, Area, Volume, Degeneracy
bbox = BoundingBox(Content=rotate.Geometry, Plane=PlaneXY(0, 0, 0))  # -> Box, Box_2
debox = DeconstructBox(Box=bbox.Box)  # -> Plane, X, Y, Z
pdecon = Deconstruct(Point=boxprop.Center)  # -> XComponent, YComponent, ZComponent
dedomain = DeconstructDomain(Domain=debox.Y)  # -> Start, End
pt_6 = ConstructPoint(XCoordinate=pdecon.XComponent, YCoordinate=dedomain.Start, ZCoordinate=pdecon.ZComponent)
xy = XYPlane(Origin=Point(0, 0, 0))
concat = Concatenate(FragmentA="Embed", FragmentB=tag_text)
pl_origin = PlaneOrigin(Base=xy, Origin=pt_6)
orient = Orient(Geometry=rotate.Geometry, Source=pl_origin, Target=xy)  # -> Geometry, Transform
xy_2 = XYPlane(Origin=Point(0, 0, 0))
attributes = DefineObjectAttributes(Color=embed_color)
ungroup = Ungroup(Group=orient.Geometry)
block = DefineBlock(Geometry=ungroup, Attributes=attributes, BlockName=concat, BasePlane=PlaneXY(0, 0, 0))
deblock = DeconstructBlock(Block=block)  # -> Name, flatten(Plane), flatten(Geometry)
group_2 = Group(Objects=deblock.Geometry)
bbox_2 = BoundingBox(Content=group_2, Plane=PlaneXY(0, 0, 0))  # -> Box, Box_2
deplane = DeconstructPlane(Plane=deblock.Plane)  # -> Origin, XAxis, YAxis, ZAxis
area = Area(Geometry=bbox_2.Box)  # -> Area, Centroid
move2pt = MoveToPoint(Geometry=flatten(deplane.Origin), PointA=flatten(deplane.Origin), PointB=flatten(area.Centroid))  # -> Moved, Vector, Transform
pl = ConstructPlane(Origin=move2pt.Moved, XAxis=deplane.YAxis, YAxis=deplane.XAxis)  # -> graft(Plane)
deplane_2 = DeconstructPlane(Plane=pl)  # -> Origin, XAxis, YAxis, ZAxis
rotate_2 = Rotate(Geometry=pl, Angle="Pi", Plane=pl)  # -> Geometry, Transform
dedomain_2 = DeconstructDomain(Domain=dom)  # -> Start, End
multiplication = Multiplication(A=dedomain_2.Start, B=dedomain_2.Start)
amp = Amplitude(Vector=deplane_2.YAxis, Amplitude=multiplication)
move_2 = Move(Geometry=deplane_2.Origin, Motion=amp)  # -> Geometry, Transform
srf = Surface(bbox_2.Box)
crv = Curve(srf)
ln = Line(StartPoint=move_2.Geometry, EndPoint=deplane_2.Origin)
ccx = CurveCurve(CurveA=ln, CurveB=crv)  # -> Points, ParamsA, ParamsB
ln_2 = Line(StartPoint=deplane_2.Origin, EndPoint=ccx.Points)
move_3 = Move(Geometry=rotate_2.Geometry, Motion=ln_2)  # -> Geometry, Transform

ln_3 = Line(StartPoint=ccx.Points, EndPoint=deplane_2.Origin)
amp_2 = Amplitude(Vector=ln_3, Amplitude=text_offset)
move_4 = Move(Geometry=rotate_2.Geometry, Motion=amp_2)  # -> Geometry, Transform
text = DefineTextObject(Text=tag_text, Plane=move_4.Geometry, DimensionStyle=dimension_style, OutputType="Text")
group_3 = Group(Objects=[block, text])

entwine_2 = Entwine(Branch00=group_3, Branch01=move_3.Geometry, FlattenInputs=True)
project = Project(Geometry=G, Plane=xy_2)  # -> Geometry, Transform
R_2 = ClusterOutput(entwine_2)
G_2 = ClusterOutput(project.Geometry)

# ==== cluster Cluster_4
T = ClusterInput()
A = ClusterInput()
A_2 = ClusterInput()
A_3 = ClusterInput()
B = ClusterInput()
B_2 = ClusterInput()
B_3 = ClusterInput()
B_4 = ClusterInput()
B_5 = ClusterInput()
T_2 = ClusterInput()

钢埋板厚度_2 = Division(A=A_2, B=2)
neg = Negative(Value=钢埋板厚度_2)
dom = ConstructDomain(DomainStart=neg, DomainEnd=钢埋板厚度_2)
panel = Panel(dom)

I = ClusterOutput(dom)

钢埋板长度_2 = Division(A=A, B=2)
neg_2 = Negative(Value=钢埋板长度_2)
dom_2 = ConstructDomain(DomainStart=neg_2, DomainEnd=钢埋板长度_2)
panel_2 = Panel(dom_2)

I_2 = ClusterOutput(dom_2)

# ----
# 列表文字以空格进行分割
panel_3 = Panel(" ")
split = TextSplit(Text=T, Separators=panel_3)

# ----
# 钢埋板肋板位置 1/4处
panel_4 = Panel("4")
division = Division(A=A_3, B=panel_4)

# ----
# 编号和截面尺寸分区
panel_5 = Panel("1")
split_2 = SplitList(List=split, Index=panel_5)  # -> flatten(ListA), flatten(ListB)

flatten = FlattenTree(Tree=T_2, Path="{0}")
addition = Addition(A=钢埋板厚度_2, B=division)
addition_2 = Addition(A=neg, B=division)

# ----
# 求出对应输入编号的钢结构截面尺寸
fsim = FindSimilarMember(Data=flatten, Set=split_2.ListA)  # -> Hit, Index
item = ListItem(List=split_2.ListB, Index=fsim.Index, Wrap=True)

dom_3 = ConstructDomain(DomainStart=addition_2, DomainEnd=addition)
I_3 = ClusterOutput(dom_3)
panel_6 = Panel(split_2.ListB)
split_3 = TextSplit(Text=item, Separators="x")
split_4 = TextSplit(Text=split_3, Separators="Q")
item_2 = ListItem(List=split_4, Index="0", Wrap=True)

shift = ShiftPaths(Data=item_2, Offset=-1)
subtraction = Subtraction(A=division, B=钢埋板厚度_2)
subtraction_2 = Subtraction(A=division, B=钢埋板厚度_2)
subtraction_3 = Subtraction(A=division, B=钢埋板厚度_2)
neg_3 = Negative(Value=钢埋板厚度_2)
neg_4 = Negative(Value=钢埋板厚度_2)
neg_5 = Negative(Value=钢埋板厚度_2)
subtraction_4 = Subtraction(A=division, B=钢埋板厚度_2)
addition_3 = Addition(A=subtraction, B=B_3)
addition_4 = Addition(A=subtraction_2, B=B_4)
subtraction_5 = Subtraction(A=neg_3, B=B_5)
subtraction_6 = Subtraction(A=neg_4, B="2")
subtraction_7 = Subtraction(A=division, B=钢埋板厚度_2)
addition_5 = Addition(A=subtraction_3, B="2")
subtraction_8 = Subtraction(A=neg_5, B="2")
neg_6 = Negative(Value=钢埋板厚度_2)
neg_7 = Negative(Value=钢埋板厚度_2)
工字钢_h = ListItem(List=shift, Index=0, Wrap=True)
工字钢_b = ListItem(List=shift, Index=1, Wrap=True)
工字钢_tf = ListItem(List=shift, Index=3, Wrap=True)
工字钢_tw = ListItem(List=shift, Index=2, Wrap=True)
pt = ConstructPoint(XCoordinate=neg_6, YCoordinate=subtraction_4, ZCoordinate=0)
pt_2 = ConstructPoint(XCoordinate=neg_7, YCoordinate=addition_3, ZCoordinate=0)
pt_3 = ConstructPoint(XCoordinate=subtraction_5, YCoordinate=addition_4, ZCoordinate=0)
pt_4 = ConstructPoint(XCoordinate=subtraction_6, YCoordinate=subtraction_7, ZCoordinate=0)
pt_5 = ConstructPoint(XCoordinate=subtraction_8, YCoordinate=addition_5, ZCoordinate=0)
subtraction_9 = Subtraction(A=工字钢_b, B=工字钢_tw)
merge = Merge(Data1=pt, Data2=pt_2, Data3=pt_3, Data4=pt_5, Data5=pt_4)
division_2 = Division(A=subtraction_9, B="2")
pline = PolyLine(Vertices=merge, Closed=True)
division_3 = Division(A=division_2, B="2")
subtraction_10 = Subtraction(A=division_3, B=B)
subtraction_11 = Subtraction(A=division_3, B=钢埋板厚度_2)
neg_8 = Negative(Value=division_3)
subtraction_12 = Subtraction(A=neg_8, B=subtraction_11)
addition_6 = Addition(A=subtraction_12, B=B_2)
dom_4 = ConstructDomain(DomainStart=addition_6, DomainEnd=subtraction_12)
dom_5 = ConstructDomain(DomainStart=addition_2, DomainEnd=addition)
subtraction_13 = Subtraction(A=subtraction_10, B=subtraction_11)
subtraction_14 = Subtraction(A=neg_8, B=subtraction_11)
dom_6 = ConstructDomain(DomainStart=subtraction_13, DomainEnd=subtraction_14)

i = ClusterOutput(工字钢_h)
i_2 = ClusterOutput(工字钢_b)
i_3 = ClusterOutput(工字钢_tf)
R = ClusterOutput(division_2)
I_4 = ClusterOutput(dom_6)
I_5 = ClusterOutput(dom_4)
I_6 = ClusterOutput(dom_5)
pl = ClusterOutput(pline)
relay = ClusterOutput(工字钢_h)
panel_7 = Panel(工字钢_b)

# ==== cluster Cluster_5
C = ClusterInput()
pt = ClusterInput()
pt_2 = Point(pt)
incurves = PointInCurves(Point=flatten(pt_2), Curves=C)  # -> Relationship, Index, Point
equals = Equality(FirstNumber=incurves.Relationship, SecondNumber="0")  # -> Equality, Inequality
dispatch = Dispatch(List=flatten(pt_2), DispatchPattern=equals.Inequality)  # -> ListA, ListB
A = ClusterOutput(dispatch.ListA)

# ==== cluster Cluster_6
pt = ClusterInput()
pt_2 = Point(pt)
C = ClusterInput()
incurves = PointInCurves(Point=flatten(pt_2), Curves=C)  # -> Relationship, Index, Point
equals = Equality(FirstNumber=incurves.Relationship, SecondNumber="0")  # -> Equality, Inequality
dispatch = Dispatch(List=flatten(pt_2), DispatchPattern=equals.Inequality)  # -> ListA, ListB
A = ClusterOutput(dispatch.ListA)

# ==== cluster Cluster_7
P = ClusterInput()
D = ClusterInput()
B = ClusterInput()
G = ClusterInput()

shift = ShiftPaths(Data=D, Offset=-1)
shift_2 = ShiftPaths(Data=shift, Offset=-1)
pull = PullPoint(Point=P, Geometry=simplify(shift_2), ClosestOnly=True)  # -> ClosestPoint, Distance
ln = Line(StartPoint=pull.ClosestPoint, EndPoint=B)
movetoplane = MoveToPlane(Geometry=G, Plane=PlaneXY(0, 0, 0), Above=True, Below=True)  # -> Geometry, Transform

# ---- group: Y Axis Line-All
crv = Curve(ln)

# ----
end = EndPoints(Curve=graft(crv))  # -> Start, End
merge = Merge(Data1=end.Start, Data2=end.End)
pull_2 = PullPoint(Point=merge, Geometry=movetoplane.Geometry, ClosestOnly=True)  # -> ClosestPoint, Distance
sort = SortList(Keys=pull_2.Distance, ValuesA=merge)  # -> Keys, ValuesA
item = ListItem(List=sort.ValuesA, Index="-1", Wrap=True)
item_2 = ListItem(List=sort.ValuesA, Index=0, Wrap=True)
pt = Point(item_2)
pt_2 = Point(item)
ln_2 = Line(StartPoint=pt_2, EndPoint=pt)
rotate = Rotate(Geometry=ln_2, Angle=1.570796327, Plane=pt)  # -> Geometry, Transform

pt_3 = Point(end.End)

pl = ConstructPlane(Origin=pt_3, XAxis=rotate.Geometry, YAxis=ln_2)
null = NullItem(Item=pl)  # -> NullFlags, InvalidFlags, Description
dispatch = Dispatch(List=pl, DispatchPattern=null.NullFlags)  # -> ListA, ListB
pln = Plane(dispatch.ListB)

shift_3 = ShiftPaths(Data=pln, Offset=-1)
D_2 = ClusterOutput(shift_3)

# ==== cluster Cluster_8
C = ClusterInput()
result = ClusterInput()
result_2 = Result(result)
incurves = PointInCurves(Point=flatten(result_2), Curves=C)  # -> Relationship, Index, Point
equals = Equality(FirstNumber=incurves.Relationship, SecondNumber="0")  # -> Equality, Inequality
dispatch = Dispatch(List=flatten(result_2), DispatchPattern=equals.Inequality)  # -> ListA, ListB
A = ClusterOutput(dispatch.ListA)

# ==== cluster Cluster_9
P = ClusterInput()
D = ClusterInput()
B = ClusterInput()
G = ClusterInput()
shift = ShiftPaths(Data=D, Offset=-1)
shift_2 = ShiftPaths(Data=shift, Offset=-1)
pull = PullPoint(Point=P, Geometry=simplify(shift_2), ClosestOnly=True)  # -> ClosestPoint, Distance
ln = Line(StartPoint=pull.ClosestPoint, EndPoint=B)

# ---- group: Y Axis Line-All
crv = Curve(ln)

# ----
movetoplane = MoveToPlane(Geometry=G, Plane=PlaneXY(0, 0, 0), Above=True, Below=True)  # -> Geometry, Transform
end = EndPoints(Curve=graft(crv))  # -> Start, End
merge = Merge(Data1=end.Start, Data2=end.End)
pull_2 = PullPoint(Point=merge, Geometry=movetoplane.Geometry, ClosestOnly=True)  # -> ClosestPoint, Distance
sort = SortList(Keys=pull_2.Distance, ValuesA=merge)  # -> Keys, ValuesA
item = ListItem(List=sort.ValuesA, Index="-1", Wrap=True)
item_2 = ListItem(List=sort.ValuesA, Index=0, Wrap=True)
pt = Point(item_2)
pt_2 = Point(item)
ln_2 = Line(StartPoint=pt_2, EndPoint=pt)
pt_3 = Point(end.End)
rotate = Rotate(Geometry=ln_2, Angle=1.570796327, Plane=pt)  # -> Geometry, Transform
pl = ConstructPlane(Origin=pt_3, XAxis=rotate.Geometry, YAxis=ln_2)
null = NullItem(Item=pl)  # -> NullFlags, InvalidFlags, Description
dispatch = Dispatch(List=pl, DispatchPattern=null.NullFlags)  # -> ListA, ListB
pln = Plane(dispatch.ListB)
shift_3 = ShiftPaths(Data=pln, Offset=-1)
D_2 = ClusterOutput(shift_3)

# ==== cluster Cluster_10
D = ClusterInput()
G = ClusterInput()
P = ClusterInput()
cullduppoints = RemoveDuplicatePoints(InputPoints=P, Tolerance=0.001)  # -> OutputPoints, FirstPointIndexes
shift = ShiftPaths(Data=D, Offset=-1)
movetoplane = MoveToPlane(Geometry=G, Plane=PlaneXY(0, 0, 0), Above=True, Below=True)  # -> Geometry, Transform
shift_2 = ShiftPaths(Data=shift, Offset=-1)
pull = PullPoint(Point=cullduppoints.OutputPoints, Geometry=simplify(shift_2), ClosestOnly=True)  # -> ClosestPoint, Distance
ln = Line(StartPoint=pull.ClosestPoint, EndPoint=cullduppoints.OutputPoints)

# ---- group: Y Axis Line-All
crv = Curve(ln)

# ----
end = EndPoints(Curve=graft(crv))  # -> Start, End
merge = Merge(Data1=end.Start, Data2=end.End)
geometry = DataDescription(movetoplane.Geometry)
pull_2 = PullPoint(Point=merge, Geometry=geometry, ClosestOnly=True)  # -> ClosestPoint, Distance
sort = SortList(Keys=pull_2.Distance, ValuesA=merge)  # -> Keys, ValuesA
item = ListItem(List=sort.ValuesA, Index=0, Wrap=True)
item_2 = ListItem(List=sort.ValuesA, Index="-1", Wrap=True)
null = NullItem(Item=item_2)  # -> NullFlags, InvalidFlags, Description
null_2 = NullItem(Item=item)  # -> NullFlags, InvalidFlags, Description
dispatch = Dispatch(List=item, DispatchPattern=null_2.NullFlags)  # -> ListA, ListB
dispatch_2 = Dispatch(List=item_2, DispatchPattern=null.NullFlags)  # -> ListA, ListB
pt = Point(dispatch_2.ListB)
pt_2 = Point(dispatch.ListB)
ln_2 = Line(StartPoint=pt, EndPoint=pt_2)
end_2 = EndPoints(Curve=graft(ln_2))  # -> Start, End
rotate = Rotate(Geometry=ln_2, Angle=1.570796327, Plane=pt_2)  # -> Geometry, Transform
pt_3 = Point(end_2.End)
pl = ConstructPlane(Origin=pt_3, XAxis=rotate.Geometry, YAxis=ln_2)
null_3 = NullItem(Item=pl)  # -> NullFlags, InvalidFlags, Description
dispatch_3 = Dispatch(List=pl, DispatchPattern=null_3.NullFlags)  # -> ListA, ListB
pln = Plane(dispatch_3.ListB)
shift_3 = ShiftPaths(Data=pln, Offset=-1)
shift_4 = ShiftPaths(Data=shift_3, Offset=-1)  # -> simplify(Data)
D_2 = ClusterOutput(shift_4)

# ==== cluster Cluster_11
P = ClusterInput()
C = ClusterInput()
L = ClusterInput()
incurves = PointInCurves(Point=flatten(P), Curves=C)  # -> Relationship, Index, Point
equals = Equality(FirstNumber=incurves.Relationship, SecondNumber="0")  # -> Equality, Inequality
dispatch = Dispatch(List=flatten(L), DispatchPattern=equals.Inequality)  # -> ListA, ListB
A = ClusterOutput(dispatch.ListA)

# ==== cluster Cluster_12
P = ClusterInput()
D = ClusterInput()
B = ClusterInput()
G = ClusterInput()
shift = ShiftPaths(Data=D, Offset=-1)
movetoplane = MoveToPlane(Geometry=G, Plane=PlaneXY(0, 0, 0), Above=True, Below=True)  # -> Geometry, Transform
shift_2 = ShiftPaths(Data=shift, Offset=-1)
pull = PullPoint(Point=P, Geometry=simplify(shift_2), ClosestOnly=True)  # -> ClosestPoint, Distance
ln = Line(StartPoint=pull.ClosestPoint, EndPoint=B)

# ---- group: Y Axis Line-All
crv = Curve(ln)

# ----
end = EndPoints(Curve=graft(crv))  # -> Start, End
merge = Merge(Data1=end.Start, Data2=end.End)
pull_2 = PullPoint(Point=merge, Geometry=movetoplane.Geometry, ClosestOnly=True)  # -> ClosestPoint, Distance
sort = SortList(Keys=pull_2.Distance, ValuesA=merge)  # -> Keys, ValuesA
item = ListItem(List=sort.ValuesA, Index="-1", Wrap=True)
item_2 = ListItem(List=sort.ValuesA, Index=0, Wrap=True)
pt = Point(item_2)
pt_2 = Point(item)
ln_2 = Line(StartPoint=pt_2, EndPoint=pt)
pt_3 = Point(end.End)
rotate = Rotate(Geometry=ln_2, Angle=1.570796327, Plane=pt)  # -> Geometry, Transform
pl = ConstructPlane(Origin=pt_3, XAxis=rotate.Geometry, YAxis=ln_2)
null = NullItem(Item=pl)  # -> NullFlags, InvalidFlags, Description
dispatch = Dispatch(List=pl, DispatchPattern=null.NullFlags)  # -> ListA, ListB
pln = Plane(dispatch.ListB)
pln_2 = ClusterOutput(pln)

# ==== cluster Cluster_13
P = ClusterInput()
D = ClusterInput()
B = ClusterInput()
G = ClusterInput()
shift = ShiftPaths(Data=D, Offset=-1)
shift_2 = ShiftPaths(Data=shift, Offset=-1)
pull = PullPoint(Point=P, Geometry=simplify(shift_2), ClosestOnly=True)  # -> ClosestPoint, Distance
ln = Line(StartPoint=pull.ClosestPoint, EndPoint=B)

# ---- group: Y Axis Line-All
crv = Curve(ln)

# ----
end = EndPoints(Curve=graft(crv))  # -> Start, End
movetoplane = MoveToPlane(Geometry=G, Plane=PlaneXY(0, 0, 0), Above=True, Below=True)  # -> Geometry, Transform
merge = Merge(Data1=end.Start, Data2=end.End)
pull_2 = PullPoint(Point=merge, Geometry=movetoplane.Geometry, ClosestOnly=True)  # -> ClosestPoint, Distance
sort = SortList(Keys=pull_2.Distance, ValuesA=merge)  # -> Keys, ValuesA
pt = Point(end.End)
item = ListItem(List=sort.ValuesA, Index="-1", Wrap=True)
item_2 = ListItem(List=sort.ValuesA, Index=0, Wrap=True)
pt_2 = Point(item_2)
pt_3 = Point(item)
ln_2 = Line(StartPoint=pt_3, EndPoint=pt_2)
rotate = Rotate(Geometry=ln_2, Angle=1.570796327, Plane=pt_2)  # -> Geometry, Transform
pl = ConstructPlane(Origin=pt, XAxis=rotate.Geometry, YAxis=ln_2)
null = NullItem(Item=pl)  # -> NullFlags, InvalidFlags, Description
dispatch = Dispatch(List=pl, DispatchPattern=null.NullFlags)  # -> ListA, ListB
pln = Plane(dispatch.ListB)
pln_2 = ClusterOutput(pln)

# ==== cluster Cluster_14
P = ClusterInput()
D = ClusterInput()
B = ClusterInput()
G = ClusterInput()

shift = ShiftPaths(Data=D, Offset=-1)
shift_2 = ShiftPaths(Data=shift, Offset=-1)
movetoplane = MoveToPlane(Geometry=G, Plane=PlaneXY(0, 0, 0), Above=True, Below=True)  # -> Geometry, Transform
pull = PullPoint(Point=P, Geometry=simplify(shift_2), ClosestOnly=True)  # -> ClosestPoint, Distance
ln = Line(StartPoint=pull.ClosestPoint, EndPoint=B)

# ---- group: Y Axis Line-All
crv = Curve(ln)

# ----
end = EndPoints(Curve=graft(crv))  # -> Start, End
merge = Merge(Data1=end.Start, Data2=end.End)
pull_2 = PullPoint(Point=merge, Geometry=movetoplane.Geometry, ClosestOnly=True)  # -> ClosestPoint, Distance
sort = SortList(Keys=pull_2.Distance, ValuesA=merge)  # -> Keys, ValuesA
item = ListItem(List=sort.ValuesA, Index="-1", Wrap=True)
item_2 = ListItem(List=sort.ValuesA, Index=0, Wrap=True)
pt = Point(item_2)
pt_2 = Point(item)
ln_2 = Line(StartPoint=pt_2, EndPoint=pt)
rotate = Rotate(Geometry=ln_2, Angle=1.570796327, Plane=pt)  # -> Geometry, Transform

pt_3 = Point(end.End)

pl = ConstructPlane(Origin=pt_3, XAxis=rotate.Geometry, YAxis=ln_2)
null = NullItem(Item=pl)  # -> NullFlags, InvalidFlags, Description
dispatch = Dispatch(List=pl, DispatchPattern=null.NullFlags)  # -> ListA, ListB
pln = Plane(dispatch.ListB)

# ---- group: 檐口-首次筛选的有效起始Plane
data = Data(pln)

# ----
data_2 = ClusterOutput(data)

# ==== cluster Cluster_15
crv = ClusterInput()
pt = ClusterInput()
crv_2 = Curve(crv)
pt_2 = Point(pt)
incurves = PointInCurves(Point=flatten(pt_2), Curves=crv_2)  # -> Relationship, Index, Point
equals = Equality(FirstNumber=incurves.Relationship, SecondNumber="0")  # -> Equality, Inequality
dispatch = Dispatch(List=flatten(pt_2), DispatchPattern=equals.Inequality)  # -> ListA, ListB
A = ClusterOutput(dispatch.ListA)

# ==== cluster Cluster_16
D = ClusterInput()
P = ClusterInput()
B = ClusterInput()
G = ClusterInput()

shift = ShiftPaths(Data=D, Offset=-1)
shift_2 = ShiftPaths(Data=shift, Offset=-1)
pull = PullPoint(Point=P, Geometry=simplify(shift_2), ClosestOnly=True)  # -> ClosestPoint, Distance
ln = Line(StartPoint=pull.ClosestPoint, EndPoint=B)
movetoplane = MoveToPlane(Geometry=G, Plane=PlaneXY(0, 0, 0), Above=True, Below=True)  # -> Geometry, Transform

# ---- group: Y Axis Line-All
crv = Curve(ln)

# ----
end = EndPoints(Curve=graft(crv))  # -> Start, End
merge = Merge(Data1=end.Start, Data2=end.End)
pull_2 = PullPoint(Point=merge, Geometry=movetoplane.Geometry, ClosestOnly=True)  # -> ClosestPoint, Distance
sort = SortList(Keys=pull_2.Distance, ValuesA=merge)  # -> Keys, ValuesA
item = ListItem(List=sort.ValuesA, Index="-1", Wrap=True)
item_2 = ListItem(List=sort.ValuesA, Index=0, Wrap=True)
pt = Point(item_2)
pt_2 = Point(item)
ln_2 = Line(StartPoint=pt_2, EndPoint=pt)
rotate = Rotate(Geometry=ln_2, Angle=1.570796327, Plane=pt)  # -> Geometry, Transform

pt_3 = Point(end.End)

pl = ConstructPlane(Origin=pt_3, XAxis=rotate.Geometry, YAxis=ln_2)
null = NullItem(Item=pl)  # -> NullFlags, InvalidFlags, Description
dispatch = Dispatch(List=pl, DispatchPattern=null.NullFlags)  # -> ListA, ListB
pln = Plane(dispatch.ListB)

shift_3 = ShiftPaths(Data=pln, Offset=-1)
D_2 = ClusterOutput(shift_3)

# ==== cluster Cluster_17
C = ClusterInput()
data = ClusterInput()
# 按照梁分类定位点
data_2 = Data(data)
incurves = PointInCurves(Point=flatten(data_2), Curves=C)  # -> Relationship, Index, Point
equals = Equality(FirstNumber=incurves.Relationship, SecondNumber="0")  # -> Equality, Inequality
dispatch = Dispatch(List=flatten(data_2), DispatchPattern=equals.Inequality)  # -> ListA, ListB
A = ClusterOutput(dispatch.ListA)

# ==== cluster Cluster_18
relay = ClusterInput()
D = ClusterInput()
shift = ShiftPaths(Data=D, Offset=-1)
shift_2 = ShiftPaths(Data=shift, Offset=-1)
pull = PullPoint(Point=relay, Geometry=simplify(shift_2), ClosestOnly=True)  # -> ClosestPoint, Distance
ln = Line(StartPoint=pull.ClosestPoint, EndPoint=relay)
G = ClusterInput()

# ---- group: Y Axis Line-All
crv = Curve(ln)

# ----
movetoplane = MoveToPlane(Geometry=G, Plane=PlaneXY(0, 0, 0), Above=True, Below=True)  # -> Geometry, Transform
end = EndPoints(Curve=graft(crv))  # -> Start, End
merge = Merge(Data1=end.Start, Data2=end.End)
pull_2 = PullPoint(Point=merge, Geometry=movetoplane.Geometry, ClosestOnly=True)  # -> ClosestPoint, Distance
sort = SortList(Keys=pull_2.Distance, ValuesA=merge)  # -> Keys, ValuesA
item = ListItem(List=sort.ValuesA, Index="-1", Wrap=True)
item_2 = ListItem(List=sort.ValuesA, Index=0, Wrap=True)
pt = Point(item_2)
pt_2 = Point(item)
ln_2 = Line(StartPoint=pt_2, EndPoint=pt)
pt_3 = Point(end.End)
rotate = Rotate(Geometry=ln_2, Angle=1.570796327, Plane=pt)  # -> Geometry, Transform
pl = ConstructPlane(Origin=pt_3, XAxis=rotate.Geometry, YAxis=ln_2)
null = NullItem(Item=pl)  # -> NullFlags, InvalidFlags, Description
dispatch = Dispatch(List=pl, DispatchPattern=null.NullFlags)  # -> ListA, ListB
pln = Plane(dispatch.ListB)
shift_3 = ShiftPaths(Data=pln, Offset=-1)
D_2 = ClusterOutput(shift_3)

# ==== cluster Cluster_19
data = ClusterInput()
crv = ClusterInput()
crv_2 = Curve(crv)

# ---- group: 交点-属于哪个梁
data_2 = Data(data)

# ----
incurves = PointInCurves(Point=flatten(data_2), Curves=crv_2)  # -> Relationship, Index, Point
equals = Equality(FirstNumber=incurves.Relationship, SecondNumber="0")  # -> Equality, Inequality
dispatch = Dispatch(List=flatten(data_2), DispatchPattern=equals.Inequality)  # -> ListA, ListB
A = ClusterOutput(dispatch.ListA)

# ==== cluster Cluster_20
D = ClusterInput()
G = ClusterInput()
relay = ClusterInput()
shift = ShiftPaths(Data=D, Offset=-1)
shift_2 = ShiftPaths(Data=shift, Offset=-1)
pull = PullPoint(Point=relay, Geometry=simplify(shift_2), ClosestOnly=True)  # -> ClosestPoint, Distance
ln = Line(StartPoint=pull.ClosestPoint, EndPoint=relay)

# ---- group: Y Axis Line-All
crv = Curve(ln)

# ----
movetoplane = MoveToPlane(Geometry=G, Plane=PlaneXY(0, 0, 0), Above=True, Below=True)  # -> Geometry, Transform
end = EndPoints(Curve=graft(crv))  # -> Start, End
merge = Merge(Data1=end.Start, Data2=end.End)
pull_2 = PullPoint(Point=merge, Geometry=movetoplane.Geometry, ClosestOnly=True)  # -> ClosestPoint, Distance
sort = SortList(Keys=pull_2.Distance, ValuesA=merge)  # -> Keys, ValuesA
item = ListItem(List=sort.ValuesA, Index="-1", Wrap=True)
item_2 = ListItem(List=sort.ValuesA, Index=0, Wrap=True)
pt = Point(item_2)
pt_2 = Point(item)
ln_2 = Line(StartPoint=pt_2, EndPoint=pt)
pt_3 = Point(end.End)
rotate = Rotate(Geometry=ln_2, Angle=1.570796327, Plane=pt)  # -> Geometry, Transform
pl = ConstructPlane(Origin=pt_3, XAxis=rotate.Geometry, YAxis=ln_2)
null = NullItem(Item=pl)  # -> NullFlags, InvalidFlags, Description
dispatch = Dispatch(List=pl, DispatchPattern=null.NullFlags)  # -> ListA, ListB
pln = Plane(dispatch.ListB)
shift_3 = ShiftPaths(Data=pln, Offset=-1)
D_2 = ClusterOutput(shift_3)
