# Grasshopper definition FacadeEmbed_JinQiao_PodiumNew.gh (Grasshopper 1.0.7)
# plug-ins: EleFront, TT Toolbox, Pufferfish, Hare, treesloth01

# ----
# 线段延长长度
number_slider = Slider(1001, range=0..10000)  # disabled

# ----
# remove duplicate curves
geo = Geometry()  # disabled
number_slider_2 = Slider(0.1, range=0..0.1)  # disabled
boundary = BoundarySurfaces(Edges=geo)  # disabled
area = Area(Geometry=boundary)  # -> Area, Centroid; disabled
cullduppoints = RemoveDuplicatePoints(InputPoints=area.Centroid, Tolerance=number_slider_2)  # -> OutputPoints, FirstPointIndexes; disabled
null = NullItem(Item=cullduppoints.FirstPointIndexes)  # -> NullFlags, InvalidFlags, Description; disabled
dispatch = Dispatch(List=boundary, DispatchPattern=null.NullFlags)  # -> ListA, ListB; disabled
geo_2 = Geometry(dispatch.ListA)  # disabled

# ----
# 调换阴阳角设定
toggle = BooleanToggle(False)  # disabled

panel = Panel("""TO DO
1.理清Input
2.
局部流程check""")

# ----
# 导入下层建筑线
# 格式：Line-0-建筑
panel_2 = Panel("Line-0-建筑-Whole")
reflay = ReferenceByLayer(LayerName=panel_2)

# ----
# 导入上层建筑线+檐口线
# 格式：Line-1-
panel_3 = Panel("Line-1-檐口")
# （3）导入单体建筑的参考线
# 按照图层导入建筑、檐口线、特殊区域线
# 
# Step1:将不同类型的curve按照以下图层分类放入Rhino中
# Step2:依次点击每个Update按钮
panel_4 = Panel("Line-1-建筑-Whole")
reflay_2 = ReferenceByLayer(LayerName=panel_4)
reflay_3 = ReferenceByLayer(LayerName=panel_3)

# ----
# 导入檐口出特殊区域参考线
# 格式：Line-1-
panel_5 = Panel("Line-1-檐口-车道等灰空间区域")
reflay_4 = ReferenceByLayer(LayerName=panel_5)
reflay_5 = ReferenceByLayer(LayerName="Line-1-檐口-吊顶处理区域")

# ----
# Step1.输入block names
# Step2:点击Update按钮
data = Data(["PX-GLAZ-F2$0$PX-GLAZ-F2$0$fin", "PX-GLAZ-F2$0$PX-GLAZ-F1$0$fin"])
panel_6 = Panel(data)
# （1）导入埋件定位点
panel_7 = Panel("")
refblock = ReferenceBlockByName(BlockName=panel_6)

# ----
# Input Curves
# 
# Step1：选中其中一个curve,得到该图层所有curves
# Step2：点击Update按钮
crv = Curve(<curve referenced from the Rhino model>)

# ----
# 埋件编号tag的Offset
number_slider_3 = Slider(190, range=0..1000)

# ----
# Embed Layer Color
swatch = ColourSwatch(SwatchColor=RGB(255, 132, 79))

# ----
# 钢结构截面列表
txt = Text(["GL2A-1\tHN 250x125x6x9\t\tQ235B\t热轧", "GL3-1\tHN 300x150x6.5x9\t\tQ235B\t热轧", "GL3-2\tH 300x100x8x10\t\tQ235B\t焊接H型", "GL3-3\tH 300x200x8x16\t\tQ355B\t焊接H型", "GL3-4\tHW 300x300x10x15\t\tQ355B\t热轧", "GL4-1\tHN 400x200x8x13\t\tQ355B\t热轧", "GL4-2\tH 400x200x10x16\t\tQ355B\t焊接H型", "GL4-3\tH 400x250x10x20\t\tQ355B\t焊接H型", "GL4-4\tH 400x350x16x35\t\tQ355B\t焊接H型", "GL4a-1\tH 450x200x9x14\t\tQ355B\t热轧", "GL5-1\tHN 500x200x10x16\t\tQ355B\t热轧", "GL5-2\tH 500x200x10x20\t\tQ355B\t焊接H型", "GL5-3\tH 500x300x14x20\t\tQ355B\t焊接H型", "GL5a-1\tH 550x250x10x25\t\tQ355B\t焊接H型", "GL5a-2\tH 550x300x14x25\t\tQ355B\t焊接H型", "GL6-1\tHN 600x200x11x17\t\tQ355B\t热轧", "GL6-2\tH 600x300x12x20\t\tQ355B\t焊接H型", "GL6-3\tH 600x350x12x25\t\tQ355B\t焊接H型", "GL6-4\tH 600x350x16x35\t\tQ355B\t焊接H型", "GL7-1\tHN 700x300x13x24\t\tQ355B\t热轧", "GL7-2\tH 700x350x14x30\t\tQ355B\t焊接H型", "GL7-3\tH 700x350x14x35\t\tQ355B\t焊接H型", "GL8-1\tHN 800x300x14x26\t\tQ355B\t热轧", "GL8-2\tH 800x300x20x40\t\tQ345GJB\t焊接H型", "GL9-1\tH 900x300x20x30\t\tQ355B\t焊接H型", "GL9-2\tH 900x400x20x40\t\tQ345GJB\t焊接H型", "GL10-1\tH 1000x400x20x30\t\tQ355B\t焊接H型", "GL10-2\tH 1000x500x20x30\t\tQ355B\t焊接H型", "GL10-3\tH 1000x500x20x35\t\tQ355B\t焊接H型", "GL10-4\tH 1000x400x20x40\t\tQ345GJB\t焊接H型", "GL10-5\tH 1000x500x20x40\t\tQ345GJB\t焊接H型", "GL10-6\t□ 1000x400x20x40\t\tQ345GJB\t焊接箱型", "GL12-1\tH 1200x400x25x50\t\tQ345GJB\t焊接H型"])

# ----
# Dimension Style
# （5）导入Default Embed
panel_8 = Panel("图例2-地上$0$XD100$0")

# ----
# 埋件编号tag
panel_9 = Panel("3-3")

# ----
# 钢埋板长度（按需设定）
number_slider_4 = Slider(350, range=0..1000)

# ----
# 钢埋板厚度（按需设定）
number_slider_5 = Slider(16, range=0..100)

# ----
# (Block & Curve的形式)
# Input Blocks (Plane的Y轴向外)
# 
# Step1.输入Block所在图层
# Step2:点击Update按钮
data_2 = Data(["PX-GLAZ-F2$0$PX-GLAZ-F1$0$标准块", "PX-GLAZ-F2$0$PX-GLAZ-F2$0$标准块", "PX-GLAZ-F2$0$PX-GLAZ-F3$0$标准块"])

# ----
# 埋件编号tag的Offset
number_slider_6 = Slider(190, range=0..1000)

# ----
# Embed Layer Color
swatch_2 = ColourSwatch(SwatchColor=RGB(255, 196, 79))

# ----
# 钢结构截面列表
txt_2 = Text(["GL2A-1\tHN 250x125x6x9\t\tQ235B\t热轧", "GL3-1\tHN 300x150x6.5x9\t\tQ235B\t热轧", "GL3-2\tH 300x100x8x10\t\tQ235B\t焊接H型", "GL3-3\tH 300x200x8x16\t\tQ355B\t焊接H型", "GL3-4\tHW 300x300x10x15\t\tQ355B\t热轧", "GL4-1\tHN 400x200x8x13\t\tQ355B\t热轧", "GL4-2\tH 400x200x10x16\t\tQ355B\t焊接H型", "GL4-3\tH 400x250x10x20\t\tQ355B\t焊接H型", "GL4-4\tH 400x350x16x35\t\tQ355B\t焊接H型", "GL4a-1\tH 450x200x9x14\t\tQ355B\t热轧", "GL5-1\tHN 500x200x10x16\t\tQ355B\t热轧", "GL5-2\tH 500x200x10x20\t\tQ355B\t焊接H型", "GL5-3\tH 500x300x14x20\t\tQ355B\t焊接H型", "GL5a-1\tH 550x250x10x25\t\tQ355B\t焊接H型", "GL5a-2\tH 550x300x14x25\t\tQ355B\t焊接H型", "GL6-1\tHN 600x200x11x17\t\tQ355B\t热轧", "GL6-2\tH 600x300x12x20\t\tQ355B\t焊接H型", "GL6-3\tH 600x350x12x25\t\tQ355B\t焊接H型", "GL6-4\tH 600x350x16x35\t\tQ355B\t焊接H型", "GL7-1\tHN 700x300x13x24\t\tQ355B\t热轧", "GL7-2\tH 700x350x14x30\t\tQ355B\t焊接H型", "GL7-3\tH 700x350x14x35\t\tQ355B\t焊接H型", "GL8-1\tHN 800x300x14x26\t\tQ355B\t热轧", "GL8-2\tH 800x300x20x40\t\tQ345GJB\t焊接H型", "GL9-1\tH 900x300x20x30\t\tQ355B\t焊接H型", "GL9-2\tH 900x400x20x40\t\tQ345GJB\t焊接H型", "GL10-1\tH 1000x400x20x30\t\tQ355B\t焊接H型", "GL10-2\tH 1000x500x20x30\t\tQ355B\t焊接H型", "GL10-3\tH 1000x500x20x35\t\tQ355B\t焊接H型", "GL10-4\tH 1000x400x20x40\t\tQ345GJB\t焊接H型", "GL10-5\tH 1000x500x20x40\t\tQ345GJB\t焊接H型", "GL10-6\t□ 1000x400x20x40\t\tQ345GJB\t焊接箱型", "GL12-1\tH 1200x400x25x50\t\tQ345GJB\t焊接H型"])

# ----
# 钢埋板长度（按需设定）
number_slider_7 = Slider(350, range=0..1000)

# ----
# 钢埋板厚度（按需设定）
number_slider_8 = Slider(16, range=0..100)

# ----
# 肋板倒角距离（按需设定）
number_slider_9 = Slider(30, range=0..100)

# ----
# Dimension Style
panel_10 = Panel("图例2-地上$0$XD100$0")

# ----
# 埋件编号tag
panel_11 = Panel("2-2")

# ----
# 输入
# 
# 1.Embed的结构编号
# 2.Embed的Tag命名
# 需要出图的钢结构编号
panel_12 = Panel("GL3-3H")

# ----
# 埋件编号tag的Offset
number_slider_10 = Slider(190, range=0..1000)

# ----
# Embed Layer Color
swatch_3 = ColourSwatch(SwatchColor=RGB(136, 235, 148))

# ----
# 钢结构截面列表
txt_3 = Text(["GL2A-1\tHN 250x125x6x9\t\tQ235B\t热轧", "GL3-1\tHN 300x150x6.5x9\t\tQ235B\t热轧", "GL3-2\tH 300x100x8x10\t\tQ235B\t焊接H型", "GL3-3\tH 300x200x8x16\t\tQ355B\t焊接H型", "GL3-4\tHW 300x300x10x15\t\tQ355B\t热轧", "GL4-1\tHN 400x200x8x13\t\tQ355B\t热轧", "GL4-2\tH 400x200x10x16\t\tQ355B\t焊接H型", "GL4-3\tH 400x250x10x20\t\tQ355B\t焊接H型", "GL4-4\tH 400x350x16x35\t\tQ355B\t焊接H型", "GL4a-1\tH 450x200x9x14\t\tQ355B\t热轧", "GL5-1\tHN 500x200x10x16\t\tQ355B\t热轧", "GL5-2\tH 500x200x10x20\t\tQ355B\t焊接H型", "GL5-3\tH 500x300x14x20\t\tQ355B\t焊接H型", "GL5a-1\tH 550x250x10x25\t\tQ355B\t焊接H型", "GL5a-2\tH 550x300x14x25\t\tQ355B\t焊接H型", "GL6-1\tHN 600x200x11x17\t\tQ355B\t热轧", "GL6-2\tH 600x300x12x20\t\tQ355B\t焊接H型", "GL6-3\tH 600x350x12x25\t\tQ355B\t焊接H型", "GL6-4\tH 600x350x16x35\t\tQ355B\t焊接H型", "GL7-1\tHN 700x300x13x24\t\tQ355B\t热轧", "GL7-2\tH 700x350x14x30\t\tQ355B\t焊接H型", "GL7-3\tH 700x350x14x35\t\tQ355B\t焊接H型", "GL8-1\tHN 800x300x14x26\t\tQ355B\t热轧", "GL8-2\tH 800x300x20x40\t\tQ345GJB\t焊接H型", "GL9-1\tH 900x300x20x30\t\tQ355B\t焊接H型", "GL9-2\tH 900x400x20x40\t\tQ345GJB\t焊接H型", "GL10-1\tH 1000x400x20x30\t\tQ355B\t焊接H型", "GL10-2\tH 1000x500x20x30\t\tQ355B\t焊接H型", "GL10-3\tH 1000x500x20x35\t\tQ355B\t焊接H型", "GL10-4\tH 1000x400x20x40\t\tQ345GJB\t焊接H型", "GL10-5\tH 1000x500x20x40\t\tQ345GJB\t焊接H型", "GL10-6\t□ 1000x400x20x40\t\tQ345GJB\t焊接箱型", "GL12-1\tH 1200x400x25x50\t\tQ345GJB\t焊接H型"])

# ----
# 钢埋板长度（按需设定）
number_slider_11 = Slider(350, range=0..1000)

# ----
# 钢埋板厚度（按需设定）
number_slider_12 = Slider(16, range=0..100)

# ----
# 肋板倒角距离（按需设定）
number_slider_13 = Slider(30, range=0..100)

# ----
# Dimension Style
panel_13 = Panel("图例2-地上$0$XD100$0")

# ----
# block names
listblockd = ListBlockDocument()

# ----
# Input Blocks (Plane的Y轴向内)
# 
# Step1:输入Block所在图层
# Step2:点击Update按钮
data_3 = Data("PX-GLAZ-F2$0$T3T")

# ----
# 肋板倒角距离（按需设定）
number_slider_14 = Slider(30, range=0..100)

# ----
# 肋板倒角距离（按需设定）
number_slider_15 = Slider(30, range=0..100)

# ----
# 导入梁线curve
crv_2 = Curve(<curve referenced from the Rhino model>)

# ----
# 埋件编号tag
panel_14 = Panel("1-1")

# ----
# 埋件编号tag的Offset
number_slider_16 = Slider(190, range=0..1000)

# ----
# Embed Layer Color
swatch_4 = ColourSwatch(SwatchColor=RGB(221, 255, 0))

# ----
# Dimension Style
panel_15 = Panel("图例2-地上$0$XD100$0")

# ----
# 钢结构截面列表
txt_4 = Text(["GL2A-1\tHN 250x125x6x9\t\tQ235B\t热轧", "GL3-1\tHN 300x150x6.5x9\t\tQ235B\t热轧", "GL3-2\tH 300x100x8x10\t\tQ235B\t焊接H型", "GL3-3\tH 300x200x8x16\t\tQ355B\t焊接H型", "GL3-4\tHW 300x300x10x15\t\tQ355B\t热轧", "GL4-1\tHN 400x200x8x13\t\tQ355B\t热轧", "GL4-2\tH 400x200x10x16\t\tQ355B\t焊接H型", "GL4-3\tH 400x250x10x20\t\tQ355B\t焊接H型", "GL4-4\tH 400x350x16x35\t\tQ355B\t焊接H型", "GL4a-1\tH 450x200x9x14\t\tQ355B\t热轧", "GL5-1\tHN 500x200x10x16\t\tQ355B\t热轧", "GL5-2\tH 500x200x10x20\t\tQ355B\t焊接H型", "GL5-3\tH 500x300x14x20\t\tQ355B\t焊接H型", "GL5a-1\tH 550x250x10x25\t\tQ355B\t焊接H型", "GL5a-2\tH 550x300x14x25\t\tQ355B\t焊接H型", "GL6-1\tHN 600x200x11x17\t\tQ355B\t热轧", "GL6-2\tH 600x300x12x20\t\tQ355B\t焊接H型", "GL6-3\tH 600x350x12x25\t\tQ355B\t焊接H型", "GL6-4\tH 600x350x16x35\t\tQ355B\t焊接H型", "GL7-1\tHN 700x300x13x24\t\tQ355B\t热轧", "GL7-2\tH 700x350x14x30\t\tQ355B\t焊接H型", "GL7-3\tH 700x350x14x35\t\tQ355B\t焊接H型", "GL8-1\tHN 800x300x14x26\t\tQ355B\t热轧", "GL8-2\tH 800x300x20x40\t\tQ345GJB\t焊接H型", "GL9-1\tH 900x300x20x30\t\tQ355B\t焊接H型", "GL9-2\tH 900x400x20x40\t\tQ345GJB\t焊接H型", "GL10-1\tH 1000x400x20x30\t\tQ355B\t焊接H型", "GL10-2\tH 1000x500x20x30\t\tQ355B\t焊接H型", "GL10-3\tH 1000x500x20x35\t\tQ355B\t焊接H型", "GL10-4\tH 1000x400x20x40\t\tQ345GJB\t焊接H型", "GL10-5\tH 1000x500x20x40\t\tQ345GJB\t焊接H型", "GL10-6\t□ 1000x400x20x40\t\tQ345GJB\t焊接箱型", "GL12-1\tH 1200x400x25x50\t\tQ345GJB\t焊接H型"])

# ----
# 钢埋板长度（按需设定）
number_slider_17 = Slider(350, range=0..1000)

# ----
# 钢埋板厚度（按需设定）
number_slider_18 = Slider(16, range=0..100)

# ----
# 埋件编号tag
panel_16 = Panel("4-4")

# ----
# 输入
# 
# Embed的Tag命名
# 埋件编号
panel_17 = Panel("5-5")

# ----
# 长
panel_18 = Panel("-175 To 175")

# ----
# 宽
panel_19 = Panel("-125 To 125")

# ----
# Dimension Style
panel_20 = Panel("图例2-地上$0$XD100$0")

# ----
# Dimension Style
panel_21 = Panel("图例2-地上$0$XD100$0")

# ----
# 埋件编号tag的Offset
number_slider_19 = Slider(353, range=0..1000)

# ----
# 埋件编号tag
panel_22 = Panel("6-6")

# ---- group: 混凝土
# 板埋几何INPUT
list = ValueList({"C15": 0, "C20": 1, "C25": 2, "C30": 3, "C35": 4, "C40": 5}, selected="C35")

# ---- group: 钢筋牌号
list_2 = ValueList({"HPB300": 0, "HRB400": 1}, selected="HPB300")

# ---- group: 直径
list_3 = ValueList({"10": 0, "12": 1, "16": 2, "18": 3, "20": 4, "25": 5}, selected="12")

# ---- group: 锚筋间距
s_y = Slider(22, range=14..60, expression="X*5")
s_x = Slider(22, range=14..60, expression="X*5")

# ---- group: 列
list_4 = ValueList({"2X": 0, "3X": 1, "4X": 2}, selected="3X")

# ---- group: 行
# （7）生成底埋钢埋件
list_5 = ValueList({"2Y": 0, "3Y": 1, "4Y": 2}, selected="2Y")

# ----
# 5特殊区域线
# 上层建筑边线,
# 默认建筑提供上翻
# 如主结构提供示意则使用结构定位【该项目无】
# 如无则使用建筑边线向内50mm作为埋件定位
# （4）导入结构线+生成对应的钢板焊埋件
# 操作步骤如下
# 
# Step1:依次根据结构编号在Rhino中按照图层分类结构线
# Step2:按照结构编号依次建立 梁中线+Offset值+埋件单体组合包
# Step3:导入对应结构编号图层中的梁线Curve
# Step4:埋件编号Tag命名
# Step5:依次将每个组合包中的Curve,Offset值和Embed连接到右侧的3个Entwine组件上
crv_3 = Curve(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)

# ---- group: 参考线起点
number_slider_20 = Slider(0.806, range=0..1)

# ---- group: Dimension Offset Input 2
number_slider_21 = Slider(1000, range=0..1000)

# ---- group: 移除重复位置点-容差
number_slider_22 = Slider(200, range=0..1000)

# ---- group: Dimension Offset Input 1
number_slider_23 = Slider(2000, range=0..10000)

# ---- group: 标注区域-单一轴网
标准范围_符合单一轴网方向 = Curve(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)

# ---- group: 轴网XY2个方向的线
crv_4 = Curve(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)
crv_5 = Curve(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)

# ---- group: 参考线: 符合轴网方向+囊括整个建筑
# (9)Bake Me!!
# 下层图纸-单一区域
crv_6 = Curve(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)

# ----
# (8) 撞到梁交点-Offset
number_slider_24 = Slider(450, range=0..1000)

# ---- group: 移除重复位置点-容差
number_slider_25 = Slider(200, range=0..1000)

# ---- group: 参考线起点
number_slider_26 = Slider(0.548, range=0..1)

# ---- group: Dimension Offset Input 2
number_slider_27 = Slider(1000, range=0..1000)

# ---- group: Dimension Offset Input 1
number_slider_28 = Slider(2000, range=0..10000)

# ---- group: 标注区域-单一轴网
标准范围_符合单一轴网方向_2 = Curve(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)

# ---- group: 轴网XY2个方向的线
crv_7 = Curve(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)
crv_8 = Curve(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)

# ----
layer = ObjectLayer(Guid=crv)  # -> LayerIndex, LayerPathName
panel_23 = Panel(data_2)
panel_25 = Panel(layer.LayerPathName)
panel_26 = Panel(data_3)
refblock_2 = ReferenceBlockByName(BlockName=panel_23)
refblock_3 = ReferenceBlockByName(BlockName=panel_26)
reflay_6 = ReferenceByLayer(LayerName=panel_25)

# ---- group: 参考线: 符合轴网方向+囊括整个建筑
# (9)Bake Me!!
# 上层图纸-单一区域
crv_9 = Curve(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)

# ----
# Step 3（Optional) :
# 调整参考轴线的位置和方向
# 然后点击Update
panel_27 = Panel("Embed-YAxis-F2")
reflay_7 = ReferenceByLayer(LayerName=panel_27)

panel_28 = Panel(txt_3)

# ----
# 生成F1层定位平面
# Step 1 : input埋件定位点+梁线+闭合的轮廓线
circle = Curve(<curve referenced from the Rhino model>)

# ---- group: Beam-Middle
# 是否F1F2相同？？？
# 和结构线相同？？
crv_10 = Curve(flatten([<curve referenced from the Rhino model> x349]))

# ----
# Step 3（Optional) :
# 调整参考轴线的位置和方向
# 然后点击Update
panel_29 = Panel("Embed-YAxis-F1")
reflay_8 = ReferenceByLayer(LayerName=panel_29)

# ---- group: Closed Outline Curve
crv_11 = Curve([<curve referenced from the Rhino model> x4])

# ----
# 生成F2层定位平面
# Step 1 : input埋件定位点+梁线+闭合的轮廓线
circle_2 = Curve(<curve referenced from the Rhino model>)

# ----
# 最终生成的定位点Plane
pln = Plane()

# ---- group: Beam-Middle
# 是否F1F2相同？？？
# 和结构线相同？？
crv_12 = Curve(flatten([<curve referenced from the Rhino model> x349]))

# ---- group: Closed Outline Curve
crv_13 = Curve([<curve referenced from the Rhino model> x3])

# ----
# （0）准备阶段
# 检测各个图层Block的Plane
panel_30 = Panel(listblockd)
deblock = DeconstructBlock(Block=refblock)  # -> Name, Plane, Geometry

# ----
# Step3.检测plane是否存在+查看Plane的Y轴方向
pln_2 = Plane(deblock.Plane)

deblock_2 = DeconstructBlock(Block=refblock_3)  # -> Name, Plane, Geometry
deblock_3 = DeconstructBlock(Block=refblock_2)  # -> Name, Plane, Geometry

# ----
# Step4.如果不存在则Blake geometry
# 并在rhino里面清理线段
geo_3 = Geometry(deblock.Geometry)

# ---- group: the Dimension Reference Curve
seam = Seam(Curve=reparameterize(crv_6), Seam=number_slider_20)

# ---- group: The Start Point of the Dimension Reference Curve
eval = EvaluateCurve(Curve=reparameterize(crv_6), Parameter=number_slider_20)  # -> Point, Tangent, Angle

# ---- group: Dimension Style
panel_31 = Panel("图例2-地上$0$XD100$0")

# ---- group: The Start Point of the Dimension Reference Curve
eval_2 = EvaluateCurve(Curve=reparameterize(crv_9), Parameter=number_slider_26)  # -> Point, Tangent, Angle

# ---- group: the Dimension Reference Curve
seam_2 = Seam(Curve=reparameterize(crv_9), Seam=number_slider_26)

# ---- group: Dimension Style
panel_32 = Panel("图例2-地上$0$XD100$0")

# ----
xy = XYPlane(Origin=Point(0, 0, 0))
xy_2 = XYPlane(Origin=Point(0, 0, 0))
xy_3 = XYPlane(Origin=Point(0, 0, 0))
# 第一层
# 
# Curves(location point)+ Smooth Curves(architecture line)
# 测试Smooth Curve是否与每个Block相切
# blocks + smooth curves
# remove duplicate blocks
# blocks + special curves
# 阳角
# 阴角
# 测试Smooth Curve是否与每个Block相切
# blocks + smooth curves
# remove duplicate blocks
# blocks + special curves
project = Project(Geometry=refblock_2, Plane=xy)  # -> Geometry, Transform
project_2 = Project(Geometry=refblock_3, Plane=xy_2)  # -> Geometry, Transform
project_3 = Project(Geometry=reflay_6, Plane=xy_3)  # -> Geometry, Transform

cluster = Cluster_3(
    structure_number=panel_12,
    tag_text=panel_16,
    text_offset=number_slider_10,
    embed_color=swatch_3,
    T=txt_3,
    A=number_slider_11,
    A_2=number_slider_12,
    B=number_slider_13,
    dimension_style=panel_13)  # -> R, G_2, R_2
data_4 = Data(flatten(cluster.R_2))
item = ListItem(List=data_4, Index=0, Wrap=True)  # -> Item, Item1
merge = Merge(Data1=item.Item, Data2=item.Item1)

xy_4 = XYPlane(Origin=Point(0, 0, 0))
xy_5 = XYPlane(Origin=Point(0, 0, 0))
xy_6 = XYPlane(Origin=Point(0, 0, 0))
xy_7 = XYPlane(Origin=Point(0, 0, 0))
xy_8 = XYPlane(Origin=Point(0, 0, 0))
project_4 = Project(Geometry=reflay_2, Plane=xy_4)  # -> Geometry, Transform
project_5 = Project(Geometry=reflay_3, Plane=xy_5)  # -> Geometry, Transform
project_6 = Project(Geometry=reflay_5, Plane=xy_6)  # -> Geometry, Transform
project_7 = Project(Geometry=reflay_4, Plane=xy_7)  # -> Geometry, Transform
project_8 = Project(Geometry=reflay, Plane=xy_8)  # -> Geometry, Transform
crv_14 = Curve(project_5.Geometry)
crv_15 = Curve(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)
crv_16 = Curve(project_6.Geometry)
crv_17 = Curve(project_7.Geometry)
crv_18 = Curve(project_8.Geometry)
crv_19 = Curve(project_4.Geometry)

# ---- group: Smoothed Curve-Site
# 是否point的定位线可以直接导入？
# 是smoothed？
crv_20 = Curve(crv_11)

# ---- group: Boundary Curve-Site
clscrv = CloseCurve(Curve=crv_11, CloseType=0, Bulge=0.5, Tolerance=0)  # -> Closed, R

# ---- group: Smoothed Curve-Site
# 是否point的定位线可以直接导入？
# 是smoothed？
crv_21 = Curve(crv_13)

# ---- group: Boundary Curve-Site
clscrv_2 = CloseCurve(Curve=crv_13, CloseType=0, Bulge=0.5, Tolerance=0)  # -> Closed, R

# ----
disc = Discontinuity(Curve=graft(crv_20), Level=1)  # -> Points, Parameters
crv_cp = CurveClosestPoint(Point=disc.Points, Curve=graft(crv_20))  # -> Point, Parameter, Distance
eval_3 = EvaluateCurve(Curve=graft(crv_20), Parameter=crv_cp.Parameter)  # -> flatten(Point), Tangent, flatten(Angle)
deg = Degrees(Radians=eval_3.Angle)
offset = OffsetCurve(Curve=clscrv.Closed, Distance=expr("-X", Slider(300, range=0..1000)), Corners=1)
larger = LargerThan(FirstNumber=deg, SecondNumber=Slider(70, range=0..100))  # -> LargerThan, OrEqualTo
disc_2 = Discontinuity(Curve=offset, Level=1)  # -> flatten(Points), Parameters
dispatch_2 = Dispatch(List=deg, DispatchPattern=larger.LargerThan)  # -> ListA, ListB
dispatch_3 = Dispatch(List=eval_3.Point, DispatchPattern=larger.LargerThan)  # -> ListA, ListB
data_5 = Data(dispatch_3.ListA)
smaller = SmallerThan(FirstNumber=dispatch_2.ListA, SecondNumber=Slider(100, range=0..100))  # -> SmallerThan, OrEqualTo
dispatch_4 = Dispatch(List=data_5, DispatchPattern=smaller.SmallerThan)  # -> ListA, ListB
data_6 = Data(dispatch_4.ListA)
pull = PullPoint(Point=data_6, Geometry=flatten(offset), ClosestOnly=True)  # -> ClosestPoint, Distance
testpoint = TestPoint(archPoint=pull.ClosestPoint, crvPoint=disc_2.Points)  # -> out, specialPt; inputs archPoint: list of Point3d, crvPoint: list of Point3d
# ---------- testpoint: C# ----------
    List<int> passIndex = new List<int>();

    for(int i = 0; i < archPoint.Count; i++){
      foreach(Point3d t in crvPoint){
        if(archPoint[i].X == t.X && archPoint[i].Y == t.Y && archPoint[i].Z == t.Z){
          Print("pass");
          passIndex.Add(i);}
      }
    }

    specialPt = passIndex;
# ---------- end testpoint ----------

disc_3 = Discontinuity(Curve=graft(crv_21), Level=1)  # -> Points, Parameters
crv_cp_2 = CurveClosestPoint(Point=disc_3.Points, Curve=graft(crv_21))  # -> Point, Parameter, Distance
eval_4 = EvaluateCurve(Curve=graft(crv_21), Parameter=crv_cp_2.Parameter)  # -> flatten(Point), Tangent, flatten(Angle)
deg_2 = Degrees(Radians=eval_4.Angle)
offset_2 = OffsetCurve(Curve=clscrv_2.Closed, Distance=expr("-X", Slider(300, range=0..1000)), Corners=1)
larger_2 = LargerThan(FirstNumber=deg_2, SecondNumber=Slider(70, range=0..100))  # -> LargerThan, OrEqualTo
disc_4 = Discontinuity(Curve=offset_2, Level=1)  # -> flatten(Points), Parameters
dispatch_5 = Dispatch(List=deg_2, DispatchPattern=larger_2.LargerThan)  # -> ListA, ListB
dispatch_6 = Dispatch(List=eval_4.Point, DispatchPattern=larger_2.LargerThan)  # -> ListA, ListB
data_7 = Data(dispatch_6.ListA)
smaller_2 = SmallerThan(FirstNumber=dispatch_5.ListA, SecondNumber=Slider(100, range=0..100))  # -> SmallerThan, OrEqualTo
dispatch_7 = Dispatch(List=data_7, DispatchPattern=smaller_2.SmallerThan)  # -> ListA, ListB
data_8 = Data(dispatch_7.ListA)
pull_2 = PullPoint(Point=data_8, Geometry=flatten(offset_2), ClosestOnly=True)  # -> ClosestPoint, Distance
testpoint_2 = TestPoint(archPoint=pull_2.ClosestPoint, crvPoint=disc_4.Points)  # -> out, specialPt; inputs archPoint: list of Point3d, crvPoint: list of Point3d; same code as testpoint

# ----
# 阴角
cull_i = CullIndex(List=data_6, Indices=testpoint.specialPt, Wrap=True)

# ----
# 阳角
item_2 = ListItem(List=data_6, Index=testpoint.specialPt, Wrap=True)

# ----
# 阴角
cull_i_2 = CullIndex(List=data_8, Indices=testpoint_2.specialPt, Wrap=True)

# ----
# 阳角
item_3 = ListItem(List=data_8, Index=testpoint_2.specialPt, Wrap=True)

merge_2 = Merge(Data1=item_2, Data2=cull_i)  # -> flatten(Result)
merge_3 = Merge(Data1=item_3, Data2=cull_i_2)  # -> flatten(Result)

# ----
# 单体选型
list_6 = ValueList({"顶埋": 0, "侧埋": 1}, selected="顶埋")

# ---- group: F2 Arch Outline
crv_22 = Curve(crv_19)

# ---- group: 车道区域 / 檐口线Input
crv_23 = Curve(crv_15)

# ---- group: 檐口线Input
crv_24 = Curve(crv_15)

# ----
# 选要重塑的线段长度
number_slider_29 = Slider(1200, range=0..10000)

# ---- group: 车道区域 / 吊顶区域
crv_25 = Curve(crv_16)

# ----
# 调整重塑线段的平滑度
number_slider_30 = Slider(11, range=0..11)

# ----
# 区分内外梁边线
# 1.根据F2建筑线制作轮廓线
explode = Explode(Curve=crv_22, Recursive=True)  # -> Segments, Vertices
len = Length(Curve=explode.Segments)
sort = SortList(Keys=len)  # -> Keys, ValuesA
larger_3 = LargerThan(FirstNumber=len, SecondNumber=number_slider_29)  # -> LargerThan, OrEqualTo
panel_33 = Panel(sort.Keys)
dispatch_8 = Dispatch(List=explode.Segments, DispatchPattern=larger_3.LargerThan)  # -> ListA, ListB
data_9 = Data(dispatch_8.ListA)
data_10 = Data(dispatch_8.ListB)
join = JoinCurves(Curves=data_10, Preserve=False)
disc_5 = Discontinuity(Curve=join, Level=1)  # -> Points, Parameters
nurbs = NurbsCurve(Vertices=disc_5.Points, Degree=number_slider_30, Periodic=False)  # -> flatten(Curve), Length, Domain
join_2 = JoinCurves(Curves=flatten([data_9, nurbs.Curve]), Preserve=False)
offset_3 = OffsetCurve(Curve=join_2, Distance=Slider(6859, range=0..10000), Corners=1)

# ---- group: F2 Archline - Smoothed
reb = RebuildCurve(Curve=offset_3, Count=Slider(17, range=0..100), Tangents=invert(False))

# ----
# InputCurve
crv_26 = Curve()

# ----
# Curve-框住要分析的建筑单体
# 如果要用自己导入Curve作为分析线，
# 请在InputCurve那里导入curve,
# 然后在上方的选型列表选择Input Curve。
# 
# 如果要用Grasshopper自动生成的Curve,
# 请在上方的选型列表选择Default Curve。
list_7 = ValueList({"Default Curve": 0, "Input Curve": 1}, selected="Default Curve")
filter = StreamFilter(Gate=list_7, Stream0=reb, Stream1=crv_26)

# ----
# 埋件向外探索最远出的梁的距离
number_slider_31 = Slider(5000, range=0..10000)

# ---- group: 下层交点-除重 / F1 Arch Line
crv_27 = Curve(crv_18)

# ---- group: 下层交点-除重 / F2 Arch Line
crv_28 = Curve(crv_19)

# ---- group: 下层交点-除重 / 容差
number_slider_32 = Slider(100, range=0..200)

# ----
# 是否有吊顶：
# 下层幕墙边线在结构边梁以内>350
# 
# （最外层结构线）
number_slider_33 = Slider(350, range=0..1000)

# ---- group: F1 Arch Line
crv_29 = Curve(crv_18)

# ----
# 3.2下层建筑边线内侧300-600mm范围内
number_slider_34 = Slider(600, range=0..1000)
crv_30 = Curve(crv_29)
offset_4 = OffsetCurve(Curve=crv_30, Distance=expr("-x", Slider(300, range=0..1000)), Corners=1)
offset_5 = OffsetCurve(Curve=crv_30, Distance=expr("-x", number_slider_34), Corners=1)

# ----
# 3.1下层建筑边线外侧50-350mm范围内
number_slider_35 = Slider(350, range=0..1000)
crv_31 = Curve(crv_29)
offset_6 = OffsetCurve(Curve=crv_31, Distance=Slider(50, range=0..100), Corners=1)
offset_7 = OffsetCurve(Curve=crv_31, Distance=number_slider_35, Corners=1)

# ----
# 4下层建筑内侧到300到外侧50内
# 有钢结构
number_slider_36 = Slider(50, range=0..1000)
crv_32 = Curve(crv_29)
offset_8 = OffsetCurve(Curve=crv_32, Distance=expr("-x", Slider(300, range=0..1000)), Corners=1)
offset_9 = OffsetCurve(Curve=crv_32, Distance=number_slider_36, Corners=1)

# ----
# （3.1）导入轴线
crv_33 = Curve(<curve referenced from the Rhino model>)
layer_2 = ObjectLayer(Guid=crv_33)  # -> LayerIndex, LayerPathName
panel_34 = Panel(layer_2.LayerPathName)
reflay_9 = ReferenceByLayer(LayerName=panel_34)
xy_9 = XYPlane(Origin=Point(0, 0, 0))
project_9 = Project(Geometry=reflay_9, Plane=xy_9)  # -> Geometry, Transform

data_11 = Data(flatten(merge))
item_4 = ListItem(List=data_11, Index=0, Wrap=True)
item_5 = ListItem(List=data_11, Index="-1", Wrap=True)

# ----
# 求内部曲线转折点
crv_34 = Curve()  # disabled
number_slider_37 = Slider(300, range=0..1000)  # disabled
neg = Negative(Value=number_slider_37)  # disabled
filter_2 = StreamFilter(Gate=toggle, Stream0=number_slider_37, Stream1=neg)  # disabled
number_slider_38 = Slider(60, range=0..100)  # disabled

ext = ExtendCurve(Curve=crv_34, Type=0, Start=number_slider, End=number_slider)  # disabled

# ----
# 第二层
# 
# Curves(location point)+ Smooth Curves(architecture line)
# 第二层-区分阴阳角
area_2 = Area(Geometry=geo_2)  # -> Area, Centroid; disabled
crv_35 = Curve(crv_34)  # disabled
pull_3 = PullPoint(Point=area_2.Centroid, Geometry=crv_35, ClosestOnly=True)  # -> ClosestPoint, Distance; disabled
number_slider_39 = Slider(200, range=0..1000)  # disabled
number_slider_40 = Slider(100, range=0..300)  # disabled

# ----
# 第二层-阴阳角
panel_35 = Panel("0.5 * Pi")  # disabled
toggle_2 = BooleanToggle(True)  # disabled
neg_2 = Negative(Value=panel_35)  # disabled
filter_3 = StreamFilter(Gate=toggle_2, Stream0=panel_35, Stream1=neg_2)  # disabled

# ----
# 第二层-大面定位
panel_36 = Panel("0.5 * Pi")  # disabled
toggle_3 = BooleanToggle(True)  # disabled
neg_3 = Negative(Value=panel_36)  # disabled
filter_4 = StreamFilter(Gate=toggle_3, Stream0=panel_36, Stream1=neg_3)  # disabled

number_slider_41 = Slider(300, range=0..1000)  # disabled
number_slider_42 = Slider(1.5, range=0..10)  # disabled

number_slider_43 = Slider(300, range=0..1000)  # disabled
number_slider_44 = Slider(1.5, range=0..10)  # disabled

number_slider_45 = Slider(300, range=0..1000)  # disabled
number_slider_46 = Slider(1.5, range=0..10)  # disabled

# ----
# 显示"False"时要选择线段延长
list_8 = ValueList({"线段不延长": 0, "线段延长": 1}, selected="线段延长")  # disabled

filter_5 = StreamFilter(Gate=list_8, Stream0=crv_34, Stream1=ext)  # disabled

disc_6 = Discontinuity(Curve=graft(filter_5), Level=1)  # -> Points, Parameters; disabled
crv_cp_3 = CurveClosestPoint(Point=disc_6.Points, Curve=graft(filter_5))  # -> Point, Parameter, Distance; disabled
eval_5 = EvaluateCurve(Curve=graft(filter_5), Parameter=crv_cp_3.Parameter)  # -> flatten(Point), Tangent, flatten(Angle); disabled
deg_3 = Degrees(Radians=eval_5.Angle)  # disabled
offset_10 = OffsetCurve(Curve=filter_5, Distance=expr("-X", filter_2), Corners=1)  # disabled
panel_37 = Panel(deg_3)  # disabled
larger_4 = LargerThan(FirstNumber=deg_3, SecondNumber=number_slider_38)  # -> LargerThan, OrEqualTo; disabled
disc_7 = Discontinuity(Curve=offset_10, Level=1)  # -> flatten(Points), Parameters; disabled
dispatch_9 = Dispatch(List=eval_5.Point, DispatchPattern=larger_4.LargerThan)  # -> ListA, ListB; disabled
end = EndPoints(Curve=filter_5)  # -> Start, End; disabled
data_12 = Data(dispatch_9.ListA)  # disabled
pull_4 = PullPoint(Point=data_12, Geometry=flatten(offset_10), ClosestOnly=True)  # -> ClosestPoint, Distance; disabled
testpoint_3 = TestPoint(archPoint=pull_4.ClosestPoint, crvPoint=disc_7.Points)  # -> out, specialPt; inputs archPoint: list of Point3d, crvPoint: list of Point3d; disabled; same code as testpoint

# ----
# 阴角
item_6 = ListItem(List=data_12, Index=testpoint_3.specialPt, Wrap=True)  # disabled

# ----
# SmoothCurve-阴角&阳角
# 阳角
cull_i_3 = CullIndex(List=data_12, Indices=testpoint_3.specialPt, Wrap=True)  # disabled

dist = Distance(PointA=pull_3.ClosestPoint, PointB=data_12)  # disabled
sort_2 = SortList(Keys=dist)  # -> Keys, ValuesA; disabled
panel_38 = Panel(sort_2.Keys)  # disabled
smaller_3 = SmallerThan(FirstNumber=dist, SecondNumber=number_slider_39)  # -> SmallerThan, OrEqualTo; disabled
dispatch_10 = Dispatch(List=geo_2, DispatchPattern=smaller_3.SmallerThan)  # -> ListA, ListB; disabled
crv_36 = Curve(filter_5)  # disabled

data_13 = Data(dispatch_10.ListA)  # disabled
explode_2 = Explode(Curve=data_13, Recursive=True)  # -> Segments, Vertices; disabled
len_2 = Length(Curve=explode_2.Segments)  # disabled
sort_3 = SortList(Keys=reverse(len_2), ValuesA=explode_2.Segments)  # -> Keys, ValuesA; disabled
item_7 = ListItem(List=sort_3.ValuesA, Index=0, Wrap=True)  # -> flatten(Item); disabled
area_3 = Area(Geometry=data_13)  # -> Area, Centroid; disabled
midpt = CurveMiddle(Curve=item_7)  # disabled
move2pt = MoveToPoint(Geometry=item_7, PointA=midpt, PointB=area_3.Centroid)  # -> Moved, Vector, Transform; disabled
end_2 = EndPoints(Curve=move2pt.Moved)  # -> Start, End; disabled
ln = Line(StartPoint=end_2.Start, EndPoint=end_2.End)  # disabled
xy_10 = XYPlane(Origin=end_2.End)  # disabled
rotate = Rotate(Geometry=ln, Angle=filter_3, Plane=xy_10)  # -> Geometry, Transform; disabled
pl = ConstructPlane(Origin=end_2.End, XAxis=rotate.Geometry, YAxis=ln)  # disabled

data_14 = Data(dispatch_10.ListB)  # disabled
explode_3 = Explode(Curve=data_14, Recursive=True)  # -> Segments, Vertices; disabled
len_3 = Length(Curve=explode_3.Segments)  # disabled
sort_4 = SortList(Keys=reverse(len_3), ValuesA=explode_3.Segments)  # -> Keys, ValuesA; disabled
item_8 = ListItem(List=sort_4.ValuesA, Index=0, Wrap=True)  # -> flatten(Item); disabled
area_4 = Area(Geometry=data_14)  # -> Area, Centroid; disabled
midpt_2 = CurveMiddle(Curve=item_8)  # disabled
move2pt_2 = MoveToPoint(Geometry=item_8, PointA=midpt_2, PointB=area_4.Centroid)  # -> Moved, Vector, Transform; disabled
end_3 = EndPoints(Curve=move2pt_2.Moved)  # -> Start, End; disabled
ln_2 = Line(StartPoint=end_3.Start, EndPoint=end_3.End)  # disabled
xy_11 = XYPlane(Origin=end_3.End)  # disabled
rotate_2 = Rotate(Geometry=ln_2, Angle=filter_4, Plane=xy_11)  # -> Geometry, Transform; disabled
pl_2 = ConstructPlane(Origin=end_3.End, XAxis=rotate_2.Geometry, YAxis=ln_2)  # disabled

data_15 = Data(flatten(pl_2))  # disabled
deplane = DeconstructPlane(Plane=data_15)  # -> Origin, XAxis, YAxis, ZAxis; disabled
amp = Amplitude(Vector=deplane.YAxis, Amplitude=number_slider_43)  # disabled
move = Move(Geometry=deplane.Origin, Motion=amp)  # -> Geometry, Transform; disabled
ln_3 = Line(StartPoint=deplane.Origin, EndPoint=move.Geometry)  # disabled
midpt_3 = CurveMiddle(Curve=ln_3)  # disabled
scale = Scale(Geometry=ln_3, Center=midpt_3, Factor=number_slider_44)  # -> Geometry, Transform; disabled
ccx = CurveCurve(CurveA=scale.Geometry, CurveB=crv_36)  # -> Points, ParamsA, ParamsB; disabled

dist_2 = Distance(PointA=graft(end_2.End), PointB=cull_i_3)  # disabled
sort_5 = SortList(Keys=dist_2)  # -> Keys, ValuesA; disabled
item_9 = ListItem(List=sort_5.Keys, Index=0, Wrap=True)  # disabled
smaller_4 = SmallerThan(FirstNumber=item_9, SecondNumber=number_slider_40)  # -> SmallerThan, OrEqualTo; disabled
flatten = FlattenTree(Tree=item_9, Path="{0}")  # disabled
dispatch_11 = Dispatch(List=graft(pl), DispatchPattern=smaller_4.SmallerThan)  # -> ListA, ListB; disabled
panel_39 = Panel(flatten)  # disabled
flatten_2 = FlattenTree(Tree=ccx.Points, Path="{0}")  # disabled
lng = ListLength(List=scale.Geometry)  # disabled
lng_2 = ListLength(List=flatten_2)  # disabled

data_16 = Data(flatten(dispatch_11.ListA))  # disabled
deplane_2 = DeconstructPlane(Plane=data_16)  # -> Origin, XAxis, YAxis, ZAxis; disabled
amp_2 = Amplitude(Vector=deplane_2.YAxis, Amplitude=number_slider_41)  # disabled
move_2 = Move(Geometry=deplane_2.Origin, Motion=amp_2)  # -> Geometry, Transform; disabled
ln_4 = Line(StartPoint=deplane_2.Origin, EndPoint=move_2.Geometry)  # disabled
midpt_4 = CurveMiddle(Curve=ln_4)  # disabled
scale_2 = Scale(Geometry=ln_4, Center=midpt_4, Factor=number_slider_42)  # -> Geometry, Transform; disabled
ccx_2 = CurveCurve(CurveA=scale_2.Geometry, CurveB=crv_36)  # -> Points, ParamsA, ParamsB; disabled

data_17 = Data(flatten(dispatch_11.ListB))  # disabled
deplane_3 = DeconstructPlane(Plane=data_17)  # -> Origin, XAxis, YAxis, ZAxis; disabled
amp_3 = Amplitude(Vector=deplane_3.YAxis, Amplitude=number_slider_45)  # disabled
move_3 = Move(Geometry=deplane_3.Origin, Motion=amp_3)  # -> Geometry, Transform; disabled
ln_5 = Line(StartPoint=deplane_3.Origin, EndPoint=move_3.Geometry)  # disabled
midpt_5 = CurveMiddle(Curve=ln_5)  # disabled
scale_3 = Scale(Geometry=ln_5, Center=midpt_5, Factor=number_slider_46)  # -> Geometry, Transform; disabled
ccx_3 = CurveCurve(CurveA=scale_3.Geometry, CurveB=crv_36)  # -> Points, ParamsA, ParamsB; disabled

equals = Equality(FirstNumber=lng, SecondNumber=lng_2)  # -> Equality, Inequality; disabled
panel_40 = Panel(equals.Equality)  # disabled

# ----
# InsideCurve-大面
move2pt_3 = MoveToPoint(Geometry=data_15, PointA=flatten(deplane.Origin), PointB=flatten(ccx.Points))  # -> Moved, Vector, Transform; disabled

# ----
# InsideCurve-阳角
move2pt_4 = MoveToPoint(Geometry=data_16, PointA=deplane_2.Origin, PointB=ccx_2.Points)  # -> Moved, Vector, Transform; disabled

# ----
# InsideCurve-阴角
move2pt_5 = MoveToPoint(Geometry=data_17, PointA=deplane_3.Origin, PointB=ccx_3.Points)  # -> Moved, Vector, Transform; disabled

# ----
# 梁中线+Offset值+埋件单体组合包
crv_37 = Curve(<curve referenced from the Rhino model>)
layer_3 = ObjectLayer(Guid=crv_37)  # -> LayerIndex, LayerPathName
panel_41 = Panel(txt)

# ----
# 需要出图的钢结构编号
panel_42 = Panel(layer_3.LayerPathName)

reflay_10 = ReferenceByLayer(LayerName=panel_42)
cluster_2 = Cluster_3(
    structure_number=panel_42,
    tag_text=panel_9,
    text_offset=number_slider_3,
    T=txt,
    G=reflay_10,
    A=number_slider_4,
    A_2=number_slider_5,
    B=number_slider_15,
    dimension_style=panel_8)  # -> R, G_2, R_2

# ----
# 要连接的梁中线Offest值
num = Number(cluster_2.R)

# ----
# 要连接的embed
data_18 = Data(cluster_2.R_2)

# ----
# 要连接的梁中线curve
crv_38 = Curve(cluster_2.G_2)

# ----
# 梁中线+Offset值+埋件单体组合包
crv_39 = Curve(<curve referenced from the Rhino model>)
layer_4 = ObjectLayer(Guid=crv_39)  # -> LayerIndex, LayerPathName
panel_43 = Panel(txt_2)

# ----
# 需要出图的钢结构编号
panel_44 = Panel(layer_4.LayerPathName)

reflay_11 = ReferenceByLayer(LayerName=panel_44)
cluster_3 = Cluster_3(
    structure_number=panel_44,
    tag_text=panel_11,
    text_offset=number_slider_6,
    T=txt_2,
    G=reflay_11,
    A=number_slider_7,
    A_2=number_slider_8,
    B=number_slider_9,
    dimension_style=panel_10)  # -> R, G_2, R_2

# ----
# 要连接的梁中线Offest值
num_2 = Number(cluster_3.R)

# ----
# 要连接的梁中线curve
crv_40 = Curve(cluster_3.G_2)

# ----
# 要连接的embed
data_19 = Data(cluster_3.R_2)

# ----
# 1.1-掩口出侧埋遗漏
panel_45 = Panel("1.1-掩口出侧埋遗漏")
layer_5 = DefineLayer(Name=panel_45)
attributes = DefineObjectAttributes(Layer=layer_5)

# ----
# (9)Bake Me!!
# 埋件和阴阳角定位
panel_46 = Panel("阴阳角定位-F1")
data_20 = Data(merge_2)
swatch_5 = ColourSwatch(SwatchColor=RGB(140, 140, 140))

layer_6 = DefineLayer(Name=panel_46, Color=swatch_5)
attributes_2 = DefineObjectAttributes(Layer=layer_6, Color=swatch_5)

bake = BakeObjects(Geometry=data_20, Attributes=attributes_2, BakeName=panel_46, Bake=False)

swatch_6 = ColourSwatch(SwatchColor=RGB(255, 212, 0))

swatch_7 = ColourSwatch(SwatchColor=RGB(255, 242, 66))

swatch_8 = ColourSwatch(SwatchColor=RGB(180, 255, 66))

swatch_9 = ColourSwatch(SwatchColor=RGB(66, 255, 236))

swatch_10 = ColourSwatch(SwatchColor=RGB(66, 167, 255))

swatch_11 = ColourSwatch(SwatchColor=RGB(66, 98, 255))

swatch_12 = ColourSwatch(SwatchColor=RGB(255, 242, 66))

swatch_13 = ColourSwatch(SwatchColor=RGB(66, 255, 69))

# ----
# 梁中线+Offset值+埋件单体组合包
layer_7 = ObjectLayer(Guid=crv_2)  # -> LayerIndex, LayerPathName
panel_47 = Panel(txt_4)

# ----
# 需要出图的钢结构编号
panel_48 = Panel(layer_7.LayerPathName)

reflay_12 = ReferenceByLayer(LayerName=panel_48)
cluster_4 = Cluster_3(
    structure_number=panel_48,
    tag_text=panel_14,
    text_offset=number_slider_16,
    embed_color=swatch_4,
    T=txt_4,
    G=reflay_12,
    A=number_slider_17,
    A_2=number_slider_18,
    B=number_slider_14,
    dimension_style=panel_15)  # -> R, G_2, R_2

# ----
# 要连接的梁中线Offest值
num_3 = Number(cluster_4.R)

# ----
# 要连接的梁中线curve
crv_41 = Curve(cluster_4.G_2)

# ----
# 要连接的embed
data_21 = Data(cluster_4.R_2)

# ----
# 依次连接
# embed
entwine = Entwine(Branch00=data_21, Branch01=data_19, Branch02=data_18, FlattenInputs=True)

# ----
# 依次连接
# curve
entwine_2 = Entwine(Branch00=crv_41, Branch01=crv_40, Branch02=crv_38, FlattenInputs=True)

# ----
# 依次连接
# 梁中线Offest值
entwine_3 = Entwine(Branch00=num_3, Branch01=num_2, Branch02=num, FlattenInputs=True)

data_22 = Data(entwine)
# Rhino 文件中导入的块名
item_10 = ListItem(List=data_22, Index=0, Wrap=True)
item_11 = ListItem(List=data_22, Index="-1", Wrap=True)
# 这里如果跑红也不要紧，
# 说明单体没有出现相撞的情况
data_23 = Data(entwine)
item_12 = ListItem(List=data_23, Index=0, Wrap=True)
item_13 = ListItem(List=data_23, Index="-1", Wrap=True)
data_24 = Data(entwine)
item_14 = ListItem(List=data_24, Index=0, Wrap=True)
item_15 = ListItem(List=data_24, Index="-1", Wrap=True)
rotate_3 = Rotate(Geometry=item_15, Angle="Pi", Plane=item_15)  # -> Geometry, Transform
data_25 = Data(entwine)
data_26 = Data(entwine)
item_16 = ListItem(List=data_25, Index=0, Wrap=True)
item_17 = ListItem(List=data_25, Index="-1", Wrap=True)
item_18 = ListItem(List=data_26, Index=0, Wrap=True)
item_19 = ListItem(List=data_26, Index="-1", Wrap=True)
rotate_4 = Rotate(Geometry=item_17, Angle="Pi", Plane=item_17)  # -> Geometry, Transform

layer_8 = DefineLayer(Name="Tag::1-1-02钢板焊埋件", Color=swatch_6)
layer_9 = DefineLayer(Name="Embed::1-1-02钢板焊埋件", Color=swatch_6)
entwine_4 = Entwine(Branch00=layer_9, Branch01=layer_8, FlattenInputs=True)
attributes_3 = DefineObjectAttributes(Layer=entwine_4, Color=swatch_6)

layer_10 = DefineLayer(Name="Tag::2-1-03钢板焊埋件", Color=swatch_12)
layer_11 = DefineLayer(Name="Embed::2-1-03钢板焊埋件", Color=swatch_12)
entwine_5 = Entwine(Branch00=layer_11, Branch01=layer_10, FlattenInputs=True)
attributes_4 = DefineObjectAttributes(Layer=entwine_5, Color=swatch_12)

layer_12 = DefineLayer(Name="Tag::1-0-01钢板焊埋件", Color=swatch_7)
layer_13 = DefineLayer(Name="Embed::1-0-01钢板焊埋件", Color=swatch_7)
entwine_6 = Entwine(Branch00=layer_13, Branch01=layer_12, FlattenInputs=True)
attributes_5 = DefineObjectAttributes(Layer=entwine_6, Color=swatch_7)

layer_14 = DefineLayer(Name="Tag::3-1-03钢板焊埋件", Color=swatch_8)
layer_15 = DefineLayer(Name="Embed::3-1-03钢板焊埋件", Color=swatch_8)
entwine_7 = Entwine(Branch00=layer_15, Branch01=layer_14, FlattenInputs=True)
attributes_6 = DefineObjectAttributes(Layer=entwine_7, Color=swatch_8)

layer_16 = DefineLayer(Name="Tag::3-2-03钢板焊埋件", Color=swatch_13)
layer_17 = DefineLayer(Name="Embed::3-2-03钢板焊埋件", Color=swatch_13)
entwine_8 = Entwine(Branch00=layer_17, Branch01=layer_16, FlattenInputs=True)
attributes_7 = DefineObjectAttributes(Layer=entwine_8, Color=swatch_13)

layer_18 = DefineLayer(Name="Tag::4-1钢板焊底埋", Color=swatch_9)
layer_19 = DefineLayer(Name="Embed::4-1钢板焊底埋", Color=swatch_9)
entwine_9 = Entwine(Branch00=layer_19, Branch01=layer_18, FlattenInputs=True)
attributes_8 = DefineObjectAttributes(Layer=entwine_9, Color=swatch_9)

layer_20 = DefineLayer(Name="Tag::5-04板埋", Color=swatch_11)
layer_21 = DefineLayer(Name="Embed::5-04板埋", Color=swatch_11)
entwine_10 = Entwine(Branch00=layer_21, Branch01=layer_20, FlattenInputs=True)
attributes_9 = DefineObjectAttributes(Layer=entwine_10, Color=swatch_11)

layer_22 = DefineLayer(Name="Tag::4-0-03默认钢板焊", Color=swatch_10)
layer_23 = DefineLayer(Name="Embed::4-0-03默认钢板焊", Color=swatch_10)
entwine_11 = Entwine(Branch00=layer_23, Branch01=layer_22, FlattenInputs=True)
attributes_10 = DefineObjectAttributes(Layer=entwine_11, Color=swatch_10)

crv_42 = Curve(join_2)
panel_49 = Panel("""Dimension::Dim1
Dimension::Dim2
Dimension::Dim3
Dimension::Dim4""")
layer_24 = DefineLayer(Name=panel_49)  # -> graft(Layer)
attributes_11 = DefineObjectAttributes(Layer=layer_24)

# ----
# 生成底埋钢埋件
rectangle = Rectangle(Plane=PlaneXY(0, 0, 0), XSize=panel_18, YSize=panel_19, Radius=0)  # -> Rectangle, Length
rec = Rectangle(rectangle.Rectangle)
pln_3 = Plane(rectangle.Rectangle)

deplane_4 = DeconstructPlane(Plane=pln_3)  # -> Origin, XAxis, YAxis, ZAxis
dedomain = DeconstructDomain(Domain=panel_19)  # -> Start, End
amp_4 = Amplitude(Vector=deplane_4.YAxis, Amplitude=dedomain.End)
move_4 = Move(Geometry=deplane_4.Origin, Motion=amp_4)  # -> Geometry, Transform
ln_6 = Line(StartPoint=deplane_4.Origin, EndPoint=move_4.Geometry)
amp_5 = Amplitude(Vector=ln_6, Amplitude=Slider(190, range=0..1000))
move_5 = Move(Geometry=deplane_4.Origin, Motion=amp_5)  # -> Geometry, Transform

text = DefineTextObject(Text=panel_17, Plane=move_5.Geometry, DimensionStyle=panel_20, OutputType="Text")
group = Group(Objects=[rec, text])
merge_4 = Merge(Data1=group, Data2=pln_3)

data_27 = Data(merge_4)
item_20 = ListItem(List=data_27, Index="-1", Wrap=True)
item_21 = ListItem(List=data_27, Index=0, Wrap=True)

crv_43 = Curve(join_2)
panel_50 = Panel("""Dimension::Dim1
Dimension::Dim2
Dimension::Dim3
Dimension::Dim4""")
layer_25 = DefineLayer(Name=panel_50)  # -> graft(Layer)
attributes_12 = DefineObjectAttributes(Layer=layer_25)

# ---- group: F1-定位排名-自动生成
layer_26 = ObjectLayer(Guid=circle)  # -> LayerIndex, LayerPathName
reflay_13 = ReferenceByLayer(LayerName=layer_26.LayerPathName)
layer_27 = DefineLayer(Name=panel_29)
attributes_13 = DefineObjectAttributes(Layer=layer_27)

# ----
movetoplane = MoveToPlane(Geometry=reflay_13, Plane=PlaneXY(0, 0, 0), Above=True, Below=True)  # -> Geometry, Transform
movetoplane_2 = MoveToPlane(Geometry=crv_10, Plane=PlaneXY(0, 0, 0), Above=True, Below=True)  # -> Geometry, Transform
movetoplane_3 = MoveToPlane(Geometry=crv_11, Plane=PlaneXY(0, 0, 0), Above=True, Below=True)  # -> Geometry, Transform

# ---- group: F1-定位平面-导入人工检验
crv_44 = Curve(reflay_8)
end_4 = EndPoints(Curve=graft(crv_44))  # -> Start, End
merge_5 = Merge(Data1=end_4.Start, Data2=end_4.End)
pull_5 = PullPoint(Point=merge_5, Geometry=movetoplane_3.Geometry, ClosestOnly=True)  # -> ClosestPoint, Distance
sort_6 = SortList(Keys=pull_5.Distance, ValuesA=merge_5)  # -> Keys, ValuesA
item_22 = ListItem(List=sort_6.ValuesA, Index=0, Wrap=True)
item_23 = ListItem(List=sort_6.ValuesA, Index="-1", Wrap=True)
pt = Point(item_23)
pt_2 = Point(item_22)
ln_7 = Line(StartPoint=pt_2, EndPoint=pt)
rotate_5 = Rotate(Geometry=ln_7, Angle=1.570796327, Plane=pt_2)  # -> Geometry, Transform

# ---- group: F1-定位Plane-未筛选阴阳角
pl_3 = ConstructPlane(Origin=pt_2, XAxis=rotate_5.Geometry, YAxis=ln_7)

# ---- group: F1-定位排名-自动生成
layer_28 = ObjectLayer(Guid=circle_2)  # -> LayerIndex, LayerPathName
reflay_14 = ReferenceByLayer(LayerName=layer_28.LayerPathName)
layer_29 = DefineLayer(Name=panel_27)
attributes_14 = DefineObjectAttributes(Layer=layer_29)

# ----
movetoplane_4 = MoveToPlane(Geometry=reflay_14, Plane=PlaneXY(0, 0, 0), Above=True, Below=True)  # -> Geometry, Transform
movetoplane_5 = MoveToPlane(Geometry=crv_12, Plane=PlaneXY(0, 0, 0), Above=True, Below=True)  # -> Geometry, Transform
movetoplane_6 = MoveToPlane(Geometry=crv_13, Plane=PlaneXY(0, 0, 0), Above=True, Below=True)  # -> Geometry, Transform

# ---- group: F1-定位平面-导入人工检验
crv_45 = Curve(reflay_7)
end_5 = EndPoints(Curve=graft(crv_45))  # -> Start, End
merge_6 = Merge(Data1=end_5.Start, Data2=end_5.End)
pull_6 = PullPoint(Point=merge_6, Geometry=movetoplane_6.Geometry, ClosestOnly=True)  # -> ClosestPoint, Distance
sort_7 = SortList(Keys=pull_6.Distance, ValuesA=merge_6)  # -> Keys, ValuesA
item_24 = ListItem(List=sort_7.ValuesA, Index=0, Wrap=True)
item_25 = ListItem(List=sort_7.ValuesA, Index="-1", Wrap=True)
pt_3 = Point(item_25)
pt_4 = Point(item_24)
ln_8 = Line(StartPoint=pt_4, EndPoint=pt_3)
rotate_6 = Rotate(Geometry=ln_8, Angle=1.570796327, Plane=pt_4)  # -> Geometry, Transform

# ---- group: F1-定位Plane-未筛选阴阳角
pl_4 = ConstructPlane(Origin=pt_4, XAxis=rotate_6.Geometry, YAxis=ln_8)

# ---- group: F1-定位排名-自动生成 (continued)
area_5 = Area(Geometry=movetoplane.Geometry)  # -> Area, Centroid
pull_7 = PullPoint(Point=area_5.Centroid, Geometry=movetoplane_2.Geometry, ClosestOnly=True)  # -> ClosestPoint, Distance

# ---- group: F1-定位排名-自动生成 / Y Axis Line
ln_9 = Line(StartPoint=area_5.Centroid, EndPoint=pull_7.ClosestPoint)

# ----
# Step 2 :点击Bake
# 生成参考轴线在Embed-YAxis图层
bake_2 = BakeObjects(Geometry=ln_9, Attributes=attributes_13, BakeName=panel_29, Bake=False)

# ---- group: F1-定位排名-自动生成 (continued)
rotate_7 = Rotate(Geometry=ln_9, Angle=1.570796327, Plane=area_5.Centroid)  # -> Geometry, Transform

# ---- group: F1-定位排名-自动生成 / Plane For Preview
pl_5 = ConstructPlane(Origin=area_5.Centroid, XAxis=ln_9, YAxis=rotate_7.Geometry)

# ---- group: F1-定位排名-自动生成 (continued)
area_6 = Area(Geometry=movetoplane_4.Geometry)  # -> Area, Centroid
pull_8 = PullPoint(Point=area_6.Centroid, Geometry=movetoplane_5.Geometry, ClosestOnly=True)  # -> ClosestPoint, Distance

# ---- group: F1-定位排名-自动生成 / Y Axis Line
ln_10 = Line(StartPoint=area_6.Centroid, EndPoint=pull_8.ClosestPoint)

# ----
# Step 2 :点击Bake
# 生成参考轴线在Embed-YAxis图层
bake_3 = BakeObjects(Geometry=ln_10, Attributes=attributes_14, BakeName=panel_27, Bake=False)

# ---- group: F1-定位排名-自动生成 (continued)
rotate_8 = Rotate(Geometry=ln_10, Angle=1.570796327, Plane=area_6.Centroid)  # -> Geometry, Transform

# ---- group: F1-定位排名-自动生成 / Plane For Preview
pl_6 = ConstructPlane(Origin=area_6.Centroid, XAxis=ln_10, YAxis=rotate_8.Geometry)

# ---- group: 筛选阴阳角
pull_9 = PullPoint(Point=flatten(pl_3), Geometry=graft(merge_2), ClosestOnly=True)  # -> ClosestPoint, Distance
sort_8 = SortList(Keys=pull_9.Distance, ValuesA=flatten(pl_3))  # -> Keys, ValuesA
item_26 = ListItem(List=sort_8.Keys, Index=0, Wrap=True)  # -> Item, Item1
item_27 = ListItem(List=sort_8.ValuesA, Index=0, Wrap=True)  # -> Item, Item1
merge_7 = Merge(Data1=item_27.Item, Data2=item_27.Item1)
merge_8 = Merge(Data1=item_26.Item, Data2=item_26.Item1)
panel_51 = Panel(merge_8)
smaller_5 = SmallerThan(FirstNumber=merge_8, SecondNumber="100")  # -> SmallerThan, OrEqualTo
dispatch_12 = Dispatch(List=merge_7, DispatchPattern=smaller_5.SmallerThan)  # -> ListA, ListB
pln_4 = Plane(pl_3)
crv_46 = Curve(movetoplane_3.Geometry)
movetoplane_7 = MoveToPlane(Geometry=crv_46, Plane=PlaneXY(0, 0, 0), Above=True, Below=True)  # -> Geometry, Transform
clscrv_3 = CloseCurve(Curve=movetoplane_7.Geometry, CloseType=0, Bulge=0.5, Tolerance=0)  # -> Closed, R

# ---- group: 筛选阴阳角 / F1-阴阳角-Plane
data_28 = Data(dispatch_12.ListA)

# ---- group: 筛选阴阳角 (continued)
check_same_points = CheckSamePoints(archPoint=flatten(pl_3), crvPoint=flatten(data_28))  # -> out, specialPt; inputs archPoint: list of Point3d, crvPoint: list of Point3d; same code as testpoint
cull_i_4 = CullIndex(List=flatten(pln_4), Indices=check_same_points.specialPt, Wrap=True)
deplane_5 = DeconstructPlane(Plane=cull_i_4)  # -> Origin, XAxis, YAxis, ZAxis
movetoplane_8 = MoveToPlane(Geometry=deplane_5.Origin, Plane=PlaneXY(0, 0, 0), Above=True, Below=True)  # -> Geometry, Transform
amp_6 = Amplitude(Vector=deplane_5.YAxis, Amplitude=Slider(300, range=0..1000))
move_6 = Move(Geometry=movetoplane_8.Geometry, Motion=amp_6)  # -> flatten(Geometry), Transform
incurves = PointInCurves(Point=move_6.Geometry, Curves=clscrv_3.Closed)  # -> Relationship, Index, Point
equals_2 = Equality(FirstNumber=incurves.Relationship, SecondNumber="2")  # -> Equality, Inequality
dispatch_13 = Dispatch(List=flatten(cull_i_4), DispatchPattern=equals_2.Equality)  # -> ListA, ListB
data_29 = Data(dispatch_13.ListA)
data_30 = Data(dispatch_13.ListB)
deplane_6 = DeconstructPlane(Plane=data_29)  # -> Origin, XAxis, YAxis, ZAxis
rev = Reverse(Vector=deplane_6.YAxis)
pl_7 = ConstructPlane(Origin=deplane_6.Origin, XAxis=deplane_6.XAxis, YAxis=rev)
merge_9 = Merge(Data1=pl_7, Data2=data_30)

# ---- group: 下层定位点Plane-去阴阳角
# 阴阳角
# 转角点
# 第一层
# 
# Angular Curves(architecture line)
# 第一层
# 
# Special Curves(architecture line)
# 第一层
# 
# Angular Curves(architecture line)
pln_5 = Plane(merge_9)

# ----
# 最终生成的定位点Plane
pln_6 = Plane(pln_5)

# ---- group: 下层定位平面-All
pln_7 = Plane(pln_5)

# ---- group: 上层定位plane
pln_8 = Plane(pln_5)

# ---- group: 筛选阴阳角
pull_10 = PullPoint(Point=flatten(pl_4), Geometry=graft(merge_3), ClosestOnly=True)  # -> ClosestPoint, Distance
sort_9 = SortList(Keys=pull_10.Distance, ValuesA=flatten(pl_4))  # -> Keys, ValuesA
item_28 = ListItem(List=sort_9.Keys, Index=0, Wrap=True)  # -> Item, Item1
item_29 = ListItem(List=sort_9.ValuesA, Index=0, Wrap=True)  # -> Item, Item1
merge_10 = Merge(Data1=item_29.Item, Data2=item_29.Item1)
merge_11 = Merge(Data1=item_28.Item, Data2=item_28.Item1)
panel_52 = Panel(merge_11)
smaller_6 = SmallerThan(FirstNumber=merge_11, SecondNumber="100")  # -> SmallerThan, OrEqualTo
dispatch_14 = Dispatch(List=merge_10, DispatchPattern=smaller_6.SmallerThan)  # -> ListA, ListB
pln_9 = Plane(pl_4)
crv_47 = Curve(movetoplane_6.Geometry)
movetoplane_9 = MoveToPlane(Geometry=crv_47, Plane=PlaneXY(0, 0, 0), Above=True, Below=True)  # -> Geometry, Transform
clscrv_4 = CloseCurve(Curve=movetoplane_9.Geometry, CloseType=0, Bulge=0.5, Tolerance=0)  # -> Closed, R

# ---- group: 筛选阴阳角 / F1-阴阳角-Plane
data_31 = Data(dispatch_14.ListA)

# ---- group: 筛选阴阳角 (continued)
check_same_points_2 = CheckSamePoints(archPoint=flatten(pl_4), crvPoint=flatten(data_31))  # -> out, specialPt; inputs archPoint: list of Point3d, crvPoint: list of Point3d; same code as testpoint
cull_i_5 = CullIndex(List=flatten(pln_9), Indices=check_same_points_2.specialPt, Wrap=True)
deplane_7 = DeconstructPlane(Plane=cull_i_5)  # -> Origin, XAxis, YAxis, ZAxis
movetoplane_10 = MoveToPlane(Geometry=deplane_7.Origin, Plane=PlaneXY(0, 0, 0), Above=True, Below=True)  # -> Geometry, Transform
amp_7 = Amplitude(Vector=deplane_7.YAxis, Amplitude=Slider(300, range=0..1000))
move_7 = Move(Geometry=movetoplane_10.Geometry, Motion=amp_7)  # -> flatten(Geometry), Transform
incurves_2 = PointInCurves(Point=move_7.Geometry, Curves=clscrv_4.Closed)  # -> Relationship, Index, Point
equals_3 = Equality(FirstNumber=incurves_2.Relationship, SecondNumber="2")  # -> Equality, Inequality
dispatch_15 = Dispatch(List=flatten(cull_i_5), DispatchPattern=equals_3.Equality)  # -> ListA, ListB
data_32 = Data(dispatch_15.ListA)
data_33 = Data(dispatch_15.ListB)
deplane_8 = DeconstructPlane(Plane=data_32)  # -> Origin, XAxis, YAxis, ZAxis
rev_2 = Reverse(Vector=deplane_8.YAxis)
pl_8 = ConstructPlane(Origin=deplane_8.Origin, XAxis=deplane_8.XAxis, YAxis=rev_2)
merge_12 = Merge(Data1=pl_8, Data2=data_33)

# ---- group: 上层定位点Plane-去阴阳角
pln_10 = Plane(merge_12)

# ---- group: 上层定位平面-All
pln_11 = Plane(pln_10)

# ----
# 板埋：制作板埋三视图
max = Maximum(A=s_x, B=s_y)
filter_6 = StreamFilter(Gate=list, Stream0=7.2, Stream1=9.6, Stream2=11.9, Stream3=14.3, Stream4=16.7, Stream5=19.1)
filter_7 = StreamFilter(Gate=list_2, Stream0=270, Stream1=360)
filter_8 = StreamFilter(Gate=list_3, Stream0=10, Stream1=12, Stream2=16, Stream3=18, Stream4=20, Stream5=25)
filter_9 = StreamFilter(Gate=list, Stream0=0.91, Stream1=1.1, Stream2=1.27, Stream3=1.43, Stream4=1.57, Stream5=1.71)
filter_10 = StreamFilter(Gate=list_2, Stream0=0.16, Stream1=0.14)
addition = Addition(A=list_4, B=1)
addition_2 = Addition(A=list_5, B=1)
division = Division(A=max, B=8)
t = Integer(division)
panel_53 = Panel(filter_9)
panel_54 = Panel(filter_6)
panel_55 = Panel(filter_10)
min = Minimum(A=filter_7, B=300)
panel_56 = Panel(min)
expression = Expression(A=filter_10, fy=filter_7, ft=filter_9, d=filter_8, Expression="(int((0.6*1.1*A*fy/ft*d)/5)+1)*5")

# ----
# 板埋Modeling
multiplication = Multiplication(A=s_x, B=addition)
multiplication_2 = Multiplication(A=s_y, B=addition_2)
recgrid = Rectangular(Plane=PlaneXY(0, 0, 0), SizeX=s_x, SizeY=s_y, ExtentX=addition, ExtentY=addition_2)  # -> Cells, Points
直径 = Text(filter_8)
division_2 = Division(A=multiplication, B=2)
division_3 = Division(A=multiplication_2, B=2)
vec = VectorXYZ(XComponent=expr("-x", division_2), YComponent=expr("-x", division_3), ZComponent=0)  # -> Vector, Length
move_8 = Move(Geometry=recgrid.Points, Motion=vec.Vector)  # -> Geometry, Transform
division_4 = Division(A=直径, B=2)
cyl = Cylinder(Base=move_8.Geometry, Radius=division_4, Length=expr("-x", expression))
X = UnitX(Factor=直径)
multiplication_3 = Multiplication(A=直径, B=6)
edges = BrepEdges(Brep=cyl)  # -> Naked, Interior, NonManifold
item_30 = ListItem(List=edges.Naked, Index=0, Wrap=True)
max_2 = Maximum(A=multiplication_3, B=70)
move_9 = Move(Geometry=item_30, Motion=X)  # -> Geometry, Transform
multiplication_4 = Multiplication(A=max_2, B=2)
addition_3 = Addition(A=multiplication, B=multiplication_4)
addition_4 = Addition(A=multiplication_2, B=multiplication_4)
division_5 = Division(A=t, B=2)
expression_2 = Expression(x=addition_4, Expression="Ceiling(x/10)*10/2")
expression_3 = Expression(x=addition_3, Expression="Ceiling(x/10)*10/2")
round = Round(Number=division_5)  # -> Nearest, Floor, Ceiling
multiplication_5 = Multiplication(A=round.Ceiling, B=2)
dom = ConstructDomain(DomainStart=expr("-x", expression_2), DomainEnd=expression_2)
dom_2 = ConstructDomain(DomainStart=expr("-x", expression_3), DomainEnd=expression_3)
box = DomainBox(Base=PlaneXY(0, 0, 0), X=dom_2, Y=dom, Z=multiplication_5)
Z = UnitZ(Factor=expr("-x", multiplication_5))

multiplication_6 = Multiplication(A=直径, B=5)

Z_2 = UnitZ(Factor=multiplication_6)
extr = Extrude(Base=move_9.Geometry, Direction=Z_2)
cap = CapHoles(Brep=[extr, cyl])
merge_13 = Merge(Data1=cap, Data2=box)
flatten_3 = FlattenTree(Tree=merge_13, Path="{0}")
move_10 = Move(Geometry=flatten_3, Motion=Z)  # -> Geometry, Transform

# ----
# 三视图
# hidden lines of top+pers view
# move to center
# 如果无法完整的生成埋件的三视图，
# 建议选择埋件的3D在Rhino中将
# Top/Perspective/Front/Right 试图缩放至合适大小后重新运行
panel_57 = Panel("""Top
Perspective
Front
Right""")
m2d_rhino = Make2DRhinoView(Name=panel_57, Clip=True)
number_slider_47 = Slider(1, range=0..10)
pt_5 = Point(Point(957.9296072, 367.7685097, 0))
pt_6 = Point("0,0,0")
recgrid_2 = Rectangular(
    Plane=pt_5,
    SizeX=Slider(12, range=1..20, expression="X*50"),
    SizeY=Slider(10, range=1..20, expression="X*50"),
    ExtentX=number_slider_47,
    ExtentY=number_slider_47)  # -> Cells, Points
flatten_4 = FlattenTree(Tree=recgrid_2.Points, Path="{0}")

# ----
# （6）生成板埋埋件
# 注意：
# 1.记得点一下Compute按钮
# 2.如果无法完整的生成埋件的三视图，
# 建议选择埋件的3D在Rhino中将
# Top/Perspective/Front/Right 试图缩放至合适大小后重新运行
make2d = Make2D(Geometry=move_10.Geometry, View=m2d_rhino, TangentEdges=False, TangentSeams=False, AutoComputeMake2D=False)  # -> VisibleCurves, VisibleIndex, VisibleType, HiddenCurves, HiddenIndex, HiddenType

bang = ExplodeTree(Data=make2d.VisibleCurves)  # -> Branch0, Branch1, Branch2, Branch3, Branch4, Branch5, Branch6, Branch7
divdist = DivideDistance(Curve=make2d.HiddenCurves, Distance=Slider(1, range=0..10))  # -> Points, Tangents, Parameters
graft = GraftTree(Tree=make2d.HiddenCurves, IncludeEmptyLists=True, IncludeNullItems=True)
shatter = Shatter(Curve=graft, Parameters=divdist.Parameters)
dispatch_16 = Dispatch(List=shatter, DispatchPattern=[True, False])  # -> ListA, ListB
crv_48 = Curve(dispatch_16.ListA)
pshift = ShiftPaths(Data=crv_48, Offset=-1)
pshift_2 = ShiftPaths(Data=pshift, Offset=-1)
bang_2 = ExplodeTree(Data=pshift_2)  # -> Branch0, Branch1, Branch2, Branch3, Branch4, Branch5, Branch6, Branch7
entwine_12 = Entwine(Branch00=bang_2.Branch0, Branch01=bang.Branch0, FlattenInputs=True)  # -> flatten(Result)
entwine_13 = Entwine(Branch00=bang_2.Branch1, Branch01=bang.Branch1, FlattenInputs=True)  # -> flatten(Result)
entwine_14 = Entwine(Branch00=entwine_12, Branch01=entwine_13, Branch02=bang.Branch2, Branch03=bang.Branch3, FlattenInputs=True)
group_2 = Group(Objects=entwine_14)
pshift_3 = ShiftPaths(Data=group_2, Offset=-1)
pshift_4 = ShiftPaths(Data=group_2, Offset=-1)
boxprop = BoxProperties(Box=pshift_3)  # -> Center, Diagonal, Area, Volume, Degeneracy
vec2pt = Vector2Pt(PointA=boxprop.Center, PointB=pt_6, Unitize=False)  # -> Vector, Length
move_11 = Move(Geometry=pshift_4, Motion=vec2pt.Vector)  # -> flatten(Geometry), Transform
orient = Orient(Geometry=flatten(move_11.Geometry), Source=PlaneXY(0, 0, 0), Target=flatten_4)  # -> Geometry, Transform
cull_i_6 = CullIndex(List=orient.Geometry, Indices="-1", Wrap=True)
split = SplitList(List=cull_i_6, Index="4")  # -> ListA, ListB
geo_4 = Geometry(split.ListA)

# ---- group: 单体定Top/Side
item_31 = ListItem(List=geo_4, Index=Slider(0, range=0..10), Wrap=True)
item_32 = ListItem(List=geo_4, Index=2, Wrap=True)
cluster_5 = Cluster(G=item_31)
cluster_6 = Cluster(G=item_32)

# ----
# 钢埋板高度，工字钢尺寸决定
ungroup = Ungroup(Group=cluster_6)
ungroup_2 = Ungroup(Group=cluster_5)

# ---- group: Top/Side
filter_11 = StreamFilter(Gate=list_6, Stream0=ungroup_2, Stream1=ungroup)

# ---- group: Block
attributes_15 = DefineObjectAttributes(Color=ColourSwatch(SwatchColor=RGB(255, 0, 0)))
block = DefineBlock(Geometry=ungroup_2, Attributes=attributes_15, BlockName="Board Plate", BasePlane=PlaneXY(0, 0, 0))

# ----
deblock_4 = DeconstructBlock(Block=block)  # -> Name, flatten(Plane), flatten(Geometry)
boundary_2 = BoundarySurfaces(Edges=deblock_4.Geometry)
deplane_9 = DeconstructPlane(Plane=deblock_4.Plane)  # -> Origin, XAxis, YAxis, ZAxis
area_7 = Area(Geometry=boundary_2)  # -> Area, Centroid
move2pt_6 = MoveToPoint(Geometry=flatten(deplane_9.Origin), PointA=flatten(deplane_9.Origin), PointB=flatten(area_7.Centroid))  # -> Moved, Vector, Transform
pl_9 = ConstructPlane(Origin=move2pt_6.Moved, XAxis=deplane_9.XAxis, YAxis=deplane_9.YAxis)  # -> graft(Plane)

deplane_10 = DeconstructPlane(Plane=deblock_4.Plane)  # -> Origin, XAxis, YAxis, ZAxis
amp_8 = Amplitude(Vector=deplane_10.YAxis, Amplitude=number_slider_19)
move_12 = Move(Geometry=deplane_10.Origin, Motion=amp_8)  # -> Geometry, Transform

text_2 = DefineTextObject(Text=panel_22, Plane=move_12.Geometry, DimensionStyle=panel_21, OutputType="Text")
group_3 = Group(Objects=flatten([block, text_2]))
entwine_15 = Entwine(Branch00=group_3, Branch01=pl_9, FlattenInputs=True)

data_34 = Data(flatten(entwine_15))
item_33 = ListItem(List=data_34, Index=0, Wrap=True)
item_34 = ListItem(List=data_34, Index="-1", Wrap=True)

# ---- group: 车道区域
# 1.是否有檐口线-下层定位点
toggle_4 = BooleanToggle(True)
clean = CleanTree(RemoveNulls=True, RemoveInvalid=True, RemoveEmpty=toggle_4, Tree=pln_7)
crv_49 = Curve(crv_17)
merge_14 = Merge(Data1=crv_25, Data2=crv_49)

# ---- group: 车道区域 / Input ???
deplane_11 = DeconstructPlane(Plane=clean)  # -> Origin, XAxis, YAxis, ZAxis

# ----
# 1.是否有檐口线-上层定位点
toggle_5 = BooleanToggle(True)
clean_2 = CleanTree(RemoveNulls=True, RemoveInvalid=True, RemoveEmpty=toggle_5, Tree=pln_11)

# ---- group: Input ???
deplane_12 = DeconstructPlane(Plane=clean_2)  # -> Origin, XAxis, YAxis, ZAxis

# ----
incurve = PointInCurve(Point=deplane_12.Origin, Curve=crv_24)  # -> Relationship, Point
equals_4 = Equality(FirstNumber=incurve.Relationship, SecondNumber="2")  # -> Equality, Inequality
dispatch_17 = Dispatch(List=clean_2, DispatchPattern=equals_4.Equality)  # -> ListA, ListB

# ----
# Site - 无檐口线的定位点
pln_12 = Plane(dispatch_17.ListB)

# ----
# 1.0无檐口线初筛-上层定位点
pln_13 = Plane(pln_12)

# ---- group: 车道区域 (continued)
incurve_2 = PointInCurve(Point=deplane_11.Origin, Curve=crv_23)  # -> Relationship, Point
equals_5 = Equality(FirstNumber=incurve_2.Relationship, SecondNumber="2")  # -> Equality, Inequality
dispatch_18 = Dispatch(List=clean, DispatchPattern=equals_5.Equality)  # -> ListA, ListB

# Site - 有檐口线的定位点
pln_14 = Plane(dispatch_18.ListA)

# Site - 无檐口线的定位点
pln_15 = Plane(dispatch_18.ListB)

incurves_3 = PointInCurves(Point=pln_14, Curves=crv_49)  # -> Relationship, Index, Point
incurves_4 = PointInCurves(Point=pln_14, Curves=merge_14)  # -> Relationship, Index, Point
equals_6 = Equality(FirstNumber=incurves_4.Relationship, SecondNumber="2")  # -> Equality, Inequality
equals_7 = Equality(FirstNumber=incurves_3.Relationship, SecondNumber="0")  # -> Equality, Inequality
dispatch_19 = Dispatch(List=pln_14, DispatchPattern=equals_6.Equality)  # -> ListA, ListB
dispatch_20 = Dispatch(List=pln_14, DispatchPattern=equals_7.Inequality)  # -> ListA, ListB

# ---- group: 车道区域 / 檐口线-Site
pln_16 = Plane(dispatch_19.ListB)

# ---- group: 车道区域
# 檐口出特殊处理:
# 比如作为吊顶处理
# +车道处特殊处理
pln_17 = Plane(dispatch_19.ListA)

# 车道处特殊处理
pln_18 = Plane(dispatch_20.ListA)

# ---- group: All-下层定位点
# 1.1有檐口线
pln_19 = Plane(pln_16)

# ----
# 1.0无檐口线初筛-下层定位点
pln_20 = Plane(pln_15)

# ----
# 0 檐口出特殊处理
# 比如作为吊顶处理
pln_21 = Plane(pln_17)
pt_7 = Point(pln_21)

# ----
# 区分内外梁边线
# 2.根据是否相交判定内外梁(平行于建筑边线方向）
crv_50 = Curve(entwine_2)
num_4 = Number(entwine_3)
crv_51 = Curve(filter)
offcrv = OffsetCurve(Curve=crv_50, Plane=PlaneXY(0, 0, 0), Distance=num_4, BothSides=expr("-x", num_4), Kinks=0, CapType="0")
midpt_6 = CurveMiddle(Curve=offcrv)
offcrv_2 = OffsetCurve(Curve=crv_50, Plane=PlaneXY(0, 0, 0), Distance=num_4, BothSides=expr("-x", num_4), Kinks=0, CapType="1")
crv_52 = Curve(offcrv)
item_35 = ListItem(List=midpt_6, Index=0, Wrap=True)
item_36 = ListItem(List=crv_52, Index=0, Wrap=True)
item_37 = ListItem(List=crv_52, Index="-1", Wrap=True)
graft_2 = GraftTree(Tree=crv_50, IncludeEmptyLists=True, IncludeNullItems=True)

# ---- group: 梁中线-中点
midpt_7 = CurveMiddle(Curve=crv_50)

# ---- group: Pull到轮廓线
pull_11 = PullPoint(Point=midpt_7, Geometry=crv_51, ClosestOnly=True)  # -> ClosestPoint, Distance

# ----
# 梁线闭合
shift = ShiftPaths(Data=offcrv_2, Offset=-1)

# ---- group: 和某组梁边线相连
ln_11 = Line(StartPoint=item_35, EndPoint=graft(pull_11.ClosestPoint))

# ---- group: 有交点为内
ccx_4 = CurveCurve(CurveA=ln_11, CurveB=graft_2)  # -> Points, ParamsA, ParamsB

# ----
null_2 = NullItem(Item=ccx_4.Points)  # -> NullFlags, InvalidFlags, Description
dispatch_21 = Dispatch(List=item_36, DispatchPattern=null_2.InvalidFlags)  # -> ListA, ListB
dispatch_22 = Dispatch(List=item_37, DispatchPattern=null_2.InvalidFlags)  # -> ListA, ListB

# ----
# 梁边线-内
merge_15 = Merge(Data1=dispatch_21.ListB, Data2=dispatch_22.ListA)

# ----
# 梁边线-外
merge_16 = Merge(Data1=dispatch_21.ListA, Data2=dispatch_22.ListB)

# ---- group: 梁-外侧
crv_53 = Curve(merge_16)

# ----
deplane_13 = DeconstructPlane(Plane=pln_20)  # -> Origin, XAxis, YAxis, ZAxis
crv_54 = Curve(crv_51)
incurves_5 = PointInCurves(Point=deplane_13.Origin, Curves=flatten(crv_54))  # -> Relationship, Index, Point
equals_8 = Equality(FirstNumber=incurves_5.Relationship, SecondNumber="2")  # -> Equality, Inequality
dispatch_23 = Dispatch(List=pln_20, DispatchPattern=equals_8.Equality)  # -> ListA, ListB
crv_55 = Curve(crv_25)
data_35 = Data(dispatch_23.ListB)

deplane_14 = DeconstructPlane(Plane=pln_13)  # -> Origin, XAxis, YAxis, ZAxis
crv_56 = Curve(crv_51)
incurves_6 = PointInCurves(Point=deplane_14.Origin, Curves=flatten(crv_56))  # -> Relationship, Index, Point
equals_9 = Equality(FirstNumber=incurves_6.Relationship, SecondNumber="2")  # -> Equality, Inequality
dispatch_24 = Dispatch(List=pln_13, DispatchPattern=equals_9.Equality)  # -> ListA, ListB
crv_57 = Curve(crv_25)
data_36 = Data(dispatch_24.ListB)

pln_22 = Plane(dispatch_23.ListA)
incurves_7 = PointInCurves(Point=pln_22, Curves=flatten(crv_55))  # -> Relationship, Index, Point
equals_10 = Equality(FirstNumber=incurves_7.Relationship, SecondNumber="0")  # -> Equality, Inequality
dispatch_25 = Dispatch(List=pln_22, DispatchPattern=equals_10.Equality)  # -> ListA, ListB
pln_23 = Plane(dispatch_25.ListB)

pln_24 = Plane(dispatch_24.ListA)
incurves_8 = PointInCurves(Point=pln_24, Curves=flatten(crv_57))  # -> Relationship, Index, Point
equals_11 = Equality(FirstNumber=incurves_8.Relationship, SecondNumber="0")  # -> Equality, Inequality
dispatch_26 = Dispatch(List=pln_24, DispatchPattern=equals_11.Equality)  # -> ListA, ListB
pln_25 = Plane(dispatch_26.ListB)

# ---- group: 下层交点-除重
# 1.0无檐口线-下层定位点
pln_26 = Plane(dispatch_25.ListA)

# 1.0无檐口线-上层定位点
pln_27 = Plane(dispatch_26.ListA)

# ----
crv_58 = Curve(shift)

# ---- group: 下层交点-除重 / 梁外侧
# 阳角
# 阴角
crv_59 = Curve(merge_16)

# ----
# 1.0
crv_60 = Curve(shift)

crv_61 = Curve(shift)

crv_62 = Curve(shift)

crv_63 = Curve(shift)

crv_64 = Curve(shift)

crv_65 = Curve(shift)

crv_66 = Curve(shift)

crv_67 = Curve(shift)

# ----
# 1.1 有檐口-整个site一起处理
pln_28 = Plane(pln_19)
deplane_15 = DeconstructPlane(Plane=pln_28)  # -> Origin, XAxis, YAxis, ZAxis
amp_9 = Amplitude(Vector=deplane_15.YAxis, Amplitude=number_slider_31)
move_13 = Move(Geometry=deplane_15.Origin, Motion=amp_9)  # -> Geometry, Transform
ln_12 = Line(StartPoint=deplane_15.Origin, EndPoint=move_13.Geometry)
ccx_5 = CurveCurve(CurveA=graft(ln_12), CurveB=flatten(crv_53))  # -> Points, ParamsA, ParamsB
shift_2 = ShiftPaths(Data=ccx_5.Points, Offset=-1)
sort_10 = SortList(Keys=shift_2, ValuesA=shift_2)  # -> Keys, ValuesA
pull_12 = PullPoint(Point=sort_10.ValuesA, Geometry=graft(deplane_15.Origin), ClosestOnly=True)  # -> ClosestPoint, Distance
sort_11 = SortList(Keys=pull_12.Distance, ValuesA=sort_10.ValuesA)  # -> Keys, ValuesA
crv_68 = Curve(shift)

# ---- group: 最外侧的交点
item_38 = ListItem(List=sort_11.ValuesA, Index="-1", Wrap=True)

# ----
null_3 = NullItem(Item=flatten(item_38))  # -> NullFlags, InvalidFlags, Description
dispatch_27 = Dispatch(List=item_38, DispatchPattern=item_38)  # -> ListA, ListB
dispatch_28 = Dispatch(List=pln_28, DispatchPattern=null_3.InvalidFlags)  # -> ListA, ListB

# ---- group: 交点对应的初始Plane
data_37 = Data(dispatch_28.ListB)

# ---- group: 交点Point
data_38 = Data(dispatch_27.ListA)

# ----
# 按照梁分类定位点
pt_8 = Point(data_38)
incurves_9 = PointInCurves(Point=flatten(pt_8), Curves=crv_68)  # -> Relationship, Index, Point
equals_12 = Equality(FirstNumber=incurves_9.Relationship, SecondNumber="0")  # -> Equality, Inequality
dispatch_29 = Dispatch(List=flatten(pt_8), DispatchPattern=equals_12.Inequality)  # -> ListA, ListB

# ----
# 按照梁分类定位点
pt_9 = Point(data_38)
incurves_10 = PointInCurves(Point=flatten(pt_9), Curves=crv_68)  # -> Relationship, Index, Point
equals_13 = Equality(FirstNumber=incurves_10.Relationship, SecondNumber="0")  # -> Equality, Inequality
dispatch_30 = Dispatch(List=flatten(data_37), DispatchPattern=equals_13.Inequality)  # -> ListA, ListB

# ---- group: Plane-属于那个梁
data_39 = Data(dispatch_30.ListA)

# ---- group: 交点-属于哪个梁
data_40 = Data(dispatch_29.ListA)

# ----
move2pt_7 = MoveToPoint(Geometry=data_39, PointA=data_39, PointB=data_40)  # -> Moved, Vector, Transform
null_4 = NullItem(Item=move2pt_7.Moved)  # -> NullFlags, InvalidFlags, Description
dispatch_31 = Dispatch(List=move2pt_7.Moved, DispatchPattern=null_4.InvalidFlags)  # -> ListA, ListB

check_same_points_3 = CheckSamePoints(archPoint=pln_28, crvPoint=data_37)  # -> out, specialPt; inputs archPoint: list of Point3d, crvPoint: list of Point3d; same code as testpoint

# ---- group: 檐口-首次筛选的有效起始Plane
data_41 = Data(dispatch_31.ListB)

# ----
# 0无檐口线
# 与梁不相交
cull_i_7 = CullIndex(List=pln_28, Indices=check_same_points_3.specialPt, Wrap=True)

# ----
# 0 檐口出定位点
# 与结构无交点
pln_29 = Plane(cull_i_7)

# ----
# 0.Missing Point-二次筛选檐口处
# 埋件定位点Offset，没有找到和梁的交点
number_slider_48 = Slider(5000, range=0..10000)
deplane_16 = DeconstructPlane(Plane=pln_29)  # -> Origin, XAxis, YAxis, ZAxis
amp_10 = Amplitude(Vector=deplane_16.YAxis, Amplitude=number_slider_48)
move_14 = Move(Geometry=deplane_16.Origin, Motion=amp_10)  # -> Geometry, Transform
ln_13 = Line(StartPoint=move_14.Geometry, EndPoint=deplane_16.Origin)
amp_11 = Amplitude(Vector=deplane_16.XAxis, Amplitude=number_slider_24)
amp_12 = Amplitude(Vector=deplane_16.XAxis, Amplitude=expr("-x", number_slider_24))

# ---- group: 2条Offset的探针找交点
move_15 = Move(Geometry=ln_13, Motion=amp_11)  # -> Geometry, Transform
move_16 = Move(Geometry=ln_13, Motion=amp_12)  # -> Geometry, Transform

# ----
# 1.1 檐口处侧埋，钢板焊
# 02：钢板焊埋件[钢梁外侧]
# @钢边梁宽@钢边梁高
pln_30 = Plane(data_41)

# ---- group: 下层交点-除重
# 1.0 无檐口线+上下层幕墙边线连续
pln_31 = Plane(pln_27)
pln_32 = Plane(pln_26)
deplane_17 = DeconstructPlane(Plane=pln_31)  # -> Origin, XAxis, YAxis, ZAxis
deplane_18 = DeconstructPlane(Plane=pln_32)  # -> Origin, XAxis, YAxis, ZAxis
number_slider_49 = Slider(3584, range=0..10000)
number_slider_50 = Slider(3584, range=0..10000)
amp_13 = Amplitude(Vector=deplane_18.YAxis, Amplitude=expr("-x", number_slider_50))
amp_14 = Amplitude(Vector=deplane_18.YAxis, Amplitude=number_slider_50)
amp_15 = Amplitude(Vector=deplane_17.YAxis, Amplitude=expr("-x", number_slider_49))
amp_16 = Amplitude(Vector=deplane_17.YAxis, Amplitude=number_slider_49)
move_17 = Move(Geometry=deplane_18.Origin, Motion=amp_13)  # -> Geometry, Transform
move_18 = Move(Geometry=deplane_18.Origin, Motion=amp_14)  # -> Geometry, Transform
move_19 = Move(Geometry=deplane_17.Origin, Motion=amp_15)  # -> Geometry, Transform
move_20 = Move(Geometry=deplane_17.Origin, Motion=amp_16)  # -> Geometry, Transform
ln_14 = Line(StartPoint=move_19.Geometry, EndPoint=move_20.Geometry)
ln_15 = Line(StartPoint=move_17.Geometry, EndPoint=move_18.Geometry)
# 阳角
# 阴角
pln_33 = Plane(pln_32)

# ---- group: 下层交点-除重 / F2-交点
ccx_6 = CurveCurve(CurveA=ln_14, CurveB=crv_28)  # -> Points, ParamsA, ParamsB

# ---- group: 下层交点-除重 / F1-交点
ccx_7 = CurveCurve(CurveA=ln_15, CurveB=crv_27)  # -> Points, ParamsA, ParamsB

# ----
ccx_8 = CurveCurve(CurveA=graft(move_16.Geometry), CurveB=flatten(merge_16))  # -> Points, ParamsA, ParamsB
shift_3 = ShiftPaths(Data=ccx_8.Points, Offset=-1)
sort_12 = SortList(Keys=shift_3, ValuesA=shift_3)  # -> Keys, ValuesA
pull_13 = PullPoint(Point=sort_12.ValuesA, Geometry=graft(pln_29), ClosestOnly=True)  # -> ClosestPoint, Distance
sort_13 = SortList(Keys=pull_13.Distance, ValuesA=sort_12.ValuesA)  # -> Keys, ValuesA

# ---- group: 最远交点
item_39 = ListItem(List=sort_13.ValuesA, Index="-1", Wrap=True)

# ----
null_5 = NullItem(Item=flatten(item_39))  # -> NullFlags, InvalidFlags, Description
dispatch_32 = Dispatch(List=simplify(item_39), DispatchPattern=simplify(graft(null_5.InvalidFlags)))  # -> ListA, ListB
dispatch_33 = Dispatch(List=pln_29, DispatchPattern=null_5.InvalidFlags)  # -> ListA, ListB
pt_10 = Point(dispatch_32.ListB)
pln_34 = Plane(dispatch_33.ListB)

# ----
# 按照梁分类定位点
pln_35 = Plane(pln_34)
pt_11 = Point(pt_10)
incurves_11 = PointInCurves(Point=flatten(pt_11), Curves=crv_58)  # -> Relationship, Index, Point
equals_14 = Equality(FirstNumber=incurves_11.Relationship, SecondNumber="0")  # -> Equality, Inequality
dispatch_34 = Dispatch(List=flatten(pln_35), DispatchPattern=equals_14.Inequality)  # -> ListA, ListB
data_42 = Data(dispatch_34.ListA)

# ----
# 按照梁分类定位点
pt_12 = Point(pt_10)
incurves_12 = PointInCurves(Point=flatten(pt_12), Curves=crv_58)  # -> Relationship, Index, Point
equals_15 = Equality(FirstNumber=incurves_12.Relationship, SecondNumber="0")  # -> Equality, Inequality
dispatch_35 = Dispatch(List=flatten(pt_12), DispatchPattern=equals_15.Inequality)  # -> ListA, ListB
data_43 = Data(dispatch_35.ListA)

move2pt_8 = MoveToPoint(Geometry=data_42, PointA=data_42, PointB=data_43)  # -> Moved, Vector, Transform
null_6 = NullItem(Item=move2pt_8.Moved)  # -> NullFlags, InvalidFlags, Description
dispatch_36 = Dispatch(List=move2pt_8.Moved, DispatchPattern=null_6.InvalidFlags)  # -> ListA, ListB
pln_36 = Plane(dispatch_36.ListB)

ccx_9 = CurveCurve(CurveA=graft(move_15.Geometry), CurveB=flatten(merge_16))  # -> Points, ParamsA, ParamsB
shift_4 = ShiftPaths(Data=ccx_9.Points, Offset=-1)
sort_14 = SortList(Keys=shift_4, ValuesA=shift_4)  # -> Keys, ValuesA
pull_14 = PullPoint(Point=sort_14.ValuesA, Geometry=graft(pln_29), ClosestOnly=True)  # -> ClosestPoint, Distance
sort_15 = SortList(Keys=pull_14.Distance, ValuesA=sort_14.ValuesA)  # -> Keys, ValuesA

# ---- group: 最远交点
item_40 = ListItem(List=sort_15.ValuesA, Index="-1", Wrap=True)

# ----
null_7 = NullItem(Item=flatten(item_40))  # -> NullFlags, InvalidFlags, Description
dispatch_37 = Dispatch(List=simplify(item_40), DispatchPattern=simplify(graft(null_7.InvalidFlags)))  # -> ListA, ListB
dispatch_38 = Dispatch(List=pln_29, DispatchPattern=null_7.InvalidFlags)  # -> ListA, ListB
pln_37 = Plane(dispatch_38.ListB)
pt_13 = Point(dispatch_37.ListB)

# ----
# 按照梁分类定位点
pln_38 = Plane(pln_37)
pt_14 = Point(pt_13)
incurves_13 = PointInCurves(Point=flatten(pt_14), Curves=crv_58)  # -> Relationship, Index, Point
equals_16 = Equality(FirstNumber=incurves_13.Relationship, SecondNumber="0")  # -> Equality, Inequality
dispatch_39 = Dispatch(List=flatten(pln_38), DispatchPattern=equals_16.Inequality)  # -> ListA, ListB
data_44 = Data(dispatch_39.ListA)

# ----
# 按照梁分类定位点
pt_15 = Point(pt_13)
incurves_14 = PointInCurves(Point=flatten(pt_15), Curves=crv_58)  # -> Relationship, Index, Point
equals_17 = Equality(FirstNumber=incurves_14.Relationship, SecondNumber="0")  # -> Equality, Inequality
dispatch_40 = Dispatch(List=flatten(pt_15), DispatchPattern=equals_17.Inequality)  # -> ListA, ListB
data_45 = Data(dispatch_40.ListA)

move2pt_9 = MoveToPoint(Geometry=data_44, PointA=data_44, PointB=data_45)  # -> Moved, Vector, Transform
null_8 = NullItem(Item=move2pt_9.Moved)  # -> NullFlags, InvalidFlags, Description
dispatch_41 = Dispatch(List=move2pt_9.Moved, DispatchPattern=null_8.InvalidFlags)  # -> ListA, ListB
pln_39 = Plane(dispatch_41.ListB)

# ----
# 撞到梁交点
pln_40 = Plane(pln_39)
pln_41 = Plane(pln_36)

merge_17 = Merge(Data1=pln_30, Data2=pln_40, Data3=pln_41)
pln_42 = Plane(dispatch_38.ListA)
orient_2 = Orient(Geometry=item_10, Source=item_11, Target=merge_17)  # -> Geometry, Transform

data_46 = Data(orient_2.Geometry)
ungroup_3 = Ungroup(Group=data_46)
item_41 = ListItem(List=ungroup_3, Index=0, Wrap=True)  # -> flatten(Item)
item_42 = ListItem(List=ungroup_3, Index="-1", Wrap=True)  # -> flatten(Item)

entwine_16 = Entwine(Branch00=item_41, Branch01=item_42, FlattenInputs=True)
bake_4 = BakeObjects(Geometry=entwine_16, Attributes=attributes_3, BakeName="Embed::1-1-02钢板焊埋件", Bake=False)

# ----
# 未生成檐口线
pt_16 = Point(pln_42)

# ----
# （10）需人工排布
pt_17 = Point(pt_16)
bake_5 = BakeObjects(Geometry=pt_17, Attributes=attributes, BakeName=panel_45, Bake=False)

# ---- group: 下层交点-除重 (continued)
pull_15 = PullPoint(Point=ccx_6.Points, Geometry=deplane_17.Origin, ClosestOnly=True)  # -> ClosestPoint, Distance
pull_16 = PullPoint(Point=ccx_7.Points, Geometry=deplane_18.Origin, ClosestOnly=True)  # -> ClosestPoint, Distance
sort_16 = SortList(Keys=pull_16.Distance, ValuesA=ccx_7.Points)  # -> Keys, ValuesA
sort_17 = SortList(Keys=pull_15.Distance, ValuesA=ccx_6.Points)  # -> Keys, ValuesA
item_43 = ListItem(List=sort_16.ValuesA, Index=0, Wrap=True)  # -> flatten(Item)
item_44 = ListItem(List=sort_17.ValuesA, Index=0, Wrap=True)  # -> flatten(Item)
null_9 = NullItem(Item=item_43)  # -> NullFlags, InvalidFlags, Description
null_10 = NullItem(Item=item_44)  # -> NullFlags, InvalidFlags, Description
dispatch_42 = Dispatch(List=item_43, DispatchPattern=null_9.NullFlags)  # -> ListA, ListB
dispatch_43 = Dispatch(List=item_44, DispatchPattern=null_10.NullFlags)  # -> ListA, ListB
pt_18 = Point(dispatch_42.ListB)

# ---- group: 下层交点-除重 / 上层交点-除重
# 是否需要比较2层？上层的风格将出现在更上一层中
pt_19 = Point(dispatch_43.ListB)

# ---- group: 下层交点-除重 (continued)
pull_17 = PullPoint(Point=pt_18, Geometry=pt_19, ClosestOnly=True)  # -> ClosestPoint, Distance
sort_18 = SortList(Keys=pull_17.Distance, ValuesA=pull_17.ClosestPoint)  # -> Keys, ValuesA
panel_58 = Panel(sort_18.Keys)
larger_5 = LargerThan(FirstNumber=pull_17.Distance, SecondNumber=number_slider_32)  # -> LargerThan, OrEqualTo
dispatch_44 = Dispatch(List=pt_18, DispatchPattern=larger_5.LargerThan)  # -> ListA, ListB

# ---- group: 下层交点-除重 / 2组交点距离大于容差-默认不同点
dispatch_45 = Dispatch(List=pull_17.ClosestPoint, DispatchPattern=larger_5.LargerThan)  # -> ListA, ListB

# ---- group: 下层交点-除重 / 大于容差算作新点
pt_20 = Point(dispatch_44.ListA)

# ---- group: 下层交点-除重 (continued)
pt_21 = Point(dispatch_45.ListB)
pull_18 = PullPoint(Point=deplane_18.Origin, Geometry=graft(pt_21), ClosestOnly=True)  # -> ClosestPoint, Distance
sort_19 = SortList(Keys=pull_18.Distance, ValuesA=pln_33)  # -> Keys, ValuesA
item_45 = ListItem(List=sort_19.ValuesA, Index=0, Wrap=True)
check_same_points_4 = CheckSamePoints(archPoint=pln_33, crvPoint=flatten(item_45))  # -> out, specialPt; inputs archPoint: list of Point3d, crvPoint: list of Point3d; same code as testpoint

# ---- group: 下层交点-除重 / 有效Plane-上下建筑线在该处连续
item_46 = ListItem(List=pln_33, Index=check_same_points_4.specialPt, Wrap=True)

# ----
cull_i_8 = CullIndex(List=pln_33, Indices=check_same_points_4.specialPt, Wrap=True)

cull_i_9 = CullIndex(List=pln_33, Indices=check_same_points_4.specialPt, Wrap=True)
pln_43 = Plane(pln_19)
merge_18 = Merge(Data1=cull_i_9, Data2=pln_43)  # -> flatten(Result)

# ----
# 和下层楼板发生关系的定位点
pln_44 = Plane(pln_43)

# ---- group: 起始Plane
pln_45 = Plane(pln_44)

# ----
pln_46 = Plane(pln_45)
number_slider_51 = Slider(3584, range=0..10000)
deplane_19 = DeconstructPlane(Plane=pln_46)  # -> Origin, XAxis, YAxis, ZAxis
crv_69 = Curve(merge_16)
boundary_3 = BoundarySurfaces(Edges=[offset_5, offset_4])
scx = SurfaceCurve(Surface=boundary_3, Curve=crv_69)  # -> flatten(Curves), Points, UVPoints, Normals, Parameters, Tangents
amp_17 = Amplitude(Vector=deplane_19.YAxis, Amplitude=number_slider_51)
amp_18 = Amplitude(Vector=deplane_19.YAxis, Amplitude=expr("-x", number_slider_51))
move_21 = Move(Geometry=deplane_19.Origin, Motion=amp_18)  # -> Geometry, Transform
move_22 = Move(Geometry=deplane_19.Origin, Motion=amp_17)  # -> Geometry, Transform
ln_16 = Line(StartPoint=move_21.Geometry, EndPoint=move_22.Geometry)
ccx_10 = CurveCurve(CurveA=graft(ln_16), CurveB=scx.Curves)  # -> Points, ParamsA, ParamsB
shift_5 = ShiftPaths(Data=ccx_10.Points, Offset=-1)
pull_19 = PullPoint(Point=graft(pln_46), Geometry=shift_5, ClosestOnly=True)  # -> ClosestPoint, Distance
sort_20 = SortList(Keys=pull_19.Distance, ValuesA=pull_19.ClosestPoint)  # -> Keys, ValuesA
item_47 = ListItem(List=sort_20.ValuesA, Index=0, Wrap=True)
null_11 = NullItem(Item=item_47)  # -> NullFlags, simplify(InvalidFlags), Description
null_12 = NullItem(Item=sort_20.ValuesA)  # -> NullFlags, simplify(InvalidFlags), Description
dispatch_46 = Dispatch(List=simplify(graft(pln_46)), DispatchPattern=null_12.InvalidFlags)  # -> ListA, ListB
dispatch_47 = Dispatch(List=simplify(graft(item_47)), DispatchPattern=null_11.InvalidFlags)  # -> ListA, ListB
pln_47 = Plane(dispatch_46.ListB)
pln_48 = Plane(dispatch_46.ListA)
pt_22 = Point(dispatch_47.ListB)

# ----
# 可能的结构交点-大量
pln_49 = Plane(pln_48)

# ----
# 0 檐口出定位点
# 与结构无交点
pln_50 = Plane(flatten(pln_49))

# ---- group: 下层交点-除重 (continued)
deplane_20 = DeconstructPlane(Plane=item_46)  # -> Origin, XAxis, YAxis, ZAxis
amp_19 = Amplitude(Vector=deplane_20.YAxis, Amplitude=expr("-x", Slider(2756, range=0..10000)))
move_23 = Move(Geometry=deplane_20.Origin, Motion=amp_19)  # -> Geometry, Transform

# ---- group: 下层交点-除重 / 相内探索
ln_17 = Line(StartPoint=deplane_20.Origin, EndPoint=move_23.Geometry)

# ---- group: 下层交点-除重 (continued)
ccx_11 = CurveCurve(CurveA=graft(ln_17), CurveB=flatten(crv_59))  # -> Points, ParamsA, ParamsB
shift_6 = ShiftPaths(Data=ccx_11.Points, Offset=-1)
pull_20 = PullPoint(Point=deplane_20.Origin, Geometry=shift_6, ClosestOnly=True)  # -> ClosestPoint, Distance
sort_21 = SortList(Keys=pull_20.Distance, ValuesA=pull_20.ClosestPoint)  # -> Keys, ValuesA

# ---- group: 下层交点-除重 / 与梁最近交点
item_48 = ListItem(List=sort_21.ValuesA, Index=0, Wrap=True)

# ---- group: 下层交点-除重 (continued)
null_13 = NullItem(Item=flatten(item_48))  # -> NullFlags, InvalidFlags, Description
dispatch_48 = Dispatch(List=item_46, DispatchPattern=null_13.InvalidFlags)  # -> ListA, ListB
dispatch_49 = Dispatch(List=flatten(item_48), DispatchPattern=null_13.InvalidFlags)  # -> ListA, ListB

# ---- group: 下层交点-除重 / 有效起始Plane
data_47 = Data(dispatch_48.ListB)

# ---- group: 下层交点-除重 / 去除Null的交点
data_48 = Data(dispatch_49.ListB)

# ---- group: 下层交点-除重 (continued)
flatten_5 = FlattenTree(Tree=data_48, Path="{0}")
move2pt_10 = MoveToPoint(Geometry=data_47, PointA=data_47, PointB=flatten(data_48))  # -> Moved, Vector, Transform
ln_18 = Line(StartPoint=data_47, EndPoint=flatten_5)
len_4 = Length(Curve=ln_18)
sort_22 = SortList(Keys=len_4)  # -> reverse(Keys), ValuesA

# ----
# 与梁无交点的定位点
pln_51 = Plane(dispatch_48.ListA)

# ----
# 1.0
number_slider_52 = Slider(50, range=0..100)
number = NumberGroups(Number=sort_22.Keys, Difference=number_slider_52)  # -> simplify(Groups), Indices
panel_59 = Panel(number.Groups)
tstat = TreeStatistics(Tree=number.Groups)  # -> Paths, Length, Count
lng_3 = ListLength(List=tstat.Paths)
smaller_7 = SmallerThan(FirstNumber=lng_3, SecondNumber="2")  # -> SmallerThan, OrEqualTo
dispatch_50 = Dispatch(List=smaller_7.SmallerThan, DispatchPattern=[True, False])  # -> ListA, ListB
filter_12 = StreamFilter(Gate=dispatch_50.ListA, Stream0="-2", Stream1="-1")
item_49 = ListItem(List=tstat.Paths, Index=filter_12, Wrap=True)
branch = TreeBranch(Tree=number.Groups, Path=item_49, MaintainPaths=True)
sort_23 = SortList(Keys=branch)  # -> reverse(Keys), ValuesA
round_2 = Round(Number=sort_23.Keys)  # -> Nearest, Floor, Ceiling
item_50 = ListItem(List=round_2.Ceiling, Index=0, Wrap=True)

# ----
# 挑出反常点-交点距离起始点过远
list_9 = ValueList({"自己输入Value": 0, "GH Defaut Value": 1}, selected="GH Defaut Value")
panel_60 = Panel(item_50)
filter_13 = StreamFilter(Gate=list_9, Stream0=Slider(1000, range=0..10000), Stream1=panel_60)

larger_6 = LargerThan(FirstNumber=len_4, SecondNumber=filter_13)  # -> LargerThan, OrEqualTo
dispatch_51 = Dispatch(List=flatten_5, DispatchPattern=larger_6.LargerThan)  # -> ListA, ListB
dispatch_52 = Dispatch(List=data_47, DispatchPattern=larger_6.LargerThan)  # -> ListA, ListB
data_49 = Data(dispatch_52.ListB)
data_50 = Data(dispatch_51.ListB)

# ----
# 按照梁分类定位点
pt_23 = Point(data_50)
pln_52 = Plane(data_49)
incurves_15 = PointInCurves(Point=flatten(pt_23), Curves=crv_60)  # -> Relationship, Index, Point
equals_18 = Equality(FirstNumber=incurves_15.Relationship, SecondNumber="0")  # -> Equality, Inequality
dispatch_53 = Dispatch(List=flatten(pln_52), DispatchPattern=equals_18.Inequality)  # -> ListA, ListB
data_51 = Data(dispatch_53.ListA)

incurves_16 = PointInCurves(Point=flatten(pt_23), Curves=crv_60)  # -> Relationship, Index, Point
equals_19 = Equality(FirstNumber=incurves_16.Relationship, SecondNumber="0")  # -> Equality, Inequality
dispatch_54 = Dispatch(List=flatten(pt_23), DispatchPattern=equals_19.Inequality)  # -> ListA, ListB
data_52 = Data(dispatch_54.ListA)

move2pt_11 = MoveToPoint(Geometry=data_51, PointA=data_51, PointB=data_52)  # -> Moved, Vector, Transform
null_14 = NullItem(Item=move2pt_11.Moved)  # -> NullFlags, InvalidFlags, Description
dispatch_55 = Dispatch(List=move2pt_11.Moved, DispatchPattern=null_14.InvalidFlags)  # -> ListA, ListB
pln_53 = Plane(dispatch_55.ListB)

# ----
# 离梁过远的定位点
pln_54 = Plane(dispatch_52.ListA)

# ----
# 1.0无檐口线
# 与梁不相交
merge_19 = Merge(Data1=pln_51, Data2=pln_54)

# ----
# 0 檐口出定位点
# 与结构无交点
pln_55 = Plane(flatten(merge_19))

# ----
# 1.0.Missing Point
# 埋件定位点Offset，没有找到和梁的交点
number_slider_53 = Slider(5000, range=0..10000)
deplane_21 = DeconstructPlane(Plane=pln_55)  # -> Origin, XAxis, YAxis, ZAxis
amp_20 = Amplitude(Vector=deplane_21.YAxis, Amplitude=expr("-x", number_slider_53))
move_24 = Move(Geometry=deplane_21.Origin, Motion=amp_20)  # -> Geometry, Transform
ln_19 = Line(StartPoint=move_24.Geometry, EndPoint=deplane_21.Origin)
crv_70 = Curve(crv_59)
amp_21 = Amplitude(Vector=deplane_21.XAxis, Amplitude=number_slider_24)
amp_22 = Amplitude(Vector=deplane_21.XAxis, Amplitude=expr("-x", number_slider_24))

# ---- group: 2组探索针
move_25 = Move(Geometry=ln_19, Motion=amp_22)  # -> Geometry, Transform
move_26 = Move(Geometry=ln_19, Motion=amp_21)  # -> Geometry, Transform

# ----
ccx_12 = CurveCurve(CurveA=graft(move_25.Geometry), CurveB=flatten(crv_70))  # -> Points, ParamsA, ParamsB
shift_7 = ShiftPaths(Data=ccx_12.Points, Offset=-1)
sort_24 = SortList(Keys=shift_7, ValuesA=shift_7)  # -> Keys, ValuesA
pull_21 = PullPoint(Point=sort_24.ValuesA, Geometry=graft(pln_55), ClosestOnly=True)  # -> ClosestPoint, Distance
sort_25 = SortList(Keys=pull_21.Distance, ValuesA=sort_24.ValuesA)  # -> Keys, ValuesA
# SmoothCurve-阴角
# SmoothCurve-阳角
# SmoothCurve-阴角
# SmoothCurve-正常
# Angular Curve - All
# Special Curve(with location)- All
# Curve for this project only - All
panel_61 = Panel("0")
item_51 = ListItem(List=sort_25.ValuesA, Index=panel_61, Wrap=True)
null_15 = NullItem(Item=flatten(item_51))  # -> NullFlags, InvalidFlags, Description
dispatch_56 = Dispatch(List=simplify(item_51), DispatchPattern=simplify(graft(null_15.InvalidFlags)))  # -> ListA, ListB
dispatch_57 = Dispatch(List=pln_55, DispatchPattern=null_15.InvalidFlags)  # -> ListA, ListB
pln_56 = Plane(dispatch_57.ListB)
pt_24 = Point(dispatch_56.ListB)

ccx_13 = CurveCurve(CurveA=graft(move_26.Geometry), CurveB=flatten(crv_70))  # -> Points, ParamsA, ParamsB
shift_8 = ShiftPaths(Data=ccx_13.Points, Offset=-1)
sort_26 = SortList(Keys=shift_8, ValuesA=shift_8)  # -> Keys, ValuesA
pull_22 = PullPoint(Point=sort_26.ValuesA, Geometry=graft(pln_55), ClosestOnly=True)  # -> ClosestPoint, Distance
sort_27 = SortList(Keys=pull_22.Distance, ValuesA=sort_26.ValuesA)  # -> Keys, ValuesA
item_52 = ListItem(List=sort_27.ValuesA, Index="0", Wrap=True)
null_16 = NullItem(Item=flatten(item_52))  # -> NullFlags, InvalidFlags, Description
dispatch_58 = Dispatch(List=simplify(item_52), DispatchPattern=simplify(graft(null_16.InvalidFlags)))  # -> ListA, ListB
dispatch_59 = Dispatch(List=pln_55, DispatchPattern=null_16.InvalidFlags)  # -> ListA, ListB
pt_25 = Point(dispatch_58.ListB)
pln_57 = Plane(dispatch_59.ListB)

# ----
# 按照梁分类定位点
pln_58 = Plane(pln_57)
pt_26 = Point(pt_25)
incurves_17 = PointInCurves(Point=flatten(pt_26), Curves=crv_61)  # -> Relationship, Index, Point
equals_20 = Equality(FirstNumber=incurves_17.Relationship, SecondNumber="0")  # -> Equality, Inequality
dispatch_60 = Dispatch(List=flatten(pln_58), DispatchPattern=equals_20.Inequality)  # -> ListA, ListB
data_53 = Data(dispatch_60.ListA)

# ----
# 按照梁分类定位点
pln_59 = Plane(pln_56)
pt_27 = Point(pt_24)
incurves_18 = PointInCurves(Point=flatten(pt_27), Curves=crv_61)  # -> Relationship, Index, Point
equals_21 = Equality(FirstNumber=incurves_18.Relationship, SecondNumber="0")  # -> Equality, Inequality
dispatch_61 = Dispatch(List=flatten(pln_59), DispatchPattern=equals_21.Inequality)  # -> ListA, ListB
data_54 = Data(dispatch_61.ListA)

incurves_19 = PointInCurves(Point=flatten(pt_27), Curves=crv_61)  # -> Relationship, Index, Point
equals_22 = Equality(FirstNumber=incurves_19.Relationship, SecondNumber="0")  # -> Equality, Inequality
dispatch_62 = Dispatch(List=flatten(pt_27), DispatchPattern=equals_22.Inequality)  # -> ListA, ListB
data_55 = Data(dispatch_62.ListA)

incurves_20 = PointInCurves(Point=flatten(pt_26), Curves=crv_61)  # -> Relationship, Index, Point
equals_23 = Equality(FirstNumber=incurves_20.Relationship, SecondNumber="0")  # -> Equality, Inequality
dispatch_63 = Dispatch(List=flatten(pt_26), DispatchPattern=equals_23.Inequality)  # -> ListA, ListB
data_56 = Data(dispatch_63.ListA)

move2pt_12 = MoveToPoint(Geometry=data_53, PointA=data_53, PointB=data_56)  # -> Moved, Vector, Transform
null_17 = NullItem(Item=move2pt_12.Moved)  # -> NullFlags, InvalidFlags, Description
dispatch_64 = Dispatch(List=move2pt_12.Moved, DispatchPattern=null_17.InvalidFlags)  # -> ListA, ListB
pln_60 = Plane(dispatch_64.ListB)

move2pt_13 = MoveToPoint(Geometry=data_54, PointA=data_54, PointB=data_55)  # -> Moved, Vector, Transform
null_18 = NullItem(Item=move2pt_13.Moved)  # -> NullFlags, InvalidFlags, Description
dispatch_65 = Dispatch(List=move2pt_13.Moved, DispatchPattern=null_18.InvalidFlags)  # -> ListA, ListB
pln_61 = Plane(dispatch_65.ListB)

# ----
# 撞到梁交点
merge_20 = Merge(Data1=pln_60, Data2=pln_61)

# ----
# 1.0无檐口线+上下层幕墙边线连续
# 01：钢板焊埋件[钢梁外侧]
# @钢边梁宽@钢边梁高
pln_62 = Plane(pln_53)

merge_21 = Merge(Data1=pln_62, Data2=merge_20)
orient_3 = Orient(Geometry=item_12, Source=item_13, Target=merge_21)  # -> Geometry, Transform

data_57 = Data(orient_3.Geometry)
ungroup_4 = Ungroup(Group=data_57)
item_53 = ListItem(List=ungroup_4, Index=0, Wrap=True)  # -> flatten(Item)
item_54 = ListItem(List=ungroup_4, Index="-1", Wrap=True)  # -> flatten(Item)

entwine_17 = Entwine(Branch00=item_53, Branch01=item_54, FlattenInputs=True)
bake_6 = BakeObjects(Geometry=entwine_17, Attributes=attributes_5, BakeName="Embed::1-0-01钢板焊埋件", Bake=False)

# ----
# 2是否有吊顶
# 梁以内>350
deplane_22 = DeconstructPlane(Plane=pln_44)  # -> Origin, XAxis, YAxis, ZAxis
number_slider_54 = Slider(5000, range=0..10000)
amp_23 = Amplitude(Vector=deplane_22.YAxis, Amplitude=expr("-x", number_slider_54))
amp_24 = Amplitude(Vector=deplane_22.YAxis, Amplitude=number_slider_54)
move_27 = Move(Geometry=deplane_22.Origin, Motion=amp_24)  # -> Geometry, Transform
move_28 = Move(Geometry=deplane_22.Origin, Motion=amp_23)  # -> Geometry, Transform
ln_20 = Line(StartPoint=move_27.Geometry, EndPoint=move_28.Geometry)
crv_71 = Curve(crv_18)
crv_72 = Curve(merge_15)

# ---- group: 和下层建筑的交点
ccx_14 = CurveCurve(CurveA=ln_20, CurveB=crv_71)  # -> Points, ParamsA, ParamsB

# ----
null_19 = NullItem(Item=ccx_14.Points)  # -> NullFlags, InvalidFlags, Description
dispatch_66 = Dispatch(List=simplify(ccx_14.Points), DispatchPattern=simplify(null_19.NullFlags))  # -> ListA, ListB
dispatch_67 = Dispatch(List=simplify(graft(pln_44)), DispatchPattern=simplify(null_19.NullFlags))  # -> ListA, ListB
pt_28 = Point(dispatch_66.ListB)
pln_63 = Plane(flatten(dispatch_67.ListB))
pt_29 = Point(pln_63)
pull_23 = PullPoint(Point=flatten(pt_29), Geometry=flatten(pt_28), ClosestOnly=True)  # -> ClosestPoint, Distance
ln_21 = Line(StartPoint=pln_63, EndPoint=pull_23.ClosestPoint)

# ----
# 定位点Project到下层建筑线
move2pt_14 = MoveToPoint(Geometry=pln_63, PointA=pln_63, PointB=pull_23.ClosestPoint)  # -> Moved, Vector, Transform

# ----
# 可能的点-离结构很远
pln_64 = Plane(dispatch_67.ListA)

deplane_23 = DeconstructPlane(Plane=move2pt_14.Moved)  # -> Origin, XAxis, YAxis, ZAxis
amp_25 = Amplitude(Vector=deplane_23.YAxis, Amplitude=Slider(5000, range=0..10000))
move_29 = Move(Geometry=deplane_23.Origin, Motion=amp_25)  # -> Geometry, Transform
ln_22 = Line(StartPoint=move_29.Geometry, EndPoint=deplane_23.Origin)

# ---- group: 和内测梁交点
ccx_15 = CurveCurve(CurveA=graft(ln_22), CurveB=flatten(crv_72))  # -> simplify(Points), ParamsA, ParamsB

# ----
shift_9 = ShiftPaths(Data=ccx_15.Points, Offset=-1)
null_20 = NullItem(Item=shift_9)  # -> NullFlags, InvalidFlags, Description
dispatch_68 = Dispatch(List=simplify(graft(move2pt_14.Moved)), DispatchPattern=null_20.NullFlags)  # -> ListA, ListB
dispatch_69 = Dispatch(List=simplify(graft(ln_22)), DispatchPattern=null_20.NullFlags)  # -> ListA, ListB
pln_65 = Plane(dispatch_68.ListA)
crv_73 = Curve(dispatch_69.ListB)
pln_66 = Plane(dispatch_68.ListB)
ccx_16 = CurveCurve(CurveA=graft(crv_73), CurveB=flatten(crv_72))  # -> Points, ParamsA, ParamsB
shift_10 = ShiftPaths(Data=simplify(ccx_16.Points), Offset=-1)
pull_24 = PullPoint(Point=pln_66, Geometry=shift_10, ClosestOnly=True)  # -> ClosestPoint, Distance
sort_28 = SortList(Keys=pull_24.Distance, ValuesA=pull_24.ClosestPoint)  # -> Keys, ValuesA

# ---- group: 交点对应的起始定位点
item_55 = ListItem(List=sort_28.ValuesA, Index=0, Wrap=True)

# ----
ln_23 = Line(StartPoint=pln_66, EndPoint=item_55)
len_5 = Length(Curve=ln_23)
larger_7 = LargerThan(FirstNumber=len_5, SecondNumber=number_slider_33)  # -> LargerThan, OrEqualTo
panel_62 = Panel(len_5)
dispatch_70 = Dispatch(List=item_55, DispatchPattern=larger_7.LargerThan)  # -> ListA, ListB
dispatch_71 = Dispatch(List=pln_66, DispatchPattern=larger_7.LargerThan)  # -> ListA, ListB
pln_67 = Plane(dispatch_71.ListB)

# ---- group: 起始点
pt_30 = Point(dispatch_70.ListA)

# ---- group: 最终Plane
pln_68 = Plane(dispatch_71.ListA)

# ---- group: 分类后的Plane
# 按照梁分类定位点
pln_69 = Plane(pln_68)
pt_31 = Point(pt_30)
incurves_21 = PointInCurves(Point=flatten(pt_31), Curves=crv_62)  # -> Relationship, Index, Point
equals_24 = Equality(FirstNumber=incurves_21.Relationship, SecondNumber="0")  # -> Equality, Inequality
dispatch_72 = Dispatch(List=flatten(pln_69), DispatchPattern=equals_24.Inequality)  # -> ListA, ListB
data_58 = Data(dispatch_72.ListA)

incurves_22 = PointInCurves(Point=flatten(pt_31), Curves=crv_62)  # -> Relationship, Index, Point
equals_25 = Equality(FirstNumber=incurves_22.Relationship, SecondNumber="0")  # -> Equality, Inequality
dispatch_73 = Dispatch(List=flatten(pt_31), DispatchPattern=equals_25.Inequality)  # -> ListA, ListB
data_59 = Data(dispatch_73.ListA)

move2pt_15 = MoveToPoint(Geometry=data_58, PointA=data_58, PointB=data_59)  # -> Moved, Vector, Transform
null_21 = NullItem(Item=move2pt_15.Moved)  # -> NullFlags, InvalidFlags, Description
dispatch_74 = Dispatch(List=move2pt_15.Moved, DispatchPattern=null_21.InvalidFlags)  # -> ListA, ListB

pln_70 = Plane(dispatch_74.ListB)

# ----
# 可能的结构交点-大量
pln_71 = Plane(pln_65)

# ----
# 可能的结构交点
pln_72 = Plane(pln_67)

# ----
# 2.1 梁以内>350
# 
# 侧埋，钢板焊
# 03：钢板焊埋件[钢梁内侧]
# @钢边梁宽@钢边梁高
pln_73 = Plane(pln_70)

# ----
# 2.1 Missing Point
# 埋件定位点Offset，没有找到和梁的交点
merge_22 = Merge(Data1=pln_64, Data2=pln_72, Data3=pln_71)
crv_74 = Curve(crv_72)

# ----
# 0 檐口出定位点
# 与结构无交点
pln_74 = Plane(flatten(merge_22))

deplane_24 = DeconstructPlane(Plane=pln_74)  # -> Origin, XAxis, YAxis, ZAxis
amp_26 = Amplitude(Vector=deplane_24.YAxis, Amplitude=Slider(5000, range=0..10000))
move_30 = Move(Geometry=deplane_24.Origin, Motion=amp_26)  # -> Geometry, Transform
ln_24 = Line(StartPoint=move_30.Geometry, EndPoint=deplane_24.Origin)
amp_27 = Amplitude(Vector=deplane_24.XAxis, Amplitude=number_slider_24)
amp_28 = Amplitude(Vector=deplane_24.XAxis, Amplitude=expr("-x", number_slider_24))
move_31 = Move(Geometry=ln_24, Motion=amp_27)  # -> Geometry, Transform
move_32 = Move(Geometry=ln_24, Motion=amp_28)  # -> Geometry, Transform

ccx_17 = CurveCurve(CurveA=graft(move_31.Geometry), CurveB=flatten(crv_74))  # -> Points, ParamsA, ParamsB
shift_11 = ShiftPaths(Data=ccx_17.Points, Offset=-1)
sort_29 = SortList(Keys=shift_11, ValuesA=shift_11)  # -> Keys, ValuesA
pull_25 = PullPoint(Point=sort_29.ValuesA, Geometry=graft(pln_74), ClosestOnly=True)  # -> ClosestPoint, Distance
sort_30 = SortList(Keys=pull_25.Distance, ValuesA=sort_29.ValuesA)  # -> Keys, ValuesA
item_56 = ListItem(List=sort_30.ValuesA, Index="-1", Wrap=True)
null_22 = NullItem(Item=flatten(item_56))  # -> NullFlags, InvalidFlags, Description
end_6 = EndPoints(Curve=move_31.Geometry)  # -> Start, End
dispatch_75 = Dispatch(List=graft(pln_74), DispatchPattern=graft(null_22.InvalidFlags))  # -> ListA, ListB
dispatch_76 = Dispatch(List=simplify(item_56), DispatchPattern=simplify(graft(null_22.InvalidFlags)))  # -> ListA, ListB
pt_32 = Point(dispatch_76.ListB)
pln_75 = Plane(dispatch_75.ListB)
dispatch_77 = Dispatch(List=simplify(graft(end_6.End)), DispatchPattern=simplify(graft(null_22.InvalidFlags)))  # -> ListA, ListB
pt_33 = Point(dispatch_77.ListB)
ln_25 = Line(StartPoint=pt_33, EndPoint=pt_32)
len_6 = Length(Curve=ln_25)
larger_8 = LargerThan(FirstNumber=len_6, SecondNumber=Slider(350, range=0..1000))  # -> LargerThan, OrEqualTo
dispatch_78 = Dispatch(List=pln_75, DispatchPattern=larger_8.LargerThan)  # -> ListA, ListB
dispatch_79 = Dispatch(List=pt_33, DispatchPattern=larger_8.LargerThan)  # -> ListA, ListB
pln_76 = Plane(dispatch_78.ListA)
pt_34 = Point(dispatch_79.ListA)

ccx_18 = CurveCurve(CurveA=graft(move_32.Geometry), CurveB=flatten(crv_74))  # -> Points, ParamsA, ParamsB
shift_12 = ShiftPaths(Data=ccx_18.Points, Offset=-1)
sort_31 = SortList(Keys=shift_12, ValuesA=shift_12)  # -> Keys, ValuesA
pull_26 = PullPoint(Point=sort_31.ValuesA, Geometry=graft(pln_74), ClosestOnly=True)  # -> ClosestPoint, Distance
sort_32 = SortList(Keys=pull_26.Distance, ValuesA=sort_31.ValuesA)  # -> Keys, ValuesA
item_57 = ListItem(List=sort_32.ValuesA, Index="-1", Wrap=True)
null_23 = NullItem(Item=flatten(item_57))  # -> NullFlags, InvalidFlags, Description
end_7 = EndPoints(Curve=move_32.Geometry)  # -> Start, End
dispatch_80 = Dispatch(List=simplify(item_57), DispatchPattern=simplify(graft(null_23.InvalidFlags)))  # -> ListA, ListB
dispatch_81 = Dispatch(List=graft(pln_74), DispatchPattern=flatten(null_23.InvalidFlags))  # -> ListA, ListB
dispatch_82 = Dispatch(List=simplify(graft(end_7.End)), DispatchPattern=simplify(graft(null_23.InvalidFlags)))  # -> ListA, ListB
pln_77 = Plane(dispatch_81.ListB)
pt_35 = Point(dispatch_80.ListB)
pt_36 = Point(dispatch_82.ListB)
ln_26 = Line(StartPoint=pt_36, EndPoint=pt_32)
len_7 = Length(Curve=ln_26)
larger_9 = LargerThan(FirstNumber=len_7, SecondNumber=Slider(350, range=0..1000))  # -> LargerThan, OrEqualTo
dispatch_83 = Dispatch(List=pln_77, DispatchPattern=larger_9.LargerThan)  # -> ListA, ListB
dispatch_84 = Dispatch(List=pt_36, DispatchPattern=larger_9.LargerThan)  # -> ListA, ListB
pln_78 = Plane(dispatch_83.ListA)
pt_37 = Point(dispatch_84.ListA)

# ----
# 按照梁分类定位点
pln_79 = Plane(pln_76)
pt_38 = Point(pt_34)
incurves_23 = PointInCurves(Point=flatten(pt_38), Curves=crv_63)  # -> Relationship, Index, Point
equals_26 = Equality(FirstNumber=incurves_23.Relationship, SecondNumber="0")  # -> Equality, Inequality
dispatch_85 = Dispatch(List=flatten(pln_79), DispatchPattern=equals_26.Inequality)  # -> ListA, ListB
data_60 = Data(dispatch_85.ListA)

# ----
# 按照梁分类定位点
pln_80 = Plane(pln_78)
pt_39 = Point(pt_37)
incurves_24 = PointInCurves(Point=flatten(pt_39), Curves=crv_63)  # -> Relationship, Index, Point
equals_27 = Equality(FirstNumber=incurves_24.Relationship, SecondNumber="0")  # -> Equality, Inequality
dispatch_86 = Dispatch(List=flatten(pln_80), DispatchPattern=equals_27.Inequality)  # -> ListA, ListB
data_61 = Data(dispatch_86.ListA)

incurves_25 = PointInCurves(Point=flatten(pt_39), Curves=crv_63)  # -> Relationship, Index, Point
equals_28 = Equality(FirstNumber=incurves_25.Relationship, SecondNumber="0")  # -> Equality, Inequality
dispatch_87 = Dispatch(List=flatten(pt_39), DispatchPattern=equals_28.Inequality)  # -> ListA, ListB
data_62 = Data(dispatch_87.ListA)

incurves_26 = PointInCurves(Point=flatten(pt_38), Curves=crv_63)  # -> Relationship, Index, Point
equals_29 = Equality(FirstNumber=incurves_26.Relationship, SecondNumber="0")  # -> Equality, Inequality
dispatch_88 = Dispatch(List=flatten(pt_38), DispatchPattern=equals_29.Inequality)  # -> ListA, ListB
data_63 = Data(dispatch_88.ListA)

move2pt_16 = MoveToPoint(Geometry=data_60, PointA=data_60, PointB=data_63)  # -> Moved, Vector, Transform
null_24 = NullItem(Item=move2pt_16.Moved)  # -> NullFlags, InvalidFlags, Description
dispatch_89 = Dispatch(List=move2pt_16.Moved, DispatchPattern=null_24.InvalidFlags)  # -> ListA, ListB

move2pt_17 = MoveToPoint(Geometry=data_61, PointA=data_61, PointB=data_62)  # -> Moved, Vector, Transform
null_25 = NullItem(Item=move2pt_17.Moved)  # -> NullFlags, InvalidFlags, Description
dispatch_90 = Dispatch(List=move2pt_17.Moved, DispatchPattern=null_25.InvalidFlags)  # -> ListA, ListB
pln_81 = Plane(dispatch_90.ListB)

# ---- group: 2次筛选所得
pln_82 = Plane(dispatch_89.ListB)

# ----
# 撞到梁交点
merge_23 = Merge(Data1=pln_82, Data2=pln_81)

merge_24 = Merge(Data1=pln_73, Data2=merge_23)
orient_4 = Orient(Geometry=item_14, Source=rotate_3.Geometry, Target=merge_24)  # -> Geometry, Transform

data_64 = Data(orient_4.Geometry)
ungroup_5 = Ungroup(Group=data_64)
item_58 = ListItem(List=ungroup_5, Index=0, Wrap=True)  # -> flatten(Item)
item_59 = ListItem(List=ungroup_5, Index="-1", Wrap=True)  # -> flatten(Item)

entwine_18 = Entwine(Branch00=item_58, Branch01=item_59, FlattenInputs=True)
bake_7 = BakeObjects(Geometry=entwine_18, Attributes=attributes_4, BakeName="Embed::2-1-03钢板焊埋件", Bake=False)

number_slider_55 = Slider(3584, range=0..10000)
deplane_25 = DeconstructPlane(Plane=pln_45)  # -> Origin, XAxis, YAxis, ZAxis
amp_29 = Amplitude(Vector=deplane_25.YAxis, Amplitude=number_slider_55)
amp_30 = Amplitude(Vector=deplane_25.YAxis, Amplitude=expr("-x", number_slider_55))
boundary_4 = BoundarySurfaces(Edges=[offset_6, offset_7])
crv_75 = Curve(merge_15)
move_33 = Move(Geometry=deplane_25.Origin, Motion=amp_30)  # -> Geometry, Transform
move_34 = Move(Geometry=deplane_25.Origin, Motion=amp_29)  # -> Geometry, Transform
ln_27 = Line(StartPoint=move_33.Geometry, EndPoint=move_34.Geometry)

# ---- group: 50-350建筑结构交点
scx_2 = SurfaceCurve(Surface=boundary_4, Curve=crv_75)  # -> flatten(Curves), Points, UVPoints, Normals, Parameters, Tangents

# ---- group: 该区间的定位点
ccx_19 = CurveCurve(CurveA=graft(ln_27), CurveB=scx_2.Curves)  # -> Points, ParamsA, ParamsB

# ----
shift_13 = ShiftPaths(Data=ccx_19.Points, Offset=-1)
pull_27 = PullPoint(Point=graft(pln_45), Geometry=shift_13, ClosestOnly=True)  # -> ClosestPoint, Distance
sort_33 = SortList(Keys=pull_27.Distance, ValuesA=pull_27.ClosestPoint)  # -> Keys, ValuesA
null_26 = NullItem(Item=sort_33.ValuesA)  # -> NullFlags, simplify(InvalidFlags), Description
item_60 = ListItem(List=sort_33.ValuesA, Index=0, Wrap=True)
dispatch_91 = Dispatch(List=simplify(graft(pln_45)), DispatchPattern=null_26.InvalidFlags)  # -> ListA, ListB
dispatch_92 = Dispatch(List=simplify(graft(item_60)), DispatchPattern=null_26.InvalidFlags)  # -> ListA, ListB
pln_83 = Plane(dispatch_91.ListB)
pln_84 = Plane(dispatch_91.ListA)
pt_40 = Point(dispatch_92.ListB)

# ----
# 可能的结构交点-大量
pln_85 = Plane(pln_84)

# ----
# 0 檐口出定位点
# 与结构无交点
pln_86 = Plane(flatten(pln_85))

crv_76 = Curve(shift)

# ----
# 按照梁分类定位点
pt_41 = Point(pt_40)
pln_87 = Plane(pln_83)
incurves_27 = PointInCurves(Point=flatten(pt_41), Curves=crv_76)  # -> Relationship, Index, Point
equals_30 = Equality(FirstNumber=incurves_27.Relationship, SecondNumber="0")  # -> Equality, Inequality
dispatch_93 = Dispatch(List=flatten(pln_87), DispatchPattern=equals_30.Inequality)  # -> ListA, ListB
data_65 = Data(dispatch_93.ListA)

incurves_28 = PointInCurves(Point=flatten(pt_41), Curves=crv_76)  # -> Relationship, Index, Point
equals_31 = Equality(FirstNumber=incurves_28.Relationship, SecondNumber="0")  # -> Equality, Inequality
dispatch_94 = Dispatch(List=flatten(pt_41), DispatchPattern=equals_31.Inequality)  # -> ListA, ListB
data_66 = Data(dispatch_94.ListA)

move2pt_18 = MoveToPoint(Geometry=data_65, PointA=data_65, PointB=data_66)  # -> Moved, Vector, Transform
null_27 = NullItem(Item=move2pt_18.Moved)  # -> NullFlags, InvalidFlags, Description
dispatch_95 = Dispatch(List=move2pt_18.Moved, DispatchPattern=null_27.InvalidFlags)  # -> ListA, ListB
pln_88 = Plane(dispatch_95.ListB)

# ----
# 3.1
# 下层建筑边线外侧50-350mm
# 03：钢板焊埋件[钢梁内侧]
# @钢边梁宽@钢边梁高
pln_89 = Plane(pln_88)

crv_77 = Curve(shift)

# ----
# 按照梁分类定位点
pt_42 = Point(pt_22)
pln_90 = Plane(pln_47)
incurves_29 = PointInCurves(Point=flatten(pt_42), Curves=crv_77)  # -> Relationship, Index, Point
equals_32 = Equality(FirstNumber=incurves_29.Relationship, SecondNumber="0")  # -> Equality, Inequality
dispatch_96 = Dispatch(List=flatten(pln_90), DispatchPattern=equals_32.Inequality)  # -> ListA, ListB
data_67 = Data(dispatch_96.ListA)

incurves_30 = PointInCurves(Point=flatten(pt_42), Curves=crv_77)  # -> Relationship, Index, Point
equals_33 = Equality(FirstNumber=incurves_30.Relationship, SecondNumber="0")  # -> Equality, Inequality
dispatch_97 = Dispatch(List=flatten(pt_42), DispatchPattern=equals_33.Inequality)  # -> ListA, ListB
data_68 = Data(dispatch_97.ListA)

move2pt_19 = MoveToPoint(Geometry=data_67, PointA=data_67, PointB=data_68)  # -> Moved, Vector, Transform
null_28 = NullItem(Item=move2pt_19.Moved)  # -> NullFlags, InvalidFlags, Description
dispatch_98 = Dispatch(List=move2pt_19.Moved, DispatchPattern=null_28.InvalidFlags)  # -> ListA, ListB
pln_91 = Plane(dispatch_98.ListB)

# ----
# 3.2
# 下层建筑边线内侧300-600mm范围
# 03：钢板焊埋件[钢梁外侧]
# @钢边梁宽@钢边梁高
pln_92 = Plane(pln_91)

# ----
# 3.1 Missing Point
# 埋件定位点Offset，没有找到和梁的交点
number_slider_56 = Slider(5000, range=0..10000)
deplane_26 = DeconstructPlane(Plane=pln_86)  # -> Origin, XAxis, YAxis, ZAxis
amp_31 = Amplitude(Vector=deplane_26.YAxis, Amplitude=number_slider_56)
crv_78 = Curve(scx_2.Curves)
move_35 = Move(Geometry=deplane_26.Origin, Motion=amp_31)  # -> Geometry, Transform
ln_28 = Line(StartPoint=move_35.Geometry, EndPoint=deplane_26.Origin)
amp_32 = Amplitude(Vector=deplane_26.XAxis, Amplitude=expr("-x", number_slider_24))
amp_33 = Amplitude(Vector=deplane_26.XAxis, Amplitude=number_slider_24)
move_36 = Move(Geometry=ln_28, Motion=amp_33)  # -> Geometry, Transform
move_37 = Move(Geometry=ln_28, Motion=amp_32)  # -> Geometry, Transform
pln_93 = Plane(pln_84)

ccx_20 = CurveCurve(CurveA=graft(move_37.Geometry), CurveB=flatten(crv_78))  # -> Points, ParamsA, ParamsB
shift_14 = ShiftPaths(Data=ccx_20.Points, Offset=-1)
sort_34 = SortList(Keys=shift_14, ValuesA=shift_14)  # -> Keys, ValuesA
pull_28 = PullPoint(Point=sort_34.ValuesA, Geometry=graft(pln_86), ClosestOnly=True)  # -> ClosestPoint, Distance
sort_35 = SortList(Keys=pull_28.Distance, ValuesA=sort_34.ValuesA)  # -> Keys, ValuesA
item_61 = ListItem(List=sort_35.ValuesA, Index="-1", Wrap=True)
null_29 = NullItem(Item=flatten(item_61))  # -> NullFlags, InvalidFlags, Description
dispatch_99 = Dispatch(List=flatten(item_61), DispatchPattern=null_29.InvalidFlags)  # -> ListA, ListB
dispatch_100 = Dispatch(List=pln_86, DispatchPattern=null_29.InvalidFlags)  # -> ListA, ListB
pt_43 = Point(dispatch_99.ListB)
pln_94 = Plane(dispatch_100.ListB)

ccx_21 = CurveCurve(CurveA=graft(move_36.Geometry), CurveB=flatten(crv_78))  # -> Points, ParamsA, ParamsB
shift_15 = ShiftPaths(Data=ccx_21.Points, Offset=-1)
sort_36 = SortList(Keys=shift_15, ValuesA=shift_15)  # -> Keys, ValuesA
pull_29 = PullPoint(Point=sort_36.ValuesA, Geometry=graft(pln_86), ClosestOnly=True)  # -> ClosestPoint, Distance
sort_37 = SortList(Keys=pull_29.Distance, ValuesA=sort_36.ValuesA)  # -> Keys, ValuesA
item_62 = ListItem(List=sort_37.ValuesA, Index="-1", Wrap=True)
null_30 = NullItem(Item=flatten(item_62))  # -> NullFlags, InvalidFlags, Description
dispatch_101 = Dispatch(List=flatten(item_62), DispatchPattern=null_30.InvalidFlags)  # -> ListA, ListB
dispatch_102 = Dispatch(List=pln_86, DispatchPattern=null_30.InvalidFlags)  # -> ListA, ListB
pln_95 = Plane(dispatch_102.ListB)
pt_44 = Point(dispatch_101.ListB)

merge_25 = Merge(Data1=pln_95, Data2=pln_94)  # -> flatten(Result)
check_same_points_5 = CheckSamePoints(archPoint=flatten(pln_93), crvPoint=merge_25)  # -> out, specialPt; inputs archPoint: list of Point3d, crvPoint: list of Point3d; same code as testpoint

# ----
# pass
cull_i_10 = CullIndex(List=flatten(pln_93), Indices=check_same_points_5.specialPt, Wrap=True)

# ----
# 按照梁分类定位点
pln_96 = Plane(pln_95)
pt_45 = Point(pt_44)
incurves_31 = PointInCurves(Point=flatten(pt_45), Curves=crv_64)  # -> Relationship, Index, Point
equals_34 = Equality(FirstNumber=incurves_31.Relationship, SecondNumber="0")  # -> Equality, Inequality
dispatch_103 = Dispatch(List=flatten(pln_96), DispatchPattern=equals_34.Inequality)  # -> ListA, ListB
data_69 = Data(dispatch_103.ListA)

# ----
# 按照梁分类定位点
pln_97 = Plane(pln_94)
pt_46 = Point(pt_43)
incurves_32 = PointInCurves(Point=flatten(pt_46), Curves=crv_64)  # -> Relationship, Index, Point
equals_35 = Equality(FirstNumber=incurves_32.Relationship, SecondNumber="0")  # -> Equality, Inequality
dispatch_104 = Dispatch(List=flatten(pln_97), DispatchPattern=equals_35.Inequality)  # -> ListA, ListB
data_70 = Data(dispatch_104.ListA)

incurves_33 = PointInCurves(Point=flatten(pt_46), Curves=crv_64)  # -> Relationship, Index, Point
equals_36 = Equality(FirstNumber=incurves_33.Relationship, SecondNumber="0")  # -> Equality, Inequality
dispatch_105 = Dispatch(List=flatten(pt_46), DispatchPattern=equals_36.Inequality)  # -> ListA, ListB
data_71 = Data(dispatch_105.ListA)

incurves_34 = PointInCurves(Point=flatten(pt_45), Curves=crv_64)  # -> Relationship, Index, Point
equals_37 = Equality(FirstNumber=incurves_34.Relationship, SecondNumber="0")  # -> Equality, Inequality
dispatch_106 = Dispatch(List=flatten(pt_45), DispatchPattern=equals_37.Inequality)  # -> ListA, ListB
data_72 = Data(dispatch_106.ListA)

move2pt_20 = MoveToPoint(Geometry=data_69, PointA=data_69, PointB=data_72)  # -> Moved, Vector, Transform
null_31 = NullItem(Item=move2pt_20.Moved)  # -> NullFlags, InvalidFlags, Description
dispatch_107 = Dispatch(List=move2pt_20.Moved, DispatchPattern=null_31.InvalidFlags)  # -> ListA, ListB
pln_98 = Plane(dispatch_107.ListB)

move2pt_21 = MoveToPoint(Geometry=data_70, PointA=data_70, PointB=data_71)  # -> Moved, Vector, Transform
null_32 = NullItem(Item=move2pt_21.Moved)  # -> NullFlags, InvalidFlags, Description
dispatch_108 = Dispatch(List=move2pt_21.Moved, DispatchPattern=null_32.InvalidFlags)  # -> ListA, ListB
pln_99 = Plane(dispatch_108.ListB)

# ----
# 撞到梁交点
merge_26 = Merge(Data1=pln_98, Data2=pln_99)

merge_27 = Merge(Data1=pln_89, Data2=merge_26)
orient_5 = Orient(Geometry=item_16, Source=rotate_4.Geometry, Target=merge_27)  # -> Geometry, Transform

data_73 = Data(orient_5.Geometry)
ungroup_6 = Ungroup(Group=data_73)
item_63 = ListItem(List=ungroup_6, Index=0, Wrap=True)  # -> flatten(Item)
item_64 = ListItem(List=ungroup_6, Index="-1", Wrap=True)  # -> flatten(Item)

entwine_19 = Entwine(Branch00=item_63, Branch01=item_64, FlattenInputs=True)
bake_8 = BakeObjects(Geometry=entwine_19, Attributes=attributes_6, BakeName="Embed::3-1-03钢板焊埋件", Bake=False)

# ----
# 3.2  Missing Point
# 埋件定位点Offset，没有找到和梁的交点
number_slider_57 = Slider(5000, range=0..10000)
crv_79 = Curve(scx.Curves)
deplane_27 = DeconstructPlane(Plane=pln_50)  # -> Origin, XAxis, YAxis, ZAxis
amp_34 = Amplitude(Vector=deplane_27.YAxis, Amplitude=number_slider_57)
move_38 = Move(Geometry=deplane_27.Origin, Motion=amp_34)  # -> Geometry, Transform
ln_29 = Line(StartPoint=move_38.Geometry, EndPoint=deplane_27.Origin)
amp_35 = Amplitude(Vector=deplane_27.XAxis, Amplitude=number_slider_24)
amp_36 = Amplitude(Vector=deplane_27.XAxis, Amplitude=expr("-x", number_slider_24))
move_39 = Move(Geometry=ln_29, Motion=amp_35)  # -> Geometry, Transform
move_40 = Move(Geometry=ln_29, Motion=amp_36)  # -> Geometry, Transform
pln_100 = Plane(pln_48)

ccx_22 = CurveCurve(CurveA=graft(move_40.Geometry), CurveB=flatten(crv_79))  # -> Points, ParamsA, ParamsB
shift_16 = ShiftPaths(Data=ccx_22.Points, Offset=-1)
sort_38 = SortList(Keys=shift_16, ValuesA=shift_16)  # -> Keys, ValuesA
pull_30 = PullPoint(Point=sort_38.ValuesA, Geometry=graft(pln_50), ClosestOnly=True)  # -> ClosestPoint, Distance
sort_39 = SortList(Keys=pull_30.Distance, ValuesA=sort_38.ValuesA)  # -> Keys, ValuesA
item_65 = ListItem(List=sort_39.ValuesA, Index="-1", Wrap=True)
null_33 = NullItem(Item=flatten(item_65))  # -> NullFlags, InvalidFlags, Description
dispatch_109 = Dispatch(List=flatten(item_65), DispatchPattern=null_33.InvalidFlags)  # -> ListA, ListB
dispatch_110 = Dispatch(List=pln_50, DispatchPattern=null_33.InvalidFlags)  # -> ListA, ListB
pt_47 = Point(dispatch_109.ListB)
pln_101 = Plane(dispatch_110.ListB)

ccx_23 = CurveCurve(CurveA=graft(move_39.Geometry), CurveB=flatten(crv_79))  # -> Points, ParamsA, ParamsB
shift_17 = ShiftPaths(Data=ccx_23.Points, Offset=-1)
sort_40 = SortList(Keys=shift_17, ValuesA=shift_17)  # -> Keys, ValuesA
pull_31 = PullPoint(Point=sort_40.ValuesA, Geometry=graft(pln_50), ClosestOnly=True)  # -> ClosestPoint, Distance
sort_41 = SortList(Keys=pull_31.Distance, ValuesA=sort_40.ValuesA)  # -> Keys, ValuesA
item_66 = ListItem(List=sort_41.ValuesA, Index="-1", Wrap=True)
null_34 = NullItem(Item=flatten(item_66))  # -> NullFlags, InvalidFlags, Description
dispatch_111 = Dispatch(List=flatten(item_66), DispatchPattern=null_34.InvalidFlags)  # -> ListA, ListB
dispatch_112 = Dispatch(List=pln_50, DispatchPattern=null_34.InvalidFlags)  # -> ListA, ListB
pln_102 = Plane(dispatch_112.ListB)
pt_48 = Point(dispatch_111.ListB)

merge_28 = Merge(Data1=pln_102, Data2=pln_101)  # -> flatten(Result)
check_same_points_6 = CheckSamePoints(archPoint=flatten(pln_100), crvPoint=merge_28)  # -> out, specialPt; inputs archPoint: list of Point3d, crvPoint: list of Point3d; same code as testpoint

# ----
# pass
cull_i_11 = CullIndex(List=flatten(pln_100), Indices=check_same_points_6.specialPt, Wrap=True)

# ----
# 按照梁分类定位点
pln_103 = Plane(pln_102)
pt_49 = Point(pt_48)
incurves_35 = PointInCurves(Point=flatten(pt_49), Curves=crv_65)  # -> Relationship, Index, Point
equals_38 = Equality(FirstNumber=incurves_35.Relationship, SecondNumber="0")  # -> Equality, Inequality
dispatch_113 = Dispatch(List=flatten(pln_103), DispatchPattern=equals_38.Inequality)  # -> ListA, ListB
data_74 = Data(dispatch_113.ListA)

# ----
# 按照梁分类定位点
pln_104 = Plane(pln_101)
pt_50 = Point(pt_47)
incurves_36 = PointInCurves(Point=flatten(pt_50), Curves=crv_65)  # -> Relationship, Index, Point
equals_39 = Equality(FirstNumber=incurves_36.Relationship, SecondNumber="0")  # -> Equality, Inequality
dispatch_114 = Dispatch(List=flatten(pln_104), DispatchPattern=equals_39.Inequality)  # -> ListA, ListB
data_75 = Data(dispatch_114.ListA)

incurves_37 = PointInCurves(Point=flatten(pt_50), Curves=crv_65)  # -> Relationship, Index, Point
equals_40 = Equality(FirstNumber=incurves_37.Relationship, SecondNumber="0")  # -> Equality, Inequality
dispatch_115 = Dispatch(List=flatten(pt_50), DispatchPattern=equals_40.Inequality)  # -> ListA, ListB
data_76 = Data(dispatch_115.ListA)

incurves_38 = PointInCurves(Point=flatten(pt_49), Curves=crv_65)  # -> Relationship, Index, Point
equals_41 = Equality(FirstNumber=incurves_38.Relationship, SecondNumber="0")  # -> Equality, Inequality
dispatch_116 = Dispatch(List=flatten(pt_49), DispatchPattern=equals_41.Inequality)  # -> ListA, ListB
data_77 = Data(dispatch_116.ListA)

move2pt_22 = MoveToPoint(Geometry=data_74, PointA=data_74, PointB=data_77)  # -> Moved, Vector, Transform
null_35 = NullItem(Item=move2pt_22.Moved)  # -> NullFlags, InvalidFlags, Description
dispatch_117 = Dispatch(List=move2pt_22.Moved, DispatchPattern=null_35.InvalidFlags)  # -> ListA, ListB
pln_105 = Plane(dispatch_117.ListB)

move2pt_23 = MoveToPoint(Geometry=data_75, PointA=data_75, PointB=data_76)  # -> Moved, Vector, Transform
null_36 = NullItem(Item=move2pt_23.Moved)  # -> NullFlags, InvalidFlags, Description
dispatch_118 = Dispatch(List=move2pt_23.Moved, DispatchPattern=null_36.InvalidFlags)  # -> ListA, ListB
pln_106 = Plane(dispatch_118.ListB)

# ----
# 撞到梁交点
merge_29 = Merge(Data1=pln_105, Data2=pln_106)

pln_107 = Plane(cull_i_11)
pln_108 = Plane(cull_i_10)

# ----
# 3.1下层建筑内侧到300到外侧50内是否有钢结构
deplane_28 = DeconstructPlane(Plane=pln_108)  # -> Origin, XAxis, YAxis, ZAxis
deplane_29 = DeconstructPlane(Plane=pln_107)  # -> Origin, XAxis, YAxis, ZAxis
check_same_points_7 = CheckSamePoints(archPoint=deplane_29.Origin, crvPoint=deplane_28.Origin)  # -> out, specialPt; inputs archPoint: list of Point3d, crvPoint: list of Point3d; same code as testpoint

merge_30 = Merge(Data1=pln_92, Data2=merge_29)
orient_6 = Orient(Geometry=item_18, Source=item_19, Target=merge_30)  # -> Geometry, Transform

data_78 = Data(orient_6.Geometry)
ungroup_7 = Ungroup(Group=data_78)
item_67 = ListItem(List=ungroup_7, Index=0, Wrap=True)  # -> flatten(Item)
item_68 = ListItem(List=ungroup_7, Index="-1", Wrap=True)  # -> flatten(Item)

entwine_20 = Entwine(Branch00=item_67, Branch01=item_68, FlattenInputs=True)
bake_9 = BakeObjects(Geometry=entwine_20, Attributes=attributes_7, BakeName="Embed::3-2-03钢板焊埋件", Bake=False)

# ----
# 同时满足N
item_69 = ListItem(List=pln_107, Index=check_same_points_7.specialPt, Wrap=True)

pln_109 = Plane(item_69)
flatten_6 = FlattenTree(Tree=crv_50, Path="{0}")
number_slider_58 = Slider(3584, range=0..10000)
deplane_30 = DeconstructPlane(Plane=pln_109)  # -> Origin, XAxis, YAxis, ZAxis
boundary_5 = BoundarySurfaces(Edges=[offset_9, offset_8])
crv_80 = Curve(flatten_6)
amp_37 = Amplitude(Vector=deplane_30.YAxis, Amplitude=number_slider_58)
amp_38 = Amplitude(Vector=deplane_30.YAxis, Amplitude=expr("-x", number_slider_58))
scx_3 = SurfaceCurve(Surface=boundary_5, Curve=crv_80)  # -> flatten(Curves), Points, UVPoints, Normals, Parameters, Tangents
move_41 = Move(Geometry=deplane_30.Origin, Motion=amp_38)  # -> Geometry, Transform
move_42 = Move(Geometry=deplane_30.Origin, Motion=amp_37)  # -> Geometry, Transform
ln_30 = Line(StartPoint=move_41.Geometry, EndPoint=move_42.Geometry)
ccx_24 = CurveCurve(CurveA=graft(ln_30), CurveB=scx_3.Curves)  # -> Points, ParamsA, ParamsB
shift_18 = ShiftPaths(Data=ccx_24.Points, Offset=-1)
pull_32 = PullPoint(Point=graft(pln_109), Geometry=shift_18, ClosestOnly=True)  # -> ClosestPoint, Distance
sort_42 = SortList(Keys=pull_32.Distance, ValuesA=pull_32.ClosestPoint)  # -> Keys, ValuesA
item_70 = ListItem(List=sort_42.ValuesA, Index=0, Wrap=True)
null_37 = NullItem(Item=sort_42.ValuesA)  # -> NullFlags, simplify(InvalidFlags), Description
dispatch_119 = Dispatch(List=simplify(graft(pln_109)), DispatchPattern=null_37.InvalidFlags)  # -> ListA, ListB
pln_110 = Plane(dispatch_119.ListB)
pln_111 = Plane(dispatch_119.ListA)

dispatch_120 = Dispatch(List=simplify(graft(item_70)), DispatchPattern=null_37.InvalidFlags)  # -> ListA, ListB
pt_51 = Point(dispatch_120.ListB)

# ----
# 按照梁分类定位点
pt_52 = Point(pt_51)
pln_112 = Plane(pln_110)
incurves_39 = PointInCurves(Point=flatten(pt_52), Curves=crv_66)  # -> Relationship, Index, Point
equals_42 = Equality(FirstNumber=incurves_39.Relationship, SecondNumber="0")  # -> Equality, Inequality
dispatch_121 = Dispatch(List=flatten(pln_112), DispatchPattern=equals_42.Inequality)  # -> ListA, ListB
data_79 = Data(dispatch_121.ListA)

incurves_40 = PointInCurves(Point=flatten(pt_52), Curves=crv_66)  # -> Relationship, Index, Point
equals_43 = Equality(FirstNumber=incurves_40.Relationship, SecondNumber="0")  # -> Equality, Inequality
dispatch_122 = Dispatch(List=flatten(pt_52), DispatchPattern=equals_43.Inequality)  # -> ListA, ListB
data_80 = Data(dispatch_122.ListA)

move2pt_24 = MoveToPoint(Geometry=data_79, PointA=data_79, PointB=data_80)  # -> Moved, Vector, Transform
null_38 = NullItem(Item=move2pt_24.Moved)  # -> NullFlags, InvalidFlags, Description
dispatch_123 = Dispatch(List=move2pt_24.Moved, DispatchPattern=null_38.InvalidFlags)  # -> ListA, ListB
pln_113 = Plane(dispatch_123.ListB)

# ----
# 可能的结构交点-大量
pln_114 = Plane(pln_111)

# ----
# 0 檐口出定位点
# 与结构无交点
pln_115 = Plane(flatten(pln_114))

# ----
# 4.1下层建筑内侧300到外侧50内
# 03底埋，钢板焊
pln_116 = Plane(pln_113)

# ----
# 4 Missing Point
# 埋件定位点Offset，没有找到和梁的交点
number_slider_59 = Slider(5000, range=0..10000)
deplane_31 = DeconstructPlane(Plane=pln_115)  # -> Origin, XAxis, YAxis, ZAxis
crv_81 = Curve(scx_3.Curves)
amp_39 = Amplitude(Vector=deplane_31.YAxis, Amplitude=number_slider_59)
move_43 = Move(Geometry=deplane_31.Origin, Motion=amp_39)  # -> Geometry, Transform
ln_31 = Line(StartPoint=move_43.Geometry, EndPoint=deplane_31.Origin)
amp_40 = Amplitude(Vector=deplane_31.XAxis, Amplitude=number_slider_24)
amp_41 = Amplitude(Vector=deplane_31.XAxis, Amplitude=expr("-x", number_slider_24))
move_44 = Move(Geometry=ln_31, Motion=amp_40)  # -> Geometry, Transform
move_45 = Move(Geometry=ln_31, Motion=amp_41)  # -> Geometry, Transform
pln_117 = Plane(pln_115)

ccx_25 = CurveCurve(CurveA=graft(move_45.Geometry), CurveB=flatten(crv_81))  # -> Points, ParamsA, ParamsB
shift_19 = ShiftPaths(Data=ccx_25.Points, Offset=-1)
sort_43 = SortList(Keys=shift_19, ValuesA=shift_19)  # -> Keys, ValuesA
pull_33 = PullPoint(Point=sort_43.ValuesA, Geometry=graft(pln_115), ClosestOnly=True)  # -> ClosestPoint, Distance
sort_44 = SortList(Keys=pull_33.Distance, ValuesA=sort_43.ValuesA)  # -> Keys, ValuesA
item_71 = ListItem(List=sort_44.ValuesA, Index="-1", Wrap=True)
null_39 = NullItem(Item=flatten(item_71))  # -> NullFlags, InvalidFlags, Description
dispatch_124 = Dispatch(List=flatten(item_71), DispatchPattern=null_39.InvalidFlags)  # -> ListA, ListB
dispatch_125 = Dispatch(List=pln_115, DispatchPattern=null_39.InvalidFlags)  # -> ListA, ListB
pln_118 = Plane(dispatch_125.ListB)
pt_53 = Point(dispatch_124.ListB)

ccx_26 = CurveCurve(CurveA=graft(move_44.Geometry), CurveB=flatten(crv_81))  # -> Points, ParamsA, ParamsB
shift_20 = ShiftPaths(Data=ccx_26.Points, Offset=-1)
sort_45 = SortList(Keys=shift_20, ValuesA=shift_20)  # -> Keys, ValuesA
pull_34 = PullPoint(Point=sort_45.ValuesA, Geometry=graft(pln_115), ClosestOnly=True)  # -> ClosestPoint, Distance
sort_46 = SortList(Keys=pull_34.Distance, ValuesA=sort_45.ValuesA)  # -> Keys, ValuesA
item_72 = ListItem(List=sort_46.ValuesA, Index="-1", Wrap=True)
null_40 = NullItem(Item=flatten(item_72))  # -> NullFlags, InvalidFlags, Description
dispatch_126 = Dispatch(List=pln_115, DispatchPattern=null_40.InvalidFlags)  # -> ListA, ListB
dispatch_127 = Dispatch(List=flatten(item_72), DispatchPattern=null_40.InvalidFlags)  # -> ListA, ListB
pt_54 = Point(dispatch_127.ListB)
pln_119 = Plane(dispatch_126.ListB)

merge_31 = Merge(Data1=pln_119, Data2=pln_118)  # -> flatten(Result)
check_same_points_8 = CheckSamePoints(archPoint=flatten(pln_117), crvPoint=merge_31)  # -> out, specialPt; inputs archPoint: list of Point3d, crvPoint: list of Point3d; same code as testpoint

# ----
# pass
cull_i_12 = CullIndex(List=flatten(pln_117), Indices=check_same_points_8.specialPt, Wrap=True)  # -> simplify(graft(List))

# ----
# 按照梁分类定位点
pln_120 = Plane(pln_119)
pt_55 = Point(pt_54)
incurves_41 = PointInCurves(Point=flatten(pt_55), Curves=crv_67)  # -> Relationship, Index, Point
equals_44 = Equality(FirstNumber=incurves_41.Relationship, SecondNumber="0")  # -> Equality, Inequality
dispatch_128 = Dispatch(List=flatten(pln_120), DispatchPattern=equals_44.Inequality)  # -> ListA, ListB
data_81 = Data(dispatch_128.ListA)

# ----
# 按照梁分类定位点
pln_121 = Plane(pln_118)
pt_56 = Point(pt_53)
incurves_42 = PointInCurves(Point=flatten(pt_56), Curves=crv_67)  # -> Relationship, Index, Point
equals_45 = Equality(FirstNumber=incurves_42.Relationship, SecondNumber="0")  # -> Equality, Inequality
dispatch_129 = Dispatch(List=flatten(pln_121), DispatchPattern=equals_45.Inequality)  # -> ListA, ListB
data_82 = Data(dispatch_129.ListA)

incurves_43 = PointInCurves(Point=flatten(pt_56), Curves=crv_67)  # -> Relationship, Index, Point
equals_46 = Equality(FirstNumber=incurves_43.Relationship, SecondNumber="0")  # -> Equality, Inequality
dispatch_130 = Dispatch(List=flatten(pt_56), DispatchPattern=equals_46.Inequality)  # -> ListA, ListB
data_83 = Data(dispatch_130.ListA)

incurves_44 = PointInCurves(Point=flatten(pt_55), Curves=crv_67)  # -> Relationship, Index, Point
equals_47 = Equality(FirstNumber=incurves_44.Relationship, SecondNumber="0")  # -> Equality, Inequality
dispatch_131 = Dispatch(List=flatten(pt_55), DispatchPattern=equals_47.Inequality)  # -> ListA, ListB
data_84 = Data(dispatch_131.ListA)

move2pt_25 = MoveToPoint(Geometry=data_81, PointA=data_81, PointB=data_84)  # -> Moved, Vector, Transform
null_41 = NullItem(Item=move2pt_25.Moved)  # -> NullFlags, InvalidFlags, Description
dispatch_132 = Dispatch(List=move2pt_25.Moved, DispatchPattern=null_41.InvalidFlags)  # -> ListA, ListB
pln_122 = Plane(dispatch_132.ListB)

move2pt_26 = MoveToPoint(Geometry=data_82, PointA=data_82, PointB=data_83)  # -> Moved, Vector, Transform
null_42 = NullItem(Item=move2pt_26.Moved)  # -> NullFlags, InvalidFlags, Description
dispatch_133 = Dispatch(List=move2pt_26.Moved, DispatchPattern=null_42.InvalidFlags)  # -> ListA, ListB
pln_123 = Plane(dispatch_133.ListB)

# ----
# 撞到梁交点
merge_32 = Merge(Data1=pln_122, Data2=pln_123)

merge_33 = Merge(Data1=flatten(pln_116), Data2=flatten(merge_32))
orient_7 = Orient(Geometry=item_21, Source=item_20, Target=merge_33)  # -> Geometry, Transform

data_85 = Data(orient_7.Geometry)
ungroup_8 = Ungroup(Group=data_85)
item_73 = ListItem(List=ungroup_8, Index=0, Wrap=True)  # -> flatten(Item)
item_74 = ListItem(List=ungroup_8, Index="-1", Wrap=True)  # -> flatten(Item)

entwine_21 = Entwine(Branch00=item_73, Branch01=item_74, FlattenInputs=True)
bake_10 = BakeObjects(Geometry=entwine_21, Attributes=attributes_8, BakeName="Embed::4-1钢板焊底埋", Bake=False)

# ----
# 5 上层建筑边线,
# 默认建筑提供上翻，如主结构提供示意则使用结构定位【该项目无】，
# 如无则使用建筑边线向内50mm作为埋件定位
# 结构线选上层or下层？？
movetoplane_11 = MoveToPlane(Geometry=crv_3, Plane=PlaneXY(0, 0, 0), Above=True, Below=True)  # -> Geometry, Transform
movetoplane_12 = MoveToPlane(Geometry=pln_8, Plane=PlaneXY(0, 0, 0), Above=True, Below=True)  # -> Geometry, Transform
crv_82 = Curve(crv_19)
incurves_45 = PointInCurves(Point=movetoplane_12.Geometry, Curves=flatten(movetoplane_11.Geometry))  # -> Relationship, Index, Point
equals_48 = Equality(FirstNumber=incurves_45.Relationship, SecondNumber="2")  # -> Equality, Inequality
dispatch_134 = Dispatch(List=pln_8, DispatchPattern=equals_48.Equality)  # -> ListA, ListB
number_slider_60 = Slider(3584, range=0..10000)

# ---- group: Plane二次筛选
pln_124 = Plane(dispatch_134.ListA)

# ----
# 4.0下层建筑内侧到300到外侧50内
# 无钢结构
# 要求主体结构提供钢结构梁，默认位置为建筑边线向内300mm
number_slider_61 = Slider(300, range=0..1000)
crv_83 = Curve(crv_29)
pln_125 = Plane(cull_i_12)
offset_11 = OffsetCurve(Curve=crv_83, Distance=expr("-x", number_slider_61), Corners=1)
pull_35 = PullPoint(Point=pln_125, Geometry=offset_11, ClosestOnly=True)  # -> ClosestPoint, Distance
sort_47 = SortList(Keys=pull_35.Distance)  # -> Keys, ValuesA
larger_10 = LargerThan(FirstNumber=pull_35.Distance, SecondNumber=Slider(400, range=0..1000))  # -> LargerThan, OrEqualTo
panel_63 = Panel(sort_47.Keys)
number_slider_62 = Slider(3584, range=0..10000)

# ---- group: 删除反常线
dispatch_135 = Dispatch(List=pln_125, DispatchPattern=larger_10.LargerThan)  # -> ListA, ListB

# ----
pln_126 = Plane(flatten(dispatch_135.ListB))
deplane_32 = DeconstructPlane(Plane=pln_126)  # -> Origin, XAxis, YAxis, ZAxis
amp_42 = Amplitude(Vector=deplane_32.YAxis, Amplitude=number_slider_62)
amp_43 = Amplitude(Vector=deplane_32.YAxis, Amplitude=expr("-x", number_slider_62))
move_46 = Move(Geometry=deplane_32.Origin, Motion=amp_43)  # -> Geometry, Transform
move_47 = Move(Geometry=deplane_32.Origin, Motion=amp_42)  # -> Geometry, Transform
ln_32 = Line(StartPoint=move_46.Geometry, EndPoint=move_47.Geometry)
ccx_27 = CurveCurve(CurveA=ln_32, CurveB=offset_11)  # -> Points, ParamsA, ParamsB
flatten_7 = FlattenTree(Tree=ccx_27.Points, Path="{0}")
null_43 = NullItem(Item=simplify(ccx_27.Points))  # -> NullFlags, InvalidFlags, Description
dispatch_136 = Dispatch(List=simplify(graft(pln_126)), DispatchPattern=null_43.NullFlags)  # -> ListA, ListB

# ---- group: 有效点
pull_36 = PullPoint(Point=deplane_32.Origin, Geometry=flatten_7, ClosestOnly=True)  # -> ClosestPoint, Distance

# ----
# 可能的双点
pln_127 = Plane(dispatch_136.ListA)

# ----
# 离结构太远
pln_128 = Plane(dispatch_135.ListA)

merge_34 = Merge(Data1=pln_128, Data2=pln_127)

# ----
# 0 檐口出定位点
# 与结构无交点
pln_129 = Plane(flatten(merge_34))

# ----
# 4.0 默认位置为建筑边线向内300mm
# 侧埋，钢板焊
# 03：钢板焊埋件[钢梁外侧]@钢边梁宽@钢边梁高
move2pt_27 = MoveToPoint(Geometry=pln_126, PointA=deplane_32.Origin, PointB=pull_36.ClosestPoint)  # -> Moved, Vector, Transform

crv_84 = Curve(project_9.Geometry)
crv_85 = Curve([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])
merge_35 = Merge(Data1=crv_84, Data2=crv_85)  # -> flatten(Result)

# ----
# curve
crv_86 = Curve(merge_35)

angle = Angle(VectorA=crv_86, VectorB="1,0,0")  # -> Angle, Reflex
deg_4 = Degrees(Radians=angle.Angle)
number_2 = NumberGroups(Number=deg_4, Difference="0.2")  # -> Groups, Indices
item_75 = ListItem(List=crv_86, Index=number_2.Indices, Wrap=True)  # -> simplify(Item)
panel_64 = Panel(number_2.Groups)
item_76 = ListItem(List=item_75, Index=0, Wrap=True)  # -> flatten(Item)
item_77 = ListItem(List=item_75, Index=0, Wrap=True)
bang_3 = ExplodeTree(Data=item_75)  # -> Branch0, Branch1, Branch2, Branch3, Branch4, Branch5
crv_87 = Curve(bang_3.Branch0)
crv_88 = Curve(bang_3.Branch1)
crv_89 = Curve(bang_3.Branch2)
crv_90 = Curve(bang_3.Branch3)
angle_2 = Angle(VectorA=item_77, VectorB=item_76)  # -> Angle, Reflex
deg_5 = Degrees(Radians=angle_2.Angle)
round_3 = Round(Number=deg_5, DecimalPlace="0")  # -> Nearest, Floor, Ceiling
equals_49 = Equality(FirstNumber=round_3.Nearest, SecondNumber="90")  # -> Equality, Inequality
panel_65 = Panel(round_3.Nearest)
dispatch_137 = Dispatch(List=item_76, DispatchPattern=equals_49.Equality)  # -> ListA, ListB
crv_91 = Curve(flatten(dispatch_137.ListA))
index = ItemIndex(List=item_76, Item=crv_91)
concat = Concatenate(FragmentA="{", FragmentB=index)
concat_2 = Concatenate(FragmentA=concat, FragmentB="}")
tstat_2 = TreeStatistics(Tree=item_75)  # -> Paths, Length, Count
item_78 = ListItem(List=tstat_2.Paths, Index=0, Wrap=True)  # -> Item, Item1
item_79 = ListItem(List=concat_2, Index=0, Wrap=True)
# Sort Text
branch_2 = TreeBranch(Tree=item_75, Path=item_78.Item, MaintainPaths=True)
branch_3 = TreeBranch(Tree=item_75, Path=item_79, MaintainPaths=True)

deplane_33 = DeconstructPlane(Plane=pln_124)  # -> Origin, XAxis, YAxis, ZAxis
amp_44 = Amplitude(Vector=deplane_33.YAxis, Amplitude=number_slider_60)
amp_45 = Amplitude(Vector=deplane_33.YAxis, Amplitude=expr("-x", number_slider_60))
move_48 = Move(Geometry=deplane_33.Origin, Motion=amp_45)  # -> Geometry, Transform
move_49 = Move(Geometry=deplane_33.Origin, Motion=amp_44)  # -> Geometry, Transform
ln_33 = Line(StartPoint=move_48.Geometry, EndPoint=move_49.Geometry)

offset_12 = OffsetCurve(Curve=crv_82, Distance=expr("-x", Slider(50, range=0..100)), Corners=1)
ccx_28 = CurveCurve(CurveA=ln_33, CurveB=offset_12)  # -> simplify(Points), ParamsA, ParamsB

ln_34 = Line(StartPoint=ccx_28.Points, EndPoint=simplify(graft(pln_124)))
len_8 = Length(Curve=ln_34)
null_44 = NullItem(Item=ccx_28.Points)  # -> NullFlags, InvalidFlags, Description
sort_48 = SortList(Keys=len_8, ValuesA=simplify(ccx_28.Points))  # -> Keys, ValuesA
dispatch_138 = Dispatch(List=simplify(graft(pln_124)), DispatchPattern=null_44.NullFlags)  # -> ListA, ListB
item_80 = ListItem(List=sort_48.ValuesA, Index=0, Wrap=True)

# ----
# 可能的双点
pln_130 = Plane(dispatch_138.ListA)

# ----
# 0 檐口出定位点
# 与结构无交点
pln_131 = Plane(flatten(pln_130))

# ----
# 5 上层建筑边线,
# 默认建筑提供上翻
# 04：板埋埋件[混凝土楼板上侧]
# @板埋参数xn
move2pt_28 = MoveToPoint(Geometry=simplify(graft(pln_124)), PointA=simplify(graft(pln_124)), PointB=item_80)  # -> flatten(Moved), Vector, Transform

# ----
# 5  Missing Point
# 埋件定位点Offset，没有找到和梁的交点
number_slider_63 = Slider(5000, range=0..10000)
deplane_34 = DeconstructPlane(Plane=pln_131)  # -> Origin, XAxis, YAxis, ZAxis
crv_92 = Curve(crv_82)
amp_46 = Amplitude(Vector=deplane_34.YAxis, Amplitude=number_slider_63)
move_50 = Move(Geometry=deplane_34.Origin, Motion=amp_46)  # -> Geometry, Transform
ln_35 = Line(StartPoint=move_50.Geometry, EndPoint=deplane_34.Origin)
amp_47 = Amplitude(Vector=deplane_34.XAxis, Amplitude=number_slider_24)
amp_48 = Amplitude(Vector=deplane_34.XAxis, Amplitude=expr("-x", number_slider_24))
move_51 = Move(Geometry=ln_35, Motion=amp_47)  # -> Geometry, Transform
move_52 = Move(Geometry=ln_35, Motion=amp_48)  # -> Geometry, Transform
pln_132 = Plane(pln_131)

ccx_29 = CurveCurve(CurveA=graft(move_52.Geometry), CurveB=flatten(crv_92))  # -> Points, ParamsA, ParamsB
shift_21 = ShiftPaths(Data=ccx_29.Points, Offset=-1)
sort_49 = SortList(Keys=shift_21, ValuesA=shift_21)  # -> Keys, ValuesA
pull_37 = PullPoint(Point=sort_49.ValuesA, Geometry=graft(pln_131), ClosestOnly=True)  # -> ClosestPoint, Distance
sort_50 = SortList(Keys=pull_37.Distance, ValuesA=sort_49.ValuesA)  # -> Keys, ValuesA
item_81 = ListItem(List=sort_50.ValuesA, Index="-1", Wrap=True)
null_45 = NullItem(Item=flatten(item_81))  # -> NullFlags, InvalidFlags, Description
dispatch_139 = Dispatch(List=simplify(item_81), DispatchPattern=simplify(graft(null_45.InvalidFlags)))  # -> ListA, ListB
dispatch_140 = Dispatch(List=pln_131, DispatchPattern=null_45.InvalidFlags)  # -> ListA, ListB
pln_133 = Plane(dispatch_140.ListB)
pt_57 = Point(dispatch_139.ListB)

ccx_30 = CurveCurve(CurveA=graft(move_51.Geometry), CurveB=flatten(crv_92))  # -> Points, ParamsA, ParamsB
shift_22 = ShiftPaths(Data=ccx_30.Points, Offset=-1)
sort_51 = SortList(Keys=shift_22, ValuesA=shift_22)  # -> Keys, ValuesA
pull_38 = PullPoint(Point=sort_51.ValuesA, Geometry=graft(pln_131), ClosestOnly=True)  # -> ClosestPoint, Distance
sort_52 = SortList(Keys=pull_38.Distance, ValuesA=sort_51.ValuesA)  # -> Keys, ValuesA
item_82 = ListItem(List=sort_52.ValuesA, Index="-1", Wrap=True)
null_46 = NullItem(Item=flatten(item_82))  # -> NullFlags, InvalidFlags, Description
dispatch_141 = Dispatch(List=simplify(item_82), DispatchPattern=simplify(graft(null_46.InvalidFlags)))  # -> ListA, ListB
dispatch_142 = Dispatch(List=pln_131, DispatchPattern=null_46.InvalidFlags)  # -> ListA, ListB
pln_134 = Plane(dispatch_142.ListB)
pt_58 = Point(dispatch_141.ListB)

merge_36 = Merge(Data1=pln_134, Data2=pln_133)  # -> flatten(Result)
check_same_points_9 = CheckSamePoints(archPoint=flatten(pln_132), crvPoint=merge_36)  # -> out, specialPt; inputs archPoint: list of Point3d, crvPoint: list of Point3d; same code as testpoint

# ----
# 撞到结构
move2pt_29 = MoveToPoint(Geometry=flatten(pln_134), PointA=flatten(pln_134), PointB=flatten(pt_58))  # -> Moved, Vector, Transform
move2pt_30 = MoveToPoint(Geometry=flatten(pln_133), PointA=flatten(pln_133), PointB=flatten(pt_57))  # -> Moved, Vector, Transform

# ----
# pass
cull_i_13 = CullIndex(List=flatten(pln_132), Indices=check_same_points_9.specialPt, Wrap=True)  # -> simplify(graft(List))

# ----
# 撞到梁交点
merge_37 = Merge(Data1=move2pt_29.Moved, Data2=move2pt_30.Moved)

merge_38 = Merge(Data1=move2pt_28.Moved, Data2=merge_37)

# ---- group: All Location Point
merge_39 = Merge(Data1=merge_17, Data2=merge_21, Data3=merge_38)

# ----
orient_8 = Orient(Geometry=item_33, Source=item_34, Target=merge_38)  # -> Geometry, Transform

data_86 = Data(orient_8.Geometry)
ungroup_9 = Ungroup(Group=data_86)
item_83 = ListItem(List=ungroup_9, Index=0, Wrap=True)  # -> flatten(Item)
item_84 = ListItem(List=ungroup_9, Index="-1", Wrap=True)  # -> flatten(Item)

entwine_22 = Entwine(Branch00=item_83, Branch01=item_84, FlattenInputs=True)
bake_11 = BakeObjects(Geometry=entwine_22, Attributes=attributes_9, BakeName="Embed::5-04板埋", Bake=False)

null_47 = NullItem(Item=merge_39)  # -> NullFlags, InvalidFlags, Description
dispatch_143 = Dispatch(List=merge_39, DispatchPattern=null_47.InvalidFlags)  # -> ListA, ListB

# ---- group: 下层图纸-标注定位点
pt_59 = Point(dispatch_143.ListB)

# ----
cluster_7 = Cluster_2(
    outline_curve=标准范围_符合单一轴网方向_2,
    dim_offset_1=number_slider_28,
    dim_offset_2=number_slider_27,
    axis_direction_crv1=crv_7,
    axis_direction_crv2=crv_8,
    f2_arch_outline=crv_43,
    location_point=pt_59,
    dim_style=panel_32,
    directed_outline=seam_2,
    移除重复位置点_容差=number_slider_25)  # -> D_3, D_4, D, D_2
dimension1 = Data(cluster_7.D_3)

# ---- group: Dimension4
data_87 = Data(cluster_7.D_2)

# ---- group: Dimension2
data_88 = Data(cluster_7.D_4)

# ---- group: Dimension3
data_89 = Data(cluster_7.D)

# ----
entwine_23 = Entwine(Branch00=dimension1, Branch01=data_88, Branch02=data_89, Branch03=data_87, FlattenInputs=True)

# ---- group: Refrash Data
# 将所有Input都输入完后要Refresh data
dam = DataDam(DataA=entwine_23, BufferDelay=10000000, BufferMode=0)

# ----
dedim = DeconstructDimension(DimensionObject=dam)  # -> Value, Text, Plane, Points, Style
shift_23 = ShiftPaths(Data=dedim.Text, Offset=-1)
smaller_8 = SmallerThan(FirstNumber=shift_23, SecondNumber=Slider(1, range=0..10))  # -> SmallerThan, OrEqualTo
dispatch_144 = Dispatch(List=dam, DispatchPattern=smaller_8.SmallerThan)  # -> ListA, ListB

# ---- group: Bake Me
bake_12 = BakeObjects(Geometry=dispatch_144.ListB, Attributes=attributes_12, Bake=False)

# ----
data_90 = Data(dispatch_144.ListB)

# ----
# 4.0  Missing Point
# 埋件定位点Offset，没有找到和梁的交点
number_slider_64 = Slider(5000, range=0..10000)
deplane_35 = DeconstructPlane(Plane=pln_129)  # -> Origin, XAxis, YAxis, ZAxis
crv_93 = Curve(scx_3.Curves)
amp_49 = Amplitude(Vector=deplane_35.YAxis, Amplitude=number_slider_64)
move_53 = Move(Geometry=deplane_35.Origin, Motion=amp_49)  # -> Geometry, Transform
ln_36 = Line(StartPoint=move_53.Geometry, EndPoint=deplane_35.Origin)
amp_50 = Amplitude(Vector=deplane_35.XAxis, Amplitude=number_slider_24)
amp_51 = Amplitude(Vector=deplane_35.XAxis, Amplitude=expr("-x", number_slider_24))
move_54 = Move(Geometry=ln_36, Motion=amp_50)  # -> Geometry, Transform
move_55 = Move(Geometry=ln_36, Motion=amp_51)  # -> Geometry, Transform
pln_135 = Plane(pln_129)

ccx_31 = CurveCurve(CurveA=graft(move_55.Geometry), CurveB=flatten(crv_93))  # -> Points, ParamsA, ParamsB
shift_24 = ShiftPaths(Data=ccx_31.Points, Offset=-1)
sort_53 = SortList(Keys=shift_24, ValuesA=shift_24)  # -> Keys, ValuesA
pull_39 = PullPoint(Point=sort_53.ValuesA, Geometry=graft(pln_129), ClosestOnly=True)  # -> ClosestPoint, Distance
sort_54 = SortList(Keys=pull_39.Distance, ValuesA=sort_53.ValuesA)  # -> Keys, ValuesA
item_85 = ListItem(List=sort_54.ValuesA, Index="-1", Wrap=True)
null_48 = NullItem(Item=flatten(item_85))  # -> NullFlags, InvalidFlags, Description
dispatch_145 = Dispatch(List=simplify(item_85), DispatchPattern=simplify(graft(null_48.InvalidFlags)))  # -> ListA, ListB
dispatch_146 = Dispatch(List=pln_129, DispatchPattern=null_48.InvalidFlags)  # -> ListA, ListB
pln_136 = Plane(dispatch_146.ListB)
pt_60 = Point(dispatch_145.ListB)

ccx_32 = CurveCurve(CurveA=graft(move_54.Geometry), CurveB=flatten(crv_93))  # -> Points, ParamsA, ParamsB
shift_25 = ShiftPaths(Data=ccx_32.Points, Offset=-1)
sort_55 = SortList(Keys=shift_25, ValuesA=shift_25)  # -> Keys, ValuesA
pull_40 = PullPoint(Point=sort_55.ValuesA, Geometry=graft(pln_129), ClosestOnly=True)  # -> ClosestPoint, Distance
sort_56 = SortList(Keys=pull_40.Distance, ValuesA=sort_55.ValuesA)  # -> Keys, ValuesA
item_86 = ListItem(List=sort_56.ValuesA, Index="-1", Wrap=True)
null_49 = NullItem(Item=flatten(item_86))  # -> NullFlags, InvalidFlags, Description
dispatch_147 = Dispatch(List=simplify(item_86), DispatchPattern=simplify(graft(null_49.InvalidFlags)))  # -> ListA, ListB
dispatch_148 = Dispatch(List=pln_129, DispatchPattern=null_49.InvalidFlags)  # -> ListA, ListB
pln_137 = Plane(dispatch_148.ListB)
pt_61 = Point(dispatch_147.ListB)

merge_40 = Merge(Data1=pln_137, Data2=pln_136)  # -> flatten(Result)
check_same_points_10 = CheckSamePoints(archPoint=flatten(pln_135), crvPoint=merge_40)  # -> out, specialPt; inputs archPoint: list of Point3d, crvPoint: list of Point3d; same code as testpoint

# ----
# 撞到结构
move2pt_31 = MoveToPoint(Geometry=flatten(pln_137), PointA=flatten(pln_137), PointB=flatten(pt_61))  # -> Moved, Vector, Transform
move2pt_32 = MoveToPoint(Geometry=flatten(pln_136), PointA=flatten(pln_136), PointB=flatten(pt_60))  # -> Moved, Vector, Transform

# ----
# pass
cull_i_14 = CullIndex(List=flatten(pln_135), Indices=check_same_points_10.specialPt, Wrap=True)  # -> simplify(graft(List))

# ----
# 撞到梁交点
merge_41 = Merge(Data1=move2pt_31.Moved, Data2=move2pt_32.Moved)

merge_42 = Merge(Data1=move2pt_27.Moved, Data2=merge_41)

# ---- group: All Location Point
merge_43 = Merge(Data1=merge_24, Data2=merge_27, Data3=merge_30, Data4=merge_33, Data5=merge_42)

# ----
orient_9 = Orient(Geometry=item_4, Source=item_5, Target=merge_42)  # -> Geometry, Transform

data_91 = Data(orient_9.Geometry)
ungroup_10 = Ungroup(Group=data_91)
item_87 = ListItem(List=ungroup_10, Index=0, Wrap=True)  # -> flatten(Item)
item_88 = ListItem(List=ungroup_10, Index="-1", Wrap=True)  # -> flatten(Item)

entwine_24 = Entwine(Branch00=item_87, Branch01=item_88, FlattenInputs=True)
bake_13 = BakeObjects(Geometry=entwine_24, Attributes=attributes_10, BakeName="Embed::4-0-03默认钢板焊", Bake=False)

null_50 = NullItem(Item=merge_43)  # -> NullFlags, InvalidFlags, Description
dispatch_149 = Dispatch(List=merge_43, DispatchPattern=null_50.InvalidFlags)  # -> ListA, ListB

# ---- group: 下层图纸-标注定位点
pt_62 = Point(dispatch_149.ListB)

# ----
cluster_8 = Cluster_2(
    outline_curve=标准范围_符合单一轴网方向,
    dim_offset_1=number_slider_23,
    dim_offset_2=number_slider_21,
    axis_direction_crv1=crv_4,
    axis_direction_crv2=crv_5,
    f2_arch_outline=crv_42,
    location_point=pt_62,
    dim_style=panel_31,
    directed_outline=seam,
    移除重复位置点_容差=number_slider_22)  # -> D_3, D_4, D, D_2
dimension1_2 = Data(cluster_8.D_3)

# ---- group: Dimension4
data_92 = Data(cluster_8.D_2)

# ---- group: Dimension2
data_93 = Data(cluster_8.D_4)

# ---- group: Dimension3
data_94 = Data(cluster_8.D)

# ----
entwine_25 = Entwine(Branch00=dimension1_2, Branch01=data_93, Branch02=data_94, Branch03=data_92, FlattenInputs=True)

# ---- group: Refrash Data
# 将所有Input都输入完后要Refresh data
dam_2 = DataDam(DataA=entwine_25, BufferDelay=10000000, BufferMode=0)

# ----
dedim_2 = DeconstructDimension(DimensionObject=dam_2)  # -> Value, Text, Plane, Points, Style
shift_26 = ShiftPaths(Data=dedim_2.Text, Offset=-1)
smaller_9 = SmallerThan(FirstNumber=shift_26, SecondNumber=Slider(1, range=0..10))  # -> SmallerThan, OrEqualTo
dispatch_150 = Dispatch(List=dam_2, DispatchPattern=smaller_9.SmallerThan)  # -> ListA, ListB

# ---- group: Bake Me
bake_14 = BakeObjects(Geometry=dispatch_150.ListB, Attributes=attributes_11, Bake=False)

# ----
data_95 = Data(dispatch_150.ListB)

# ==== cluster Cluster
G = ClusterInput()
rotate = Rotate(Geometry=G, Angle=3.141592654, Plane=PlaneXY(0, 0, 0))  # -> Geometry, Transform
boxprop = BoxProperties(Box=rotate.Geometry)  # -> Center, Diagonal, Area, Volume, Degeneracy
bbox = BoundingBox(Content=rotate.Geometry, Plane=PlaneXY(0, 0, 0))  # -> Box, Box_2
debox = DeconstructBox(Box=bbox.Box)  # -> Plane, X, Y, Z
pdecon = Deconstruct(Point=boxprop.Center)  # -> XComponent, YComponent, ZComponent
dedomain = DeconstructDomain(Domain=debox.Y)  # -> Start, End
pt = ConstructPoint(XCoordinate=pdecon.XComponent, YCoordinate=dedomain.Start, ZCoordinate=pdecon.ZComponent)
xy = XYPlane(Origin=Point(0, 0, 0))
pl_origin = PlaneOrigin(Base=xy, Origin=pt)
orient = Orient(Geometry=rotate.Geometry, Source=pl_origin, Target=xy)  # -> Geometry, Transform
G_2 = ClusterOutput(orient.Geometry)

# ==== cluster Cluster_2
f2_arch_outline = ClusterInput()
directed_outline = ClusterInput()
location_point = ClusterInput()
移除重复位置点_容差 = ClusterInput()
dim_offset_1 = ClusterInput()
dim_offset_2 = ClusterInput()
axis_direction_crv1 = ClusterInput()
axis_direction_crv2 = ClusterInput()
dim_style = ClusterInput()
outline_curve = ClusterInput()
pt = Point(location_point)
merge = Merge(Data1=axis_direction_crv1, Data2=axis_direction_crv2)
crv = Curve(f2_arch_outline)
number_slider = Slider(61, range=0..100)

incurve = PointInCurve(Point=flatten(pt), Curve=outline_curve)  # -> Relationship, Point
equals = Equality(FirstNumber=incurve.Relationship, SecondNumber="0")  # -> Equality, Inequality
dispatch = Dispatch(List=flatten(pt), DispatchPattern=equals.Inequality)  # -> ListA, ListB
pt_2 = Point(dispatch.ListA)
crv_cp = CurveClosestPoint(Point=pt_2, Curve=directed_outline)  # -> Point, Parameter, Distance
sort = SortList(Keys=crv_cp.Parameter, ValuesA=pt_2)  # -> Keys, ValuesA
pt_3 = Point(sort.ValuesA)
item = ListItem(List=merge, Index=0, Wrap=True)  # -> Item, Item1

# ----
# remove重复定位点生成的2个点
pt_4 = Point(pt_3)
shift = ShiftList(List=pt_4, Shift=1, Wrap=invert(True))
pt_5 = Point(pt_3)
pt_6 = Point(shift)
dist = Distance(PointA=pt_5, PointB=pt_6)
larger = LargerThan(FirstNumber=dist, SecondNumber=移除重复位置点_容差)  # -> LargerThan, OrEqualTo
dispatch_2 = Dispatch(List=pt_5, DispatchPattern=larger.LargerThan)  # -> ListA, ListB
pt_7 = Point(dispatch_2.ListA)
pt_8 = Point(dispatch_2.ListB)

dispatch_3 = Dispatch(List=pt_7, DispatchPattern=[True, False])  # -> ListA, ListB
pt_9 = Point(dispatch_3.ListB)
pt_10 = Point(dispatch_3.ListA)
pl = ConstructPlane(Origin=pt_10, XAxis=item.Item1, YAxis=item.Item)
pl_2 = ConstructPlane(Origin=pt_10, XAxis=item.Item, YAxis=item.Item1)

item_2 = ListItem(List=pt_7, Index=number_slider, Wrap=True)
shift_2 = ShiftList(List=pt_7, Shift=1, Wrap=invert(True))
item_3 = ListItem(List=shift_2, Index=number_slider, Wrap=True)

dispatch_4 = Dispatch(List=shift_2, DispatchPattern=[True, False])  # -> ListA, ListB
item_4 = ListItem(List=merge, Index=0, Wrap=True)  # -> Item, Item1
pt_11 = Point(dispatch_4.ListB)
pt_12 = Point(dispatch_4.ListA)
pl_3 = ConstructPlane(Origin=pt_12, XAxis=item_4.Item1, YAxis=item_4.Item)
pl_4 = ConstructPlane(Origin=pt_12, XAxis=item_4.Item, YAxis=item_4.Item1)

ln = Line(StartPoint=pt_10, EndPoint=pt_9)
ln_2 = Line(StartPoint=pt_12, EndPoint=pt_11)

crv_2 = Curve(crv)
deplane = DeconstructPlane(Plane=pl_3)  # -> Origin, XAxis, YAxis, ZAxis
amp = Amplitude(Vector=deplane.YAxis, Amplitude=Slider(3000, range=0..10000))
move = Move(Geometry=deplane.Origin, Motion=amp)  # -> Geometry, Transform
clscrv = CloseCurve(Curve=crv_2, CloseType=0, Bulge=0.5, Tolerance=0)  # -> Closed, R
pt_13 = Point(move.Geometry)
incurve_2 = PointInCurve(Point=pt_13, Curve=clscrv.Closed)  # -> Relationship, Point
equals_2 = Equality(FirstNumber=incurve_2.Relationship, SecondNumber="2")  # -> Equality, Inequality
lng = ListLength(List=equals_2.Equality)
lng_2 = ListLength(List=equals_2.Equality)
neg = Negative(Value=dim_offset_1)
repeat = RepeatData(Data=graft(neg), Length=lng)
repeat_2 = RepeatData(Data=graft(dim_offset_1), Length=lng_2)
panel = Panel(equals_2.Equality)
dispatch_5 = Dispatch(List=graft(repeat_2), DispatchPattern=graft(equals_2.Equality))  # -> ListA, ListB
dispatch_6 = Dispatch(List=graft(repeat), DispatchPattern=graft(equals_2.Equality))  # -> ListA, ListB
merge_2 = Merge(Data1=dispatch_5.ListA, Data2=dispatch_6.ListB)  # -> flatten(Result)

crv_3 = Curve(crv)
deplane_2 = DeconstructPlane(Plane=pl_4)  # -> Origin, XAxis, YAxis, ZAxis
amp_2 = Amplitude(Vector=deplane_2.YAxis, Amplitude=Slider(3000, range=0..10000))
move_2 = Move(Geometry=deplane_2.Origin, Motion=amp_2)  # -> Geometry, Transform
clscrv_2 = CloseCurve(Curve=crv_3, CloseType=0, Bulge=0.5, Tolerance=0)  # -> Closed, R
pt_14 = Point(move_2.Geometry)
incurve_3 = PointInCurve(Point=pt_14, Curve=clscrv_2.Closed)  # -> Relationship, Point
equals_3 = Equality(FirstNumber=incurve_3.Relationship, SecondNumber="2")  # -> Equality, Inequality
lng_3 = ListLength(List=equals_3.Equality)
neg_2 = Negative(Value=dim_offset_1)
lng_4 = ListLength(List=equals_3.Equality)
repeat_3 = RepeatData(Data=graft(neg_2), Length=lng_4)
repeat_4 = RepeatData(Data=graft(dim_offset_1), Length=lng_3)
panel_2 = Panel(equals_3.Equality)
dispatch_7 = Dispatch(List=graft(repeat_4), DispatchPattern=graft(equals_3.Equality))  # -> ListA, ListB
dispatch_8 = Dispatch(List=graft(repeat_3), DispatchPattern=graft(equals_3.Equality))  # -> ListA, ListB
merge_3 = Merge(Data1=dispatch_7.ListA, Data2=dispatch_8.ListB)  # -> flatten(Result)

crv_4 = Curve(crv)
deplane_3 = DeconstructPlane(Plane=pl)  # -> Origin, XAxis, YAxis, ZAxis
amp_3 = Amplitude(Vector=deplane_3.YAxis, Amplitude=Slider(3000, range=0..10000))
move_3 = Move(Geometry=deplane_3.Origin, Motion=amp_3)  # -> Geometry, Transform
clscrv_3 = CloseCurve(Curve=crv_4, CloseType=0, Bulge=0.5, Tolerance=0)  # -> Closed, R
pt_15 = Point(move_3.Geometry)
incurve_4 = PointInCurve(Point=pt_15, Curve=clscrv_3.Closed)  # -> Relationship, Point
equals_4 = Equality(FirstNumber=incurve_4.Relationship, SecondNumber="2")  # -> Equality, Inequality
lng_5 = ListLength(List=equals_4.Equality)
neg_3 = Negative(Value=dim_offset_2)
lng_6 = ListLength(List=equals_4.Equality)
repeat_5 = RepeatData(Data=graft(neg_3), Length=lng_6)
repeat_6 = RepeatData(Data=graft(dim_offset_2), Length=lng_5)
panel_3 = Panel(equals_4.Equality)
dispatch_9 = Dispatch(List=graft(repeat_6), DispatchPattern=graft(equals_4.Equality))  # -> ListA, ListB
dispatch_10 = Dispatch(List=graft(repeat_5), DispatchPattern=graft(equals_4.Equality))  # -> ListA, ListB
merge_4 = Merge(Data1=dispatch_9.ListA, Data2=dispatch_10.ListB)  # -> flatten(Result)

crv_5 = Curve(crv)
deplane_4 = DeconstructPlane(Plane=pl_2)  # -> Origin, XAxis, YAxis, ZAxis
amp_4 = Amplitude(Vector=deplane_4.YAxis, Amplitude=Slider(3000, range=0..10000))
move_4 = Move(Geometry=deplane_4.Origin, Motion=amp_4)  # -> Geometry, Transform
clscrv_4 = CloseCurve(Curve=crv_5, CloseType=0, Bulge=0.5, Tolerance=0)  # -> Closed, R
pt_16 = Point(move_4.Geometry)
incurve_5 = PointInCurve(Point=pt_16, Curve=clscrv_4.Closed)  # -> Relationship, Point
equals_5 = Equality(FirstNumber=incurve_5.Relationship, SecondNumber="2")  # -> Equality, Inequality
lng_7 = ListLength(List=equals_5.Equality)
neg_4 = Negative(Value=dim_offset_2)
lng_8 = ListLength(List=equals_5.Equality)
repeat_7 = RepeatData(Data=graft(neg_4), Length=lng_8)
repeat_8 = RepeatData(Data=graft(dim_offset_2), Length=lng_7)
panel_4 = Panel(equals_5.Equality)
dispatch_11 = Dispatch(List=graft(repeat_8), DispatchPattern=graft(equals_5.Equality))  # -> ListA, ListB
dispatch_12 = Dispatch(List=graft(repeat_7), DispatchPattern=graft(equals_5.Equality))  # -> ListA, ListB
merge_5 = Merge(Data1=dispatch_11.ListA, Data2=dispatch_12.ListB)  # -> flatten(Result)

lineardim = DefineLinearDimension(
    Point1=simplify(pt_12),
    Point2=simplify(pt_11),
    DimensionPlane=simplify(pl_3),
    Offset=expr("-x", merge_2),
    DimensionStyle=dim_style)
lineardim_2 = DefineLinearDimension(
    Point1=simplify(pt_12),
    Point2=simplify(pt_11),
    DimensionPlane=simplify(pl_4),
    Offset=expr("-x", merge_3),
    DimensionStyle=dim_style)
lineardim_3 = DefineLinearDimension(
    Point1=simplify(pt_10),
    Point2=simplify(pt_9),
    DimensionPlane=simplify(pl),
    Offset=expr("-x", merge_4),
    DimensionStyle=dim_style)
lineardim_4 = DefineLinearDimension(
    Point1=simplify(pt_10),
    Point2=simplify(pt_9),
    DimensionPlane=simplify(pl_2),
    Offset=expr("-x", merge_5),
    DimensionStyle=dim_style)
D = ClusterOutput(lineardim)
D_2 = ClusterOutput(lineardim_2)
D_3 = ClusterOutput(lineardim_3)
D_4 = ClusterOutput(lineardim_4)

# ==== cluster Cluster_3
structure_number = ClusterInput()
tag_text = ClusterInput()
text_offset = ClusterInput()
embed_color = ClusterInput()
T = ClusterInput()
G = ClusterInput()
A = ClusterInput()
A_2 = ClusterInput()
B = ClusterInput()
dimension_style = ClusterInput()

# ----
# 列表文字以空格进行分割
panel = Panel(" ")
split = TextSplit(Text=T, Separators=panel)

钢埋板长度_2 = Division(A=A, B=2)
neg = Negative(Value=钢埋板长度_2)
dom = ConstructDomain(DomainStart=neg, DomainEnd=钢埋板长度_2)
panel_2 = Panel(dom)

钢埋板厚度_2 = Division(A=A_2, B=2)
neg_2 = Negative(Value=钢埋板厚度_2)
dom_2 = ConstructDomain(DomainStart=neg_2, DomainEnd=钢埋板厚度_2)
panel_3 = Panel(dom_2)

# ----
# 钢埋板肋板位置 1/4处
panel_4 = Panel("4")
division = Division(A=A, B=panel_4)

# ----
# 编号和截面尺寸分区
panel_5 = Panel("1")
split_2 = SplitList(List=split, Index=panel_5)  # -> flatten(ListA), flatten(ListB)

# ----
# 求出对应输入编号的钢结构截面尺寸
fsim = FindSimilarMember(Data=structure_number, Set=split_2.ListA)  # -> Hit, Index
item = ListItem(List=split_2.ListB, Index=fsim.Index, Wrap=True)

addition = Addition(A=neg_2, B=division)
addition_2 = Addition(A=钢埋板厚度_2, B=division)
dom_3 = ConstructDomain(DomainStart=addition, DomainEnd=addition_2)
panel_6 = Panel(split_2.ListB)
split_3 = TextSplit(Text=item, Separators="x")
split_4 = TextSplit(Text=split_3, Separators="Q")
item_2 = ListItem(List=split_4, Index="0", Wrap=True)  # -> flatten(Item)
subtraction = Subtraction(A=division, B=钢埋板厚度_2)
subtraction_2 = Subtraction(A=division, B=钢埋板厚度_2)
subtraction_3 = Subtraction(A=division, B=钢埋板厚度_2)
neg_3 = Negative(Value=钢埋板厚度_2)
neg_4 = Negative(Value=钢埋板厚度_2)
neg_5 = Negative(Value=钢埋板厚度_2)
subtraction_4 = Subtraction(A=division, B=钢埋板厚度_2)
addition_3 = Addition(A=subtraction, B=A_2)
addition_4 = Addition(A=subtraction_2, B=A_2)
subtraction_5 = Subtraction(A=neg_3, B=A_2)
subtraction_6 = Subtraction(A=neg_4, B="2")
subtraction_7 = Subtraction(A=division, B=钢埋板厚度_2)
addition_5 = Addition(A=subtraction_3, B="2")
subtraction_8 = Subtraction(A=neg_5, B="2")
neg_6 = Negative(Value=钢埋板厚度_2)
neg_7 = Negative(Value=钢埋板厚度_2)
工字钢_h = ListItem(List=item_2, Index=0, Wrap=True)
工字钢_b = ListItem(List=item_2, Index=1, Wrap=True)
工字钢_tf = ListItem(List=item_2, Index=3, Wrap=True)
工字钢_tw = ListItem(List=item_2, Index=2, Wrap=True)
pt = ConstructPoint(XCoordinate=neg_6, YCoordinate=subtraction_4, ZCoordinate=0)
pt_2 = ConstructPoint(XCoordinate=neg_7, YCoordinate=addition_3, ZCoordinate=0)
pt_3 = ConstructPoint(XCoordinate=subtraction_5, YCoordinate=addition_4, ZCoordinate=0)
pt_4 = ConstructPoint(XCoordinate=subtraction_6, YCoordinate=subtraction_7, ZCoordinate=0)
pt_5 = ConstructPoint(XCoordinate=subtraction_8, YCoordinate=addition_5, ZCoordinate=0)
subtraction_9 = Subtraction(A=工字钢_b, B=工字钢_tw)
division_2 = Division(A=subtraction_9, B="2")
merge = Merge(Data1=pt, Data2=pt_2, Data3=pt_3, Data4=pt_5, Data5=pt_4)
pline = PolyLine(Vertices=merge, Closed=True)
division_3 = Division(A=division_2, B="2")
subtraction_10 = Subtraction(A=division_3, B=A_2)
subtraction_11 = Subtraction(A=division_3, B=钢埋板厚度_2)
neg_8 = Negative(Value=division_3)
subtraction_12 = Subtraction(A=neg_8, B=subtraction_11)
addition_6 = Addition(A=subtraction_12, B=B)
dom_4 = ConstructDomain(DomainStart=addition_6, DomainEnd=subtraction_12)
dom_5 = ConstructDomain(DomainStart=addition, DomainEnd=addition_2)
钢肋板倒角_侧视图 = Rectangle(Plane=PlaneXY(0, 0, 0), XSize=dom_4, YSize=dom_5, Radius=0)  # -> Rectangle, Length
subtraction_13 = Subtraction(A=subtraction_10, B=subtraction_11)
subtraction_14 = Subtraction(A=neg_8, B=subtraction_11)
dom_6 = ConstructDomain(DomainStart=subtraction_13, DomainEnd=subtraction_14)
钢肋板_侧视图 = Rectangle(Plane=PlaneXY(0, 0, 0), XSize=dom_6, YSize=dom_3, Radius=0)  # -> Rectangle, Length
merge_2 = Merge(Data1=钢肋板_侧视图.Rectangle, Data2=pline, Data3=钢肋板倒角_侧视图.Rectangle)
xz = XZPlane(Origin=Point(0, 0, 0))
mirror = Mirror(Geometry=merge_2, Plane=xz)  # -> Geometry, Transform
钢埋板_侧视图 = Rectangle(Plane=PlaneXY(0, 0, 0), XSize=dom_2, YSize=dom, Radius=0)  # -> Rectangle, Length
division_4 = Division(A=工字钢_b, B=2)
侧视图 = Entwine(Branch00=钢埋板_侧视图.Rectangle, Branch01=merge_2, Branch02=mirror.Geometry, FlattenInputs=True)
R = ClusterOutput(division_4)
division_5 = Division(A=工字钢_h, B="2")
subtraction_15 = Subtraction(A=division_5, B=工字钢_tf)
addition_7 = Addition(A=subtraction_15, B=Slider(200, range=0..1000))
addition_8 = Addition(A=addition_7, B=division_2)
X = UnitX(Factor=addition_8)
move = Move(Geometry=侧视图, Motion=X)  # -> Geometry, Transform
split_tree = SplitTree(Data=move.Geometry, Masks=flatten("{0;0}"))  # -> Positive, Negative
dispatch = Dispatch(List=split_tree.Negative, DispatchPattern=[True, False])  # -> flatten(ListA), ListB
merge_3 = Merge(Data1=split_tree.Positive, Data2=dispatch.ListA)
entwine = Entwine(Branch00=merge_3, Branch01=dispatch.ListB, FlattenInputs=True)
flatten = FlattenTree(Tree=entwine, Path="{0}")
group = Group(Objects=flatten)
rotate = Rotate(Geometry=group, Angle=3.141592654, Plane=PlaneXY(0, 0, 0))  # -> Geometry, Transform
boxprop = BoxProperties(Box=rotate.Geometry)  # -> Center, Diagonal, Area, Volume, Degeneracy
bbox = BoundingBox(Content=rotate.Geometry, Plane=PlaneXY(0, 0, 0))  # -> Box, Box_2
debox = DeconstructBox(Box=bbox.Box)  # -> Plane, X, Y, Z
pdecon = Deconstruct(Point=boxprop.Center)  # -> XComponent, YComponent, ZComponent
dedomain = DeconstructDomain(Domain=debox.Y)  # -> Start, End
pt_6 = ConstructPoint(XCoordinate=pdecon.XComponent, YCoordinate=dedomain.Start, ZCoordinate=pdecon.ZComponent)
xy = XYPlane(Origin=Point(0, 0, 0))
concat = Concatenate(FragmentA="Embed", FragmentB=tag_text)
pl_origin = PlaneOrigin(Base=xy, Origin=pt_6)
orient = Orient(Geometry=rotate.Geometry, Source=pl_origin, Target=xy)  # -> Geometry, Transform
xy_2 = XYPlane(Origin=Point(0, 0, 0))
attributes = DefineObjectAttributes(Color=embed_color)
ungroup = Ungroup(Group=orient.Geometry)
block = DefineBlock(Geometry=ungroup, Attributes=attributes, BlockName=concat, BasePlane=PlaneXY(0, 0, 0))
deblock = DeconstructBlock(Block=block)  # -> Name, flatten(Plane), flatten(Geometry)
group_2 = Group(Objects=deblock.Geometry)
bbox_2 = BoundingBox(Content=group_2, Plane=PlaneXY(0, 0, 0))  # -> Box, Box_2
deplane = DeconstructPlane(Plane=deblock.Plane)  # -> Origin, XAxis, YAxis, ZAxis
area = Area(Geometry=bbox_2.Box)  # -> Area, Centroid
move2pt = MoveToPoint(Geometry=flatten(deplane.Origin), PointA=flatten(deplane.Origin), PointB=flatten(area.Centroid))  # -> Moved, Vector, Transform
pl = ConstructPlane(Origin=move2pt.Moved, XAxis=deplane.YAxis, YAxis=deplane.XAxis)  # -> graft(Plane)
deplane_2 = DeconstructPlane(Plane=pl)  # -> Origin, XAxis, YAxis, ZAxis
rotate_2 = Rotate(Geometry=pl, Angle="Pi", Plane=pl)  # -> Geometry, Transform
dedomain_2 = DeconstructDomain(Domain=dom)  # -> Start, End
multiplication = Multiplication(A=dedomain_2.Start, B=dedomain_2.Start)
amp = Amplitude(Vector=deplane_2.YAxis, Amplitude=multiplication)
move_2 = Move(Geometry=deplane_2.Origin, Motion=amp)  # -> Geometry, Transform
srf = Surface(bbox_2.Box)
crv = Curve(srf)
ln = Line(StartPoint=move_2.Geometry, EndPoint=deplane_2.Origin)
ccx = CurveCurve(CurveA=ln, CurveB=crv)  # -> Points, ParamsA, ParamsB
ln_2 = Line(StartPoint=deplane_2.Origin, EndPoint=ccx.Points)
move_3 = Move(Geometry=rotate_2.Geometry, Motion=ln_2)  # -> Geometry, Transform

ln_3 = Line(StartPoint=ccx.Points, EndPoint=deplane_2.Origin)
amp_2 = Amplitude(Vector=ln_3, Amplitude=text_offset)
move_4 = Move(Geometry=rotate_2.Geometry, Motion=amp_2)  # -> Geometry, Transform
text = DefineTextObject(Text=tag_text, Plane=move_4.Geometry, DimensionStyle=dimension_style, OutputType="Text")
group_3 = Group(Objects=[block, text])

entwine_2 = Entwine(Branch00=group_3, Branch01=move_3.Geometry, FlattenInputs=True)
project = Project(Geometry=G, Plane=xy_2)  # -> Geometry, Transform
R_2 = ClusterOutput(entwine_2)
G_2 = ClusterOutput(project.Geometry)
