# Grasshopper definition FacadeEmbed_jinqiao.gh (Grasshopper 1.0.7)
# plug-ins: EleFront, Wombat, Hare

# ---- group: 钢结构预埋
crv = Curve([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])

# ---- group: 板槽
inblock = InsertBlock(BlockName="xxx", SourcePlane=PlaneXY(0, 0, 0))

# ---- group: 锚筋间距
s_x = Slider(25, range=14..60, expression="X*5")
s_y = Slider(20, range=14..60, expression="X*5")

s_x_2 = Slider(25, range=14..60, expression="X*5")
s_y_2 = Slider(20, range=14..60, expression="X*5")

# ----
# 单体选型
list = ValueList({"板埋": 0, "槽埋": 1, "板槽": 2, "钢板槽": 3}, selected="板槽")
list_2 = ValueList({"顶埋": 0, "侧埋": 1}, selected="顶埋")
panel = Panel(list)
panel_2 = Panel(list_2)

# ---- group: 螺栓直径
list_3 = ValueList({"10": 0, "12": 1, "16": 2, "18": 3, "20": 4, "25": 5}, selected="16")

# ---- group: 锚筋直径
list_4 = ValueList({"10": 0, "12": 1, "16": 2, "18": 3, "20": 4, "25": 5}, selected="12")

# ---- group: 列
list_5 = ValueList({"2X": 0, "3X": 1, "4X": 2}, selected="3X")

# ---- group: 行
list_6 = ValueList({"2Y": 0, "3Y": 1, "4Y": 2}, selected="2Y")

# ---- group: 螺栓直径
list_7 = ValueList({"10": 0, "12": 1, "16": 2, "18": 3, "20": 4, "25": 5}, selected="16")

# ---- group: 锚筋直径
list_8 = ValueList({"10": 0, "12": 1, "16": 2, "18": 3, "20": 4, "25": 5}, selected="12")

# ---- group: 列
list_9 = ValueList({"2X": 0, "3X": 1, "4X": 2}, selected="3X")

# ---- group: 行
list_10 = ValueList({"2Y": 0, "3Y": 1, "4Y": 2}, selected="2Y")

# ---- group: 混凝土
# 板埋几何INPUT
list_11 = ValueList({"C15": 0, "C20": 1, "C25": 2, "C30": 3, "C35": 4, "C40": 5}, selected="C35")

# ---- group: 钢筋牌号
list_12 = ValueList({"HPB300": 0, "HRB400": 1}, selected="HPB300")

# ---- group: 直径
list_13 = ValueList({"10": 0, "12": 1, "16": 2, "18": 3, "20": 4, "25": 5}, selected="12")

# ---- group: 列
list_14 = ValueList({"2X": 0, "3X": 1, "4X": 2}, selected="3X")

# ---- group: 行
list_15 = ValueList({"2Y": 0, "3Y": 1, "4Y": 2}, selected="2Y")

# ---- group: 锚筋间距
s_x_3 = Slider(22, range=14..60, expression="X*5")
s_y_3 = Slider(22, range=14..60, expression="X*5")

# ---- group: 结构线
crv_2 = Curve(<curve referenced from the Rhino model>)

# ----
# 平面定位INPUT
玻璃线 = Curve(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)

# ---- group: 定位竖料
crv_3 = Curve([<curve referenced from the Rhino model> x383])

# ---- group: 结构线
crv_4 = Curve(<curve referenced from the Rhino model>)

# ----
# 平面定位INPUT
number_slider = Slider(341, range=0..1000)

# ----
# beam lines
crv_5 = Curve(<curve referenced from the Rhino model>)

crv_6 = Curve([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])

# ----
# arch lines
crv_7 = Curve(<curve referenced from the Rhino model>)

# ----
# 槽埋-角部选择
list_16 = ValueList({"槽埋角部-L形": 0, "槽埋角部-I形": 1}, selected="槽埋角部-I形")

flip = FlipCurve(Curve=crv_5)  # -> Curve, Flag
filter = StreamFilter(Gate=Toggle(False), Stream0=crv_5, Stream1=flip.Curve)
join = JoinCurves(Curves=crv_6, Preserve=False)
flip_2 = FlipCurve(Curve=crv_7)  # -> Curve, Flag
flip_3 = FlipCurve(Curve=玻璃线)  # -> Curve, Flag
boundary = BoundarySurfaces(Edges=join)
offset = OffsetCurve(Curve=filter, Distance=Slider(100, range=0..100), Corners=1)
filter_2 = StreamFilter(Gate=Toggle(False), Stream0=crv_7, Stream1=flip_2.Curve)
filter_3 = StreamFilter(Gate=Toggle(True), Stream0=玻璃线, Stream1=flip_3.Curve)
disc = Discontinuity(Curve=crv_7, Level=1)  # -> Points, Parameters
sunion = SolidUnion(Breps=boundary)
disc_2 = Discontinuity(Curve=offset, Level=1)  # -> Points, Parameters
offset_2 = OffsetCurve(Curve=filter_3, Distance=expr("-x", Slider(375, range=0..1000)), Corners=1)
offset_3 = OffsetCurve(Curve=filter_2, Distance=expr("-x", number_slider), Corners=1)
area = Area(Geometry=sunion)  # -> Area, Centroid
pt = Point(disc.Points)

# ---- group: 钢结构预埋
# 随文件数据请勿覆盖
crv_8 = Curve([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])

# ---- group: 槽埋3D
brep = Brep(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)

# ----
pt_2 = Point(area.Centroid)
explode = Explode(Curve=offset_2, Recursive=True)  # -> Segments, Vertices
disc_3 = Discontinuity(Curve=offset_3, Level=1)  # -> Points, Parameters
pull = PullPoint(Point=pt, Geometry=disc_2.Points, ClosestOnly=True)  # -> ClosestPoint, Distance
entwine = Entwine(Branch00=pt, Branch01=pull.ClosestPoint, FlattenInputs=True)
flip_4 = FlipMatrix(Data=entwine)

# ----
# column lines
crv_9 = Curve([<curve referenced from the Rhino model> x16])

max = Maximum(A=s_x_3, B=s_y_3)
item = ListItem(List=flip_4, Index="0", Wrap=True)  # -> flatten(Item)
crv_cp = CurveClosestPoint(Point=item, Curve=offset_3)  # -> Point, Parameter, Distance
c_script = CSharpScript(archPoint=crv_cp.Point, crvPoint=disc_3.Points)  # -> out, specialPt; inputs archPoint: list of Point3d, crvPoint: list of Point3d
# ---------- c_script: C# ----------
    List<int> passIndex = new List<int>();

    for(int i = 0; i < archPoint.Count; i++){
      foreach(Point3d t in crvPoint){
        if(archPoint[i].X == t.X && archPoint[i].Y == t.Y && archPoint[i].Z == t.Z){
          Print("pass");
          passIndex.Add(i);}
      }
    }

    specialPt = passIndex;
# ---------- end c_script ----------
pt_3 = Point(explode.Vertices)
entwine_2 = Entwine(Branch00=sunion, Branch01=pt_2, FlattenInputs=True)
filter_4 = StreamFilter(Gate=list_11, Stream0=7.2, Stream1=9.6, Stream2=11.9, Stream3=14.3, Stream4=16.7, Stream5=19.1)
filter_5 = StreamFilter(Gate=list_12, Stream0=270, Stream1=360)
filter_6 = StreamFilter(Gate=list_13, Stream0=10, Stream1=12, Stream2=16, Stream3=18, Stream4=20, Stream5=25)
filter_7 = StreamFilter(Gate=list_11, Stream0=0.91, Stream1=1.1, Stream2=1.27, Stream3=1.43, Stream4=1.57, Stream5=1.71)
filter_8 = StreamFilter(Gate=list_12, Stream0=0.16, Stream1=0.14)

# ----
# board lines
crv_10 = Curve(<curve referenced from the Rhino model>)

addition = Addition(A=list_14, B=1)
addition_2 = Addition(A=list_15, B=1)
division = Division(A=max, B=8)
item_2 = ListItem(List=flip_4, Index="1", Wrap=True)  # -> flatten(Item)
flip_5 = FlipMatrix(Data=entwine_2)
disc_4 = Discontinuity(Curve=crv_9, Level=1)  # -> Points, Parameters
disc_5 = Discontinuity(Curve=crv_10, Level=1)  # -> Points, Parameters
t = Integer(division)
panel_3 = Panel(filter_7)
panel_4 = Panel(filter_4)
cull_i = CullIndex(List=item, Indices=c_script.specialPt, Wrap=True)
panel_5 = Panel(filter_8)
item_3 = ListItem(List=item, Index=c_script.specialPt, Wrap=True)
min = Minimum(A=filter_5, B=300)

# ---- group: 建筑定位轮廓
item_4 = ListItem(List=flip_5, Index="0", Wrap=True)  # -> flatten(Item)

# ---- group: 埋件定位点
item_5 = ListItem(List=flip_5, Index="-1", Wrap=True)  # -> flatten(Item)

# ----
cull_i_2 = CullIndex(List=item_2, Indices=c_script.specialPt, Wrap=True)
brep_2 = Brep(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)
shift = ShiftList(List=item_3, Shift="1", Wrap=True)
pull_2 = PullPoint(Point=item, Geometry=disc_5.Points, ClosestOnly=True)  # -> ClosestPoint, Distance
panel_6 = Panel(min)
pt_4 = Point(cull_i_2)
item_6 = ListItem(List=cull_i, Index=0, Wrap=True)
item_7 = ListItem(List=item_3, Index=0, Wrap=True)
item_8 = ListItem(List=shift, Index=0, Wrap=True)
item_9 = ListItem(List=pull_2.ClosestPoint, Index=Slider(10, range=0..10), Wrap=True)
pt_5 = Point(graft(cull_i))
pt_6 = Point(graft(item_3))
pt_7 = Point(graft(shift))
ln = Line(StartPoint=pt_6, EndPoint=pt_5)
expression = Expression(A=filter_8, fy=filter_5, ft=filter_7, d=filter_6, Expression="(int((0.6*1.1*A*fy/ft*d)/5)+1)*5")
ln_2 = Line(StartPoint=pt_7, EndPoint=pt_5)
angle = Angle(VectorA=ln_2, VectorB=ln)  # -> flatten(Angle), Reflex
deg = Degrees(Radians=angle.Angle)
larger = LargerThan(FirstNumber=deg, SecondNumber="96")  # -> LargerThan, OrEqualTo
dispatch = Dispatch(List=flatten(pt_4), DispatchPattern=larger.LargerThan)  # -> ListA, ListB
pt_8 = Point(dispatch.ListA)
pt_9 = Point(dispatch.ListB)
dispatch_2 = Dispatch(List=flatten(pt_5), DispatchPattern=larger.LargerThan)  # -> ListA, ListB
pt_10 = Point(dispatch_2.ListA)
pt_11 = Point(dispatch_2.ListB)
panel_7 = Panel(deg)

# ----
# 导入槽埋模型
brep_3 = Brep(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)

# ---- group: 槽埋
# 槽埋Modeling
brep_4 = Brep(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)
bbox = BoundingBox(Content=brep_3, Plane=PlaneXY(0, 0, 0))  # -> Box, Box_2
debox = DeconstructBox(Box=bbox.Box)  # -> Plane, X, Y, Z
area_2 = Area(Geometry=brep_3)  # -> Area, Centroid
pdecon = Deconstruct(Point=area_2.Centroid)  # -> XComponent, YComponent, ZComponent
dedomain = DeconstructDomain(Domain=debox.Z)  # -> Start, End
xy = XYPlane(Origin=Point(0, 0, 0))
pt_12 = ConstructPoint(XCoordinate=pdecon.XComponent, YCoordinate=pdecon.YComponent, ZCoordinate=dedomain.End)
pl_origin = PlaneOrigin(Base=xy, Origin=pt_12)
xy_2 = XYPlane(Origin=Point(0, 0, 0))
orient = Orient(Geometry=brep_3, Source=pl_origin, Target=xy_2)  # -> Geometry, Transform

# ----
edges = BrepEdges(Brep=bbox.Box)  # -> Naked, Interior, NonManifold
item_10 = ListItem(List=edges.Interior, Index="5", Wrap=True)
item_11 = ListItem(List=edges.Interior, Index="4", Wrap=True)
clx = CurveLine(Curve=item_11, Line=item_10)  # -> Points, Params, Count
Y = UnitY(Factor=item_10)
rotate = Rotate(Geometry=brep_3, Angle=1.570796327, Plane=clx.Points)  # -> Geometry, Transform
move = Move(Geometry=rotate.Geometry, Motion=Y)  # -> Geometry, Transform
merge = Merge(Data1=brep_3, Data2=move.Geometry)  # -> flatten(Result)
sunion_2 = SolidUnion(Breps=merge)
bbox_2 = BoundingBox(Content=sunion_2, Plane=PlaneXY(0, 0, 0))  # -> Box, Box_2
area_3 = Area(Geometry=sunion_2)  # -> Area, Centroid
debox_2 = DeconstructBox(Box=bbox_2.Box)  # -> Plane, X, Y, Z
pdecon_2 = Deconstruct(Point=area_3.Centroid)  # -> XComponent, YComponent, ZComponent
dedomain_2 = DeconstructDomain(Domain=debox_2.Z)  # -> Start, End
pt_13 = ConstructPoint(XCoordinate=pdecon_2.XComponent, YCoordinate=pdecon_2.YComponent, ZCoordinate=dedomain_2.End)
xy_3 = XYPlane(Origin=Point(0, 0, 0))
pl_origin_2 = PlaneOrigin(Base=xy_3, Origin=pt_13)
xy_4 = XYPlane(Origin=Point(0, 0, 0))
orient_2 = Orient(Geometry=sunion_2, Source=pl_origin_2, Target=xy_4)  # -> Geometry, Transform

filter_9 = StreamFilter(Gate=list_16, Stream0=orient_2.Geometry, Stream1=orient.Geometry)
entwine_3 = Entwine(Branch00=orient.Geometry, Branch01=filter_9, FlattenInputs=True)
crv_11 = Curve(offset_2)
crv_12 = Curve([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])
crv_13 = Curve(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)
merge_2 = Merge(Data1=crv_12, Data2=crv_13)

锚筋末端焊板厚度 = Slider(12, range=0..100)
锚筋长度 = Slider(12, range=0..30, expression="x*10")
锚筋末端焊板边长 = Slider(40, range=0..100)
锚板厚度 = Slider(12, range=0..100)
槽长 = Slider(270, range=0..1000)
value_list = ValueList({"锚筋": 0, "锚焊": 1}, selected="锚焊")
锚筋到边 = Panel("75")
curve = Curve(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)
subtraction = Subtraction(A=锚筋长度, B=锚板厚度)
filter_10 = StreamFilter(Gate=list_4, Stream0=10, Stream1=12, Stream2=16, Stream3=18, Stream4=20, Stream5=25)
filter_11 = StreamFilter(Gate=list_3, Stream0=10, Stream1=12, Stream2=16, Stream3=18, Stream4=20, Stream5=25)
addition_3 = Addition(A=list_6, B=1)
addition_4 = Addition(A=list_5, B=1)

yz_plane = YZPlane(Origin=Point(0, 0, 0))
orient_3 = Orient(Geometry=curve, Source=PlaneXY(0, 0, 0), Target=yz_plane)  # -> Geometry, Transform
unit_x = UnitX(Factor=槽长)
division_2 = Division(A=槽长, B=2)
extrude = Extrude(Base=orient_3.Geometry, Direction=unit_x)
unit_x_2 = UnitX(Factor=division_2)
move_2 = Move(Geometry=extrude, Motion=expr("-x", unit_x_2))  # -> Geometry, Transform
cap_holes = CapHoles(Brep=move_2.Geometry)

锚筋末端焊板厚度_2 = Slider(12, range=0..100)
锚筋长度_2 = Slider(12, range=0..30, expression="x*10")
锚筋末端焊板边长_2 = Slider(40, range=0..100)
锚板厚度_2 = Slider(12, range=0..100)
板凳厚度 = Slider(16, range=0..100)
槽长_2 = Slider(270, range=0..1000)
value_list_2 = ValueList({"锚筋": 0, "锚焊": 1}, selected="锚焊")
锚筋到边_2 = Panel("75")
list_17 = ValueList({"板埋": 0, "槽埋": 1}, selected="板埋")
list_18 = ValueList({"顶埋": 0, "侧埋": 1}, selected="顶埋")
curve_2 = Curve(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)
subtraction_2 = Subtraction(A=锚筋长度_2, B=锚板厚度_2)
filter_12 = StreamFilter(Gate=list_8, Stream0=10, Stream1=12, Stream2=16, Stream3=18, Stream4=20, Stream5=25)
filter_13 = StreamFilter(Gate=list_7, Stream0=10, Stream1=12, Stream2=16, Stream3=18, Stream4=20, Stream5=25)
addition_5 = Addition(A=list_10, B=1)
addition_6 = Addition(A=list_9, B=1)

# ----
# 钢板槽Modeling
recgrid = Rectangular(Plane=PlaneXY(0, 0, 0), SizeX=s_x_2, SizeY=s_y_2, ExtentX=addition_6, ExtentY=addition_5)  # -> Cells, Points
multiplication = Multiplication(A=s_x_2, B=addition_6)
multiplication_2 = Multiplication(A=s_y_2, B=addition_5)
division_3 = Division(A=multiplication, B=2)
division_4 = Division(A=multiplication_2, B=2)
vec = VectorXYZ(XComponent=expr("-x", division_3), YComponent=expr("-x", division_4), ZComponent=0)  # -> Vector, Length
division_5 = Division(A=filter_12, B=2)
move_3 = Move(Geometry=recgrid.Points, Motion=vec.Vector)  # -> Geometry, Transform
multiplication_3 = Multiplication(A=division_5, B=2)
yz_plane_2 = YZPlane(Origin=Point(0, 0, 0))
orient_4 = Orient(Geometry=curve_2, Source=PlaneXY(0, 0, 0), Target=yz_plane_2)  # -> Geometry, Transform
divide_curve = DivideCurve(Curve=orient_4.Geometry, Count=Slider(50, range=0..100), Kinks=False)  # -> Points, Tangents, Parameters
unit_x_3 = UnitX(Factor=槽长_2)
division_6 = Division(A=槽长_2, B=2)
extrude_2 = Extrude(Base=orient_4.Geometry, Direction=unit_x_3)
unit_x_4 = UnitX(Factor=division_6)
convex_hull = ConvexHull(Points=divide_curve.Points, Plane=yz_plane_2)  # -> Hull, HullZ, Indices
move_4 = Move(Geometry=extrude_2, Motion=expr("-x", unit_x_4))  # -> Geometry, Transform
boundary_surfaces = BoundarySurfaces(Edges=convex_hull.Hull)
multiplication_4 = Multiplication(A=Slider(10, range=0..100), B=2)
subtraction_3 = Subtraction(A=槽长_2, B=multiplication_4)
unit_z = UnitZ(Factor=expr("-X", subtraction_2))
cap_holes_2 = CapHoles(Brep=move_4.Geometry)
unit_x_5 = UnitX(Factor=subtraction_3)
extrude_3 = Extrude(Base=boundary_surfaces, Direction=unit_x_5)
division_7 = Division(A=unit_x_5, B=2)
extrude_4 = Extrude(Base=boundary_surfaces, Direction=unit_x_3)
move_5 = Move(Geometry=extrude_3, Motion=expr("-x", division_7))  # -> Geometry, Transform
move_6 = Move(Geometry=extrude_4, Motion=expr("-x", unit_x_4))  # -> Geometry, Transform
solid_difference = SolidDifference(BrepsA=move_6.Geometry, BrepsB=move_5.Geometry)
Z = UnitZ(Factor=expr("-x", 锚板厚度_2))
xy_plane = XYPlane(Origin=Point(0, 0, 0))
deconstruct_plane = DeconstructPlane(Plane=xy_plane)  # -> Origin, XAxis, YAxis, ZAxis

multiplication_5 = Multiplication(A=multiplication_3, B=6)
max_2 = Maximum(A=multiplication_5, B=70)
multiplication_6 = Multiplication(A=锚筋到边_2, B=2)
addition_7 = Addition(A=multiplication, B=multiplication_6)
addition_8 = Addition(A=multiplication_2, B=multiplication_6)
expression_2 = Expression(x=addition_7, Expression="Ceiling(x/10)*10/2")
expression_3 = Expression(x=addition_8, Expression="Ceiling(x/10)*10/2")
dom = ConstructDomain(DomainStart=expr("-x", expression_2), DomainEnd=expression_2)
dom_2 = ConstructDomain(DomainStart=expr("-x", expression_3), DomainEnd=expression_3)
box = DomainBox(Base=PlaneXY(0, 0, 0), X=dom, Y=dom_2, Z=锚板厚度_2)

flip_matrix = FlipMatrix(Data=move_3.Geometry)
cull_first_last = CullFirstLast(List=flip_matrix)  # -> CullFirst, CullLast, CullFirstAndEnd
point = Point(cull_first_last.CullFirstAndEnd)
flip_matrix_2 = FlipMatrix(Data=point)
number_slider_2 = Slider(50, range=0..100)
polyline = PolyLine(Vertices=flip_matrix_2, Closed=False)
extend_curve = ExtendCurve(Curve=polyline, Type=0, Start=number_slider_2, End=number_slider_2)
xy_plane_2 = XYPlane(Origin=Point(0, 0, 0))
average = Average(Input=move_3.Geometry)
addition_9 = Addition(A=filter_13, B=Slider(1, range=0..1))
multiplication_7 = Multiplication(A=filter_12, B=2.5)
division_8 = Division(A=addition_9, B=2)
polyline_2 = PolyLine(Vertices=flatten(average), Closed=False)
negative = Negative(Value=division_8)
offset_curve = OffsetCurve(
    Curve=extend_curve,
    Distance=[Slider(25, range=0..100), Slider(25, range=0..100, expression="-x")],
    Plane=xy_plane_2,
    Corners=1)
circle = Circle(Plane=move_3.Geometry, Radius=multiplication_7)
shift_paths = ShiftPaths(Data=offset_curve, Offset=-1)
region_union = RegionUnion(Curves=circle)
offset_curve_2 = OffsetCurve(Curve=polyline_2, Distance=[division_8, negative], Plane=xy_plane_2, Corners=1)
boundary_surfaces_2 = BoundarySurfaces(Edges=region_union)
loft = Loft(Curves=shift_paths, Options={Adjust=False, Closed=False, LoftEnds=0, LoftSimp=0, LoftType=0, Rebuild=10, Refit=0.01})
trim_with_regions = TrimWithRegions(Curve=offset_curve_2, Regions=flatten(boundary_surfaces_2))  # -> Inside, Outside
trim_with_regions_2 = TrimWithRegions(Curve=trim_with_regions.Outside, Regions=flatten(loft))  # -> Inside, Outside
curve_3 = Curve(trim_with_regions_2.Outside)
flip_matrix_3 = FlipMatrix(Data=curve_3)
loft_2 = Loft(Curves=flip_matrix_3, Options={Adjust=False, Closed=False, LoftEnds=0, LoftSimp=0, LoftType=0, Rebuild=10, Refit=0.01})
length = Length(Curve=flip_matrix_3)  # -> flatten(Length)
brep_edges = BrepEdges(Brep=loft_2)  # -> Naked, Interior, NonManifold
max_min = MaxMin(Numbers=length)  # -> Max, MaxIndex, Min, MinIndex
join_curves = JoinCurves(Curves=brep_edges.Naked, Preserve=False)
number_slider_3 = Slider(100, range=0..100)
subtraction_4 = Subtraction(A=max_min.Min, B=filter_13)
fillet = Fillet(Curve=join_curves, Radius=division_8)
unit_z_2 = UnitZ(Factor=expr("-x", number_slider_3))
unit_z_3 = UnitZ(Factor=number_slider_3)
boundary_surfaces_3 = BoundarySurfaces(Edges=fillet)
extrude_5 = Extrude(Base=boundary_surfaces_3, Direction=[unit_z_3, unit_z_2])
solid_difference_2 = SolidDifference(BrepsA=box, BrepsB=flatten(extrude_5))

最短槽长 = Panel(subtraction_4)

subtraction_5 = Subtraction(A=expression_3, B=板凳厚度)
dom_3 = ConstructDomain(DomainStart=expr("-x", subtraction_5), DomainEnd=subtraction_5)
rectangle = Rectangle(Plane=PlaneXY(0, 0, 0), XSize=dom, YSize=dom_3, Radius=0)  # -> Rectangle, Length
rectangle_2 = Rectangle(Plane=PlaneXY(0, 0, 0), XSize=dom, YSize=dom_2, Radius=0)  # -> Rectangle, Length
region_difference = RegionDifference(CurvesA=rectangle_2.Rectangle, CurvesB=rectangle.Rectangle)
boundary_surfaces_4 = BoundarySurfaces(Edges=region_difference)
extrude_6 = Extrude(Base=boundary_surfaces_4, Direction=unit_z)
merge_3 = Merge(Data1=extrude_6, Data2=solid_difference_2, Data3=cap_holes_2, Data4=solid_difference)
flatten = FlattenTree(Tree=merge_3, Path="{0}")

move_7 = Move(Geometry=flatten, Motion=Z)  # -> Geometry, Transform
centre_point = Point(deconstruct_plane.Origin)

# ----
# 板槽Modeling
recgrid_2 = Rectangular(Plane=PlaneXY(0, 0, 0), SizeX=s_x, SizeY=s_y, ExtentX=addition_4, ExtentY=addition_3)  # -> Cells, Points
multiplication_8 = Multiplication(A=s_x, B=addition_4)
multiplication_9 = Multiplication(A=s_y, B=addition_3)
division_9 = Division(A=multiplication_8, B=2)
division_10 = Division(A=multiplication_9, B=2)
vec_2 = VectorXYZ(XComponent=expr("-x", division_9), YComponent=expr("-x", division_10), ZComponent=0)  # -> Vector, Length
move_8 = Move(Geometry=recgrid_2.Points, Motion=vec_2.Vector)  # -> Geometry, Transform
division_11 = Division(A=filter_10, B=2)
divide_curve_2 = DivideCurve(Curve=orient_3.Geometry, Count=Slider(50, range=0..100), Kinks=False)  # -> Points, Tangents, Parameters
convex_hull_2 = ConvexHull(Points=divide_curve_2.Points, Plane=yz_plane)  # -> Hull, HullZ, Indices
boundary_surfaces_5 = BoundarySurfaces(Edges=convex_hull_2.Hull)
multiplication_10 = Multiplication(A=Slider(10, range=0..100), B=2)
subtraction_6 = Subtraction(A=槽长, B=multiplication_10)
unit_x_6 = UnitX(Factor=subtraction_6)
extrude_7 = Extrude(Base=boundary_surfaces_5, Direction=unit_x_6)
division_12 = Division(A=unit_x_6, B=2)
extrude_8 = Extrude(Base=boundary_surfaces_5, Direction=unit_x)
move_9 = Move(Geometry=extrude_7, Motion=expr("-x", division_12))  # -> Geometry, Transform
move_10 = Move(Geometry=extrude_8, Motion=expr("-x", unit_x_2))  # -> Geometry, Transform
solid_difference_3 = SolidDifference(BrepsA=move_10.Geometry, BrepsB=move_9.Geometry)
Z_2 = UnitZ(Factor=expr("-x", 锚板厚度))
xy_plane_3 = XYPlane(Origin=Point(0, 0, 0))
deconstruct_plane_2 = DeconstructPlane(Plane=xy_plane_3)  # -> Origin, XAxis, YAxis, ZAxis

unit_z_4 = UnitZ(Factor=expr("x", 锚筋末端焊板厚度))
unit_z_5 = UnitZ(Factor=expr("-x", subtraction))
division_13 = Division(A=锚筋末端焊板边长, B=2)
construct_domain = ConstructDomain(DomainStart=expr("-x", division_13), DomainEnd=division_13)
move_11 = Move(Geometry=move_8.Geometry, Motion=unit_z_5)  # -> Geometry, Transform
rectangle_3 = Rectangle(Plane=move_11.Geometry, XSize=construct_domain, YSize=construct_domain, Radius=0)  # -> Rectangle, Length
extrude_9 = Extrude(Base=rectangle_3.Rectangle, Direction=unit_z_4)

multiplication_11 = Multiplication(A=division_11, B=2)
cyl = Cylinder(Base=move_8.Geometry, Radius=division_11, Length=expr("-x", subtraction))
edges_2 = BrepEdges(Brep=cyl)  # -> Naked, Interior, NonManifold
multiplication_12 = Multiplication(A=multiplication_11, B=5)
item_12 = ListItem(List=edges_2.Naked, Index=0, Wrap=True)
X = UnitX(Factor=multiplication_11)
Z_3 = UnitZ(Factor=multiplication_12)
move_12 = Move(Geometry=item_12, Motion=X)  # -> Geometry, Transform
extr = Extrude(Base=move_12.Geometry, Direction=Z_3)

multiplication_13 = Multiplication(A=multiplication_11, B=6)
max_3 = Maximum(A=multiplication_13, B=70)
multiplication_14 = Multiplication(A=锚筋到边, B=2)
addition_10 = Addition(A=multiplication_8, B=multiplication_14)
addition_11 = Addition(A=multiplication_9, B=multiplication_14)
expression_4 = Expression(x=addition_10, Expression="Ceiling(x/10)*10/2")
expression_5 = Expression(x=addition_11, Expression="Ceiling(x/10)*10/2")
dom_4 = ConstructDomain(DomainStart=expr("-x", expression_4), DomainEnd=expression_4)
dom_5 = ConstructDomain(DomainStart=expr("-x", expression_5), DomainEnd=expression_5)
box_2 = DomainBox(Base=PlaneXY(0, 0, 0), X=dom_4, Y=dom_5, Z=锚板厚度)

flip_matrix_4 = FlipMatrix(Data=move_8.Geometry)
cull_first_last_2 = CullFirstLast(List=flip_matrix_4)  # -> CullFirst, CullLast, CullFirstAndEnd
point_2 = Point(cull_first_last_2.CullFirstAndEnd)
flip_matrix_5 = FlipMatrix(Data=point_2)
number_slider_4 = Slider(50, range=0..100)
polyline_3 = PolyLine(Vertices=flip_matrix_5, Closed=False)
extend_curve_2 = ExtendCurve(Curve=polyline_3, Type=0, Start=number_slider_4, End=number_slider_4)
xy_plane_4 = XYPlane(Origin=Point(0, 0, 0))
average_2 = Average(Input=move_8.Geometry)
addition_12 = Addition(A=filter_11, B=Slider(1, range=0..1))
multiplication_15 = Multiplication(A=filter_10, B=2.5)
division_14 = Division(A=addition_12, B=2)
polyline_4 = PolyLine(Vertices=flatten(average_2), Closed=False)
negative_2 = Negative(Value=division_14)
offset_curve_3 = OffsetCurve(
    Curve=extend_curve_2,
    Distance=[Slider(25, range=0..100), Slider(25, range=0..100, expression="-x")],
    Plane=xy_plane_4,
    Corners=1)
circle_2 = Circle(Plane=move_8.Geometry, Radius=multiplication_15)
shift_paths_2 = ShiftPaths(Data=offset_curve_3, Offset=-1)
region_union_2 = RegionUnion(Curves=circle_2)
offset_curve_4 = OffsetCurve(Curve=polyline_4, Distance=[division_14, negative_2], Plane=xy_plane_4, Corners=1)
boundary_surfaces_6 = BoundarySurfaces(Edges=region_union_2)
loft_3 = Loft(Curves=shift_paths_2, Options={Adjust=False, Closed=False, LoftEnds=0, LoftSimp=0, LoftType=0, Rebuild=10, Refit=0.01})
trim_with_regions_3 = TrimWithRegions(Curve=offset_curve_4, Regions=flatten(boundary_surfaces_6))  # -> Inside, Outside
trim_with_regions_4 = TrimWithRegions(Curve=trim_with_regions_3.Outside, Regions=flatten(loft_3))  # -> Inside, Outside
curve_4 = Curve(trim_with_regions_4.Outside)
flip_matrix_6 = FlipMatrix(Data=curve_4)
loft_4 = Loft(Curves=flip_matrix_6, Options={Adjust=False, Closed=False, LoftEnds=0, LoftSimp=0, LoftType=0, Rebuild=10, Refit=0.01})
length_2 = Length(Curve=flip_matrix_6)  # -> flatten(Length)
brep_edges_2 = BrepEdges(Brep=loft_4)  # -> Naked, Interior, NonManifold
max_min_2 = MaxMin(Numbers=length_2)  # -> Max, MaxIndex, Min, MinIndex
join_curves_2 = JoinCurves(Curves=brep_edges_2.Naked, Preserve=False)
number_slider_5 = Slider(100, range=0..100)
subtraction_7 = Subtraction(A=max_min_2.Min, B=filter_11)
fillet_2 = Fillet(Curve=join_curves_2, Radius=division_14)
unit_z_6 = UnitZ(Factor=expr("-x", number_slider_5))
unit_z_7 = UnitZ(Factor=number_slider_5)
boundary_surfaces_7 = BoundarySurfaces(Edges=fillet_2)
extrude_10 = Extrude(Base=boundary_surfaces_7, Direction=[unit_z_7, unit_z_6])
solid_difference_4 = SolidDifference(BrepsA=box_2, BrepsB=flatten(extrude_10))

最短槽长_2 = Panel(subtraction_7)

stream_filter = StreamFilter(Gate=value_list, Stream0=extr, Stream1=extrude_9)
cap = CapHoles(Brep=[cyl, stream_filter])
merge_4 = Merge(Data1=cap, Data2=solid_difference_4, Data3=cap_holes, Data4=solid_difference_3)
flatten_2 = FlattenTree(Tree=merge_4, Path="{0}")

move_13 = Move(Geometry=flatten_2, Motion=Z_2)  # -> Geometry, Transform
centre_point_2 = Point(deconstruct_plane_2.Origin)

entwine_4 = Entwine(Branch00=move_13.Geometry, Branch01=move_7.Geometry, FlattenInputs=True)

# ----
# 三视图
# hidden lines of top+pers view
# move to center
# 如果无法完整的生成埋件的三视图，
# 建议选择埋件的3D在Rhino中将
# Top/Perspective/Front/Right 试图缩放至合适大小后重新运行
panel_8 = Panel("""Top
Perspective
Front
Right""")
m2d_rhino = Make2DRhinoView(Name=panel_8, Clip=True)
make2d = Make2D(Geometry=entwine_4, View=m2d_rhino, TangentEdges=False, TangentSeams=False, AutoComputeMake2D=False)  # -> VisibleCurves, VisibleIndex, VisibleType, HiddenCurves, HiddenIndex, HiddenType
bang = ExplodeTree(Data=make2d.VisibleCurves)  # -> Branch0, Branch1, Branch2, Branch3, Branch4, Branch5, Branch6, Branch7
bang_2 = ExplodeTree(Data=make2d.VisibleCurves)  # -> Branch0, Branch1, Branch2, Branch3, Branch4, Branch5, Branch6, Branch7
divdist = DivideDistance(Curve=make2d.HiddenCurves, Distance=Slider(1, range=0..10))  # -> Points, Tangents, Parameters
graft = GraftTree(Tree=make2d.HiddenCurves, IncludeEmptyLists=True, IncludeNullItems=True)
shatter = Shatter(Curve=graft, Parameters=divdist.Parameters)
dispatch_3 = Dispatch(List=shatter, DispatchPattern=[True, False])  # -> ListA, ListB
crv_14 = Curve(dispatch_3.ListA)
pshift = ShiftPaths(Data=crv_14, Offset=-1)
pshift_2 = ShiftPaths(Data=pshift, Offset=-1)
bang_3 = ExplodeTree(Data=pshift_2)  # -> Branch0, Branch1, Branch2, Branch3, Branch4, Branch5, Branch6, Branch7
bang_4 = ExplodeTree(Data=pshift_2)  # -> Branch0, Branch1, Branch2, Branch3, Branch4, Branch5, Branch6, Branch7
entwine_5 = Entwine(Branch00=bang_4.Branch4, Branch01=bang_2.Branch4, FlattenInputs=True)  # -> flatten(Result)
entwine_6 = Entwine(Branch00=bang_4.Branch5, Branch01=bang_2.Branch5, FlattenInputs=True)  # -> flatten(Result)
entwine_7 = Entwine(Branch00=bang_3.Branch0, Branch01=bang.Branch0, FlattenInputs=True)  # -> flatten(Result)
entwine_8 = Entwine(Branch00=bang_3.Branch1, Branch01=bang.Branch1, FlattenInputs=True)  # -> flatten(Result)
entwine_9 = Entwine(Branch00=entwine_7, Branch01=entwine_8, Branch02=bang.Branch2, Branch03=bang.Branch3, FlattenInputs=True)
entwine_10 = Entwine(Branch00=entwine_5, Branch01=entwine_6, Branch02=bang_2.Branch6, Branch03=bang_2.Branch7, FlattenInputs=True)
group = Group(Objects=entwine_9)
group_2 = Group(Objects=entwine_10)
entwine_11 = Entwine(Branch00=group, Branch01=group_2, FlattenInputs=True)
pshift_3 = ShiftPaths(Data=entwine_11, Offset=-1)
pshift_4 = ShiftPaths(Data=entwine_11, Offset=-1)
number_slider_6 = Slider(2, range=0..10)
boxprop = BoxProperties(Box=pshift_3)  # -> Center, Diagonal, Area, Volume, Degeneracy
pt_14 = Point(Point(957.9296072, 367.7685097, 0))
pt_15 = Point("0,0,0")
recgrid_3 = Rectangular(
    Plane=pt_14,
    SizeX=Slider(12, range=1..20, expression="X*50"),
    SizeY=Slider(10, range=1..20, expression="X*50"),
    ExtentX=number_slider_6,
    ExtentY=number_slider_6)  # -> Cells, Points
vec2pt = Vector2Pt(PointA=boxprop.Center, PointB=pt_15, Unitize=False)  # -> Vector, Length
flatten_3 = FlattenTree(Tree=recgrid_3.Points, Path="{0}")
move_14 = Move(Geometry=pshift_4, Motion=vec2pt.Vector)  # -> flatten(Geometry), Transform
orient_5 = Orient(Geometry=flatten(move_14.Geometry), Source=PlaneXY(0, 0, 0), Target=flatten_3)  # -> Geometry, Transform
cull_i_3 = CullIndex(List=orient_5.Geometry, Indices="-1", Wrap=True)
split = SplitList(List=cull_i_3, Index="4")  # -> ListA, ListB
data = Data(split.ListA)
data_2 = Data(split.ListB)
entwine_12 = Entwine(Branch00=data, Branch01=data_2, FlattenInputs=True)
geo = Geometry(entwine_12)

# ---- group: 单体定Top/Side
item_13 = ListItem(List=geo, Index=2, Wrap=True)
item_14 = ListItem(List=geo, Index=Slider(0, range=0..10), Wrap=True)
cluster = Cluster(G=item_14)
cluster_2 = Cluster(G=item_13)

# ---- group: 单体定Top/Side / Top/Side
filter_14 = StreamFilter(Gate=list_2, Stream0=cluster, Stream1=cluster_2)

# ----
data_3 = Data(flatten(filter_14))

# ---- group: Block
# 自定义块所在图层
# 自定义块所在图层颜色
# 自定义块名称
panel_9 = Panel("Embeded::Embeded")
layer = DefineLayer(Name=panel_9, Color=ColourSwatch(SwatchColor=RGB(255, 0, 0)))
attributes = DefineObjectAttributes(Layer=layer)
block = DefineBlock(Geometry=filter_14, Attributes=attributes, BlockName="Steel Plate", BasePlane=PlaneXY(0, 0, 0))

# ---- group: 阴阳角区分
cp = ClosestPoint(Point=pt_3, Cloud=item_5)  # -> ClosestPoint, CPIndex, Distance
item_15 = ListItem(List=item_5, Index=cp.CPIndex, Wrap=True)
crv_cp_2 = CurveClosestPoint(Point=item_15, Curve=offset_2)  # -> Point, Parameter, Distance
eval = EvaluateCurve(Curve=offset_2, Parameter=crv_cp_2.Parameter)  # -> Point, Tangent, Angle

# ----
# 板埋Modeling
multiplication_16 = Multiplication(A=s_x_3, B=addition)
multiplication_17 = Multiplication(A=s_y_3, B=addition_2)
recgrid_4 = Rectangular(Plane=PlaneXY(0, 0, 0), SizeX=s_x_3, SizeY=s_y_3, ExtentX=addition, ExtentY=addition_2)  # -> Cells, Points
直径 = Text(filter_6)
division_15 = Division(A=multiplication_16, B=2)
division_16 = Division(A=multiplication_17, B=2)
vec_3 = VectorXYZ(XComponent=expr("-x", division_15), YComponent=expr("-x", division_16), ZComponent=0)  # -> Vector, Length
move_15 = Move(Geometry=recgrid_4.Points, Motion=vec_3.Vector)  # -> Geometry, Transform
division_17 = Division(A=直径, B=2)
cyl_2 = Cylinder(Base=move_15.Geometry, Radius=division_17, Length=expr("-x", expression))
X_2 = UnitX(Factor=直径)
multiplication_18 = Multiplication(A=直径, B=6)
edges_3 = BrepEdges(Brep=cyl_2)  # -> Naked, Interior, NonManifold
item_16 = ListItem(List=edges_3.Naked, Index=0, Wrap=True)
max_4 = Maximum(A=multiplication_18, B=70)
move_16 = Move(Geometry=item_16, Motion=X_2)  # -> Geometry, Transform
multiplication_19 = Multiplication(A=max_4, B=2)
addition_13 = Addition(A=multiplication_16, B=multiplication_19)
addition_14 = Addition(A=multiplication_17, B=multiplication_19)
division_18 = Division(A=t, B=2)
expression_6 = Expression(x=addition_14, Expression="Ceiling(x/10)*10/2")
expression_7 = Expression(x=addition_13, Expression="Ceiling(x/10)*10/2")
round = Round(Number=division_18)  # -> Nearest, Floor, Ceiling
multiplication_20 = Multiplication(A=round.Ceiling, B=2)
dom_6 = ConstructDomain(DomainStart=expr("-x", expression_6), DomainEnd=expression_6)
dom_7 = ConstructDomain(DomainStart=expr("-x", expression_7), DomainEnd=expression_7)
box_3 = DomainBox(Base=PlaneXY(0, 0, 0), X=dom_7, Y=dom_6, Z=multiplication_20)
Z_4 = UnitZ(Factor=expr("-x", multiplication_20))
move_17 = Move(Geometry=box_3, Motion=Z_4)  # -> Geometry, Transform
Z_5 = UnitZ(Factor=expr("-x", multiplication_20))

multiplication_21 = Multiplication(A=直径, B=5)

Z_6 = UnitZ(Factor=multiplication_21)
extr_2 = Extrude(Base=move_16.Geometry, Direction=Z_6)
cap_2 = CapHoles(Brep=[extr_2, cyl_2])
merge_5 = Merge(Data1=cap_2, Data2=box_3)
flatten_4 = FlattenTree(Tree=merge_5, Path="{0}")
move_18 = Move(Geometry=flatten_4, Motion=Z_5)  # -> Geometry, Transform

box_4 = DomainBox(Base=PlaneXY(0, 0, 0), X=dom_7, Y=dom_7, Z=multiplication_20)
merge_6 = Merge(Data1=cap_2, Data2=box_4)
flatten_5 = FlattenTree(Tree=merge_6, Path="{0}")
move_19 = Move(Geometry=flatten_5, Motion=Z_5)  # -> Geometry, Transform
# Rhino 文件中导入的块名
entwine_13 = Entwine(Branch00=move_18.Geometry, Branch01=move_19.Geometry, FlattenInputs=True)

# ---- group: 正常+阳角+阴角区分
cull_i_4 = CullIndex(List=item_5, Indices=cp.CPIndex, Wrap=True)
crv_15 = Curve(offset_2)
crv_16 = Curve(flip_3.Curve)
explode_2 = Explode(Curve=crv_15, Recursive=True)  # -> Segments, Vertices
explode_3 = Explode(Curve=crv_16, Recursive=True)  # -> Segments, Vertices

# ---- group: 阴角定位-细化
item_17 = ListItem(List=item_4, Index=cp.CPIndex, Wrap=True)

# ---- group: 大面
# 大面埋件布置
number_slider_7 = Slider(0.002, range=0..0.01)
filter_15 = StreamFilter(Gate=list_2, Stream0=expression_6, Stream1=number_slider_7)
filter_16 = StreamFilter(Gate=list, Stream0=filter_15, Stream1=expression_6, Stream2=filter_15)
offset_4 = OffsetCurve(Curve=offset_2, Distance=expr("-x", filter_16), Plane=PlaneXY(0, 0, 0), Corners=1)

# ---- group: 阴阳角区分 (continued)
crv_cp_3 = CurveClosestPoint(Point=item_15, Curve=offset_4)  # -> Point, Parameter, Distance
vec2pt_2 = Vector2Pt(PointA=crv_cp_3.Point, PointB=crv_cp_2.Point, Unitize=False)  # -> expr("-x", Vector), Length
angle_2 = Angle(VectorA=eval.Tangent, VectorB=vec2pt_2.Vector)  # -> Angle, Reflex
deg_2 = Degrees(Radians=angle_2.Angle)
smaller = SmallerThan(FirstNumber=deg_2, SecondNumber=89)  # -> SmallerThan, OrEqualTo
dispatch_4 = Dispatch(List=item_15, DispatchPattern=smaller.SmallerThan)  # -> ListA, ListB

# ---- group: 正常+阳角+阴角区分 (continued)
data_4 = Data(dispatch_4.ListA)
data_5 = Data(dispatch_4.ListB)
pull_3 = PullPoint(Point=data_4, Geometry=crv_15, ClosestOnly=True)  # -> ClosestPoint, Distance
pull_4 = PullPoint(Point=data_5, Geometry=crv_16, ClosestOnly=True)  # -> ClosestPoint, Distance
c_script_2 = CSharpScript(archPoint=pull_3.ClosestPoint, crvPoint=explode_2.Vertices)  # -> out, specialPt; inputs archPoint: list of Point3d, crvPoint: list of Point3d; same code as c_script
c_script_3 = CSharpScript(archPoint=pull_4.ClosestPoint, crvPoint=explode_3.Vertices)  # -> out, specialPt; inputs archPoint: list of Point3d, crvPoint: list of Point3d; same code as c_script
cull_i_5 = CullIndex(List=data_4, Indices=c_script_2.specialPt, Wrap=True)

# ---- group: 阴角定位-细化 (continued)
dispatch_5 = Dispatch(List=item_17, DispatchPattern=smaller.SmallerThan)  # -> ListA, ListB
item_18 = ListItem(List=dispatch_5.ListB, Index=c_script_3.specialPt, Wrap=True)
join_2 = JoinCurves(Curves=item_18, Preserve=False)
explode_4 = Explode(Curve=join_2, Recursive=True)  # -> Segments, Vertices
crv_17 = Curve(simplify(explode_4.Segments))
len = Length(Curve=crv_17)
sort = SortList(Keys=len, ValuesA=crv_17)  # -> Keys, ValuesA
item_19 = ListItem(List=sort.ValuesA, Index=0, Wrap=True)  # -> Item2, Item1, Item
crv_18 = Curve([item_19.Item2, item_19.Item1])
disc_6 = Discontinuity(Curve=crv_18, Level=1)  # -> Points, Parameters
item_20 = ListItem(List=disc_6.Points, Index=0, Wrap=True)
pull_5 = PullPoint(Point=disc_6.Points, Geometry=pt_3, ClosestOnly=True)  # -> ClosestPoint, Distance
crv_cp_4 = CurveClosestPoint(Point=disc_6.Points, Curve=offset_2)  # -> Point, Parameter, Distance
sort_2 = SortList(Keys=pull_5.Distance, ValuesA=crv_cp_4.Point)  # -> Keys, ValuesA

# ---- group: 正常+阳角+阴角区分 / 正常-遗漏
cull_i_6 = CullIndex(List=data_5, Indices=c_script_3.specialPt, Wrap=True)

# ---- group: 正常+阳角+阴角区分 / 阴角定位点
item_21 = ListItem(List=data_5, Index=c_script_3.specialPt, Wrap=True)

# ---- group: 正常+阳角+阴角区分 / 正常定位点
merge_7 = Merge(Data1=cull_i_4, Data2=cull_i_6, Data3=cull_i_5)

# ---- group: 正常+阳角+阴角区分 / 阳角定位点
item_22 = ListItem(List=data_4, Index=c_script_2.specialPt, Wrap=True)

# ---- group: 阴角定位-细化 / 阴角-2点定位
item_23 = ListItem(List=sort_2.ValuesA, Index=0, Wrap=True)

# ----
# 阳角埋件布置
pt_16 = Point(item_22)
explode_5 = Explode(Curve=crv_11, Recursive=True)  # -> Segments, Vertices
cp_2 = ClosestPoint(Point=pt_16, Cloud=explode_5.Vertices)  # -> ClosestPoint, CPIndex, Distance
cir = Circle(Plane=cp_2.ClosestPoint, Radius=Slider(150, range=0..1000))
pt_17 = Point(cp_2.ClosestPoint)
ccx = CurveCurve(CurveA=cir, CurveB=offset_2)  # -> Points, ParamsA, ParamsB
item_24 = ListItem(List=ccx.Points, Index=0, Wrap=True)  # -> Item, Item1
ln_3 = Line(StartPoint=graft(pt_17), EndPoint=graft(item_24.Item))  # -> flatten(Line)
ln_4 = Line(StartPoint=graft(pt_17), EndPoint=graft(item_24.Item1))  # -> flatten(Line)
item_25 = ListItem(List=data_3, Index="1", Wrap=True)
pl = ConstructPlane(Origin=pt_17, XAxis=ln_3, YAxis=ln_4)
bbox_3 = BoundingBox(Content=graft(item_25), Plane=PlaneXY(0, 0, 0))  # -> Box, Box_2
srf = Surface(bbox_3.Box)
explode_6 = Explode(Curve=srf, Recursive=True)  # -> Segments, Vertices
item_26 = ListItem(List=explode_6.Vertices, Index=0, Wrap=True)  # -> Item, Item1, Item2
ln_5 = Line(StartPoint=graft(item_26.Item1), EndPoint=graft(item_26.Item2))
ln_6 = Line(StartPoint=graft(item_26.Item1), EndPoint=graft(item_26.Item))
ln_7 = Line(StartPoint=graft(item_26.Item1), EndPoint=graft(item_26.Item))
ln_8 = Line(StartPoint=graft(item_26.Item1), EndPoint=graft(item_26.Item2))
pl_2 = ConstructPlane(Origin=item_26.Item1, XAxis=ln_8, YAxis=ln_7)
pl_3 = ConstructPlane(Origin=item_26.Item1, XAxis=ln_6, YAxis=ln_5)
orient_6 = Orient(Geometry=item_25, Source=pl_3, Target=pl)  # -> Geometry, Transform
orient_7 = Orient(Geometry=item_25, Source=pl_2, Target=pl)  # -> Geometry, Transform
merge_8 = Merge(Data1=orient_6.Geometry, Data2=orient_7.Geometry)
filter_17 = StreamFilter(Gate=list_2, Stream0=orient_6.Geometry, Stream1=merge_8)
bbox_4 = BoundingBox(Content=filter_17, Plane=PlaneXY(0, 0, 0))  # -> Box, Box_2
entwine_14 = Entwine(Branch00=filter_17, Branch01=bbox_4.Box, FlattenInputs=True)
flip_6 = FlipMatrix(Data=entwine_14)
item_27 = ListItem(List=flip_6, Index=-1, Wrap=True)  # -> flatten(Item)
item_28 = ListItem(List=flip_6, Index="0", Wrap=True)  # -> flatten(Item)

# ---- group: 阴角
# 阴角埋件布置
explode_7 = Explode(Curve=crv_11, Recursive=True)  # -> Segments, Vertices
cp_3 = ClosestPoint(Point=item_21, Cloud=explode_7.Vertices)  # -> ClosestPoint, CPIndex, Distance
pshift_5 = ShiftPaths(Data=item_23, Offset=-1)
crv_cp_5 = CurveClosestPoint(Point=pshift_5)  # -> Point, Parameter, Distance
crv_cp_6 = CurveClosestPoint(Point=pshift_5, Curve=offset_2)  # -> Point, Parameter, Distance
vec2pt_3 = Vector2Pt(PointA=crv_cp_5.Point, PointB=crv_cp_6.Point, Unitize=False)  # -> expr("-x", Vector), Length
eval_2 = EvaluateCurve(Curve=offset_2, Parameter=crv_cp_6.Parameter)  # -> Point, Tangent, Angle
pl_4 = ConstructPlane(Origin=crv_cp_6.Point, XAxis=eval_2.Tangent, YAxis=vec2pt_3.Vector)
orient_8 = Orient(Geometry=block, Source=PlaneXY(0, 0, 0), Target=pl_4)  # -> Geometry, Transform

# ---- group: 大面 (continued)
crv_cp_7 = CurveClosestPoint(Point=merge_7, Curve=offset_4)  # -> Point, Parameter, Distance
crv_cp_8 = CurveClosestPoint(Point=merge_7, Curve=offset_2)  # -> Point, Parameter, Distance
vec2pt_4 = Vector2Pt(PointA=crv_cp_7.Point, PointB=crv_cp_8.Point, Unitize=False)  # -> expr("-x", Vector), Length
eval_3 = EvaluateCurve(Curve=offset_2, Parameter=crv_cp_8.Parameter)  # -> Point, Tangent, Angle
pl_5 = ConstructPlane(Origin=crv_cp_8.Point, XAxis=eval_3.Tangent, YAxis=vec2pt_4.Vector)
orient_9 = Orient(Geometry=block, Source=PlaneXY(0, 0, 0), Target=pl_5)  # -> flatten(Geometry), Transform

# ---- group: Datea / 2
lng = ListLength(List=orient_9.Geometry)
division_19 = Division(A=lng, B=2)
split_2 = SplitList(List=orient_9.Geometry, Index=division_19)  # -> ListA, ListB
data_6 = Data(split_2.ListA)

# ----
bbox_5 = BoundingBox(Content=data_6, Plane=PlaneXY(0, 0, 0))  # -> Box, Box_2
entwine_15 = Entwine(Branch00=data_6, Branch01=bbox_5.Box, FlattenInputs=True)
flip_7 = FlipMatrix(Data=entwine_15)
item_29 = ListItem(List=flip_7, Index=-1, Wrap=True)  # -> flatten(Item)
item_30 = ListItem(List=flip_7, Index="0", Wrap=True)  # -> flatten(Item)
阴角 = Geometry(orient_8.Geometry)

# ---- group: Monomer + Side/Top / Monomer Type
filter_18 = StreamFilter(Gate=list, Stream0=item_27, Stream1=item_27, Stream2=item_27)

# ----
# 槽埋-角部倾斜时
bbox_6 = BoundingBox(Content=item_27, Plane=PlaneXY(0, 0, 0))  # -> Box, Box_2
ln_9 = Line(StartPoint=pt_16, EndPoint=pt_17)
debrep = DeconstructBrep(Brep=bbox_6.Box)  # -> Faces, Edges, Vertices
deplane = DeconstructPlane(Plane=ln_9)  # -> Origin, XAxis, YAxis, ZAxis
len_2 = Length(Curve=debrep.Edges)
sort_3 = SortList(Keys=len_2, ValuesA=debrep.Edges)  # -> Keys, reverse(ValuesA)
amp = Amplitude(Vector=deplane.XAxis, Amplitude=Slider(63.5, range=10..100))
item_31 = ListItem(List=sort_3.ValuesA, Index=0, Wrap=True)  # -> Item, Item1, Item2
item_32 = ListItem(List=sort_3.ValuesA, Index=0, Wrap=True)
move_20 = Move(Geometry=deplane.Origin, Motion=amp)  # -> Geometry, Transform
len_3 = Length(Curve=item_32)
end = EndPoints(Curve=item_31.Item2)  # -> Start, End
end_2 = EndPoints(Curve=item_31.Item1)  # -> Start, End
ln_10 = Line(StartPoint=deplane.Origin, EndPoint=move_20.Geometry)
ln_11 = Line(StartPoint=move_20.Geometry, EndPoint=deplane.Origin)
avr = Average(Input=[end_2.Start, end_2.End])
ln_12 = Line(StartPoint=end.Start, EndPoint=end.End)
ln_13 = Line(StartPoint=end_2.Start, EndPoint=avr)
c_script_4 = CSharpScript(iReset=Toggle(True), turns=Slider(30, range=0..100), steps=Slider(10, range=0..10))  # -> out, num; inputs numDefault: Double, iReset: Boolean, turns: Int32, steps: Double
# ---------- c_script_4: C# ----------
    if(iReset){
      number = 0;}

    for(int i = 0; i < turns;i++){
      number = number + steps;
      numStore.Add(number);
      Print(number.ToString());}

    num = numStore;
# ---------- c_script_4: C# additional code ----------
  double number = 0;
  List <double> numStore = new List<double>();
# ---------- end c_script_4 ----------
pl_6 = ConstructPlane(Origin=avr, XAxis=ln_13, YAxis=ln_12)
panel_10 = Panel(c_script_4.num)
amp_2 = Amplitude(Vector=ln_9, Amplitude=graft(c_script_4.num))

item_33 = ListItem(List=flatten(len_3), Index=0, Wrap=True)

ln_14 = Line(StartPoint=pt_16, EndPoint=pt_17)
move_21 = Move(Geometry=pt_17, Motion=ln_14)  # -> Geometry, Transform
ccx_2 = CurveCurve(CurveA=cir, CurveB=offset_2)  # -> Points, ParamsA, ParamsB
item_34 = ListItem(List=ccx_2.Points, Index=0, Wrap=True)  # -> flatten(Item), flatten(Item1)
ln_15 = Line(StartPoint=pt_17, EndPoint=item_34.Item)
ln_16 = Line(StartPoint=pt_17, EndPoint=move_21.Geometry)
ln_17 = Line(StartPoint=pt_17, EndPoint=item_34.Item1)
angle_3 = Angle(VectorA=ln_15, VectorB=ln_16)  # -> Angle, Reflex
angle_4 = Angle(VectorA=ln_17, VectorB=ln_16)  # -> Angle, Reflex
deg_3 = Degrees(Radians=angle_3.Angle)
deg_4 = Degrees(Radians=angle_4.Angle)
item_35 = ListItem(List=ln_16, Index=Slider(3, range=0..4), Wrap=True)
tan = Tangent(Value=degrees(deg_3))
entwine_16 = Entwine(Branch00=ln_15, Branch01=tan, FlattenInputs=True)
tan_2 = Tangent(Value=degrees(deg_4))
division_20 = Division(A=tan, B=tan_2)
panel_11 = Panel(deg_4)
panel_12 = Panel(deg_3)
addition_15 = Addition(A=division_20, B=1)
division_21 = Division(A="1", B=addition_15)
subtraction_8 = Subtraction(A="1", B=division_21)
num = Number(division_21)
larger_2 = LargerThan(FirstNumber=tan, SecondNumber=tan_2)  # -> LargerThan, OrEqualTo

amp_3 = Amplitude(Vector=ln_11, Amplitude=expr("x/2", flatten(item_33)))
amp_4 = Amplitude(Vector=ln_10, Amplitude=expr("x/2", flatten(item_33)))
move_22 = Move(Geometry=pt_17, Motion=amp_3)  # -> Geometry, Transform
move_23 = Move(Geometry=pt_17, Motion=amp_4)  # -> Geometry, Transform
ln_18 = Line(StartPoint=move_22.Geometry, EndPoint=move_23.Geometry)

crv_19 = Curve(ln_18)
mp = Midpoint(Curve=crv_19)
eval_4 = EvaluateCurve(Curve=crv_19, Parameter=subtraction_8)  # -> Point, Tangent, Angle
eval_5 = EvaluateCurve(Curve=crv_19, Parameter=num)  # -> Point, Tangent, Angle
dispatch_6 = Dispatch(List=eval_4.Point, DispatchPattern=larger_2.OrEqualTo)  # -> ListA, ListB
dispatch_7 = Dispatch(List=eval_5.Point, DispatchPattern=larger_2.OrEqualTo)  # -> ListA, ListB
pt_18 = Point(dispatch_6.ListB)
pt_19 = Point(dispatch_7.ListA)
merge_9 = Merge(Data1=pt_19, Data2=pt_18)
pull_6 = PullPoint(Point=merge_9, Geometry=graft(mp), ClosestOnly=True)  # -> ClosestPoint, Distance
panel_13 = Panel(merge_9)
sort_4 = SortList(Keys=pull_6.Distance, ValuesA=merge_9)  # -> Keys, ValuesA
item_36 = ListItem(List=sort_4.ValuesA, Index=0, Wrap=True)  # -> flatten(Item)
ln_19 = Line(StartPoint=item_36, EndPoint=mp)
panel_14 = Panel(item_36)
move_24 = Move(Geometry=crv_19, Motion=ln_19)  # -> Geometry, Transform

# ---- group: 正常和阳角 - BoundingBox — 测Intersection
entwine_17 = Entwine(Branch00=flip_3.Curve, Branch01=offset_2, FlattenInputs=True)
flip_8 = FlipMatrix(Data=entwine_17)
item_37 = ListItem(List=flip_8, Index=0, Wrap=True)  # -> Item, Item1

# ----
move_25 = Move(Geometry=move_24.Geometry, Motion=amp_2)  # -> Geometry, Transform
ccx_3 = CurveCurve(CurveA=move_25.Geometry, CurveB=crv_11)  # -> Points, ParamsA, ParamsB
item_38 = ListItem(List=ccx_3.Points, Index=0, Wrap=True)
item_39 = ListItem(List=ccx_3.Points, Index="-1", Wrap=True)
pshift_6 = ShiftPaths(Data=item_38, Offset=-1)
pshift_7 = ShiftPaths(Data=item_39, Offset=-1)
flip_9 = FlipMatrix(Data=pshift_6)
flip_10 = FlipMatrix(Data=pshift_7)
pt_20 = Point(flip_9)
pt_21 = Point(flip_10)
pull_7 = PullPoint(Point=pt_20, Geometry=graft(mp), ClosestOnly=True)  # -> ClosestPoint, Distance
pull_8 = PullPoint(Point=pt_21, Geometry=graft(mp), ClosestOnly=True)  # -> ClosestPoint, Distance
sort_5 = SortList(Keys=pull_7.Distance, ValuesA=pt_20)  # -> Keys, ValuesA
sort_6 = SortList(Keys=pull_8.Distance, ValuesA=pt_21)  # -> Keys, ValuesA
item_40 = ListItem(List=sort_5.ValuesA, Index="-1", Wrap=True)
item_41 = ListItem(List=sort_6.ValuesA, Index="-1", Wrap=True)
ln_20 = Line(StartPoint=item_41, EndPoint=item_40)

end_3 = EndPoints(Curve=ln_20)  # -> Start, End

avr_2 = Average(Input=[end_3.Start, end_3.End])
pl_7 = ConstructPlane(Origin=avr_2, XAxis=ln_20, YAxis=graft(ln_9))
orient_10 = Orient(Geometry=graft(item_28), Source=pl_6, Target=pl_7)  # -> Geometry, Transform
orient_11 = Orient(Geometry=graft(item_27), Source=pl_6, Target=pl_7)  # -> Geometry, Transform

filter_19 = StreamFilter(Gate=list_16, Stream0=item_27, Stream1=orient_11.Geometry)

# ---- group: Monomer + Side/Top / Monomer Type (continued)
filter_20 = StreamFilter(Gate=list, Stream0=item_27, Stream1=filter_19, Stream2=item_27)

# ---- group: Monomer + Side/Top / Top/Side
filter_21 = StreamFilter(Gate=list_2, Stream0=filter_20, Stream1=filter_18)

# ----
filter_22 = StreamFilter(Gate=list_16, Stream0=item_28, Stream1=orient_10.Geometry)

# ---- group: 阳角分类
filter_23 = StreamFilter(Gate=list, Stream0=item_28, Stream1=filter_22, Stream2=item_28)
filter_24 = StreamFilter(Gate=list, Stream0=item_28, Stream1=item_28, Stream2=item_28)
filter_25 = StreamFilter(Gate=list_2, Stream0=filter_23, Stream1=filter_24)

# ----
阳角 = Geometry(filter_25)

# ---- group: 正常和阳角 - BoundingBox — 测Intersection (continued)
c_script_5 = CSharpScript(BrepMain=item_29, BrepStay=filter_21)  # -> out, BrepInters, BrepRemain, IndexM, IndexS; inputs BrepMain: list of Brep, BrepStay: list of Brep
# ---------- c_script_5: C# ----------
    List<Brep> BrepI = new List<Brep>();
    List<Brep> BrepR = new List<Brep>();
    List<int> num = new List<int>();
    List<int> numS = new List<int>();


    double tolr = Rhino.RhinoDoc.ActiveDoc.ModelAbsoluteTolerance;

    for(int j = 0; j < BrepMain.Count;j++){
      for(int i = 0; i < BrepStay.Count;i++){
        bool test = Rhino.Geometry.Intersect.Intersection.BrepBrep(BrepMain[j], BrepStay[i], tolr, out crv, out pts);
        if(test && crv.Length != 0){
          tryThis = true;
          numS.Add(i);
          break;}
        else{
          tryThis = false;}
      }
      if(tryThis){
        BrepI.Add(BrepMain[j]);
        num.Add(j);
      }
      else{
        BrepR.Add(BrepMain[j]);
      }
    }



    BrepInters = BrepI;
    BrepRemain = BrepR;
    IndexM = num;
    IndexS = numS;
# ---------- c_script_5: C# additional code ----------
  Rhino.Geometry.Curve[] crv;
  Rhino.Geometry.Point3d[] pts;
  bool tryThis;
# ---------- end c_script_5 ----------
item_42 = ListItem(List=item_29, Index=c_script_5.IndexM, Wrap=True)  # -> graft(Item)
item_43 = ListItem(List=filter_21, Index=c_script_5.IndexS, Wrap=True)  # -> graft(Item)
cull_i_7 = CullIndex(List=item_30, Indices=c_script_5.IndexM, Wrap=True)
item_44 = ListItem(List=item_30, Index=c_script_5.IndexM, Wrap=True)  # -> graft(Item)
area_4 = Area(Geometry=item_42)  # -> Area, Centroid
bbx = BrepBrep(BrepA=item_42, BrepB=item_43)  # -> simplify(Curves), Points
area_5 = Area(Geometry=bbx.Curves)  # -> Area, Centroid
ln_21 = Line(StartPoint=area_4.Centroid, EndPoint=area_5.Centroid)
mp_2 = Midpoint(Curve=ln_21)
scale = Scale(Geometry=ln_21, Center=mp_2, Factor=Slider(1000000, range=0..1000000))  # -> Geometry, Transform
ccx_4 = CurveCurve(CurveA=scale.Geometry, CurveB=bbx.Curves)  # -> Points, ParamsA, ParamsB
item_45 = ListItem(List=ccx_4.Points, Index=0, Wrap=True)  # -> Item, Item1
ln_22 = Line(StartPoint=item_45.Item1, EndPoint=item_45.Item)
move_26 = Move(Geometry=item_44, Motion=ln_22)  # -> simplify(Geometry), Transform
bbox_7 = BoundingBox(Content=move_26.Geometry, Plane=PlaneXY(0, 0, 0))  # -> Box, Box_2

# ----
# 这里如果跑红也不要紧，
# 说明单体没有出现相撞的情况
area_6 = Area(Geometry=bbox_7.Box)  # -> Area, Centroid

# ---- group: 正常和阳角 - BoundingBox — 测Intersection (continued)
entwine_18 = Entwine(Branch00=move_26.Geometry, Branch01=area_6.Centroid, FlattenInputs=True)
flip_11 = FlipMatrix(Data=entwine_18)
item_46 = ListItem(List=flip_11, Index="0", Wrap=True)  # -> flatten(Item)
item_47 = ListItem(List=flip_11, Index="-1", Wrap=True)  # -> flatten(Item)
pull_9 = PullPoint(Point=item_47, Geometry=item_37.Item, ClosestOnly=True)  # -> flatten(ClosestPoint), Distance
pull_10 = PullPoint(Point=item_47, Geometry=item_37.Item1, ClosestOnly=True)  # -> flatten(ClosestPoint), Distance
vec2pt_5 = Vector2Pt(PointA=item_47, PointB=pull_9.ClosestPoint, Unitize=False)  # -> Vector, Length
vec2pt_6 = Vector2Pt(PointA=item_47, PointB=pull_10.ClosestPoint, Unitize=False)  # -> Vector, Length
multiplication_22 = Multiplication(A=vec2pt_5.Vector, B=vec2pt_6.Vector)
larger_3 = LargerThan(FirstNumber=multiplication_22, SecondNumber=0)  # -> LargerThan, OrEqualTo
dispatch_8 = Dispatch(List=item_46, DispatchPattern=larger_3.LargerThan)  # -> ListA, ListB

# ---- group: Normal
geo_2 = Geometry(cull_i_7)

# ---- group: Normal-Move
移动 = Geometry(dispatch_8.ListA)

# ----
# PLAN Results
merge_10 = Merge(Data1=geo_2, Data2=阳角, Data3=移动, Data4=阴角)

# ==== cluster Cluster
G = ClusterInput()
rotate = Rotate(Geometry=G, Angle=3.141592654, Plane=PlaneXY(0, 0, 0))  # -> Geometry, Transform
boxprop = BoxProperties(Box=rotate.Geometry)  # -> Center, Diagonal, Area, Volume, Degeneracy
bbox = BoundingBox(Content=rotate.Geometry, Plane=PlaneXY(0, 0, 0))  # -> Box, Box_2
debox = DeconstructBox(Box=bbox.Box)  # -> Plane, X, Y, Z
pdecon = Deconstruct(Point=boxprop.Center)  # -> XComponent, YComponent, ZComponent
dedomain = DeconstructDomain(Domain=debox.Y)  # -> Start, End
pt = ConstructPoint(XCoordinate=pdecon.XComponent, YCoordinate=dedomain.Start, ZCoordinate=pdecon.ZComponent)
xy = XYPlane(Origin=Point(0, 0, 0))
pl_origin = PlaneOrigin(Base=xy, Origin=pt)
orient = Orient(Geometry=rotate.Geometry, Source=pl_origin, Target=xy)  # -> Geometry, Transform
G_2 = ClusterOutput(orient.Geometry)
